# Grasshopper definition AutoZonerABTester.gh (Grasshopper 1.0.7)
# plug-ins: ClimateStudioGH, treesloth01

# ---- group: Weather File
path = FilePath("C:\ProgramData\Solemma\Common\WeatherData\EPW\USA_NY_New.York-LaGuardia.AP.725030_TMYx.2004-2018.epw")

# ---- group: 15-Zone Dimensions
f2f_height_meters = Panel("4")
perim_offset = Panel("4")
n_floors = Slider(3, range=0..30)
y_axis_meters = Panel("40")
x_axis_meters = Panel("40")

# ----
# RUN
button = Button()

series = Series(Start=0, Step="1/24 * 2*pi", Count="8760")
expression = Expression(x=series, Expression="-cos(x)*0.5+0.5")

# ---- group: shoebox dimensions
perim_depth = Slider(3.6, range=2..10)
width = Slider(3, range=1..15)
core_depth = Slider(6.4, range=2..60)

# ----
addition = Addition(A=perim_depth, B=core_depth)
year_schedule = ConstructCSYearSchedule(Name="Sinusoid", Type=0, Category=0, DaysHours=expression)  # -> Sched, Values
multiplication = Multiplication(A=width, B=addition)
multiplication_2 = Multiplication(A=width, B=core_depth)
multiplication_3 = Multiplication(A=width, B=perim_depth)

# ---- group: perim_to_facade desired properties
actual_perim_area_m2 = Panel(multiplication_3)
actual_core_area_m2 = Panel(multiplication_2)
actual_shoebox_total_area_m2 = Panel(multiplication)

# ----
ventilationperperson_l_s_person = Slider(1, range=0..10)
ventilationperarea_l_s_m2 = Slider(0.1, range=0..5)
coolingsetpoint_degc = Slider(25, range=16..30)
heatingsetpoint_degc = Slider(19, range=10..24)
econ = ValueList({"NoEconomizer", "DifferentialEnthalpy"}, selected="NoEconomizer")
mechventon = BooleanToggle(False)
hrv = ValueList({"None", "Sensible", "Enthalpy"}, selected="None")

infiltrationmethod = ValueList({"ACH", "Flow Per Exterior Area": "FlowExtArea"}, selected="Flow Per Exterior Area")
infiltration_m3_s_m2 = Slider(0.0005, range=0..0.0005)
infiltration_ach = Slider(0, range=0..1)

# ---- group: Loads
lpd_w_m2 = Slider(2, range=0..50)
epd_w_m2 = Slider(2, range=0..50)
peopledensity_ppl_m2 = Slider(0.025, range=0..0.5)

# ----
# Unit Converter
# Internalized Geometry is
# modeled in meters.
toggle = BooleanToggle(True)
unit = CSUnitScale(
    From="Meters",
    To="ActiveRhinoDocUnits",
    Listener=toggle,
    Input_0_Hidden=False,
    Input_0_Name="From",
    Input_1_Hidden=False,
    Input_1_Name="To",
    Input_2_Hidden=False,
    Input_2_Name="Listener",
    UnitSystem=4)

wwr = Slider(60, range=10..90)

# ---- group: Windows
number_slider = Slider(0.5, range=0..1)
number_slider_2 = Slider(4, range=0.6..7)
tvis = Panel("0.5")

# ---- group: Roof
list = ValueList({"UVal_0.4", "UVal_0.3", "UVal_0.2", "UVal_0.1"}, selected="UVal_0.2")
list_2 = ValueList({"Light": "_Light", "Mass": "_Mass"}, selected="Light")

# ---- group: Unit Conversion for 15 zone dimensions
multiplication_4 = Multiplication(A=f2f_height_meters, B=unit)
multiplication_5 = Multiplication(A=x_axis_meters, B=unit)
multiplication_6 = Multiplication(A=y_axis_meters, B=unit)
multiplication_7 = Multiplication(A=perim_offset, B=unit)

# ---- group: Facade
list_3 = ValueList({"UVal_0.4", "UVal_0.3", "UVal_0.2", "UVal_0.1"}, selected="UVal_0.2")
list_4 = ValueList({"Light": "_Light", "Mass": "_Mass"}, selected="Light")

# ---- group: Ground Slab
list_5 = ValueList({"UVal_0.4", "UVal_0.3", "UVal_0.2", "UVal_0.1"}, selected="UVal_0.2")
list_6 = ValueList({"Light": "_Light", "Mass": "_Mass"}, selected="Light")

# ---- group: MechVentilationSchedule
sched = GetCSYearSchedule(UnitSystem=4)
panel = Panel("AllOn")

# ----
expression_2 = Expression(
    width=multiplication_5,
    len=multiplication_6,
    f2f_h=multiplication_4,
    floors=n_floors,
    Expression="(2*width + 2*len)*floors*f2f_h")
expression_3 = Expression(
    width=multiplication_5,
    len=multiplication_6,
    f2f_h=multiplication_4,
    floors=n_floors,
    Expression="(2*width + 2*len)*f2f_h")
expression_4 = Expression(width=multiplication_5, len=multiplication_6, floors=n_floors, Expression="width*len*floors")
division = Division(A=expression_4, B=expression_2)
merge = Merge(Data1=list, Data2=list_2)
merge_2 = Merge(Data1=list_3, Data2=list_4)
merge_3 = Merge(Data1=list_5, Data2=list_6)
multiplication_8 = Multiplication(Shoebox_width=width, Shoebox_height=multiplication_4)

# ---- group: computed shoebox information
shoebox_height_m_driven = Panel(multiplication_4)
sheobox_facade_area_m2 = Panel(multiplication_8)

# ----
list_7 = ValueList({"Residential", "Kitchen", "Office", "MeetingRoom", "HotelRoom", "ClassRoom", "Library", "LectureHall", "SuperMarket", "Shopping", "ScienceLab"}, selected="Office")
simple_window = ConstructCSSimpleWindow(Name="MLForBem-SimpleWindowConstruction", Shgf=number_slider, Uval=number_slider_2, Tvis=tvis)
zonetemplate = GetZoneTemplate(SearchZoneTemplate=list_7, Selection="Office")
join = TextJoin(Text=merge)
heating_coolingconstant = BooleanToggle(True)
join_2 = TextJoin(Text=merge_2)
scheduledventilationon = BooleanToggle(False)
join_3 = TextJoin(Text=merge_3)
people_equip_lightson = BooleanToggle(True)

panel_2 = Panel("Airspeed 0")
sched_2 = GetCSYearSchedule(UnitSystem=4)

heating_coolingon = BooleanToggle(True)
humidistaton = BooleanToggle(True)
infiltrationon = BooleanToggle(True)

sched_3 = GetCSYearSchedule(UnitSystem=4)

item = ListItem(List=zonetemplate, Index=0, Wrap=True)
fanenergy = BooleanToggle(False)
shadingon = BooleanToggle(False)
hasframe = BooleanToggle(False)
dhwon = BooleanToggle(False)
dhwon_2 = BooleanToggle(False)
construction = GetCSConstruction(SearchConstructions=join)
construction_2 = GetCSConstruction(SearchConstructions=join_2)
construction_3 = GetCSConstruction(SearchConstructions=join_3)
multiplication_9 = Multiplication(Shoebox_facade_area=multiplication_8, Gfa_2_facade_area_ratio=division)
dimmingtype = Panel("Off")
cluster = Cluster_3(numfloors=n_floors, floorheight=multiplication_4, xlen=multiplication_5, ylen=multiplication_6, offset=multiplication_7)  # -> floorzaxismovementvec, perimnames, perimeter_2, core_names, f2fzaxismovementvec, core_2, footprintbasecurve, ground_plane_2
merge_4 = Merge(
    Data1=ColourSwatch(SwatchColor=RGB(13, 69, 255)),
    Data2=ColourSwatch(SwatchColor=RGB(150, 166, 255)),
    Data3=ColourSwatch(SwatchColor=RGB(255, 13, 13)),
    Data4=ColourSwatch(SwatchColor=RGB(255, 150, 150)))
panel_4 = Panel("""Perim Cooling
Core Cooling
Perim Heating
Core Heating""")
zset = CSZoneSettings(
    Name="ParametricZoneSettings",
    ZoneSettings=item,
    RoofConstruction=construction,
    FacadeConstruction=construction_2,
    SlabConstruction=construction_3,
    ExternalFloorConstruction=construction_3,
    GroundSlabConstruction=construction_3,
    PeopleDensity=peopledensity_ppl_m2,
    AirspeedSchedule=sched_2,
    EquipmentPowerDensity=epd_w_m2,
    LightingPowerDensity=lpd_w_m2,
    OccupancySchedule=year_schedule.Sched,
    EquipmentAvailabilitySchedule=year_schedule.Sched,
    LightsAvailabilitySchedule=year_schedule.Sched,
    DimmingType=dimmingtype,
    PeopleIsOn=people_equip_lightson,
    EquipmentIsOn=people_equip_lightson,
    LightsIsOn=people_equip_lightson,
    CoolingCOP=Slider(1, range=0.6..6),
    HeatingCOP=Slider(1, range=0.6..6),
    HeatingSetpoint=heatingsetpoint_degc,
    CoolingSetpoint=coolingsetpoint_degc,
    HeatingSetpointConstant=heating_coolingconstant,
    CoolingSetpointConstant=heating_coolingconstant,
    HeatIsOn=heating_coolingon,
    CoolIsOn=heating_coolingon,
    MechVentIsOn=mechventon,
    HumidistatIsOn=humidistaton,
    HeatingLimitType="NoLimit",
    CoolingLimitType="NoLimit",
    HeatingSchedule=sched_3,
    CoolingSchedule=sched_3,
    MechVentSchedule=sched,
    MinFreshAirPerson=ventilationperperson_l_s_person,
    MinFreshAirArea=ventilationperarea_l_s_m2,
    EconomizerType=econ,
    HeatRecoveryType=hrv,
    HeatRecoveryEfficiencySensible="0.7",
    HeatRecoveryEfficiencyLatent="0.65",
    MinHumidity="20",
    MaxHumidity="80",
    TurnOnEMSFanEnergy=fanenergy,
    MaxHeatSupplyAirTemp="30",
    MinCoolSupplyAirTemp="18",
    NatVentIsOn=dhwon,
    SchedVentIsOn=scheduledventilationon,
    InfiltrationIsOn=infiltrationon,
    InfiltrationAch=infiltration_ach,
    InfiltrationFlowExtArea=infiltration_m3_s_m2,
    InfiltrationCalculationMethod=infiltrationmethod,
    DHWOn=dhwon_2,
    Input_0_Hidden=False,
    Input_0_Name="Name",
    Input_100_Hidden=True,
    Input_100_Name="Interior Vertical Insulation Depth",
    Input_101_Hidden=True,
    Input_101_Name="Exterior Horizontal Insulation Depth",
    Input_102_Hidden=True,
    Input_102_Name="Exterior Horizontal Insulation Width",
    Input_103_Hidden=True,
    Input_103_Name="Footing Thickness",
    Input_104_Hidden=True,
    Input_104_Name="Footing Depth",
    Input_105_Hidden=True,
    Input_105_Name="ElectricityCO2",
    Input_106_Hidden=True,
    Input_106_Name="ElectricityCost",
    Input_107_Hidden=True,
    Input_107_Name="HotWaterCO2",
    Input_108_Hidden=True,
    Input_108_Name="HotWaterCost",
    Input_109_Hidden=True,
    Input_109_Name="CoolingCO2",
    Input_10_Hidden=True,
    Input_10_Name="Ground Wall Construction",
    Input_110_Hidden=True,
    Input_110_Name="HeatingCO2",
    Input_111_Hidden=True,
    Input_111_Name="CoolingCost",
    Input_112_Hidden=True,
    Input_112_Name="HeatingCost"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)
wset = CSWindowSettings(
    Name="MLForBem-SimpleWindowSettings",
    Type="External",
    ShadingSystemIsOn=shadingon,
    GlazingConstruction=simple_window,
    OperableArea="0",
    HasFrame=hasframe,
    AFNWindowAvailability="AllOff",
    Input_0_Hidden=False,
    Input_0_Name="Name",
    Input_10_Hidden=True,
    Input_10_Name="ShadingThickness",
    Input_11_Hidden=True,
    Input_11_Name="ShadeGlassDistance",
    Input_12_Hidden=True,
    Input_12_Name="TopBottomEdgeOpeningMultiplier",
    Input_13_Hidden=True,
    Input_13_Name="Analysis Mesh Resolution",
    Input_14_Hidden=True,
    Input_14_Name="ZoneMixingIsOn",
    Input_15_Hidden=True,
    Input_15_Name="ZoneMixingDeltaTemperature",
    Input_16_Hidden=True,
    Input_16_Name="ZoneMixingFlowRate",
    Input_17_Hidden=False,
    Input_17_Name="Glazing Construction",
    Input_18_Hidden=False,
    Input_18_Name="OperableArea",
    Input_19_Hidden=True,
    Input_19_Name="ZoneMixingAvailibilitySchedule",
    Input_1_Hidden=False,
    Input_1_Name="WindowSettings",
    Input_20_Hidden=False,
    Input_20_Name="HasFrame",
    Input_21_Hidden=True,
    Input_21_Name="FrameWidth",
    Input_22_Hidden=True,
    Input_22_Name="FrameProjection"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)
library = CSLibrary(AddObjects=flatten([year_schedule.Sched, simple_window]))
division_2 = Division(Total_shoebox_area=multiplication_9, Shoebox_width=width)

# ---- group: gfa_to_facade desired properties
desired_shoebox_total_floor_area_m2 = Panel(multiplication_9)
deesired_shoebox_total_depth_m = Panel(division_2)

# ----
explode = Explode(Curve=cluster.footprintbasecurve, Recursive=True)  # -> Segments, Vertices
wwr_n = Number(wwr)
item_2 = ListItem(List=flatten(cluster.core_2), Index=0, Wrap=True)
flip = FlipMatrix(Data=cluster.perimeter_2)
extr = Extrude(Base=explode.Segments, Direction=cluster.f2fzaxismovementvec)  # -> graft(Extrusion)
debrep = DeconstructBrep(Brep=flip)  # -> Faces, Edges, Vertices
debrep_2 = DeconstructBrep(Brep=item_2)  # -> Faces, Edges, Vertices
horizontal_spacing = Slider(100, range=0..100)
depth_sapcing = Slider(50, range=0..100)
number_slider_3 = Slider(5, range=0..5)
item_3 = ListItem(List=debrep.Faces, Index=number_slider_3, Wrap=True)
panel_5 = Panel("""Bottom
Middle
Top""")
trim = TrimTree(Tree=item_3, Depth=1)
area = Area(Geometry=trim)  # -> Area, Centroid
panel_6 = Panel("""South
East
North
West""")
merge_5 = Merge(Data1=wwr_n, Data2=wwr_n, Data3=wwr_n, Data4=wwr_n)  # -> simplify(flatten(Result))
move = Move(Geometry=extr, Motion=cluster.floorzaxismovementvec)  # -> simplify(flatten(Geometry)), Transform
ma = MassAddition(Input=area.Area)  # -> flatten(Result), PartialResults
item_4 = ListItem(List=debrep_2.Faces, Index=number_slider_3, Wrap=True)
cluster_2 = Cluster_5(
    base_point="-30,0,0",
    f2f_height=multiplication_4,
    width=width,
    depth_spacing=depth_sapcing,
    perim_depth=perim_depth,
    core_depth=core_depth,
    wwr=wwr,
    base_point_2="-30,0,0",
    horizontal_spacing=horizontal_spacing)  # -> adiabatic_walls_2, bottom_floor_ground_surfaces_2, middle_floor_ground_surfaces_2, top_floor_ground_surfaces_2, bottom_floor_roof_surfaces_2, middle_floor_roof_surfaces_2, top_floor_roof_surfaces_2, perim_zones_2, core_zones_2, window_surfaces_2
crossref = CrossReference(ListA=panel_6, ListB=panel_5, CrossMode=1)  # -> ListA, ListB
item_5 = ListItem(List=ma.Result, Index=0, Wrap=True)
area_2 = Area(Geometry=item_4)  # -> Core_area, Centroid
winshdgen = WinShdGen(zone_geometry=move.Geometry, wwr=merge_5)
total_perim_area = Number(item_5)
merge_6 = Merge(Data1=graft(crossref.ListA), Data2=graft(crossref.ListB))
addition_2 = Addition(Total_perim_area=total_perim_area, Total_core_area=area_2.Core_area)
windows = Geometry(winshdgen)
division_3 = Division(Total_core_area=area_2.Core_area, Total_perim_area=total_perim_area)
division_4 = Division(Total_perim_area=total_perim_area, Total_facade_area=expression_3)
multiplication_10 = Multiplication(Shoebox_facade_area=multiplication_8, Perim_area_2_facade_area=division_4)
division_5 = Division(Total_perim_area=multiplication_10, Shoebox_width=width)
multiplication_11 = Multiplication(Total_perim_depth=division_5, Core_2_perim=division_3)

# ---- group: perim_to_facade desired properties
desired_perim_area_m2 = Panel(multiplication_10)
desired_perim_depth_m = Panel(division_5)
desired_core_depth = Panel(multiplication_11)

# ----
ins = InsertItems(List=merge_6, Item="Perim", Indices="0", Wrap=True)
ins_2 = InsertItems(List=merge_6, Item="Core", Indices="0", Wrap=True)
division_6 = Division(Total_perim_area=total_perim_area, Footprint_area=addition_2)
join_4 = TextJoin(Text=ins, Join="_")  # -> flatten(Result)
join_5 = TextJoin(Text=ins_2, Join="_")  # -> flatten(Result)
division_7 = Division(Total_core_area=area_2.Core_area, Footprint_area=addition_2)

# ---- group: 15-zone model computed properties
perim_area_to_facade_area_unitless = Panel(division_4)
core_fraction_core_footprint = Panel(division_7)
building_core_to_perim_ratio_unitless = Panel(division_3)
core_fraction_core_footprint_2 = Panel(division_6)
gfa_facade_area_unitless = Panel(division)
facade_area_m2 = Panel(expression_2)
gfa_m2 = Panel(expression_4)

# ----
bottom_floor_ground_surfaces = Geometry(simplify(cluster_2.bottom_floor_ground_surfaces_2))
middle_floor_ground_surfaces = Geometry(simplify(cluster_2.middle_floor_ground_surfaces_2))
bottom_floor_roof_surfaces = Geometry(simplify(cluster_2.bottom_floor_roof_surfaces_2))
top_floor_ground_surfaces = Geometry(simplify(cluster_2.top_floor_ground_surfaces_2))
window_surfaces = Geometry(flatten(cluster_2.window_surfaces_2))
top_floor_roof_surfaces = Geometry(simplify(cluster_2.top_floor_roof_surfaces_2))
perim_zones = Geometry(flatten(cluster_2.perim_zones_2))
core_zones = Geometry(flatten(cluster_2.core_zones_2))
middle_floor_roof_surfaces = Geometry(simplify(cluster_2.middle_floor_roof_surfaces_2))
adiabatic_walls = Geometry(cluster_2.adiabatic_walls_2)
bco = CSBoundaryObject(Brep=flatten(bottom_floor_ground_surfaces), type="GROUND")
bco_2 = CSBoundaryObject(
    Brep=flatten([middle_floor_ground_surfaces, adiabatic_walls, top_floor_ground_surfaces, bottom_floor_roof_surfaces, middle_floor_roof_surfaces]),
    type="ADIABAT")
zone = CSEnergyZone(Brep=perim_zones, Name=join_4, Settings=zset, UsedLibraryObjects="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")  # -> Zones, Settings
zone_2 = CSEnergyZone(Brep=core_zones, Name=join_5, Settings=zset, UsedLibraryObjects="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")  # -> Zones, Settings
window = CSWindow(Surface=window_surfaces, Settings=wset, UsedLibraryObjects="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")  # -> Window, Settings

# ----
# Model Setup
zone_3 = CSEnergyZone(
    Brep=flatten(cluster.perimeter_2),
    Name=flatten(cluster.perimnames),
    Settings=zset,
    UsedLibraryObjects="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")  # -> Zones, Settings
zone_4 = CSEnergyZone(
    Brep=cluster.core_2,
    Name=cluster.core_names,
    Settings=zset,
    UsedLibraryObjects="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")  # -> Zones, Settings
bco_3 = CSBoundaryObject(Brep=cluster.ground_plane_2, type="GROUND")
window_2 = CSWindow(Surface=windows, Settings=wset, UsedLibraryObjects="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")  # -> Window, Settings
model = CSModelMaker(Zones=flatten([zone_4.Zones, zone_3.Zones]), Windows=window_2.Window, Boundaries=bco_3, Library=library)  # -> Model, Invalid
run_e = RunCSEnergyModel(
    Model=model.Model,
    Name="Autozoner",
    Location=path,
    Run=button,
    NorthOffset=0,
    settings="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")  # -> Model, Settings, Result

model_2 = CSModelMaker(Zones=flatten([zone.Zones, zone_2.Zones]), Windows=window.Window, Boundaries=flatten([bco, bco_2]), Library=library)  # -> Model, Invalid
run_e_2 = RunCSEnergyModel(
    Model=model_2.Model,
    Name="Shoeboxer",
    Location=path,
    Run=button,
    NorthOffset=0,
    settings="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")  # -> Model, Settings, Result
energy_results = LoadCSEnergyResult(ThermalModel=run_e_2.Model, Mode=0, Resolution=0, Toggle=Toggle(True))  # -> TotalEUI, Baseline, TotalCO2, TotalCost, FloorArea, Data, Labels, Months, Colors, CSR
toggle_2 = BooleanToggle(True)
toggle_3 = BooleanToggle(True)
load_zone_results = LoadCSZoneResults(
    ThermalModel=run_e.Model,
    Toggle=toggle_2,
    byzone="True",
    settings="""{
  "zoneIDs": [],
  "output2Display": [
    {
      "key": "Zone Ideal Loads Supply Air Total Heating Energy",
      "unit": "HVAC Sum [J]",
      "type": 0
    }
  ],
  "normalizeByFloorArea": false
}""")  # -> ResultsPerZone, Labels, Name, Zone
load_zone_results_2 = LoadCSZoneResults(
    ThermalModel=run_e.Model,
    Toggle=toggle_2,
    byzone="True",
    settings="""{
  "zoneIDs": [],
  "output2Display": [
    {
      "key": "Zone Ideal Loads Supply Air Total Cooling Energy",
      "unit": "HVAC Sum [J]",
      "type": 0
    }
  ],
  "normalizeByFloorArea": false
}""")  # -> ResultsPerZone, Labels, Name, Zone
load_zone_results_3 = LoadCSZoneResults(
    ThermalModel=run_e_2.Model,
    Toggle=toggle_3,
    byzone="True",
    settings="""{
  "zoneIDs": [],
  "output2Display": [
    {
      "key": "Zone Ideal Loads Supply Air Total Heating Energy",
      "unit": "HVAC Sum [J]",
      "type": 0
    }
  ],
  "normalizeByFloorArea": false
}""")  # -> ResultsPerZone, Labels, Name, Zone
load_zone_results_4 = LoadCSZoneResults(
    ThermalModel=run_e_2.Model,
    Toggle=toggle_3,
    byzone="True",
    settings="""{
  "zoneIDs": [],
  "output2Display": [
    {
      "key": "Zone Ideal Loads Supply Air Total Cooling Energy",
      "unit": "HVAC Sum [J]",
      "type": 0
    }
  ],
  "normalizeByFloorArea": false
}""")  # -> ResultsPerZone, Labels, Name, Zone
debrep_3 = DeconstructBrep(Brep=load_zone_results_2.Zone)  # -> Faces, Edges, Vertices
debrep_4 = DeconstructBrep(Brep=load_zone_results_4.Zone)  # -> Faces, Edges, Vertices
item_6 = ListItem(List=debrep_3.Faces, Index="5", Wrap=True)  # -> graft(Item)
item_7 = ListItem(List=debrep_4.Faces, Index="5", Wrap=True)  # -> graft(Item)
area_3 = Area(Geometry=item_6)  # -> simplify(Area), Centroid
area_4 = Area(Geometry=item_7)  # -> simplify(Area), Centroid
pow = Power(A="10", B="-7")
multiplication_12 = Multiplication(A="2.777", B=pow)
energy_results_2 = LoadCSEnergyResult(ThermalModel=run_e.Model, Mode=0, Resolution=0, Toggle=Toggle(True))  # -> TotalEUI, Baseline, TotalCO2, TotalCost, FloorArea, Data, Labels, Months, Colors, CSR
cluster_3 = Cluster_6()
multiplication_13 = Multiplication(A=load_zone_results_2.ResultsPerZone, B=multiplication_12)
multiplication_14 = Multiplication(A=load_zone_results.ResultsPerZone, B=multiplication_12)
multiplication_15 = Multiplication(A=load_zone_results_4.ResultsPerZone, B=cluster_3)
multiplication_16 = Multiplication(A=load_zone_results_3.ResultsPerZone, B=cluster_3)
division_8 = Division(A=multiplication_13, B=area_3.Area)
python = GhPythonScript(x=load_zone_results_4.Name)  # -> out, a
# ---------- python: Python ----------
__author__ = "szvsw"
__version__ = "2023.11.05"

import rhinoscriptsyntax as rs

a = "Perim" in x
# ---------- end python ----------
division_9 = Division(A=multiplication_14, B=area_3.Area)
division_10 = Division(A=multiplication_15, B=area_4.Area)
plotter = CSPlotter(
    Type=0,
    Width=550,
    Height=450,
    Title="Monthly EUI By End Use",
    Y_title="kWh/m2",
    X_labels=energy_results_2.Months,
    X_rot=0,
    Y_data=energy_results_2.Data,
    Colors=energy_results_2.Colors,
    Names=energy_results_2.Labels,
    Range="50",
    Show_xgrid=False,
    Show_ygrid=True,
    Legend=0,
    PreviewDimension=1,
    InfinateZoomDisplay=True,
    UnitSystem=4)
division_11 = Division(A=multiplication_16, B=area_4.Area)
not = GateNot(A=python.a)
flip_2 = FlipMatrix(Data=division_11)
flip_3 = FlipMatrix(Data=division_10)
merge_7 = Merge(
    Data1=ColourSwatch(SwatchColor=RGB(0, 255, 0)),
    Data2=ColourSwatch(SwatchColor=RGB(0, 123, 255)),
    Data3=ColourSwatch(SwatchColor=RGB(234, 255, 0)),
    Data4=ColourSwatch(SwatchColor=RGB(225, 0, 255)),
    Data5=ColourSwatch(SwatchColor=RGB(255, 0, 0)))
stack = StackData(Data=merge_7, Stack=Slider(3, range=0..10))
cull = CullPattern(List=flip_2, CullPattern=python.a)
cull_2 = CullPattern(List=flip_2, CullPattern=not)
cull_3 = CullPattern(List=flip_3, CullPattern=python.a)
cull_4 = CullPattern(List=flip_3, CullPattern=not)
cull_5 = CullPattern(List=load_zone_results_4.Name, CullPattern=python.a)
flip_4 = FlipMatrix(Data=cull)
flip_5 = FlipMatrix(Data=cull_2)
cull_6 = CullPattern(List=load_zone_results_4.Name, CullPattern=not)
flip_6 = FlipMatrix(Data=cull_3)
flip_7 = FlipMatrix(Data=cull_4)
python_2 = GhPythonScript(
    x=cull_6,
    y=ColourSwatch(SwatchColor=RGB(0, 255, 0)),
    z=ColourSwatch(SwatchColor=RGB(0, 123, 255)),
    u=ColourSwatch(SwatchColor=RGB(234, 255, 0)),
    v=ColourSwatch(SwatchColor=RGB(225, 0, 255)))  # -> out, a
# ---------- python_2: Python ----------
__author__ = "szvsw"
__version__ = "2023.11.05"

import rhinoscriptsyntax as rs

if "south" in x or "South" in x:
    a= y
if "east" in x or "East" in x:
    a= z
if "north" in x or "North" in x:
    a= u
if "west" in x or "West" in x:
    a= v
# ---------- end python_2 ----------

panel_7 = Panel("Heating Demand (kWh/m2)")
plotter_2 = CSPlotter(
    Type=0,
    Width=550,
    Height=450,
    Title="3floor,5zone Autozoner Heating",
    Y_title=panel_7,
    X_rot=0,
    Y_data=division_9,
    Colors=stack,
    Names=load_zone_results_2.Name,
    Range="40",
    Show_xgrid=False,
    Show_ygrid=True,
    Legend=0,
    PreviewDimension=1,
    InfinateZoomDisplay=True,
    UnitSystem=4)
panel_8 = Panel("Cooling Demand (kWh/m2)")
plotter_3 = CSPlotter(
    Type=0,
    Width=550,
    Height=450,
    Title="3floor,5zone Autozoner Cooling",
    Y_title=panel_8,
    X_rot=0,
    Y_data=division_8,
    Colors=stack,
    Names=load_zone_results_2.Name,
    Range="50",
    Show_xgrid=False,
    Show_ygrid=True,
    Legend=0,
    PreviewDimension=1,
    InfinateZoomDisplay=True,
    UnitSystem=4)
plotter_4 = CSPlotter(
    Type=0,
    Width=550,
    Height=450,
    Title="Shoeboxer Perim Heating",
    Y_title=panel_7,
    X_rot=0,
    Y_data=flip_4,
    Colors=python_2.a,
    Names=cull_5,
    Range="40",
    Show_xgrid=False,
    Show_ygrid=True,
    Legend=0,
    PreviewDimension=1,
    InfinateZoomDisplay=True,
    UnitSystem=4)
plotter_5 = CSPlotter(
    Type=0,
    Width=550,
    Height=450,
    Title="Shoeboxer Perimeter Cooling",
    Y_title=panel_8,
    X_rot=0,
    Y_data=flip_6,
    Colors=python_2.a,
    Names=cull_5,
    Range="50",
    Show_xgrid=False,
    Show_ygrid=True,
    Legend=0,
    PreviewDimension=1,
    InfinateZoomDisplay=True,
    UnitSystem=4)
plotter_6 = CSPlotter(
    Type=0,
    Width=550,
    Height=450,
    Title="Shoeboxer Core Heating",
    Y_title=panel_7,
    X_rot=0,
    Y_data=flip_5,
    Colors=python_2.a,
    Names=cull_6,
    Range="40",
    Show_xgrid=False,
    Show_ygrid=True,
    Legend=0,
    PreviewDimension=1,
    InfinateZoomDisplay=True,
    UnitSystem=4)
plotter_7 = CSPlotter(
    Type=0,
    Width=550,
    Height=450,
    Title="Shoeboxer Core Cooling",
    Y_title=panel_8,
    X_rot=0,
    Y_data=flip_7,
    Colors=python_2.a,
    Names=cull_6,
    Range="50",
    Show_xgrid=False,
    Show_ygrid=True,
    Legend=0,
    PreviewDimension=1,
    InfinateZoomDisplay=True,
    UnitSystem=4)

flip_8 = FlipMatrix(Data=flip_7)
flip_9 = FlipMatrix(Data=flip_6)
panel_9 = Panel(cull_5)
flip_10 = FlipMatrix(Data=flip_4)
flip_11 = FlipMatrix(Data=flip_5)
ma_2 = MassAddition(Input=flip_6)  # -> flatten(Result), PartialResults
avr = Average(Input=flip_8)
avr_2 = Average(Input=flip_9)
avr_3 = Average(Input=flip_10)
avr_4 = Average(Input=flip_11)
flip_12 = FlipMatrix(Data=avr_2)
flip_13 = FlipMatrix(Data=avr)
flip_14 = FlipMatrix(Data=avr_3)
flip_15 = FlipMatrix(Data=avr_4)
panel_10 = Panel(ma_2.Result)
stack_2 = StackTrees(Data0=flip_12, Data1=flip_13, Data2=flip_14, Data3=flip_15, Reduce=True)
plotter_8 = CSPlotter(
    Type=0,
    Width=550,
    Height=450,
    Title="Shoeox Averages (demand - no CoPs)",
    Y_title="kWh/m2",
    X_rot=0,
    Y_data=stack_2,
    Colors=merge_4,
    Names=panel_4,
    Range="50",
    Show_xgrid=False,
    Show_ygrid=True,
    Legend=0,
    PreviewDimension=1,
    InfinateZoomDisplay=True,
    UnitSystem=4)

# ==== cluster WinShdGen
zone_geometry = ClusterInput()
debrep = DeconstructBrep(ZoneGeometry=zone_geometry)  # -> Faces, Edges, Vertices
area = Area(Geometry=debrep.Faces)  # -> Area, Centroid
evalsrf = EvaluateSurface(Surface=debrep.Faces, Point=area.Centroid)  # -> Point, Normal, UDirection, VDirection, Frame
Z = UnitZ(Factor=1)
dprod = DotProduct(VectorA=evalsrf.Normal, VectorB=Z, Unitize=False)
wwr = ClusterInput()  # WWR (N,E,S,W)
abs = Absolute(Value=dprod)
smaller = SmallerThan(FirstNumber=abs, SecondNumber=".9")  # -> SmallerThan, OrEqualTo
dispatch = Dispatch(List=debrep.Faces, DispatchPattern=smaller.SmallerThan)  # -> ListA, ListB
srf = Surface(dispatch.ListA)
cluster = Cluster_2(srf=srf)
srf_2 = Surface(flatten(cluster))
item = ListItem(List=wwr, Index="0", Wrap=True)
item_2 = ListItem(List=wwr, Index="1", Wrap=True)
item_3 = ListItem(List=wwr, Index="2", Wrap=True)
item_4 = ListItem(List=wwr, Index="3", Wrap=True)
Y = UnitY(Factor=1)
X = UnitX(Factor=1)
Y_2 = UnitY(Factor="-1")
X_2 = UnitX(Factor="-1")
cluster_2 = Cluster(S=srf, dir=X, wwr=item_2)
cluster_3 = Cluster(S=srf, dir=Y_2, wwr=item_3)
cluster_4 = Cluster(S=srf, dir=X_2, wwr=item_4)
cluster_5 = Cluster(S=srf, dir=Y, wwr=item)
geo_n = Geometry(cluster_5)
geo_e = Geometry(cluster_2)
geo_s = Geometry(cluster_3)
geo_w = Geometry(cluster_4)
merge = Merge(Data1=geo_n, Data2=geo_e, Data3=geo_s, Data4=geo_w)
clean = CleanTree(RemoveNulls=True, RemoveInvalid=True, RemoveEmpty=False, Tree=merge)  # -> flatten(Tree)
T = ClusterOutput(clean)

# ==== cluster Cluster_3
floorheight = ClusterInput()
numfloors = ClusterInput()
xlen = ClusterInput()
ylen = ClusterInput()
offset = ClusterInput()

floorheight_2 = Number(floorheight)
numfloors_2 = Number(numfloors)
xlen_2 = Number(xlen)
ylen_2 = Number(ylen)
xy = XYPlane(Origin=Point(0, 0, 0))
Z = UnitZ(Factor=expr("x*0.5", floorheight_2))
footprintcurve = Rectangle(Plane=xy, XSize=xlen_2, YSize=ylen_2, Radius=0)  # -> FootprintBaseCurve, Length
Z_2 = UnitZ(Factor=floorheight_2)
move = Move(Geometry=xy, Motion=Z)  # -> Geometry, Transform
az = Autozoner(FloorPlanOutlines=footprintcurve.FootprintBaseCurve, Offset=offset)  # -> Outline, PerimeterPolylines, CorePolylines, SkeletonPolylines
box = CenterBox(Base=move.Geometry, X=xlen_2, Y=ylen_2, Z=expr("x*0.5", floorheight_2))
series = Series(Start=0, Step=floorheight_2, Count=numfloors_2)
pcol = PolylineCollapse(Polyline=az.PerimeterPolylines, Tolerance=1)  # -> Polyline, Count
pcol_2 = PolylineCollapse(Polyline=az.CorePolylines, Tolerance=1)  # -> Polyline, Count
floorzmove = UnitZ(Factor=series)
extr = Extrude(Base=pcol.Polyline, Direction=Z_2)
extr_2 = Extrude(Base=pcol_2.Polyline, Direction=Z_2)
cap = CapHoles(Brep=extr_2)
cap_2 = CapHoles(Brep=extr)  # -> graft(Brep)
move_2 = Move(Geometry=cap_2, Motion=floorzmove)  # -> Geometry, Transform
move_3 = Move(Geometry=cap, Motion=floorzmove)  # -> Geometry, Transform
ground_plane = Surface(footprintcurve.FootprintBaseCurve)
perimeter = Geometry(move_2.Geometry)
core = Geometry(move_3.Geometry)

footprintbasecurve = ClusterOutput(footprintcurve.FootprintBaseCurve)
f2fzaxismovementvec = ClusterOutput(Z_2)
floorzaxismovementvec = ClusterOutput(floorzmove)
ground_plane_2 = ClusterOutput(ground_plane)
perimeter_2 = ClusterOutput(perimeter)
core_2 = ClusterOutput(core)
panel = Panel("""South
East
North
West""")
series_2 = Series(Start=0, Step=1, Count=numfloors_2)
ins = InsertItems(List=graft(series_2), Item="Core", Indices=0, Wrap=True)  # -> simplify(List)
stack = StackData(Data=graft(panel), Stack=numfloors_2)
stack_2 = StackData(Data=graft(series_2), Stack="4")
join = TextJoin(Text=ins, Join="_Level_")  # -> flatten(Core_Names)
panel_2 = Panel(stack)
flip = FlipMatrix(Data=stack_2)
panel_3 = Panel(flip)
core_names = ClusterOutput(join)
merge = Merge(Data1=simplify(graft(panel_2)), Data2=simplify(graft(panel_3)))
join_2 = TextJoin(Text=merge, Join="_Level_")
panel_4 = Panel(join_2)
trim = TrimTree(Tree=panel_4, Depth="1")
perimnames = ClusterOutput(trim)

# ==== cluster Cluster_5
perim_depth = ClusterInput()
core_depth = ClusterInput()
wwr = ClusterInput()
base_point = ClusterInput()
f2f_height = ClusterInput()
width = ClusterInput()
cluster = Cluster_4(base_point=base_point, f2f_height=f2f_height, width=width, perim_depth=perim_depth, core_depth=core_depth, A=wwr)  # -> adiabatic_sides_2, bottom_plane_2, top_plane_2, perim_zone_2, core_zone_2, window_2
adiabatic_sides = Geometry(cluster.adiabatic_sides_2)
perim_zone = Geometry(cluster.perim_zone_2)
core_zone = Geometry(cluster.core_zone_2)
window = Geometry(cluster.window_2)
top_plane = Geometry(cluster.top_plane_2)
bottom_plane = Geometry(cluster.bottom_plane_2)
base_point_2 = ClusterInput()
stack = StackTrees(Data0=adiabatic_sides, Data1=bottom_plane, Data2=top_plane, Data3=perim_zone, Data4=core_zone, Data5=window, Reduce=True)
base_point_3 = Data(base_point_2)
depth_spacing = ClusterInput()
panel = Panel(base_point_3)
depth_spacing_2 = Number(depth_spacing)
multiplication = Multiplication(A=depth_spacing_2, B=2)
multiplication_2 = Multiplication(A=depth_spacing_2, B="3")
rotate = Rotate(Geometry=stack, Angle="PI/2", Plane=panel)  # -> Geometry, Transform
rotate_2 = Rotate(Geometry=stack, Angle="PI", Plane=panel)  # -> Geometry, Transform
rotate_3 = Rotate(Geometry=stack, Angle="3*PI/2", Plane=panel)  # -> Geometry, Transform
Y = UnitY(Factor=depth_spacing_2)
Y_2 = UnitY(Factor=multiplication)
Y_3 = UnitY(Factor=multiplication_2)
horizontal_spacing = ClusterInput()
move = Move(Geometry=rotate.Geometry, Motion=Y)  # -> Geometry, Transform
move_2 = Move(Geometry=rotate_2.Geometry, Motion=Y_2)  # -> Geometry, Transform
move_3 = Move(Geometry=rotate_3.Geometry, Motion=Y_3)  # -> Geometry, Transform
X = UnitX(HorizontalSpacing=horizontal_spacing)
entwine = Entwine(Branch0X=stack, Branch1X=move.Geometry, Branch2X=move_2.Geometry, Branch3X=move_3.Geometry, FlattenInputs=False)
multiplication_3 = Multiplication(A=X, B=2)
move_4 = Move(Geometry=entwine, Motion=X)  # -> Geometry, Transform
move_5 = Move(Geometry=entwine, Motion=multiplication_3)  # -> Geometry, Transform
entwine_2 = Entwine(Branch0X=entwine, Branch1X=move_4.Geometry, Branch2X=move_5.Geometry, FlattenInputs=False)
split = SplitTree(Data=entwine_2, Masks=flatten("{*;*;0}"))  # -> Positive, Negative
split_2 = SplitTree(Data=entwine_2, Masks=flatten("{*;*;1}"))  # -> Positive, Negative
split_3 = SplitTree(Data=entwine_2, Masks=flatten("{*;*;2}"))  # -> Positive, Negative
split_4 = SplitTree(Data=entwine_2, Masks=flatten("{*;*;3}"))  # -> Positive, Negative
split_5 = SplitTree(Data=entwine_2, Masks=flatten("{*;*;4}"))  # -> Positive, Negative
split_6 = SplitTree(Data=entwine_2, Masks=flatten("{*;*;5}"))  # -> Positive, Negative
adiabatic_walls = Geometry(split.Positive)
roof_surfaces = Geometry(split_3.Positive)
ground_surfaces = Geometry(split_2.Positive)
perim_zones = Geometry(split_4.Positive)
core_zones = Geometry(split_5.Positive)
window_surfaces = Geometry(split_6.Positive)
adiabatic_walls_2 = ClusterOutput(adiabatic_walls)
core_zones_2 = ClusterOutput(core_zones)
perim_zones_2 = ClusterOutput(perim_zones)
window_surfaces_2 = ClusterOutput(window_surfaces)
ground_surfaces_2 = Geometry(simplify(ground_surfaces))
ground_surfaces_3 = Geometry(simplify(roof_surfaces))
split_7 = SplitTree(Data=ground_surfaces_2, Masks=flatten("{0;*}"))  # -> Positive, Negative
split_8 = SplitTree(Data=ground_surfaces_2, Masks=flatten("{1;*}"))  # -> Positive, Negative
split_9 = SplitTree(Data=ground_surfaces_2, Masks=flatten("{2;*}"))  # -> Positive, Negative
split_10 = SplitTree(Data=ground_surfaces_3, Masks=flatten("{0;*}"))  # -> Positive, Negative
split_11 = SplitTree(Data=ground_surfaces_3, Masks=flatten("{1;*}"))  # -> Positive, Negative
split_12 = SplitTree(Data=ground_surfaces_3, Masks=flatten("{2;*}"))  # -> Positive, Negative
bottom_floor_ground_surfaces = Geometry(simplify(split_7.Positive))
middle_floor_ground_surfaces = Geometry(simplify(split_8.Positive))
top_floor_ground_surfaces = Geometry(simplify(split_9.Positive))
bottom_floor_roof_surfaces = Geometry(simplify(split_10.Positive))
middle_floor_roof_surfaces = Geometry(simplify(split_11.Positive))
top_floor_roof_surfaces = Geometry(simplify(split_12.Positive))
bottom_floor_ground_surfaces_2 = ClusterOutput(bottom_floor_ground_surfaces)
middle_floor_ground_surfaces_2 = ClusterOutput(middle_floor_ground_surfaces)
top_floor_ground_surfaces_2 = ClusterOutput(top_floor_ground_surfaces)
bottom_floor_roof_surfaces_2 = ClusterOutput(bottom_floor_roof_surfaces)
middle_floor_roof_surfaces_2 = ClusterOutput(middle_floor_roof_surfaces)
top_floor_roof_surfaces_2 = ClusterOutput(top_floor_roof_surfaces)

# ==== cluster Cluster_6
pow = Power(A="10", B="-7")
multiplication = Multiplication(A="2.778", B=pow)
R = ClusterOutput(multiplication)

# ==== cluster Cluster
wwr = ClusterInput()  # WWR
dir = ClusterInput()  # Dir
S = ClusterInput()  # S

# ----
# north south gets priority
Y = UnitY(Factor=1)
dprod = DotProduct(VectorA=dir, VectorB=Y, Unitize=False)
abs = Absolute(Value=dprod)
int = Integer(abs)
item = ListItem(List=[".71", ".7"], Index=int, Wrap=True)

area = Area(Geometry=S)  # -> Area, Centroid
evalsrf = EvaluateSurface(Surface=S, Point=area.Centroid)  # -> Point, Normal, UDirection, VDirection, Frame
dprod_2 = DotProduct(VectorA=evalsrf.Normal, VectorB=dir, Unitize=False)
larger = LargerThan(FirstNumber=dprod_2, SecondNumber=item)  # -> LargerThan, OrEqualTo
panel = Panel(evalsrf.Normal)
dispatch = Dispatch(List=S, DispatchPattern=larger.LargerThan)  # -> WallsNORTH, ListB
wall_geometry = Geometry(dispatch.WallsNORTH)

# ---- group: User-Defined WWR Scale
division = Division(NorthScaleInput=wwr, B="100")

# ---- group: Centroids of Walls
area_2 = Area(Geometry=wall_geometry)  # -> Area, Centroid

# ----
sqrt = SquareRoot(Value=division)
scale = Scale(Geometry=wall_geometry, Center=area_2.Centroid, Factor=sqrt)  # -> flatten(NORTHWindows), Transform
area_3 = Area(Geometry=scale.NORTHWindows)  # -> Area, Centroid; disabled
division_2 = Division(A=area_3.Area, B=area_2.Area)  # disabled
panel_2 = Panel(division_2)  # disabled
north_windows = ClusterOutput(scale.NORTHWindows)

# ==== cluster Cluster_2
srf = ClusterInput()
srf_2 = Surface(srf)
crv = Curve(srf_2)
crv_2 = Curve(srf_2)  # disabled
srf_3 = Surface(crv_2)  # disabled
area = Area(Geometry=srf_2)  # -> Area, Centroid; disabled
srf_4 = Surface(crv)
area_2 = Area(Geometry=srf_3)  # -> Area, Centroid; disabled
flip = Flip(Surface=srf_4, Guide=srf_2)  # -> Surface, Result
evalsrf = EvaluateSurface(Surface=srf_2, Point=area.Centroid)  # -> Point, Normal, UDirection, VDirection, Frame; disabled
evalsrf_2 = EvaluateSurface(Surface=srf_3, Point=area_2.Centroid)  # -> Point, Normal, UDirection, VDirection, Frame; disabled
panel = Panel(flip.Result)
vdis = VectorDisplay(Anchor=area_2.Centroid)  # disabled
dprod = DotProduct(VectorA=evalsrf.Normal, VectorB=evalsrf_2.Normal, Unitize=False)  # disabled
vdis_2 = VectorDisplay(Anchor=area.Centroid, Vector=expr("x*10", evalsrf.Normal))  # disabled
panel_2 = Panel(".9")  # disabled
smaller = SmallerThan(FirstNumber=dprod, SecondNumber=panel_2)  # -> SmallerThan, OrEqualTo; disabled
dispatch = Dispatch(List=srf_3, DispatchPattern=smaller.SmallerThan)  # -> ListA, ListB; disabled
flip_2 = Flip(Surface=dispatch.ListA)  # -> Surface, Result; disabled
srf_5 = Surface(flatten([flip_2.Surface, dispatch.ListB]))  # disabled
S = ClusterOutput(flip.Surface)

# ==== cluster Cluster_4
floor_2_facade = ClusterInput()
core_2_perim = ClusterInput()
width = ClusterInput()
core_depth = ClusterInput()
perim_depth = ClusterInput()
f2f_height = ClusterInput()
base_point = ClusterInput()
floor_2_facade_2 = Number(floor_2_facade)
width_2 = Number(width)
core_2_perim_2 = Number(core_2_perim)
base_point_2 = Data(base_point)
f2f_height_2 = Number(f2f_height)
perim_depth_2 = Number(perim_depth)
core_depth_2 = Number(core_depth)
panel = Panel(base_point_2)
multiplication = Multiplication(A=f2f_height_2, B=floor_2_facade_2)
Y = UnitY(Factor=perim_depth_2)
multiplication_2 = Multiplication(A=multiplication, B=core_2_perim_2)
move = Move(Geometry=panel, Motion=Y)  # -> Geometry, Transform
box = DomainBox(Base=panel, X=width_2, Y=perim_depth_2, Z=f2f_height_2)
box_2 = DomainBox(Base=move.Geometry, X=width_2, Y=core_depth_2, Z=f2f_height_2)
debrep = DeconstructBrep(Brep=box)  # -> Faces, Edges, Vertices
debrep_2 = DeconstructBrep(Brep=box_2)  # -> Faces, Edges, Vertices
stack = StackTrees(Data0=debrep.Faces, Data1=debrep_2.Faces, Reduce=True)
A = ClusterInput()
item = ListItem(List=stack, Index=0, Wrap=True)  # -> Item, Item1, Item2, Item3, Item4, Item5
item_2 = ListItem(List=debrep.Faces, Index=0, Wrap=True)
division = Division(A=A, B=100)
area = Area(Geometry=item_2)  # -> Area, Centroid
geo = Geometry(item.Item4)
geo_2 = Geometry(item.Item5)
geo_3 = Geometry(item.Item1)
geo_4 = Geometry(item.Item3)
sqrt = SquareRoot(Value=division)
division_2 = Division(A=division, B=2)
join = BrepJoin(Breps=flatten(geo))  # -> Breps, Closed
join_2 = BrepJoin(Breps=flatten(geo_2))  # -> Breps, Closed
join_3 = BrepJoin(Breps=flatten(geo_4))  # -> Breps, Closed
item_3 = ListItem(List=flatten(item.Item2), Index=0, Wrap=True)  # -> Item, Item1
join_4 = BrepJoin(Breps=flatten(geo_3))  # -> Breps, Closed
addition = Addition(A=division_2, B=division)
scale = Scale(Geometry=item_2, Center=area.Centroid, Factor=sqrt)  # -> Geometry, Transform
subtraction = Subtraction(A="0.5", B=division_2)
addition_2 = Addition(A="0.5", B=division_2)
geo_5 = Geometry(join_4.Breps)
geo_6 = Geometry(join_3.Breps)
geo_7 = Geometry(join.Breps)
geo_8 = Geometry(join_2.Breps)
dom = ConstructDomain(DomainStart=subtraction, DomainEnd=addition_2)
fmerge = MergeFaces(Brep=geo_6)  # -> Breps, Before, After
fmerge_2 = MergeFaces(Brep=geo_5)  # -> Breps, Before, After
geo_9 = Geometry(item_3.Item1)
dom² = ConstructDomain²(DomainU="0.05 to 0.95", DomainV=dom)
fmerge_3 = MergeFaces(Brep=geo_8)  # -> Breps, Before, After
subsrf = Isotrim(Surface=reparameterize(item_2), Domain=dom²)
fmerge_4 = MergeFaces(Brep=geo_7)  # -> Breps, Before, After
merge = Merge(Data1=geo_9, Data2=fmerge_2.Breps, Data3=fmerge.Breps)
perim_zone = Geometry(box)
core_zone = Geometry(box_2)
window = Geometry(subsrf)
top_plane = Geometry(fmerge_3.Breps)
window_2 = ClusterOutput(window)
core_zone_2 = ClusterOutput(core_zone)
perim_zone_2 = ClusterOutput(perim_zone)
bottom_plane = Geometry(fmerge_4.Breps)
adiabatic_sides = Geometry(merge)
top_plane_2 = ClusterOutput(top_plane)
bottom_plane_2 = ClusterOutput(bottom_plane)
adiabatic_sides_2 = ClusterOutput(adiabatic_sides)
