# Grasshopper definition AutoZonerABTester_v2.gh (Grasshopper 1.0.7)
# plug-ins: ClimateStudioGH, treesloth01, jSwan, LadybugGrasshopper

number_slider = Slider(1.25, range=1.25..12)

# ---- group: Weather File
path = FilePath("C:\ProgramData\Solemma\Common\WeatherData\EPW\USA_NY_New.York-LaGuardia.AP.725030_TMYx.2004-2018.epw")

# ----
panel = Panel(path)

# ----
# Unit Converter
# Internalized Geometry is
# modeled in meters.
toggle = BooleanToggle(True)
unit = CSUnitScale(
    From="Meters",
    To="ActiveRhinoDocUnits",
    Listener=toggle,
    Input_0_Hidden=False,
    Input_0_Name="From",
    Input_1_Hidden=False,
    Input_1_Name="To",
    Input_2_Hidden=False,
    Input_2_Name="Listener",
    UnitSystem=4)

# ---- group: 15-Zone Dimensions
f2f_height_meters = Panel("4")
perim_offset = Panel(number_slider)
n_floors = Slider(3, range=2..15)
y_axis_meters = Panel("40")
x_axis_meters = Panel("40")

# ----
falsestart = LBFalseStartToggle(False)

# ----
# RUN
button = Button()

filename = Panel("perimoffset")
output_directory = Panel("D:\DATA\AutozonerTests\")
python = GhPythonScript(y=number_slider)  # -> f
# ---------- python: Python ----------
__author__ = "zoelh"
__version__ = "2023.12.06"

import rhinoscriptsyntax as rs

f = str(y).replace(".", "p")
print(f)
# ---------- end python ----------

# ---- group: shoebox dimensions
perim_depth = Slider(3.6, range=2..10)
width = Slider(3, range=1..15)
core_depth = Slider(6.4, range=2..60)

# ----
expression = Expression(x=filename, y=python, Expression="Format(\"{0}_{1}\", x, y)")
addition = Addition(A=perim_offset, B=core_depth)
multiplication = Multiplication(A=width, B=perim_offset)
multiplication_2 = Multiplication(A=width, B=core_depth)
multiplication_3 = Multiplication(A=width, B=addition)

# ---- group: perim_to_facade desired properties
actual_perim_area_m2 = Panel(multiplication)
actual_core_area_m2 = Panel(multiplication_2)
actual_shoebox_total_area_m2 = Panel(multiplication_3)

# ----
panel_2 = Panel(expression)

infiltrationmethod = ValueList({"ACH", "Flow Per Exterior Area": "FlowExtArea"}, selected="Flow Per Exterior Area")
infiltration_m3_s_m2 = Slider(5e-05, range=0..0.0005)
infiltration_ach = Slider(0, range=0..1)

ventilationperperson_l_s_person = Slider(6.9, range=0..10)
ventilationperarea_l_s_m2 = Slider(0.1, range=0..5)
heatingsetpoint_degc = Slider(19, range=10..24)
coolingsetpoint_degc = Slider(25, range=16..30)
econ = ValueList({"NoEconomizer", "DifferentialEnthalpy"}, selected="NoEconomizer")
hrv = ValueList({"None", "Sensible", "Enthalpy"}, selected="None")
mechventon = BooleanToggle(True)

# ---- group: Loads
lpd_w_m2 = Slider(0, range=0..50)
epd_w_m2 = Slider(0, range=0..50)
peopledensity_ppl_m2 = Slider(0.025, range=0..0.5)

# ----
expression_2 = Expression(x=expression, Expression="Format(\"{0}_settings\", x)")

# ---- group: Windows
number_slider_2 = Slider(0.65, range=0..1)
number_slider_3 = Slider(4, range=0.6..7)
tvis = Panel("0.8")

# ----
panel_3 = Panel(expression_2)

# ---- group: MechVentilationSchedule
panel_4 = Panel("AllOn")

# ---- group: Unit Conversion for 15 zone dimensions
multiplication_4 = Multiplication(A=f2f_height_meters, B=unit)
multiplication_5 = Multiplication(A=x_axis_meters, B=unit)
multiplication_6 = Multiplication(A=y_axis_meters, B=unit)
multiplication_7 = Multiplication(A=perim_offset, B=unit)

# ----
expression_3 = Expression(x=expression, Expression="Format(\"{0}_Shoeboxer\", x)")
expression_4 = Expression(x=expression, Expression="Format(\"{0}_Autozoner\", x)")
toggle_2 = BooleanToggle(True)
toggle_3 = BooleanToggle(True)
j_to_kwh = JToKWh()
j_to_kwh_2 = JToKWh()
n_floors_2 = Data(n_floors)
subtraction = Subtraction(A=n_floors_2, B="2")
number_slider_4 = Slider(4, range=0..10)
panel_5 = Panel("""Perim Cooling, AZ
Core Cooling, AZ
Perim Heating, AZ
Core Heating, AZ
Perim Cooling, CS sb
Core Cooling, CS sb
Perim Heating, CS sb
Core Heating, CS sb""")
repeat = RepeatData(Data=Slider(6, range=0..10), Length=number_slider_4)
repeat_2 = RepeatData(Data=Slider(1, range=0..10), Length=number_slider_4)
merge = Merge(Data1=repeat_2, Data2=repeat)

# ---- group: ROOF CONSTRUCTION
roof_concrete_thickness = Panel("0.203")
roof_xps_thickness = Panel("0.4")

# ---- group: FACADE CONSTRUCTION
wall_concrete_thickness = Panel("0.203")
wall_insul_thickness = Panel("0.05")

# ---- group: SLAB CONSTRUCTION
slab_insul_thickness = Panel("0.151")

# ----
# Template Settings
panel_6 = Panel("Occupancy")
number_slider_5 = Slider(5, range=0..15)
panel_7 = Panel("D:\Users\zoelh\GitRepos\ml-for-building-energy-modeling\ml-for-bem\data\")
python_2 = GhPythonScript(index=number_slider_5, path=panel_7)  # -> schedules
# ---------- python_2: Python ----------
__author__ = "zoelh"
__version__ = "2023.11.18"

import rhinoscriptsyntax as rs
import csv
import ghpythonlib.treehelpers as th

schedules = []
l = ["EquipmentAvailabilitySchedule.csv", "LightsAvailabilitySchedule.csv", "OccupancySchedule.csv"]
for file in l:
    filename = path + file
    with open(filename) as csvfile:
        reader = csv.reader(csvfile)
        rows = list(reader)
        row = rows[int(index)+1]
        schedules.append([row[1:]])
schedules = th.list_to_tree(schedules)
# ---------- end python_2 ----------
bang = ExplodeTree(Data=python_2)  # -> Branch0, Branch1, Branch2
year_schedule = ConstructCSYearSchedule(Name=panel_6, Type=0, Category=0, DaysHours=bang.Branch2)  # -> Sched, Values
year_schedule_2 = ConstructCSYearSchedule(Name="Equip", Type=0, Category=0, DaysHours=bang.Branch0)  # -> Sched, Values
year_schedule_3 = ConstructCSYearSchedule(Name="Lights", Type=0, Category=0, DaysHours=bang.Branch1)  # -> Sched, Values
wwr = Slider(40, range=0..100)
occupancy = Data(year_schedule.Sched)
list = ValueList({"Residential", "Kitchen", "Office", "MeetingRoom", "HotelRoom", "ClassRoom", "Library", "LectureHall", "SuperMarket", "Shopping", "ScienceLab"}, selected="Office")
simple_window = ConstructCSSimpleWindow(Name="windowtest", Shgf=number_slider_2, Uval=number_slider_3, Tvis=tvis)
zonetemplate = GetZoneTemplate(SearchZoneTemplate=list, Selection="Office")
heating_coolingconstant = BooleanToggle(True)
scheduledventilationon = BooleanToggle(False)
scheduledventilationon_2 = BooleanToggle(False)
people_equip_lightson = BooleanToggle(True)
heating_coolingon = BooleanToggle(True)
humidistaton = BooleanToggle(False)
item = ListItem(List=zonetemplate, Index=0, Wrap=True)
infiltrationon = BooleanToggle(True)
natventon = BooleanToggle(False)
fanenergy = BooleanToggle(False)
dhwon = BooleanToggle(True)
shadingon = BooleanToggle(False)
hasframe = BooleanToggle(False)
panel_8 = Panel("Airspeed 0")
dimmingtype = Panel("Off")
wset = CSWindowSettings(
    Name="SimpleWindowSettings",
    Type="External",
    ShadingSystemIsOn=shadingon,
    GlazingConstruction=simple_window,
    OperableArea="0",
    HasFrame=hasframe,
    AFNWindowAvailability="AllOff",
    Input_0_Hidden=False,
    Input_0_Name="Name",
    Input_10_Hidden=True,
    Input_10_Name="ShadingThickness",
    Input_11_Hidden=True,
    Input_11_Name="ShadeGlassDistance",
    Input_12_Hidden=True,
    Input_12_Name="TopBottomEdgeOpeningMultiplier",
    Input_13_Hidden=True,
    Input_13_Name="Analysis Mesh Resolution",
    Input_14_Hidden=True,
    Input_14_Name="ZoneMixingIsOn",
    Input_15_Hidden=True,
    Input_15_Name="ZoneMixingDeltaTemperature",
    Input_16_Hidden=True,
    Input_16_Name="ZoneMixingFlowRate",
    Input_17_Hidden=False,
    Input_17_Name="Glazing Construction",
    Input_18_Hidden=False,
    Input_18_Name="OperableArea",
    Input_19_Hidden=True,
    Input_19_Name="ZoneMixingAvailibilitySchedule",
    Input_1_Hidden=False,
    Input_1_Name="WindowSettings",
    Input_20_Hidden=False,
    Input_20_Name="HasFrame",
    Input_21_Hidden=True,
    Input_21_Name="FrameWidth",
    Input_22_Hidden=True,
    Input_22_Name="FrameProjection"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)

# ----
# 5-Zone Builder
expression_5 = Expression(
    width=multiplication_5,
    len=multiplication_6,
    f2f_h=multiplication_4,
    floors=n_floors,
    Expression="(2*width + 2*len)*floors*f2f_h")
expression_6 = Expression(
    width=multiplication_5,
    len=multiplication_6,
    f2f_h=multiplication_4,
    floors=n_floors,
    Expression="(2*width + 2*len)*f2f_h")
expression_7 = Expression(width=multiplication_5, len=multiplication_6, floors=n_floors, Expression="width*len*floors")
division = Division(A=expression_7, B=expression_5)
cluster = Cluster_3(numfloors=n_floors, floorheight=multiplication_4, xlen=multiplication_5, ylen=multiplication_6, offset=multiplication_7)  # -> floorzaxismovementvec, perimnames, perimeter_2, core_names, f2fzaxismovementvec, core_2, footprintbasecurve, ground_plane_2
explode = Explode(Curve=cluster.footprintbasecurve, Recursive=True)  # -> Segments, Vertices
wwr_n = Number(wwr)
item_2 = ListItem(List=flatten(cluster.core_2), Index=0, Wrap=True)
flip = FlipMatrix(Data=cluster.perimeter_2)
extr = Extrude(Base=explode.Segments, Direction=cluster.f2fzaxismovementvec)  # -> graft(Extrusion)
debrep = DeconstructBrep(Brep=flip)  # -> Faces, Edges, Vertices
debrep_2 = DeconstructBrep(Brep=item_2)  # -> Faces, Edges, Vertices
number_slider_6 = Slider(5, range=0..5)
item_3 = ListItem(List=debrep.Faces, Index=number_slider_6, Wrap=True)
trim = TrimTree(Tree=item_3, Depth=1)
area = Area(Geometry=trim)  # -> Area, Centroid
merge_2 = Merge(Data1=wwr_n, Data2=wwr_n, Data3=wwr_n, Data4=wwr_n)  # -> simplify(flatten(Result))
move = Move(Geometry=extr, Motion=cluster.floorzaxismovementvec)  # -> simplify(flatten(Geometry)), Transform
ma = MassAddition(Input=area.Area)  # -> flatten(Result), PartialResults
item_4 = ListItem(List=debrep_2.Faces, Index=number_slider_6, Wrap=True)
item_5 = ListItem(List=ma.Result, Index=0, Wrap=True)
area_2 = Area(Geometry=item_4)  # -> Core_area, Centroid
winshdgen = WinShdGen(zone_geometry=move.Geometry, wwr=merge_2)
total_perim_area = Number(item_5)
addition_2 = Addition(Total_perim_area=total_perim_area, Total_core_area=area_2.Core_area)
division_2 = Division(Total_core_area=area_2.Core_area, Total_perim_area=total_perim_area)
division_3 = Division(Total_perim_area=total_perim_area, Total_facade_area=expression_6)
division_4 = Division(Total_perim_area=total_perim_area, Footprint_area=addition_2)
division_5 = Division(Total_core_area=area_2.Core_area, Footprint_area=addition_2)
zone_names = Data(cluster.perimnames)
zones = Data(cluster.perimeter_2)
windows = Geometry(winshdgen)

# ---- group: 15-zone model computed properties
perim_area_to_facade_area_unitless = Panel(division_3)
core_fraction_core_footprint = Panel(division_5)
building_core_to_perim_ratio_unitless = Panel(division_2)
core_fraction_core_footprint_2 = Panel(division_4)
gfa_facade_area_unitless = Panel(division)
facade_area_m2 = Panel(expression_5)
gfa_m2 = Panel(expression_7)

# ----
# Shoeboxer - Simple
multiplication_8 = Multiplication(Shoebox_width=width, Shoebox_height=multiplication_4)
multiplication_9 = Multiplication(Shoebox_facade_area=multiplication_8, Perim_area_2_facade_area=division_3)
multiplication_10 = Multiplication(Shoebox_facade_area=multiplication_8, Gfa_2_facade_area_ratio=division)
division_6 = Division(Total_shoebox_area=multiplication_10, Shoebox_width=width)
division_7 = Division(Total_perim_area=multiplication_9, Shoebox_width=width)
multiplication_11 = Multiplication(Total_perim_depth=division_7, Core_2_perim=division_2)
panel_9 = Panel("""South
East
North
West""")
panel_10 = Panel("""Bottom
Middle
Top""")
depth_sapcing = Slider(50, range=0..100)
horizontal_spacing = Slider(100, range=0..100)
crossref = CrossReference(ListA=panel_9, ListB=panel_10, CrossMode=1)  # -> ListA, ListB
merge_3 = Merge(Data1=graft(crossref.ListA), Data2=graft(crossref.ListB))
cluster_2 = Cluster_5(
    base_point="-30,0,0",
    f2f_height=multiplication_4,
    width=width,
    depth_spacing=depth_sapcing,
    perim_depth=perim_offset,
    core_depth=core_depth,
    wwr=wwr,
    base_point_2="-30,0,0",
    horizontal_spacing=horizontal_spacing)  # -> adiabatic_walls_2, bottom_floor_ground_surfaces_2, middle_floor_ground_surfaces_2, top_floor_ground_surfaces_2, bottom_floor_roof_surfaces_2, middle_floor_roof_surfaces_2, top_floor_roof_surfaces_2, perim_zones_2, core_zones_2, window_surfaces_2
ins = InsertItems(List=merge_3, Item="Perim", Indices="0", Wrap=True)
ins_2 = InsertItems(List=merge_3, Item="Core", Indices="0", Wrap=True)
join = TextJoin(Text=ins, Join="_")  # -> flatten(Result)
join_2 = TextJoin(Text=ins_2, Join="_")  # -> flatten(Result)
middle_floor_roof_surfaces = Geometry(simplify(cluster_2.middle_floor_roof_surfaces_2))
perim_zones = Geometry(flatten(cluster_2.perim_zones_2))
core_zones = Geometry(flatten(cluster_2.core_zones_2))
adiabatic_walls = Geometry(cluster_2.adiabatic_walls_2)
bottom_floor_ground_surfaces = Geometry(simplify(cluster_2.bottom_floor_ground_surfaces_2))
middle_floor_ground_surfaces = Geometry(simplify(cluster_2.middle_floor_ground_surfaces_2))
top_floor_ground_surfaces = Geometry(simplify(cluster_2.top_floor_ground_surfaces_2))
bottom_floor_roof_surfaces = Geometry(simplify(cluster_2.bottom_floor_roof_surfaces_2))
top_floor_roof_surfaces = Geometry(simplify(cluster_2.top_floor_roof_surfaces_2))
window_surfaces = Geometry(flatten(cluster_2.window_surfaces_2))

# ---- group: computed shoebox information
shoebox_height_m_driven = Panel(multiplication_4)
sheobox_facade_area_m2 = Panel(multiplication_8)

# ---- group: perim_to_facade desired properties
desired_perim_area_m2 = Panel(multiplication_9)
desired_perim_depth_m = Panel(division_7)
desired_core_depth = Panel(multiplication_11)

# ---- group: gfa_to_facade desired properties
desired_shoebox_total_floor_area_m2 = Panel(multiplication_10)
deesired_shoebox_total_depth_m = Panel(division_6)

# ----
window_settings = Data(wset)

material = ConstructCSOpaqueMaterial(
    Name="Partition Plaster",
    Conductivity=1,
    Density=2000,
    Roughness="Rough",
    SpecificHeat=1130,
    ThermalAbsorptance=0.9,
    SolarAbsorptance=0.7,
    VisibleAbsorptance=0.7,
    Type="Finishes",
    Input_0_Hidden=False,
    Input_0_Name="Name",
    Input_10_Hidden=True,
    Input_10_Name="TemperatureCoefficientThermalConductivity",
    Input_11_Hidden=True,
    Input_11_Name="TemperatureArray",
    Input_12_Hidden=True,
    Input_12_Name="EnthalpyArray",
    Input_13_Hidden=True,
    Input_13_Name="VariableConductivityArray",
    Input_14_Hidden=False,
    Input_14_Name="Type",
    Input_15_Hidden=True,
    Input_15_Name="EmbodiedEnergy",
    Input_16_Hidden=True,
    Input_16_Name="EmbodiedCarbon",
    Input_17_Hidden=True,
    Input_17_Name="Cost",
    Input_18_Hidden=True,
    Input_18_Name="Life",
    Input_1_Hidden=False,
    Input_1_Name="Conductivity",
    Input_2_Hidden=False,
    Input_2_Name="Density",
    Input_3_Hidden=False,
    Input_3_Name="Roughness",
    Input_4_Hidden=False,
    Input_4_Name="SpecificHeat",
    Input_5_Hidden=False,
    Input_5_Name="ThermalAbsorptance"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)
material_2 = ConstructCSOpaqueMaterial(
    Name="Stucco",
    Conductivity=0.72,
    Density=1856,
    Roughness="Rough",
    SpecificHeat=840,
    ThermalAbsorptance=0.9,
    SolarAbsorptance=0.7,
    VisibleAbsorptance=0.7,
    Type="Sealing",
    Input_0_Hidden=False,
    Input_0_Name="Name",
    Input_10_Hidden=True,
    Input_10_Name="TemperatureCoefficientThermalConductivity",
    Input_11_Hidden=True,
    Input_11_Name="TemperatureArray",
    Input_12_Hidden=True,
    Input_12_Name="EnthalpyArray",
    Input_13_Hidden=True,
    Input_13_Name="VariableConductivityArray",
    Input_14_Hidden=False,
    Input_14_Name="Type",
    Input_15_Hidden=True,
    Input_15_Name="EmbodiedEnergy",
    Input_16_Hidden=True,
    Input_16_Name="EmbodiedCarbon",
    Input_17_Hidden=True,
    Input_17_Name="Cost",
    Input_18_Hidden=True,
    Input_18_Name="Life",
    Input_1_Hidden=False,
    Input_1_Name="Conductivity",
    Input_2_Hidden=False,
    Input_2_Name="Density",
    Input_3_Hidden=False,
    Input_3_Name="Roughness",
    Input_4_Hidden=False,
    Input_4_Name="SpecificHeat",
    Input_5_Hidden=False,
    Input_5_Name="ThermalAbsorptance"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)
material_3 = ConstructCSOpaqueMaterial(
    Name="Plaster",
    Conductivity=1,
    Density=2000,
    Roughness="Rough",
    SpecificHeat=1130,
    ThermalAbsorptance=0.9,
    SolarAbsorptance=0.7,
    VisibleAbsorptance=0.7,
    Type="Sealing",
    Input_0_Hidden=False,
    Input_0_Name="Name",
    Input_10_Hidden=True,
    Input_10_Name="TemperatureCoefficientThermalConductivity",
    Input_11_Hidden=True,
    Input_11_Name="TemperatureArray",
    Input_12_Hidden=True,
    Input_12_Name="EnthalpyArray",
    Input_13_Hidden=True,
    Input_13_Name="VariableConductivityArray",
    Input_14_Hidden=False,
    Input_14_Name="Type",
    Input_15_Hidden=True,
    Input_15_Name="EmbodiedEnergy",
    Input_16_Hidden=True,
    Input_16_Name="EmbodiedCarbon",
    Input_17_Hidden=True,
    Input_17_Name="Cost",
    Input_18_Hidden=True,
    Input_18_Name="Life",
    Input_1_Hidden=False,
    Input_1_Name="Conductivity",
    Input_2_Hidden=False,
    Input_2_Name="Density",
    Input_3_Hidden=False,
    Input_3_Name="Roughness",
    Input_4_Hidden=False,
    Input_4_Name="SpecificHeat",
    Input_5_Hidden=False,
    Input_5_Name="ThermalAbsorptance"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)
material_4 = ConstructCSOpaqueMaterial(
    Name="Carpet",
    Conductivity=0.6,
    Density=288,
    Roughness="Rough",
    SpecificHeat=1380,
    ThermalAbsorptance=0.9,
    SolarAbsorptance=0.7,
    VisibleAbsorptance=0.7,
    Type="Finishes",
    Input_0_Hidden=False,
    Input_0_Name="Name",
    Input_10_Hidden=True,
    Input_10_Name="TemperatureCoefficientThermalConductivity",
    Input_11_Hidden=True,
    Input_11_Name="TemperatureArray",
    Input_12_Hidden=True,
    Input_12_Name="EnthalpyArray",
    Input_13_Hidden=True,
    Input_13_Name="VariableConductivityArray",
    Input_14_Hidden=False,
    Input_14_Name="Type",
    Input_15_Hidden=True,
    Input_15_Name="EmbodiedEnergy",
    Input_16_Hidden=True,
    Input_16_Name="EmbodiedCarbon",
    Input_17_Hidden=True,
    Input_17_Name="Cost",
    Input_18_Hidden=True,
    Input_18_Name="Life",
    Input_1_Hidden=False,
    Input_1_Name="Conductivity",
    Input_2_Hidden=False,
    Input_2_Name="Density",
    Input_3_Hidden=False,
    Input_3_Name="Roughness",
    Input_4_Hidden=False,
    Input_4_Name="SpecificHeat",
    Input_5_Hidden=False,
    Input_5_Name="ThermalAbsorptance"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)
material_5 = ConstructCSOpaqueMaterial(
    Name="Mineral Wool",
    Conductivity=0.041,
    Density=155,
    Roughness="Rough",
    SpecificHeat=1130,
    ThermalAbsorptance=0.9,
    SolarAbsorptance=0.7,
    VisibleAbsorptance=0.7,
    Type="Sealing",
    Input_0_Hidden=False,
    Input_0_Name="Name",
    Input_10_Hidden=True,
    Input_10_Name="TemperatureCoefficientThermalConductivity",
    Input_11_Hidden=True,
    Input_11_Name="TemperatureArray",
    Input_12_Hidden=True,
    Input_12_Name="EnthalpyArray",
    Input_13_Hidden=True,
    Input_13_Name="VariableConductivityArray",
    Input_14_Hidden=False,
    Input_14_Name="Type",
    Input_15_Hidden=True,
    Input_15_Name="EmbodiedEnergy",
    Input_16_Hidden=True,
    Input_16_Name="EmbodiedCarbon",
    Input_17_Hidden=True,
    Input_17_Name="Cost",
    Input_18_Hidden=True,
    Input_18_Name="Life",
    Input_1_Hidden=False,
    Input_1_Name="Conductivity",
    Input_2_Hidden=False,
    Input_2_Name="Density",
    Input_3_Hidden=False,
    Input_3_Name="Roughness",
    Input_4_Hidden=False,
    Input_4_Name="SpecificHeat",
    Input_5_Hidden=False,
    Input_5_Name="ThermalAbsorptance"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)
material_6 = ConstructCSOpaqueMaterial(
    Name="WallConcrete",
    Conductivity=2,
    Density=2400,
    Roughness="Rough",
    SpecificHeat=950,
    ThermalAbsorptance=0.9,
    SolarAbsorptance=0.7,
    VisibleAbsorptance=0.7,
    Type="Concrete",
    Input_0_Hidden=False,
    Input_0_Name="Name",
    Input_10_Hidden=True,
    Input_10_Name="TemperatureCoefficientThermalConductivity",
    Input_11_Hidden=True,
    Input_11_Name="TemperatureArray",
    Input_12_Hidden=True,
    Input_12_Name="EnthalpyArray",
    Input_13_Hidden=True,
    Input_13_Name="VariableConductivityArray",
    Input_14_Hidden=False,
    Input_14_Name="Type",
    Input_15_Hidden=True,
    Input_15_Name="EmbodiedEnergy",
    Input_16_Hidden=True,
    Input_16_Name="EmbodiedCarbon",
    Input_17_Hidden=True,
    Input_17_Name="Cost",
    Input_18_Hidden=True,
    Input_18_Name="Life",
    Input_1_Hidden=False,
    Input_1_Name="Conductivity",
    Input_2_Hidden=False,
    Input_2_Name="Density",
    Input_3_Hidden=False,
    Input_3_Name="Roughness",
    Input_4_Hidden=False,
    Input_4_Name="SpecificHeat",
    Input_5_Hidden=False,
    Input_5_Name="ThermalAbsorptance"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)
material_7 = ConstructCSOpaqueMaterial(
    Name="Felt",
    Conductivity=0.9,
    Density=0.5,
    Roughness="Rough",
    SpecificHeat=1800,
    ThermalAbsorptance=0.9,
    SolarAbsorptance=0.7,
    VisibleAbsorptance=0.7,
    Type="Sealing",
    Input_0_Hidden=False,
    Input_0_Name="Name",
    Input_10_Hidden=True,
    Input_10_Name="TemperatureCoefficientThermalConductivity",
    Input_11_Hidden=True,
    Input_11_Name="TemperatureArray",
    Input_12_Hidden=True,
    Input_12_Name="EnthalpyArray",
    Input_13_Hidden=True,
    Input_13_Name="VariableConductivityArray",
    Input_14_Hidden=False,
    Input_14_Name="Type",
    Input_15_Hidden=True,
    Input_15_Name="EmbodiedEnergy",
    Input_16_Hidden=True,
    Input_16_Name="EmbodiedCarbon",
    Input_17_Hidden=True,
    Input_17_Name="Cost",
    Input_18_Hidden=True,
    Input_18_Name="Life",
    Input_1_Hidden=False,
    Input_1_Name="Conductivity",
    Input_2_Hidden=False,
    Input_2_Name="Density",
    Input_3_Hidden=False,
    Input_3_Name="Roughness",
    Input_4_Hidden=False,
    Input_4_Name="SpecificHeat",
    Input_5_Hidden=False,
    Input_5_Name="ThermalAbsorptance"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)
material_8 = ConstructCSOpaqueMaterial(
    Name="Concrete",
    Conductivity=2,
    Density=2100,
    Roughness="Rough",
    SpecificHeat=1040,
    ThermalAbsorptance=0.9,
    SolarAbsorptance=0.7,
    VisibleAbsorptance=0.7,
    Type="Concrete",
    Input_0_Hidden=False,
    Input_0_Name="Name",
    Input_10_Hidden=True,
    Input_10_Name="TemperatureCoefficientThermalConductivity",
    Input_11_Hidden=True,
    Input_11_Name="TemperatureArray",
    Input_12_Hidden=True,
    Input_12_Name="EnthalpyArray",
    Input_13_Hidden=True,
    Input_13_Name="VariableConductivityArray",
    Input_14_Hidden=False,
    Input_14_Name="Type",
    Input_15_Hidden=True,
    Input_15_Name="EmbodiedEnergy",
    Input_16_Hidden=True,
    Input_16_Name="EmbodiedCarbon",
    Input_17_Hidden=True,
    Input_17_Name="Cost",
    Input_18_Hidden=True,
    Input_18_Name="Life",
    Input_1_Hidden=False,
    Input_1_Name="Conductivity",
    Input_2_Hidden=False,
    Input_2_Name="Density",
    Input_3_Hidden=False,
    Input_3_Name="Roughness",
    Input_4_Hidden=False,
    Input_4_Name="SpecificHeat",
    Input_5_Hidden=False,
    Input_5_Name="ThermalAbsorptance"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)
material_9 = ConstructCSOpaqueMaterial(
    Name="AcousticTile",
    Conductivity=0.06,
    Density=368,
    Roughness="Rough",
    SpecificHeat=590,
    ThermalAbsorptance=0.9,
    SolarAbsorptance=0.7,
    VisibleAbsorptance=0.7,
    Type="Finishes",
    Input_0_Hidden=False,
    Input_0_Name="Name",
    Input_10_Hidden=True,
    Input_10_Name="TemperatureCoefficientThermalConductivity",
    Input_11_Hidden=True,
    Input_11_Name="TemperatureArray",
    Input_12_Hidden=True,
    Input_12_Name="EnthalpyArray",
    Input_13_Hidden=True,
    Input_13_Name="VariableConductivityArray",
    Input_14_Hidden=False,
    Input_14_Name="Type",
    Input_15_Hidden=True,
    Input_15_Name="EmbodiedEnergy",
    Input_16_Hidden=True,
    Input_16_Name="EmbodiedCarbon",
    Input_17_Hidden=True,
    Input_17_Name="Cost",
    Input_18_Hidden=True,
    Input_18_Name="Life",
    Input_1_Hidden=False,
    Input_1_Name="Conductivity",
    Input_2_Hidden=False,
    Input_2_Name="Density",
    Input_3_Hidden=False,
    Input_3_Name="Roughness",
    Input_4_Hidden=False,
    Input_4_Name="SpecificHeat",
    Input_5_Hidden=False,
    Input_5_Name="ThermalAbsorptance"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)
material_10 = ConstructCSOpaqueMaterial(
    Name="XPS",
    Conductivity=0.034,
    Density=35,
    Roughness="Rough",
    SpecificHeat=1400,
    ThermalAbsorptance=0.9,
    SolarAbsorptance=0.7,
    VisibleAbsorptance=0.7,
    Type="Insulation",
    Input_0_Hidden=False,
    Input_0_Name="Name",
    Input_10_Hidden=True,
    Input_10_Name="TemperatureCoefficientThermalConductivity",
    Input_11_Hidden=True,
    Input_11_Name="TemperatureArray",
    Input_12_Hidden=True,
    Input_12_Name="EnthalpyArray",
    Input_13_Hidden=True,
    Input_13_Name="VariableConductivityArray",
    Input_14_Hidden=False,
    Input_14_Name="Type",
    Input_15_Hidden=True,
    Input_15_Name="EmbodiedEnergy",
    Input_16_Hidden=True,
    Input_16_Name="EmbodiedCarbon",
    Input_17_Hidden=True,
    Input_17_Name="Cost",
    Input_18_Hidden=True,
    Input_18_Name="Life",
    Input_1_Hidden=False,
    Input_1_Name="Conductivity",
    Input_2_Hidden=False,
    Input_2_Name="Density",
    Input_3_Hidden=False,
    Input_3_Name="Roughness",
    Input_4_Hidden=False,
    Input_4_Name="SpecificHeat",
    Input_5_Hidden=False,
    Input_5_Name="ThermalAbsorptance"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)

# ---- group: WallInsul
layer = ConstructCSLayer(Material=material_3, Thickness="0.013")

# ---- group: WallConcrete
layer_2 = ConstructCSLayer(Material=material_6, Thickness=wall_concrete_thickness)

# ---- group: WallInsul
layer_3 = ConstructCSLayer(Material=material_5, Thickness=wall_insul_thickness)

layer_4 = ConstructCSLayer(Material=material_2, Thickness="0.025")

# ---- group: RoofFelt
layer_5 = ConstructCSLayer(Material=material_7, Thickness="0.003")

# ---- group: RoofConcrete
layer_6 = ConstructCSLayer(Material=material_8, Thickness=roof_concrete_thickness)

# ---- group: RoofTile
layer_7 = ConstructCSLayer(Material=material_9, Thickness="0.005")

# ---- group: RoofXPS
layer_8 = ConstructCSLayer(Material=material_10, Thickness=roof_xps_thickness)

# ---- group: GroundCarpet
layer_9 = ConstructCSLayer(Material=material, Thickness="0.013")

# ---- group: GroundConcrete
layer_10 = ConstructCSLayer(Material=material_6, Thickness="0.203")

# ---- group: GroundCarpet
layer_11 = ConstructCSLayer(Material=material_4, Thickness="0.02")

# ---- group: GroundXPS
layer_12 = ConstructCSLayer(Material=material_10, Thickness=slab_insul_thickness)

# ----
relay = Relay([layer_8, layer_6, layer_7, layer_5])
panel_11 = Panel(relay)
mats = Data([material_10, material_8, material_9, material_7, material_6, material_5, material_3, material_2, material_4, material])

dup = DuplicateData(Data=layer_9, Number=2, Order=True)
construction = ConstructCSConstruction(
    Name="CustomExteriorRoof",
    Category="Roof",
    Layers=relay,
    Input_0_Hidden=False,
    Input_0_Name="Name",
    Input_1_Hidden=False,
    Input_1_Name="Category",
    Input_2_Hidden=False,
    Input_2_Name="Layers",
    Input_3_Hidden=True,
    Input_3_Name="EmbodiedEnergy",
    Input_4_Hidden=True,
    Input_4_Name="EmbodiedCarbon",
    Input_5_Hidden=True,
    Input_5_Name="Cost",
    Input_6_Hidden=True,
    Input_6_Name="Life",
    UnitSystem=4,
    Input_3_GHParam_Branch0_Path="{0}",
    Input_3_GHParam_Branch0_Item0_number=0,
    Input_4_GHParam_Branch0_Path="{0}",
    Input_4_GHParam_Branch0_Item0_number=0,
    Input_5_GHParam_Branch0_Path="{0}",
    Input_5_GHParam_Branch0_Item0_number=0,
    Input_6_GHParam_Branch0_Path="{0}",
    Input_6_GHParam_Branch0_Item0_number=10)  # -> Construction, ConstructionInformation
construction_2 = ConstructCSConstruction(
    Name="CustomGroundSlab",
    Category="GroundFloor",
    Layers=flatten([layer_12, layer_10, layer_11]),
    Input_0_Hidden=False,
    Input_0_Name="Name",
    Input_1_Hidden=False,
    Input_1_Name="Category",
    Input_2_Hidden=False,
    Input_2_Name="Layers",
    Input_3_Hidden=True,
    Input_3_Name="EmbodiedEnergy",
    Input_4_Hidden=True,
    Input_4_Name="EmbodiedCarbon",
    Input_5_Hidden=True,
    Input_5_Name="Cost",
    Input_6_Hidden=True,
    Input_6_Name="Life",
    UnitSystem=4,
    Input_3_GHParam_Branch0_Path="{0}",
    Input_3_GHParam_Branch0_Item0_number=0,
    Input_4_GHParam_Branch0_Path="{0}",
    Input_4_GHParam_Branch0_Item0_number=0,
    Input_5_GHParam_Branch0_Path="{0}",
    Input_5_GHParam_Branch0_Item0_number=0,
    Input_6_GHParam_Branch0_Path="{0}",
    Input_6_GHParam_Branch0_Item0_number=10)  # -> Construction, ConstructionInformation
construction_3 = ConstructCSConstruction(
    Name="CustomInteriorPartition",
    Category="Facade",
    Layers=flatten(dup),
    Input_0_Hidden=False,
    Input_0_Name="Name",
    Input_1_Hidden=False,
    Input_1_Name="Category",
    Input_2_Hidden=False,
    Input_2_Name="Layers",
    Input_3_Hidden=True,
    Input_3_Name="EmbodiedEnergy",
    Input_4_Hidden=True,
    Input_4_Name="EmbodiedCarbon",
    Input_5_Hidden=True,
    Input_5_Name="Cost",
    Input_6_Hidden=True,
    Input_6_Name="Life",
    UnitSystem=4,
    Input_3_GHParam_Branch0_Path="{0}",
    Input_3_GHParam_Branch0_Item0_number=0,
    Input_4_GHParam_Branch0_Path="{0}",
    Input_4_GHParam_Branch0_Item0_number=0,
    Input_5_GHParam_Branch0_Path="{0}",
    Input_5_GHParam_Branch0_Item0_number=0,
    Input_6_GHParam_Branch0_Path="{0}",
    Input_6_GHParam_Branch0_Item0_number=10)  # -> Construction, ConstructionInformation
construction_4 = ConstructCSConstruction(
    Name="CustomExteriorWall",
    Category="Roof",
    Layers=flatten([layer_2, layer_3, layer, layer_4]),
    Input_0_Hidden=False,
    Input_0_Name="Name",
    Input_1_Hidden=False,
    Input_1_Name="Category",
    Input_2_Hidden=False,
    Input_2_Name="Layers",
    Input_3_Hidden=True,
    Input_3_Name="EmbodiedEnergy",
    Input_4_Hidden=True,
    Input_4_Name="EmbodiedCarbon",
    Input_5_Hidden=True,
    Input_5_Name="Cost",
    Input_6_Hidden=True,
    Input_6_Name="Life",
    UnitSystem=4,
    Input_3_GHParam_Branch0_Path="{0}",
    Input_3_GHParam_Branch0_Item0_number=0,
    Input_4_GHParam_Branch0_Path="{0}",
    Input_4_GHParam_Branch0_Item0_number=0,
    Input_5_GHParam_Branch0_Path="{0}",
    Input_5_GHParam_Branch0_Item0_number=0,
    Input_6_GHParam_Branch0_Path="{0}",
    Input_6_GHParam_Branch0_Item0_number=10)  # -> Construction, ConstructionInformation
python_3 = GhPythonScript(x=construction_2.ConstructionInformation)  # -> Rval, mass
# ---------- python_3: Python ----------
__author__ = "zoelh"
__version__ = "2023.11.21"

import rhinoscriptsyntax as rs
import re

Rval = None

s = re.sub(r'[^\w.\n]+', ' ', x)
s=s.replace(" ", '')
print(s)
Rval = float(s.split("RValuemKW")[1].split("\n")[0])
mass = float(s.split("CapacitancekJKm")[1].split("\n")[0])
print(Rval)
print(mass)
# ---------- end python_3 ----------

# ---- group: PARTITION CONSTRUCTION
panel_12 = Panel(construction_3.ConstructionInformation)
partition = Data(construction_3.Construction)

# ---- group: ROOF CONSTRUCTION (continued)
panel_13 = Panel(construction.ConstructionInformation)
exteriorroof = Data(construction.Construction)

# ---- group: SLAB CONSTRUCTION (continued)
panel_14 = Panel(construction_2.ConstructionInformation)
slab = Data(construction_2.Construction)

# ---- group: FACADE CONSTRUCTION (continued)
panel_15 = Panel(construction_4.ConstructionInformation)
exteriorwall = Data(construction_4.Construction)

# ----
python_4 = GhPythonScript(x=construction.ConstructionInformation)  # -> Rval, mass; same code as python_3
python_5 = GhPythonScript(x=construction_4.ConstructionInformation)  # -> Rval, mass; same code as python_3
zset = CSZoneSettings(
    Name="ParametricZoneSettings",
    ZoneSettings=item,
    RoofConstruction=exteriorroof,
    FacadeConstruction=exteriorwall,
    SlabConstruction=slab,
    PartitionConstruction=partition,
    ExternalFloorConstruction=slab,
    InternalMassConstruction=partition,
    InternalMassExposedArea=Slider(0, range=0..1),
    GroundSlabConstruction=slab,
    PeopleDensity=peopledensity_ppl_m2,
    AirspeedSchedule="AirSpeed 0",
    EquipmentPowerDensity=epd_w_m2,
    LightingPowerDensity=lpd_w_m2,
    OccupancySchedule=year_schedule.Sched,
    EquipmentAvailabilitySchedule=year_schedule_2.Sched,
    LightsAvailabilitySchedule=year_schedule_3.Sched,
    DimmingType=dimmingtype,
    PeopleIsOn=people_equip_lightson,
    EquipmentIsOn=people_equip_lightson,
    LightsIsOn=people_equip_lightson,
    CoolingCOP=Slider(1, range=0.6..6),
    HeatingCOP=Slider(1, range=0.6..6),
    HeatingSetpoint=heatingsetpoint_degc,
    CoolingSetpoint=coolingsetpoint_degc,
    HeatingSetpointConstant=heating_coolingconstant,
    CoolingSetpointConstant=heating_coolingconstant,
    HeatingSetpointSchedule="S21 B18 8to18",
    CoolingSetpointSchedule="S25 B30 8to18",
    HeatIsOn=heating_coolingon,
    CoolIsOn=heating_coolingon,
    MechVentIsOn=mechventon,
    HumidistatIsOn=humidistaton,
    HeatingLimitType="NoLimit",
    CoolingLimitType="LimitFlowRateAndCapacity",
    MaxHeatingCapacity=100,
    MaxCoolingCapacity=100,
    MaxHeatFlow=100,
    MaxCoolFlow=100,
    HeatingSchedule="AllOn",
    CoolingSchedule="AllOn",
    MechVentSchedule=occupancy,
    MinFreshAirPerson=ventilationperperson_l_s_person,
    MinFreshAirArea=ventilationperarea_l_s_m2,
    EconomizerType=econ,
    HeatRecoveryType=hrv,
    HeatRecoveryEfficiencySensible="0.7",
    HeatRecoveryEfficiencyLatent="0.65",
    MinHumidity="20",
    MaxHumidity="80",
    TurnOnEMSFanEnergy=fanenergy,
    FanPressureRise=1000,
    MaxHeatSupplyAirTemp="30",
    MinCoolSupplyAirTemp="18",
    HeatingSizingFactor=1.2,
    CoolingSizingFactore=1.2,
    NatVentIsOn=natventon,
    SchedVentIsOn=scheduledventilationon,
    ScheduledVentilationAvailability="Off",
    NaturalVentilationSchedule="Off",
    StackDrivenFlow=scheduledventilationon_2,
    Crossventilation=scheduledventilationon_2,
    InfiltrationIsOn=infiltrationon,
    InfiltrationAch=infiltration_ach,
    InfiltrationFlowExtArea=infiltration_m3_s_m2,
    InfiltrationCalculationMethod=infiltrationmethod,
    AFNAirMassFlowCoefficientCrack=0.001,
    FlowRatePerPerson="0",
    DHWOn=dhwon,
    Input_0_Hidden=False,
    Input_0_Name="Name",
    Input_100_Hidden=True,
    Input_100_Name="Interior Vertical Insulation Depth",
    Input_101_Hidden=True,
    Input_101_Name="Exterior Horizontal Insulation Depth",
    Input_102_Hidden=True,
    Input_102_Name="Exterior Horizontal Insulation Width",
    Input_103_Hidden=True,
    Input_103_Name="Footing Thickness",
    Input_104_Hidden=True,
    Input_104_Name="Footing Depth",
    Input_105_Hidden=True,
    Input_105_Name="ElectricityCO2",
    Input_106_Hidden=True,
    Input_106_Name="ElectricityCost",
    Input_107_Hidden=True,
    Input_107_Name="HotWaterCO2",
    Input_108_Hidden=True,
    Input_108_Name="HotWaterCost",
    Input_109_Hidden=True,
    Input_109_Name="CoolingCO2",
    Input_10_Hidden=True,
    Input_10_Name="Ground Wall Construction",
    Input_110_Hidden=True,
    Input_110_Name="HeatingCO2",
    Input_111_Hidden=True,
    Input_111_Name="CoolingCost",
    Input_112_Hidden=True,
    Input_112_Name="HeatingCost"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)
library = CSLibrary(AddObjects=flatten([year_schedule_2.Sched, year_schedule_3.Sched, year_schedule.Sched, simple_window, exteriorroof, exteriorwall, slab, partition, mats]))

# ----
# Save building settings
python_6 = GhPythonScript(
    x_dim=x_axis_meters,
    y_dim=y_axis_meters,
    n_floors=n_floors,
    f2f_height=f2f_height_meters,
    sb_w=width,
    pd=perim_offset,
    cd=core_depth,
    wwr=wwr,
    uval=number_slider_3,
    shgc=number_slider_2,
    sched=number_slider_5,
    RoofRval=python_4.Rval,
    RoofMass=python_4.mass,
    WallRval=python_5.Rval,
    WallMass=python_5.mass,
    SlabRval=python_3.Rval)  # -> d
# ---------- python_6: Python ----------
__author__ = "zoelh"
__version__ = "2023.11.18"

import rhinoscriptsyntax as rs
import json
d= dict(
    BuildingSettings=dict(
        x_dim = float(x_dim),
        y_dim = float(y_dim),
        n_floors = float(n_floors),
        f2f_height = float(f2f_height),
        schedule_index=int(sched),
    ),
    ShoeboxConfig=dict(
        FacadeMass = float(WallMass)*1000,
        RoofMass = float(RoofMass)*1000,
        FacadeRValue = float(WallRval),
        RoofRValue = float(RoofRval),
        SlabRValue = float(SlabRval),
        WindowUValue = float(uval),
        WindowShgc = float(shgc),
        wwr = float(wwr)/100,
        template_idx=int(sched),
        width=float(sb_w),
        height=float(f2f_height),
        perim_depth=float(pd),
        core_depth=float(cd),
    )
)
d = json.dumps(d)
print(d)
# ---------- end python_6 ----------
jmerge = MergeJson(SourceJson=python_6, OverrideJson=zset)
panel_16 = Panel(jmerge)
python_7 = GhPythonScript(set=jmerge, name=panel_3, dir=output_directory, save=falsestart)
# ---------- python_7: Python ----------
__author__ = "zoelh"
__version__ = "2023.11.18"

import rhinoscriptsyntax as rs
import json

if save:
    fname = dir + name + ".json"
    print(fname)
    with open(fname, "w") as f:
        json.dump(json.loads(set), f, indent=4)
# ---------- end python_7 ----------

zone_settings = Data(zset)

# ----
# Model Setup
bco = CSBoundaryObject(Brep=flatten(bottom_floor_ground_surfaces), type="GROUND")
bco_2 = CSBoundaryObject(
    Brep=flatten([middle_floor_ground_surfaces, adiabatic_walls, top_floor_ground_surfaces, bottom_floor_roof_surfaces, middle_floor_roof_surfaces]),
    type="ADIABAT")
zone = CSEnergyZone(Brep=perim_zones, Name=join, Settings=zone_settings, UsedLibraryObjects="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")  # -> Zones, Settings
zone_2 = CSEnergyZone(Brep=core_zones, Name=join_2, Settings=zone_settings, UsedLibraryObjects="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")  # -> Zones, Settings
window = CSWindow(Surface=window_surfaces, Settings=window_settings, UsedLibraryObjects="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")  # -> Window, Settings
panel_17 = Panel(expression_3)
model = CSModelMaker(Zones=flatten([zone.Zones, zone_2.Zones]), Windows=window.Window, Boundaries=flatten([bco, bco_2]), Library=library)  # -> Model, Invalid
run_e = RunCSEnergyModel(
    Model=model.Model,
    Name=panel_17,
    Directory=output_directory,
    Location=path,
    Run=falsestart,
    NorthOffset=0,
    settings="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")  # -> Model, Settings, Result

# ----
# Model Setup
zone_3 = CSEnergyZone(
    Brep=flatten(zones),
    Name=flatten(zone_names),
    Settings=zone_settings,
    UsedLibraryObjects="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")  # -> Zones, Settings
zone_4 = CSEnergyZone(
    Brep=cluster.core_2,
    Name=cluster.core_names,
    Settings=zone_settings,
    UsedLibraryObjects="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")  # -> Zones, Settings
bco_3 = CSBoundaryObject(Brep=cluster.ground_plane_2, type="GROUND")
window_2 = CSWindow(Surface=windows, Settings=window_settings, UsedLibraryObjects="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")  # -> Window, Settings
model_2 = CSModelMaker(Zones=flatten([zone_4.Zones, zone_3.Zones]), Windows=window_2.Window, Boundaries=bco_3, Library=library)  # -> Model, Invalid
panel_18 = Panel(expression_4)
run_e_2 = RunCSEnergyModel(
    Model=model_2.Model,
    Name=panel_18,
    Directory=output_directory,
    Location=path,
    Run=falsestart,
    NorthOffset=0,
    settings="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")  # -> Model, Settings, Result

energy_results = LoadCSEnergyResult(ThermalModel=run_e.Model, Mode=0, Resolution=0, Toggle=Toggle(True))  # -> TotalEUI, Baseline, TotalCO2, TotalCost, FloorArea, Data, Labels, Months, Colors, CSR
load_zone_results = LoadCSZoneResults(
    ThermalModel=run_e_2.Model,
    Toggle=toggle_2,
    byzone="True",
    settings="""{
  "zoneIDs": [],
  "output2Display": [
    {
      "key": "Zone Ideal Loads Supply Air Total Heating Energy",
      "unit": "HVAC Sum [J]",
      "type": 0
    }
  ],
  "normalizeByFloorArea": false
}""")  # -> ResultsPerZone, Labels, Name, Zone
load_zone_results_2 = LoadCSZoneResults(
    ThermalModel=run_e_2.Model,
    Toggle=toggle_2,
    byzone="True",
    settings="""{
  "zoneIDs": [],
  "output2Display": [
    {
      "key": "Zone Ideal Loads Supply Air Total Cooling Energy",
      "unit": "HVAC Sum [J]",
      "type": 0
    }
  ],
  "normalizeByFloorArea": false
}""")  # -> ResultsPerZone, Labels, Name, Zone
load_zone_results_3 = LoadCSZoneResults(
    ThermalModel=run_e.Model,
    Toggle=toggle_3,
    byzone="True",
    settings="""{
  "zoneIDs": [],
  "output2Display": [
    {
      "key": "Zone Ideal Loads Supply Air Total Cooling Energy",
      "unit": "HVAC Sum [J]",
      "type": 0
    }
  ],
  "normalizeByFloorArea": false
}""")  # -> ResultsPerZone, Labels, Name, Zone
panel_19 = Panel(energy_results.TotalEUI)
load_zone_results_4 = LoadCSZoneResults(
    ThermalModel=run_e.Model,
    Toggle=toggle_3,
    byzone="True",
    settings="""{
  "zoneIDs": [],
  "output2Display": [
    {
      "key": "Zone Ideal Loads Supply Air Total Heating Energy",
      "unit": "HVAC Sum [J]",
      "type": 0
    }
  ],
  "normalizeByFloorArea": false
}""")  # -> ResultsPerZone, Labels, Name, Zone
debrep_3 = DeconstructBrep(Brep=load_zone_results_2.Zone)  # -> Faces, Edges, Vertices
branch = TreeBranch(Tree=load_zone_results_3.Zone, Path="{-1}", MaintainPaths=True)
item_6 = ListItem(List=debrep_3.Faces, Index="5", Wrap=True)  # -> graft(Item)
debrep_4 = DeconstructBrep(Brep=load_zone_results_3.Zone)  # -> Faces, Edges, Vertices
area_3 = Area(Geometry=item_6)  # -> simplify(Area), Centroid
item_7 = ListItem(List=debrep_4.Faces, Index="5", Wrap=True)  # -> graft(Item)
panel_20 = Panel(load_zone_results_3.Name)
sort_sbs = GhPythonScript(x=load_zone_results_3.Name)  # -> perim_mid, perim_ext, core_mid, core_ext
# ---------- sort_sbs: Python ----------
__author__ = "szvsw"
__version__ = "2023.11.05"

import rhinoscriptsyntax as rs

perim_mid = ("Perim" in x) and ("Middle" in x)
perim_ext = ("Perim" in x) and ("Middle" not in x)
core_mid = ("Core" in x) and ("Middle" in x)
core_ext = ("Core" in x) and ("Middle" not in x)
# ---------- end sort_sbs ----------
flip_2 = FlipMatrix(Data=load_zone_results_3.Zone)
flip_3 = FlipMatrix(Data=load_zone_results_3.Zone)
flip_4 = FlipMatrix(Data=load_zone_results_3.Zone)
flip_5 = FlipMatrix(Data=load_zone_results_3.Zone)
area_4 = Area(Geometry=item_7)  # -> simplify(Area), Centroid
ma_2 = MassAddition(Input=[sort_sbs.core_mid, sort_sbs.core_ext, sort_sbs.perim_ext, sort_sbs.perim_mid])  # -> Result, PartialResults
cull = CullPattern(List=flip_2, CullPattern=sort_sbs.perim_mid)
cull_2 = CullPattern(List=flip_3, CullPattern=sort_sbs.perim_ext)
cull_3 = CullPattern(List=flip_4, CullPattern=sort_sbs.core_mid)
cull_4 = CullPattern(List=flip_5, CullPattern=sort_sbs.core_ext)
multiplication_12 = Multiplication(A=load_zone_results_2.ResultsPerZone, B=j_to_kwh)
multiplication_13 = Multiplication(A=load_zone_results.ResultsPerZone, B=j_to_kwh)
multiplication_14 = Multiplication(A=load_zone_results_3.ResultsPerZone, B=j_to_kwh_2)
multiplication_15 = Multiplication(A=load_zone_results_4.ResultsPerZone, B=j_to_kwh_2)
division_8 = Division(A=multiplication_12, B=area_3.Area)
division_9 = Division(A=multiplication_13, B=area_3.Area)
is_core = GhPythonScript(x=load_zone_results_2.Name)  # -> out, a
# ---------- is_core: Python ----------
__author__ = "szvsw"
__version__ = "2023.11.05"

import rhinoscriptsyntax as rs

a = "Core" in x
# ---------- end is_core ----------
is_perim = GhPythonScript(x=load_zone_results_3.Name)  # -> out, a
# ---------- is_perim: Python ----------
__author__ = "szvsw"
__version__ = "2023.11.05"

import rhinoscriptsyntax as rs

a = "Perim" in x
# ---------- end is_perim ----------
flip_6 = FlipMatrix(Data=division_8)
division_10 = Division(A=multiplication_14, B=area_4.Area)
division_11 = Division(A=multiplication_15, B=area_4.Area)
flip_7 = FlipMatrix(Data=division_9)
not = GateNot(A=is_core.a)
flip_8 = FlipMatrix(Data=division_10)
cull_5 = CullPattern(List=flip_8, CullPattern=sort_sbs.perim_mid)
cull_6 = CullPattern(List=flip_8, CullPattern=sort_sbs.perim_ext)
cull_7 = CullPattern(List=flip_8, CullPattern=sort_sbs.core_mid)
cull_8 = CullPattern(List=flip_8, CullPattern=sort_sbs.core_ext)
not_2 = GateNot(A=is_perim.a)
flip_9 = FlipMatrix(Data=division_11)
cull_9 = CullPattern(List=flip_9, CullPattern=sort_sbs.perim_mid)
cull_10 = CullPattern(List=flip_9, CullPattern=sort_sbs.perim_ext)
cull_11 = CullPattern(List=flip_9, CullPattern=sort_sbs.core_mid)
cull_12 = CullPattern(List=flip_9, CullPattern=sort_sbs.core_ext)
avr = Average(Input=cull_6)
avr_2 = Average(Input=cull_7)
avr_3 = Average(Input=cull_5)
avr_4 = Average(Input=cull_8)
avr_5 = Average(Input=cull_9)
avr_6 = Average(Input=cull_11)
avr_7 = Average(Input=cull_10)
avr_8 = Average(Input=cull_12)
cull_13 = CullPattern(List=flip_6, CullPattern=is_core.a)
cull_14 = CullPattern(List=flip_7, CullPattern=is_core.a)
cull_15 = CullPattern(List=flip_6, CullPattern=not)
cull_16 = CullPattern(List=flip_7, CullPattern=not)
cull_17 = CullPattern(List=flip_8, CullPattern=not_2)
cull_18 = CullPattern(List=flip_8, CullPattern=is_perim.a)
cull_19 = CullPattern(List=flip_9, CullPattern=not_2)
multiplication_16 = Multiplication(A=avr_6, B=subtraction)
cull_20 = CullPattern(List=flip_9, CullPattern=is_perim.a)
multiplication_17 = Multiplication(A=avr_3, B=subtraction)
multiplication_18 = Multiplication(A=avr_5, B=subtraction)
multiplication_19 = Multiplication(A=avr_2, B=subtraction)
viewer = ParamViewer(cull_13)
avr_9 = Average(Input=cull_15)
avr_10 = Average(Input=cull_14)
avr_11 = Average(Input=cull_16)
avr_12 = Average(Input=cull_13)
avr_13 = Average(Input=cull_20)
avr_14 = Average(Input=cull_18)
avr_15 = Average(Input=cull_19)
flip_10 = FlipMatrix(Data=cull_18)
avr_16 = Average(Input=cull_17)
ma_3 = MassAddition(Input=[multiplication_18, avr_7])  # -> Result, PartialResults
# Shoebox weights?
ma_4 = MassAddition(Input=[multiplication_17, avr])  # -> Result, PartialResults
ma_5 = MassAddition(Input=[multiplication_16, avr_8])  # -> Result, PartialResults
ma_6 = MassAddition(Input=[multiplication_19, avr_4])  # -> Result, PartialResults
flip_11 = FlipMatrix(Data=avr_10)
cull_21 = CullPattern(List=load_zone_results_3.Name, CullPattern=is_perim.a)
flip_12 = FlipMatrix(Data=avr_11)
cull_22 = CullPattern(List=load_zone_results_3.Name, CullPattern=not_2)
flip_13 = FlipMatrix(Data=avr_9)
ma_7 = MassAddition(Input=flip_10)  # -> flatten(Result), PartialResults
flip_14 = FlipMatrix(Data=avr_13)
flip_15 = FlipMatrix(Data=avr_12)
flip_16 = FlipMatrix(Data=avr_15)
division_12 = Division(A=ma_3.Result, B=n_floors_2)  # -> flatten(Result)
flip_17 = FlipMatrix(Data=avr_14)
division_13 = Division(A=ma_4.Result, B=n_floors_2)  # -> flatten(Result)
division_14 = Division(A=ma_5.Result, B=n_floors_2)  # -> flatten(Result)
flip_18 = FlipMatrix(Data=avr_16)
division_15 = Division(A=ma_6.Result, B=n_floors_2)  # -> flatten(Result)
python_8 = GhPythonScript(
    x=cull_22,
    y=ColourSwatch(SwatchColor=RGB(0, 255, 0)),
    z=ColourSwatch(SwatchColor=RGB(0, 123, 255)),
    u=ColourSwatch(SwatchColor=RGB(255, 119, 0)),
    v=ColourSwatch(SwatchColor=RGB(255, 0, 0)))  # -> out, a
# ---------- python_8: Python ----------
__author__ = "szvsw"
__version__ = "2023.11.05"

import rhinoscriptsyntax as rs

if "south" in x or "South" in x:
    a= y
if "east" in x or "East" in x:
    a= z
if "north" in x or "North" in x:
    a= u
if "west" in x or "West" in x:
    a= v
# ---------- end python_8 ----------
stack = StackTrees(Data0=flip_15, Data1=flip_13, Data2=flip_11, Data3=flip_12, Reduce=True)
stack_2 = StackTrees(Data0=flip_17, Data1=flip_18, Data2=flip_14, Data3=flip_16, Reduce=True)
panel_21 = Panel(cull_18)
viewer_2 = ParamViewer(cull_18)
stack_3 = StackTrees(
    Data0=flip_13,
    Data1=flip_15,
    Data2=flip_12,
    Data3=flip_11,
    Data4=flip_17,
    Data5=flip_18,
    Data6=flip_14,
    Data7=flip_16,
    Reduce=True)
stack_4 = StackTrees(
    Data0=flip_13,
    Data1=flip_15,
    Data2=flip_12,
    Data3=flip_11,
    Data4=flip_17,
    Data5=flip_18,
    Data6=flip_14,
    Data7=flip_16,
    Data8=division_13,
    Data9=division_15,
    Data10=division_12,
    Data11=division_14,
    Reduce=True)
viewer_3 = ParamViewer(cull_18)
plotter = CSPlotter(
    Type=0,
    Width=550,
    Height=450,
    X_labels=energy_results.Months,
    X_rot=0,
    Y_data=stack_3,
    Colors=python_8.a,
    Names=panel_5,
    Show_xgrid=False,
    Show_ygrid=True,
    Legend=0,
    Point_size=merge,
    PreviewDimension=2,
    InfinateZoomDisplay=True,
    UnitSystem=4)

# ----
# Save CS results
button_2 = Button()
python_9 = GhPythonScript(data=simplify(stack_3), outpath=output_directory, name=expression, save=falsestart)  # -> out; inputs data: tree
# ---------- python_9: Python ----------
__author__ = "szvsw"
__version__ = "2023.11.15"

import rhinoscriptsyntax as rs
import ghpythonlib.treehelpers as th
import json

#cols = ["Core_Cooling", "Perimeter_Cooling", "Core_Heating", "Perimeter_Heating"]
zones = ["Perimeter", "Core"]
loads = ["Cooling", "Heating"]
types = ["CSshoeboxer", "Autozoner"]

out = {}

assert data.BranchCount == len(loads)*len(types)*len(zones)

i = 0
for t in types:
    results_d = {}
#    for l in loads:
    for l in loads:
        loads_d = {}
        for z in zones:
            loads_d[z] = [float(val) for val in data.Branch(i)]
            i += 1
        results_d[l] = loads_d 
    out[t] = results_d
print(out)
fname=str(outpath)+name+"_CSresults.json"
if save:
    with open(fname,"w") as f:
        json.dump(out,f,indent=4)
# ---------- end python_9 ----------

# ==== cluster WinShdGen
zone_geometry = ClusterInput()
debrep = DeconstructBrep(ZoneGeometry=zone_geometry)  # -> Faces, Edges, Vertices
area = Area(Geometry=debrep.Faces)  # -> Area, Centroid
evalsrf = EvaluateSurface(Surface=debrep.Faces, Point=area.Centroid)  # -> Point, Normal, UDirection, VDirection, Frame
Z = UnitZ(Factor=1)
dprod = DotProduct(VectorA=evalsrf.Normal, VectorB=Z, Unitize=False)
wwr = ClusterInput()  # WWR (N,E,S,W)
abs = Absolute(Value=dprod)
smaller = SmallerThan(FirstNumber=abs, SecondNumber=".9")  # -> SmallerThan, OrEqualTo
dispatch = Dispatch(List=debrep.Faces, DispatchPattern=smaller.SmallerThan)  # -> ListA, ListB
srf = Surface(dispatch.ListA)
cluster = Cluster_2(srf=srf)
srf_2 = Surface(flatten(cluster))
item = ListItem(List=wwr, Index="0", Wrap=True)
item_2 = ListItem(List=wwr, Index="1", Wrap=True)
item_3 = ListItem(List=wwr, Index="2", Wrap=True)
item_4 = ListItem(List=wwr, Index="3", Wrap=True)
Y = UnitY(Factor=1)
X = UnitX(Factor=1)
Y_2 = UnitY(Factor="-1")
X_2 = UnitX(Factor="-1")
cluster_2 = Cluster(S=srf, dir=X, wwr=item_2)
cluster_3 = Cluster(S=srf, dir=Y_2, wwr=item_3)
cluster_4 = Cluster(S=srf, dir=X_2, wwr=item_4)
cluster_5 = Cluster(S=srf, dir=Y, wwr=item)
geo_n = Geometry(cluster_5)
geo_e = Geometry(cluster_2)
geo_s = Geometry(cluster_3)
geo_w = Geometry(cluster_4)
merge = Merge(Data1=geo_n, Data2=geo_e, Data3=geo_s, Data4=geo_w)
clean = CleanTree(RemoveNulls=True, RemoveInvalid=True, RemoveEmpty=False, Tree=merge)  # -> flatten(Tree)
T = ClusterOutput(clean)

# ==== cluster Cluster_3
floorheight = ClusterInput()
numfloors = ClusterInput()
xlen = ClusterInput()
ylen = ClusterInput()
offset = ClusterInput()

floorheight_2 = Number(floorheight)
numfloors_2 = Number(numfloors)
xlen_2 = Number(xlen)
ylen_2 = Number(ylen)
xy = XYPlane(Origin=Point(0, 0, 0))
Z = UnitZ(Factor=expr("x*0.5", floorheight_2))
footprintcurve = Rectangle(Plane=xy, XSize=xlen_2, YSize=ylen_2, Radius=0)  # -> FootprintBaseCurve, Length
Z_2 = UnitZ(Factor=floorheight_2)
move = Move(Geometry=xy, Motion=Z)  # -> Geometry, Transform
az = Autozoner(FloorPlanOutlines=footprintcurve.FootprintBaseCurve, Offset=offset)  # -> Outline, PerimeterPolylines, CorePolylines, SkeletonPolylines
box = CenterBox(Base=move.Geometry, X=xlen_2, Y=ylen_2, Z=expr("x*0.5", floorheight_2))
series = Series(Start=0, Step=floorheight_2, Count=numfloors_2)
pcol = PolylineCollapse(Polyline=az.PerimeterPolylines, Tolerance=1)  # -> Polyline, Count
pcol_2 = PolylineCollapse(Polyline=az.CorePolylines, Tolerance=1)  # -> Polyline, Count
floorzmove = UnitZ(Factor=series)
extr = Extrude(Base=pcol.Polyline, Direction=Z_2)
extr_2 = Extrude(Base=pcol_2.Polyline, Direction=Z_2)
cap = CapHoles(Brep=extr_2)
cap_2 = CapHoles(Brep=extr)  # -> graft(Brep)
move_2 = Move(Geometry=cap_2, Motion=floorzmove)  # -> Geometry, Transform
move_3 = Move(Geometry=cap, Motion=floorzmove)  # -> Geometry, Transform
ground_plane = Surface(footprintcurve.FootprintBaseCurve)
perimeter = Geometry(move_2.Geometry)
core = Geometry(move_3.Geometry)

footprintbasecurve = ClusterOutput(footprintcurve.FootprintBaseCurve)
f2fzaxismovementvec = ClusterOutput(Z_2)
floorzaxismovementvec = ClusterOutput(floorzmove)
ground_plane_2 = ClusterOutput(ground_plane)
perimeter_2 = ClusterOutput(perimeter)
core_2 = ClusterOutput(core)
panel = Panel("""South
East
North
West""")
series_2 = Series(Start=0, Step=1, Count=numfloors_2)
ins = InsertItems(List=graft(series_2), Item="Core", Indices=0, Wrap=True)  # -> simplify(List)
stack = StackData(Data=graft(panel), Stack=numfloors_2)
stack_2 = StackData(Data=graft(series_2), Stack="4")
join = TextJoin(Text=ins, Join="_Level_")  # -> flatten(Core_Names)
panel_2 = Panel(stack)
flip = FlipMatrix(Data=stack_2)
panel_3 = Panel(flip)
core_names = ClusterOutput(join)
merge = Merge(Data1=simplify(graft(panel_2)), Data2=simplify(graft(panel_3)))
join_2 = TextJoin(Text=merge, Join="_Level_")
panel_4 = Panel(join_2)
trim = TrimTree(Tree=panel_4, Depth="1")
perimnames = ClusterOutput(trim)

# ==== cluster Cluster_5
perim_depth = ClusterInput()
core_depth = ClusterInput()
wwr = ClusterInput()
base_point = ClusterInput()
f2f_height = ClusterInput()
width = ClusterInput()
cluster = Cluster_4(base_point=base_point, f2f_height=f2f_height, width=width, perim_depth=perim_depth, core_depth=core_depth, A=wwr)  # -> adiabatic_sides_2, bottom_plane_2, top_plane_2, perim_zone_2, core_zone_2, window_2
adiabatic_sides = Geometry(cluster.adiabatic_sides_2)
perim_zone = Geometry(cluster.perim_zone_2)
core_zone = Geometry(cluster.core_zone_2)
window = Geometry(cluster.window_2)
top_plane = Geometry(cluster.top_plane_2)
bottom_plane = Geometry(cluster.bottom_plane_2)
base_point_2 = ClusterInput()
stack = StackTrees(Data0=adiabatic_sides, Data1=bottom_plane, Data2=top_plane, Data3=perim_zone, Data4=core_zone, Data5=window, Reduce=True)
base_point_3 = Data(base_point_2)
depth_spacing = ClusterInput()
panel = Panel(base_point_3)
depth_spacing_2 = Number(depth_spacing)
multiplication = Multiplication(A=depth_spacing_2, B=2)
multiplication_2 = Multiplication(A=depth_spacing_2, B="3")
rotate = Rotate(Geometry=stack, Angle="PI/2", Plane=panel)  # -> Geometry, Transform
rotate_2 = Rotate(Geometry=stack, Angle="PI", Plane=panel)  # -> Geometry, Transform
rotate_3 = Rotate(Geometry=stack, Angle="3*PI/2", Plane=panel)  # -> Geometry, Transform
Y = UnitY(Factor=depth_spacing_2)
Y_2 = UnitY(Factor=multiplication)
Y_3 = UnitY(Factor=multiplication_2)
horizontal_spacing = ClusterInput()
move = Move(Geometry=rotate.Geometry, Motion=Y)  # -> Geometry, Transform
move_2 = Move(Geometry=rotate_2.Geometry, Motion=Y_2)  # -> Geometry, Transform
move_3 = Move(Geometry=rotate_3.Geometry, Motion=Y_3)  # -> Geometry, Transform
X = UnitX(HorizontalSpacing=horizontal_spacing)
entwine = Entwine(Branch0X=stack, Branch1X=move.Geometry, Branch2X=move_2.Geometry, Branch3X=move_3.Geometry, FlattenInputs=False)
multiplication_3 = Multiplication(A=X, B=2)
move_4 = Move(Geometry=entwine, Motion=X)  # -> Geometry, Transform
move_5 = Move(Geometry=entwine, Motion=multiplication_3)  # -> Geometry, Transform
entwine_2 = Entwine(Branch0X=entwine, Branch1X=move_4.Geometry, Branch2X=move_5.Geometry, FlattenInputs=False)
split = SplitTree(Data=entwine_2, Masks=flatten("{*;*;0}"))  # -> Positive, Negative
split_2 = SplitTree(Data=entwine_2, Masks=flatten("{*;*;1}"))  # -> Positive, Negative
split_3 = SplitTree(Data=entwine_2, Masks=flatten("{*;*;2}"))  # -> Positive, Negative
split_4 = SplitTree(Data=entwine_2, Masks=flatten("{*;*;3}"))  # -> Positive, Negative
split_5 = SplitTree(Data=entwine_2, Masks=flatten("{*;*;4}"))  # -> Positive, Negative
split_6 = SplitTree(Data=entwine_2, Masks=flatten("{*;*;5}"))  # -> Positive, Negative
adiabatic_walls = Geometry(split.Positive)
roof_surfaces = Geometry(split_3.Positive)
ground_surfaces = Geometry(split_2.Positive)
perim_zones = Geometry(split_4.Positive)
core_zones = Geometry(split_5.Positive)
window_surfaces = Geometry(split_6.Positive)
adiabatic_walls_2 = ClusterOutput(adiabatic_walls)
core_zones_2 = ClusterOutput(core_zones)
perim_zones_2 = ClusterOutput(perim_zones)
window_surfaces_2 = ClusterOutput(window_surfaces)
ground_surfaces_2 = Geometry(simplify(ground_surfaces))
ground_surfaces_3 = Geometry(simplify(roof_surfaces))
split_7 = SplitTree(Data=ground_surfaces_2, Masks=flatten("{0;*}"))  # -> Positive, Negative
split_8 = SplitTree(Data=ground_surfaces_2, Masks=flatten("{1;*}"))  # -> Positive, Negative
split_9 = SplitTree(Data=ground_surfaces_2, Masks=flatten("{2;*}"))  # -> Positive, Negative
split_10 = SplitTree(Data=ground_surfaces_3, Masks=flatten("{0;*}"))  # -> Positive, Negative
split_11 = SplitTree(Data=ground_surfaces_3, Masks=flatten("{1;*}"))  # -> Positive, Negative
split_12 = SplitTree(Data=ground_surfaces_3, Masks=flatten("{2;*}"))  # -> Positive, Negative
bottom_floor_ground_surfaces = Geometry(simplify(split_7.Positive))
middle_floor_ground_surfaces = Geometry(simplify(split_8.Positive))
top_floor_ground_surfaces = Geometry(simplify(split_9.Positive))
bottom_floor_roof_surfaces = Geometry(simplify(split_10.Positive))
middle_floor_roof_surfaces = Geometry(simplify(split_11.Positive))
top_floor_roof_surfaces = Geometry(simplify(split_12.Positive))
bottom_floor_ground_surfaces_2 = ClusterOutput(bottom_floor_ground_surfaces)
middle_floor_ground_surfaces_2 = ClusterOutput(middle_floor_ground_surfaces)
top_floor_ground_surfaces_2 = ClusterOutput(top_floor_ground_surfaces)
bottom_floor_roof_surfaces_2 = ClusterOutput(bottom_floor_roof_surfaces)
middle_floor_roof_surfaces_2 = ClusterOutput(middle_floor_roof_surfaces)
top_floor_roof_surfaces_2 = ClusterOutput(top_floor_roof_surfaces)

# ==== cluster JToKWh
pow = Power(A="10", B="-7")
multiplication = Multiplication(A="2.778", B=pow)
R = ClusterOutput(multiplication)

# ==== cluster Cluster
wwr = ClusterInput()  # WWR
dir = ClusterInput()  # Dir
S = ClusterInput()  # S

# ----
# north south gets priority
Y = UnitY(Factor=1)
dprod = DotProduct(VectorA=dir, VectorB=Y, Unitize=False)
abs = Absolute(Value=dprod)
int = Integer(abs)
item = ListItem(List=[".71", ".7"], Index=int, Wrap=True)

area = Area(Geometry=S)  # -> Area, Centroid
evalsrf = EvaluateSurface(Surface=S, Point=area.Centroid)  # -> Point, Normal, UDirection, VDirection, Frame
dprod_2 = DotProduct(VectorA=evalsrf.Normal, VectorB=dir, Unitize=False)
larger = LargerThan(FirstNumber=dprod_2, SecondNumber=item)  # -> LargerThan, OrEqualTo
panel = Panel(evalsrf.Normal)
dispatch = Dispatch(List=S, DispatchPattern=larger.LargerThan)  # -> WallsNORTH, ListB
wall_geometry = Geometry(dispatch.WallsNORTH)

# ---- group: User-Defined WWR Scale
division = Division(NorthScaleInput=wwr, B="100")

# ---- group: Centroids of Walls
area_2 = Area(Geometry=wall_geometry)  # -> Area, Centroid

# ----
sqrt = SquareRoot(Value=division)
scale = Scale(Geometry=wall_geometry, Center=area_2.Centroid, Factor=sqrt)  # -> flatten(NORTHWindows), Transform
area_3 = Area(Geometry=scale.NORTHWindows)  # -> Area, Centroid; disabled
division_2 = Division(A=area_3.Area, B=area_2.Area)  # disabled
panel_2 = Panel(division_2)  # disabled
north_windows = ClusterOutput(scale.NORTHWindows)

# ==== cluster Cluster_2
srf = ClusterInput()
srf_2 = Surface(srf)
crv = Curve(srf_2)
crv_2 = Curve(srf_2)  # disabled
srf_3 = Surface(crv_2)  # disabled
area = Area(Geometry=srf_2)  # -> Area, Centroid; disabled
srf_4 = Surface(crv)
area_2 = Area(Geometry=srf_3)  # -> Area, Centroid; disabled
flip = Flip(Surface=srf_4, Guide=srf_2)  # -> Surface, Result
evalsrf = EvaluateSurface(Surface=srf_2, Point=area.Centroid)  # -> Point, Normal, UDirection, VDirection, Frame; disabled
evalsrf_2 = EvaluateSurface(Surface=srf_3, Point=area_2.Centroid)  # -> Point, Normal, UDirection, VDirection, Frame; disabled
panel = Panel(flip.Result)
vdis = VectorDisplay(Anchor=area_2.Centroid)  # disabled
dprod = DotProduct(VectorA=evalsrf.Normal, VectorB=evalsrf_2.Normal, Unitize=False)  # disabled
vdis_2 = VectorDisplay(Anchor=area.Centroid, Vector=expr("x*10", evalsrf.Normal))  # disabled
panel_2 = Panel(".9")  # disabled
smaller = SmallerThan(FirstNumber=dprod, SecondNumber=panel_2)  # -> SmallerThan, OrEqualTo; disabled
dispatch = Dispatch(List=srf_3, DispatchPattern=smaller.SmallerThan)  # -> ListA, ListB; disabled
flip_2 = Flip(Surface=dispatch.ListA)  # -> Surface, Result; disabled
srf_5 = Surface(flatten([flip_2.Surface, dispatch.ListB]))  # disabled
S = ClusterOutput(flip.Surface)

# ==== cluster Cluster_4
floor_2_facade = ClusterInput()
core_2_perim = ClusterInput()
width = ClusterInput()
core_depth = ClusterInput()
perim_depth = ClusterInput()
f2f_height = ClusterInput()
base_point = ClusterInput()
floor_2_facade_2 = Number(floor_2_facade)
width_2 = Number(width)
core_2_perim_2 = Number(core_2_perim)
base_point_2 = Data(base_point)
f2f_height_2 = Number(f2f_height)
perim_depth_2 = Number(perim_depth)
core_depth_2 = Number(core_depth)
panel = Panel(base_point_2)
multiplication = Multiplication(A=f2f_height_2, B=floor_2_facade_2)
Y = UnitY(Factor=perim_depth_2)
multiplication_2 = Multiplication(A=multiplication, B=core_2_perim_2)
move = Move(Geometry=panel, Motion=Y)  # -> Geometry, Transform
box = DomainBox(Base=panel, X=width_2, Y=perim_depth_2, Z=f2f_height_2)
box_2 = DomainBox(Base=move.Geometry, X=width_2, Y=core_depth_2, Z=f2f_height_2)
debrep = DeconstructBrep(Brep=box)  # -> Faces, Edges, Vertices
debrep_2 = DeconstructBrep(Brep=box_2)  # -> Faces, Edges, Vertices
stack = StackTrees(Data0=debrep.Faces, Data1=debrep_2.Faces, Reduce=True)
A = ClusterInput()
item = ListItem(List=stack, Index=0, Wrap=True)  # -> Item, Item1, Item2, Item3, Item4, Item5
item_2 = ListItem(List=debrep.Faces, Index=0, Wrap=True)
division = Division(A=A, B=100)
area = Area(Geometry=item_2)  # -> Area, Centroid
geo = Geometry(item.Item4)
geo_2 = Geometry(item.Item5)
geo_3 = Geometry(item.Item1)
geo_4 = Geometry(item.Item3)
sqrt = SquareRoot(Value=division)
division_2 = Division(A=division, B=2)
join = BrepJoin(Breps=flatten(geo))  # -> Breps, Closed
join_2 = BrepJoin(Breps=flatten(geo_2))  # -> Breps, Closed
join_3 = BrepJoin(Breps=flatten(geo_4))  # -> Breps, Closed
item_3 = ListItem(List=flatten(item.Item2), Index=0, Wrap=True)  # -> Item, Item1
join_4 = BrepJoin(Breps=flatten(geo_3))  # -> Breps, Closed
addition = Addition(A=division_2, B=division)
scale = Scale(Geometry=item_2, Center=area.Centroid, Factor=sqrt)  # -> Geometry, Transform
subtraction = Subtraction(A="0.5", B=division_2)
addition_2 = Addition(A="0.5", B=division_2)
geo_5 = Geometry(join_4.Breps)
geo_6 = Geometry(join_3.Breps)
geo_7 = Geometry(join.Breps)
geo_8 = Geometry(join_2.Breps)
dom = ConstructDomain(DomainStart=subtraction, DomainEnd=addition_2)
fmerge = MergeFaces(Brep=geo_6)  # -> Breps, Before, After
fmerge_2 = MergeFaces(Brep=geo_5)  # -> Breps, Before, After
geo_9 = Geometry(item_3.Item1)
dom² = ConstructDomain²(DomainU="0.05 to 0.95", DomainV=dom)
fmerge_3 = MergeFaces(Brep=geo_8)  # -> Breps, Before, After
subsrf = Isotrim(Surface=reparameterize(item_2), Domain=dom²)
fmerge_4 = MergeFaces(Brep=geo_7)  # -> Breps, Before, After
merge = Merge(Data1=geo_9, Data2=fmerge_2.Breps, Data3=fmerge.Breps)
perim_zone = Geometry(box)
core_zone = Geometry(box_2)
window = Geometry(subsrf)
top_plane = Geometry(fmerge_3.Breps)
window_2 = ClusterOutput(window)
core_zone_2 = ClusterOutput(core_zone)
perim_zone_2 = ClusterOutput(perim_zone)
bottom_plane = Geometry(fmerge_4.Breps)
adiabatic_sides = Geometry(merge)
top_plane_2 = ClusterOutput(top_plane)
bottom_plane_2 = ClusterOutput(bottom_plane)
adiabatic_sides_2 = ClusterOutput(adiabatic_sides)
