# Grasshopper definition AutozoneContextGenerator.gh (Grasshopper 1.0.7)
# plug-ins: ClimateStudioGH, Autozoner, LadybugGrasshopper, jSwan, Sampler

# ---- group: Weather File
path = FilePath("C:\ProgramData\Solemma\Common\WeatherData\EPW\USA_NY_New.York-LaGuardia.AP.725030_TMYx.2004-2018.epw")

# ----
panel = Panel(path)

# ----
# Unit Converter
# Internalized Geometry is
# modeled in meters.
toggle = BooleanToggle(True)
unit = CSUnitScale(
    From="Meters",
    To="ActiveRhinoDocUnits",
    Listener=toggle,
    Input_0_Hidden=False,
    Input_0_Name="From",
    Input_1_Hidden=False,
    Input_1_Name="To",
    Input_2_Hidden=False,
    Input_2_Name="Listener",
    UnitSystem=4)

run_eplus = Button()
falsestart = LBFalseStartToggle(False)

# ----
# RUN
button = Button()

sampler = Sampler(Type=0, Directory="None")  # -> DesignMap, Data
filename = Panel("test")
output_directory = Panel("D:\DATA\ShadingAutozoner\")
number_slider = Slider(0, range=0..19)

# ---- group: 15-Zone Dimensions
f2f_height_meters = Panel("4")
n_floors = Slider(3, range=2..15)
perim_offset = Panel("4")
y_axis_meters = Panel("40")
x_axis_meters = Panel("40")

# ----
# Building Generation Parameters
bldg_dim_m = Panel("10 to 70")
corner_pertub_m = Panel("0 to 0")
f2f_height_m = Panel("3 to 5")
n_floors_2 = Panel("1 to 10")
wwr_frac = Panel("0.1 to 0.8")
perim_offset_2 = Slider(4.5, range=3..7)
n_buildings = Slider(5, range=1..1000)
x_spread = Slider(150, range=0..200)

# ---- group: Unit Conversion for 15 zone dimensions
multiplication = Multiplication(A=f2f_height_meters, B=unit)  # disabled
multiplication_2 = Multiplication(A=x_axis_meters, B=unit)  # disabled
multiplication_3 = Multiplication(A=y_axis_meters, B=unit)  # disabled
multiplication_4 = Multiplication(A=perim_offset, B=unit)  # disabled

# ----
number_slider_2 = Slider(42, range=0..100)
number_slider_3 = Slider(68, range=0..100)

# ---- group: BUILDING IDS
id = Panel("0 to 999999")
random = Random(Range=id, Number=n_buildings, Seed=number_slider_2)
python = GhPythonScript(x=random)  # -> out, a
# ---------- python: Python ----------
__author__ = "zoelh"
__version__ = "2023.12.15"

import rhinoscriptsyntax as rs

a = "%06d" % (int(x), )
# ---------- end python ----------

# ----
item = ListItem(List=python.a, Index=number_slider, Wrap=True)
expression = Expression(x=filename, y=item, Expression="Format(\"{0}_{1}\", x, y)")
panel_2 = Panel(expression)

heating_sp = Panel("14 to 24")
cooling_sp = Panel("22 to 30")
epd = Panel("0 to 60")
lpd = Panel("0 to 30")
people_density = Panel("0 to 0.5")
infiltration = Panel("0 to 0.001")
ventperarea = Panel("0 to 0.005")
ventperperson = Panel("0 to 0.005")
uval = Panel("0.3 to 7.0")
ventmode = Panel("0 to 2")  # disabled
roofmass = Panel("0 to 3")
facademass = Panel("0 to 3")
slabr = Panel("0.3 to 15")
roofr = Panel("0.3 to 18")
shgc = Panel("0.05 to 0.99")
econ = Panel("0 to 1")
hrv = Panel("0 to 2")
facader = Panel("0.3 to 15")
schedule = Panel("0 to 15")
random_2 = Random(Range=uval, Number=n_buildings, Seed=number_slider_2)
random_3 = Random(Range=shgc, Number=n_buildings, Seed=number_slider_2)
random_4 = Random(Range=slabr, Number=n_buildings, Seed=number_slider_2)
random_5 = Random(Range=heating_sp, Number=n_buildings, Seed=number_slider_2)
random_6 = Random(Range=facademass, Number=n_buildings, Seed=expr("x+1", number_slider_2))
random_7 = Random(Range=roofmass, Number=n_buildings, Seed=number_slider_2)
random_8 = Random(Range=roofr, Number=n_buildings, Seed=number_slider_2)
random_9 = Random(Range=cooling_sp, Number=n_buildings, Seed=number_slider_2)
random_10 = Random(Range=epd, Number=n_buildings, Seed=number_slider_2)
random_11 = Random(Range=econ, Number=n_buildings, Seed=number_slider_2)
random_12 = Random(Range=hrv, Number=n_buildings, Seed=number_slider_2)
random_13 = Random(Range=facader, Number=n_buildings, Seed=number_slider_2)
random_14 = Random(Range=ventperarea, Number=n_buildings, Seed=number_slider_2)
random_15 = Random(Range=lpd, Number=n_buildings, Seed=number_slider_2)
random_16 = Random(Range=people_density, Number=n_buildings, Seed=number_slider_2)
random_17 = Random(Range=infiltration, Number=n_buildings, Seed=number_slider_2)
random_18 = Random(Range=ventperperson, Number=n_buildings, Seed=number_slider_2)
random_19 = Random(Range=ventmode, Number=n_buildings, Seed=number_slider_2)  # disabled
random_20 = Random(Range=schedule, Number=n_buildings, Seed=number_slider_2)
int = Integer(random_7)
minwood_con = Panel("0.041")
item_2 = ListItem(List=random_5, Index=number_slider, Wrap=True)
item_3 = ListItem(List=random_9, Index=number_slider, Wrap=True)
item_4 = ListItem(List=random_10, Index=number_slider, Wrap=True)
int_2 = Integer(random_11)
int_3 = Integer(random_12)
item_5 = ListItem(List=random_15, Index=number_slider, Wrap=True)
item_6 = ListItem(List=random_16, Index=number_slider, Wrap=True)
item_7 = ListItem(List=random_14, Index=number_slider, Wrap=True)
item_8 = ListItem(List=random_18, Index=number_slider, Wrap=True)
item_9 = ListItem(List=random_17, Index=number_slider, Wrap=True)
int_4 = Integer(random_6)
item_10 = ListItem(List=random_3, Index=number_slider, Wrap=True)
int_5 = Integer(random_20)
xps_con = Panel("0.034")
item_11 = ListItem(List=random_2, Index=number_slider, Wrap=True)
item_12 = ListItem(List=int_2, Index=number_slider, Wrap=True)
item_13 = ListItem(List=int_3, Index=number_slider, Wrap=True)
concrete_den = Panel("2100")
concrete_sh = Panel("1040")
item_14 = ListItem(List=int_5, Index=number_slider, Wrap=True)
multiplication_5 = Multiplication(A=random_4, B=xps_con)
multiplication_6 = Multiplication(A=random_13, B=minwood_con)
multiplication_7 = Multiplication(A=random_8, B=xps_con)
python_2 = GhPythonScript(x=item_12)  # -> econstr
# ---------- python_2: Python ----------
__author__ = "zoelh"
__version__ = "2023.12.16"

import rhinoscriptsyntax as rs

l = ["NoEconomizer", "DifferentialEnthalpy"]
econstr = l[x]
# ---------- end python_2 ----------
python_3 = GhPythonScript(x=item_13)  # -> hrvstr
# ---------- python_3: Python ----------
__author__ = "zoelh"
__version__ = "2023.12.16"

import rhinoscriptsyntax as rs

l = ["None", "Sensible", "Enthalpy"]
hrvstr = l[x]
# ---------- end python_3 ----------
python_4 = GhPythonScript(x=int_4, specific_heat=concrete_sh, density=concrete_den)  # -> t
# ---------- python_4: Python ----------
__author__ = "zoelh"
__version__ = "2023.12.16"

import rhinoscriptsyntax as rs

tm_list = [450000, 100000, 50000, 20000]

needed_tm = tm_list[x]

t = needed_tm / float(specific_heat) / float(density)
# ---------- end python_4 ----------
python_5 = GhPythonScript(x=int, specific_heat=concrete_sh, density=concrete_den)  # -> t; same code as python_4
item_15 = ListItem(List=multiplication_7, Index=number_slider, Wrap=True)
item_16 = ListItem(List=multiplication_5, Index=number_slider, Wrap=True)
item_17 = ListItem(List=multiplication_6, Index=number_slider, Wrap=True)
item_18 = ListItem(List=python_5, Index=number_slider, Wrap=True)
item_19 = ListItem(List=python_4, Index=number_slider, Wrap=True)

panel_3 = Panel(random_8)

# ----
# 5-Zone Builder
expression_2 = Expression(
    width=multiplication_2,
    len=multiplication_3,
    f2f_h=multiplication,
    floors=n_floors,
    Expression="(2*width + 2*len)*floors*f2f_h")  # disabled
expression_3 = Expression(
    width=multiplication_2,
    len=multiplication_3,
    f2f_h=multiplication,
    floors=n_floors,
    Expression="(2*width + 2*len)*f2f_h")  # disabled
expression_4 = Expression(width=multiplication_2, len=multiplication_3, floors=n_floors, Expression="width*len*floors")  # disabled
division = Division(A=expression_4, B=expression_2)  # disabled
cluster = Cluster_3(numfloors=n_floors, floorheight=multiplication, xlen=multiplication_2, ylen=multiplication_3, offset=multiplication_4)  # -> floorzaxismovementvec, perimnames, perimeter_2, core_names, f2fzaxismovementvec, core_2, footprintbasecurve, ground_plane_2; disabled
explode = Explode(Curve=cluster.footprintbasecurve, Recursive=True)  # -> Segments, Vertices; disabled
wwr_n = Number()  # disabled
item_20 = ListItem(List=flatten(cluster.core_2), Index=0, Wrap=True)  # disabled
flip = FlipMatrix(Data=cluster.perimeter_2)  # disabled
extr = Extrude(Base=explode.Segments, Direction=cluster.f2fzaxismovementvec)  # -> graft(Extrusion); disabled
debrep = DeconstructBrep(Brep=flip)  # -> Faces, Edges, Vertices; disabled
debrep_2 = DeconstructBrep(Brep=item_20)  # -> Faces, Edges, Vertices; disabled
number_slider_4 = Slider(5, range=0..5)  # disabled
item_21 = ListItem(List=debrep.Faces, Index=number_slider_4, Wrap=True)  # disabled
trim = TrimTree(Tree=item_21, Depth=1)  # disabled
area = Area(Geometry=trim)  # -> Area, Centroid; disabled
merge = Merge(Data1=wwr_n, Data2=wwr_n, Data3=wwr_n, Data4=wwr_n)  # -> simplify(flatten(Result)); disabled
move = Move(Geometry=extr, Motion=cluster.floorzaxismovementvec)  # -> simplify(flatten(Geometry)), Transform; disabled
ma = MassAddition(Input=area.Area)  # -> flatten(Result), PartialResults; disabled
item_22 = ListItem(List=debrep_2.Faces, Index=number_slider_4, Wrap=True)  # disabled
item_23 = ListItem(List=ma.Result, Index=0, Wrap=True)  # disabled
area_2 = Area(Geometry=item_22)  # -> Core_area, Centroid; disabled
winshdgen = WinShdGen(zone_geometry=move.Geometry, wwr=merge)  # disabled
total_perim_area = Number(item_23)  # disabled
addition = Addition(Total_perim_area=total_perim_area, Total_core_area=area_2.Core_area)  # disabled
division_2 = Division(Total_core_area=area_2.Core_area, Total_perim_area=total_perim_area)  # disabled
division_3 = Division(Total_perim_area=total_perim_area, Total_facade_area=expression_3)  # disabled
division_4 = Division(Total_perim_area=total_perim_area, Footprint_area=addition)  # disabled
division_5 = Division(Total_core_area=area_2.Core_area, Footprint_area=addition)  # disabled
zone_names = Data(cluster.perimnames)  # disabled
zones = Data(cluster.perimeter_2)  # disabled
windows = Geometry(winshdgen)  # disabled

panel_4 = Panel(multiplication_6)
panel_5 = Panel(item_17)

random_21 = Random(Range=bldg_dim_m, Number=n_buildings, Seed=expr("x+1", number_slider_2))
random_22 = Random(Range=bldg_dim_m, Number=n_buildings, Seed=number_slider_2)
subtraction = Subtraction(A=n_buildings, B=1)
series = Series(Start=0, Step=x_spread, Count=n_buildings)
series_2 = Series(Start=0, Step=x_spread, Count=n_buildings)
Y = UnitY(Factor=series_2)
ma_2 = MassAddition(Input=random_22)  # -> Result, PartialResults
rectangle = Rectangle(Plane=PlaneXY(0, 0, 0), XSize=random_22, YSize=random_21, Radius=0)  # -> Rectangle, Length
ins = InsertItems(List=ma_2.PartialResults, Item="0", Indices="0", Wrap=True)
subset = SubList(List=ins, Domain=subtraction, Wrap=True)  # -> List, Index
addition_2 = Addition(A=subset.List, B=series)
X = UnitX(Factor=addition_2)
multiplication_8 = Multiplication(A=n_buildings, B="4")
move_2 = Move(Geometry=rectangle.Rectangle, Motion=X)  # -> Geometry, Transform
random_23 = Random(Range="2*pi", Number=multiplication_8, Seed=Slider(64, range=0..100))
random_24 = Random(Range=corner_pertub_m, Number=multiplication_8, Seed=number_slider_3)
move_3 = Move(Geometry=move_2.Geometry, Motion=Y)  # -> Geometry, Transform
partition = PartitionList(List=random_23, Size="4")
partition_2 = PartitionList(List=random_24, Size="4")
disc = Discontinuity(Curve=move_3.Geometry, Level=1)  # -> Points, Parameters
Z = UnitZ(Factor=1)
X_2 = UnitX(Factor=1)
vrot = Rotate(Vector=X_2, Axis=Z, Angle=partition)
multiplication_9 = Multiplication(A=vrot, B=partition_2)
move_4 = Move(Geometry=disc.Points, Motion=multiplication_9)  # -> Geometry, Transform
pline = PolyLine(Vertices=move_4.Geometry, Closed=True)  # -> simplify(flatten(Polyline))
area_3 = Area(Geometry=pline)  # -> Area, Centroid
random_25 = Random(Range="2*pi", Number=n_buildings, Seed=Slider(76, range=0..100))
rotate = Rotate(Geometry=pline, Angle=random_25, Plane=area_3.Centroid)  # -> Geometry, Transform
cx = CurveSelf(Curve=rotate.Geometry)  # -> Points, Params
lng = ListLength(List=cx.Points)  # -> flatten(Length)
equals = Equality(FirstNumber=lng, SecondNumber="0")  # -> Equality, Inequality
cull = CullPattern(List=rotate.Geometry, CullPattern=equals.Equality)
az = Autozoner(FloorPlanOutlines=graft(cull), Offset=perim_offset_2)  # -> Outline, PerimeterPolylines, CorePolylines, SkeletonPolylines
lng_2 = ListLength(List=cull)
geo = Geometry(az.Outline)
geo_2 = Geometry(az.PerimeterPolylines)
geo_3 = Geometry(az.CorePolylines)
random_26 = Random(Range=f2f_height_m, Number=lng_2, Seed=Slider(87, range=0..100))
random_27 = Random(Range=n_floors_2, Number=lng_2, Seed=Slider(11, range=0..100), Integers=True)
random_28 = Random(Range=wwr_frac, Number=lng_2, Seed=Slider(25, range=0..100))
srf = Surface(graft(geo_2))
srf_2 = Surface(simplify(geo_3))
trim_2 = TrimTree(Tree=srf, Depth=1)
Z_2 = UnitZ(Factor=random_26)
extr_2 = Extrude(Base=srf_2, Direction=graft(Z_2))  # -> simplify(Extrusion)
extr_3 = Extrude(Base=trim_2, Direction=graft(Z_2))  # -> simplify(Extrusion)
series_3 = Series(Start=0, Step=graft(random_26), Count=graft(random_27))  # -> simplify(Series)
division_6 = Division(A=random_26, B=2)
Z_3 = UnitZ(Factor=division_6)
Z_4 = UnitZ(Factor=series_3)
move_5 = Move(Geometry=cull, Motion=Z_3)  # -> Geometry, Transform
explode_2 = Explode(Curve=move_5.Geometry, Recursive=True)  # -> Segments, Vertices
lng_3 = ListLength(List=Z_4)  # -> flatten(Length)
end = EndPoints(Curve=explode_2.Segments)  # -> Start, End
move_6 = Move(Geometry=extr_2, Motion=Z_4)  # -> Geometry, Transform
multiplication_10 = Multiplication(A=random_26, B=random_28)
python_6 = GhPythonScript(x=extr_3, y=Z_4)  # -> out, a; inputs x: list of Brep, y: list of Vector3d
# ---------- python_6: Python ----------
__author__ = "szvsw"
__version__ = "2023.11.14"

import rhinoscriptsyntax as rs
import ghpythonlib.components as ghcomp
import ghpythonlib.treehelpers as th
breps = x
vecs = y
breps_out = []

for brep in breps:
    for vec in vecs:
        new_brep,_ = ghcomp.Move(brep,vec)
        breps_out.append(new_brep)

a = th.list_to_tree(breps_out)
# ---------- end python_6 ----------
midpt = CurveMiddle(Curve=explode_2.Segments)
geo_4 = Geometry(move_6.Geometry)
geo_5 = Geometry(python_6.a)
vec2pt = Vector2Pt(PointA=end.End, PointB=midpt, Unitize=invert(False))  # -> Vector, Length
vec2pt_2 = Vector2Pt(PointA=end.Start, PointB=midpt, Unitize=invert(False))  # -> Vector, Length
stack = StackData(Data=lng_3, Stack="4")
division_7 = Division(A=multiplication_10, B=2)
multiplication_11 = Multiplication(A=vec2pt.Vector, B="0.1")
multiplication_12 = Multiplication(A=vec2pt_2.Vector, B="0.1")
Z_5 = UnitZ(Factor=division_7)
move_7 = Move(Geometry=end.End, Motion=multiplication_11)  # -> Geometry, Transform
move_8 = Move(Geometry=end.Start, Motion=multiplication_12)  # -> Geometry, Transform
partition_3 = PartitionList(List=geo_5, Size=stack)  # -> simplify(Chunks)
neg = Negative(Value=Z_5)
ln = Line(StartPoint=move_8.Geometry, EndPoint=move_7.Geometry)
path_mapper = PathMapper(partition_3, source="{a}[i]", target="{floor(a/4);a%4}[i]")
move_9 = Move(Geometry=ln, Motion=graft(Z_5))  # -> Geometry, Transform
move_10 = Move(Geometry=ln, Motion=graft(neg))  # -> Geometry, Transform
geo_6 = Geometry(path_mapper)
merge_2 = Merge(Data1=graft(move_9.Geometry), Data2=graft(move_10.Geometry))  # -> simplify(Result)
loft = Loft(Curves=merge_2, Options={Adjust=False, Closed=False, LoftEnds=0, LoftSimp=0, LoftType=0, Rebuild=10, Refit=0.01})
trim_3 = TrimTree(Tree=loft, Depth=1)
python_7 = GhPythonScript(x=trim_3, y=Z_4)  # -> out, a; inputs x: list of Brep, y: list of Vector3d; same code as python_6
geo_7 = Geometry(python_7.a)
partition_4 = PartitionList(List=geo_7, Size=stack)  # -> simplify(Chunks)
path_mapper_2 = PathMapper(partition_4, source="{a}[i]", target="{floor(a/4);a%4}[i]")
geo_8 = Geometry(path_mapper_2)

# ---- group: Windows
tvis = Panel("0.8")

# ----
multiplication_13 = Multiplication(A=item_8, B="1000")
multiplication_14 = Multiplication(A=item_7, B="1000")

# ---- group: shoebox dimensions
perim_depth = Slider(3.6, range=2..10)
width = Slider(3, range=1..15)
core_depth = Slider(6.4, range=2..60)

# ----
addition_3 = Addition(A=perim_offset, B=core_depth)
multiplication_15 = Multiplication(A=width, B=perim_offset)
multiplication_16 = Multiplication(A=width, B=core_depth)
multiplication_17 = Multiplication(A=width, B=addition_3)

# ---- group: 15-zone model computed properties
perim_area_to_facade_area_unitless = Panel(division_3)
core_fraction_core_footprint = Panel(division_5)
building_core_to_perim_ratio_unitless = Panel(division_2)
core_fraction_core_footprint_2 = Panel(division_4)
gfa_facade_area_unitless = Panel(division)
gfa_m2 = Panel(expression_4)
facade_area_m2 = Panel(expression_2)

# ----
srf_3 = Surface(az.CorePolylines)
srf_4 = Surface(az.Outline)
srf_5 = Surface(az.PerimeterPolylines)
area_4 = Area(Geometry=srf_4)  # -> flatten(FootprintArea), Centroid
len = Length(Curve=geo)  # -> flatten(PerimeterLengths)
shoebox_width = Panel("3")
floor_to_floor_heights = Number(random_26)
area_5 = Area(Geometry=srf_3)  # -> flatten(CoreAreas), Centroid
area_6 = Area(Geometry=srf_5)  # -> PerimAreas, Centroid
ma_3 = MassAddition(Input=area_6.PerimAreas)  # -> flatten(TotalPerimArea), PartialResults
multiplication_18 = Multiplication(A=floor_to_floor_heights, B=len)
multiplication_19 = Multiplication(ShoeboxWidth=shoebox_width, FloorToFloorHeights=floor_to_floor_heights)
division_8 = Division(PerimOffset=perim_offset_2, FloorToFloorHeight=floor_to_floor_heights)
facade_area = Division(TotalPerimArea=ma_3.TotalPerimArea, FacadeArea=multiplication_18)
division_9 = Division(CoreAreas=area_5.CoreAreas, TotalPerimAreas=ma_3.TotalPerimArea)
panel_6 = Panel(division_8)
panel_7 = Panel(facade_area)
panel_8 = Panel(division_9)
multiplication_20 = Multiplication(SBFacadeArea=multiplication_19, PerimAreaToFacadeArea=facade_area)
division_10 = Division(ShoeboxAreas=multiplication_20, ShoeboxWidths=shoebox_width)
perim_depths = Panel(division_10)
multiplication_21 = Multiplication(PerimDepths=division_10, CoreAreaToPerimArea=division_9)
core_depths = Panel(multiplication_21)
footprint_areas = Panel(area_4.FootprintArea)

# ---- group: computed shoebox information
shoebox_height_m_driven = Panel(multiplication)

# ---- group: perim_to_facade desired properties
actual_perim_area_m2 = Panel(multiplication_15)
actual_core_area_m2 = Panel(multiplication_16)
actual_shoebox_total_area_m2 = Panel(multiplication_17)

desired_perim_area_m2 = Panel("""South
East
North
West""")

# ----
explode_3 = Explode(Curve=cull, Recursive=True)  # -> Segments, Vertices
midpt_2 = CurveMiddle(Curve=explode_3.Segments)
len_2 = Length(Curve=explode_3.Segments)
end_2 = EndPoints(Curve=explode_3.Segments)  # -> Start, End
len_3 = Length(Curve=cull)
vec2pt_3 = Vector2Pt(PointA=end_2.Start, PointB=midpt_2, Unitize=False)  # -> Vector, Length
division_11 = Division(A=len_2, B=graft(len_3))  # -> simplify(EdgeWeights)
move_11 = Move(Geometry=explode_3.Segments, Motion=vec2pt_3.Vector)  # -> Geometry, Transform
rotate_2 = Rotate(Geometry=move_11.Geometry, Angle="-PI/2", Plane=midpt_2)  # -> Geometry, Transform
end_3 = EndPoints(Curve=rotate_2.Geometry)  # -> Start, End
Y_2 = UnitY(Factor=1)
vec2pt_4 = Vector2Pt(PointA=end_3.Start, PointB=end_3.End, Unitize=False)  # -> Vector, Length
neg_2 = Negative(Value=Y_2)
xy = XYPlane(Origin=Point(0, 0, 0))
angle = Angle(VectorA=neg_2, VectorB=vec2pt_4.Vector, Plane=xy)  # -> OrientationsRads, Reflex
multiplication_22 = Multiplication(A=angle.OrientationsRads, B=57.29577951)
round = Round(Number=multiplication_22)  # -> Nearest, Floor, Ceiling
merge_3 = Merge(Data1=simplify(graft(round.Nearest)), Data2=simplify(graft(division_11)))
join = TextJoin(Text=merge_3, Join="deg, weight:")  # -> simplify(Result)
ins_2 = InsertItems(List=graft(random_26), Item="f2fHeight (m)", Indices="1", Wrap=True)
ins_3 = InsertItems(List=graft(random_27), Item="floors", Indices="1", Wrap=True)
ins_4 = InsertItems(List=graft(random_28), Item="WWRs", Indices="1", Wrap=True)
# For each edge, save normal in json (see gen city tester for geom stuff)
line = LineSDL(Start=end_3.Start, Direction=vec2pt_4.Vector, Length="10")
join_2 = TextJoin(Text=ins_2, Join=" ")  # -> flatten(Result)
join_3 = TextJoin(Text=ins_3, Join=" ")  # -> flatten(Result)
join_4 = TextJoin(Text=ins_4, Join=" ")  # -> flatten(Result)
end_4 = EndPoints(Curve=line)  # -> Start, End
trim_4 = TrimTree(Tree=join, Depth=1)
tag = TextTag(Location=end_4.End, Text=trim_4)
item_24 = ListItem(List=end_4.End, Index=0, Wrap=True)  # -> flatten(Item)
tag_2 = TextTag(Location=item_24, Text=join_2)
tag_3 = TextTag(Location=item_24, Text=join_3)
tag_4 = TextTag(Location=item_24, Text=join_4)
wwr = Panel(random_28)
edge_weights = Panel(division_11)
orientation_radians = Panel(angle.OrientationsRads)
floor_to_floor_height = Panel(random_26)
floors = Panel(random_27)

explode_4 = Explode(Curve=cull, Recursive=True)  # -> simplify(Segments), Vertices
len_4 = Length(Curve=explode_4.Segments)
edge_lengths = Panel(len_4)
area_7 = Area(Geometry=geo_6)  # -> simplify(Area), Centroid
area_8 = Area(Geometry=geo_4)  # -> Area, Centroid
perim_area = Panel(area_7.Area)
corearea = Panel(area_8.Area)

# ---- group: ZONE NAMES
lng_4 = ListLength(List=geo_6)
trim_5 = TrimTree(Tree=lng_4, Depth=1)
lng_5 = ListLength(List=geo_4)
python_8 = GhPythonScript(x="core", y=lng_5)  # -> simplify(names); inputs y: tree
# ---------- python_8: Python ----------
__author__ = "zoelh"
__version__ = "2023.12.16"

import rhinoscriptsyntax as rs
import ghpythonlib.treehelpers as th

names = []

for i, branch in enumerate(y.Branches):
    n = []
    print(branch)
    for k in range(len(branch)):
        n.append([x+"_floor_"+str(j)+"_n_"+str(k) for j in range(branch[k])])
    names.append(n)
     
print(names)
names = th.list_to_tree(names, source=[0,0])
#names = [x+"_"+str(i) for i in range(y)]
# ---------- end python_8 ----------
python_9 = GhPythonScript(x="perim", y=trim_5)  # -> simplify(names); inputs y: tree; same code as python_8
trim_6 = TrimTree(Tree=python_9, Depth=1)
branch = TreeBranch(Tree=simplify(python_8), Path=number_slider, MaintainPaths=True)
branch_2 = TreeBranch(Tree=simplify(trim_6), Path=number_slider, MaintainPaths=True)

# ----
item_25 = ListItem(List=floor_to_floor_heights, Index=number_slider, Wrap=True)
item_26 = ListItem(List=shoebox_width, Index=number_slider, Wrap=True)
item_27 = ListItem(List=perim_depths, Index=number_slider, Wrap=True)
normals = Geometry(line)
points = Data(end_3.Start)
item_28 = ListItem(List=core_depths, Index=number_slider, Wrap=True)
item_29 = ListItem(List=random_28, Index=number_slider, Wrap=True)

windows_2 = Geometry(flatten(geo_8))
perim = Geometry(flatten(geo_6))
core = Geometry(flatten(geo_4))
ground = Surface(cull)
preview = CustomPreview(Geometry=perim, Material=ColourSwatch(SwatchColor=RGB(222, 171, 144)))
preview_2 = CustomPreview(Geometry=windows_2, Material=ColourSwatch(SwatchColor=RGB(144, 204, 222)))
preview_3 = CustomPreview(Geometry=core, Material=ColourSwatch(SwatchColor=RGB(201, 222, 144)))
preview_4 = CustomPreview(Geometry=ground, Material=ColourSwatch(SwatchColor=RGB(102, 53, 0)))

area_9 = Area(Geometry=ground)  # -> Area, Centroid
multiplication_23 = Multiplication(A=area_9.Area, B=random_27)
total_area = Panel(multiplication_23)
trim_7 = TrimTree(Tree=geo_8, Depth=1)
trim_8 = TrimTree(Tree=geo_6, Depth=1)
item_30 = ListItem(List=geo_4, Index=0, Wrap=True)
branch_3 = TreeBranch(Tree=simplify(points), Path=number_slider, MaintainPaths=True)
branch_4 = TreeBranch(Tree=simplify(normals), Path=number_slider, MaintainPaths=True)
branch_5 = TreeBranch(Tree=simplify(trim_7), Path=number_slider, MaintainPaths=True)
branch_6 = TreeBranch(Tree=simplify(trim_8), Path=number_slider, MaintainPaths=True)
area_10 = Area(Geometry=branch_6)  # -> Area, Centroid
tag_5 = TextTag(Location=area_10.Centroid, Text=branch_2)
branch_7 = TreeBranch(Tree=simplify(geo_4), Path=number_slider, MaintainPaths=True)
item_31 = ListItem(List=ground, Index=number_slider, Wrap=True)
data = Data(simplify(orientation_radians))
area_11 = Area(Geometry=geo_4)  # -> Area, Centroid
wires = BrepWireframe(Brep=perim, Density=-1)
area_12 = Area(Geometry=geo_6)  # -> Area, Centroid
concat = Concatenate(FragmentA="Orient: ", FragmentB=data)  # -> graft(Result)
concat_2 = Concatenate(FragmentA="Area: ", FragmentB=perim_area)
preview_5 = CustomPreview(
    Geometry=wires,
    Material={diffuse=RGB(221, 160, 221), emission=RGB(66, 48, 66), shine=0.5, specular=RGB(255, 255, 255), transparency=0})
item_32 = ListItem(List=area_11.Centroid, Index=-1, Wrap=True)
item_33 = ListItem(List=area_12.Centroid, Index=0, Wrap=True)
item_34 = ListItem(List=concat_2, Index=0, Wrap=True)
concat_3 = Concatenate(FragmentA="Length: ", FragmentB=edge_lengths)  # -> graft(Result)
facade_centroids = Data(simplify(points))  # disabled
facade_normals = Data(simplify(normals))  # disabled
data_2 = Data(simplify(graft(python.a)))
Z_6 = UnitZ(Factor=1)
move_12 = Move(Geometry=item_33, Motion=simplify(graft(vec2pt_4.Vector)))  # -> Geometry, Transform
move_13 = Move(Geometry=item_32, Motion=expr("x*10", Z_6))  # -> Geometry, Transform
xy_2 = XYPlane(Origin=Point(0, 0, 0))  # disabled
tag_6 = TextTag(Location=move_13.Geometry, Text=data_2, Colour=ColourSwatch(SwatchColor=RGB(5, 114, 247)))
swatch = ColourSwatch(SwatchColor=RGB(0, 0, 0))
Z_7 = UnitZ(Factor="-10")
Z_8 = UnitZ(Factor="-20")
Z_9 = UnitZ(Factor="-30")
item_35 = ListItem(List=python_9, Index=0, Wrap=True)
move_14 = Move(Geometry=move_12.Geometry, Motion=Z_7)  # -> Geometry, Transform
move_15 = Move(Geometry=move_12.Geometry, Motion=Z_8)  # -> Geometry, Transform
panel_10 = Panel("{0}")  # disabled
move_16 = Move(Geometry=move_12.Geometry, Motion=Z_9)  # -> Geometry, Transform
tag_7 = TextTag(Location=move_12.Geometry, Text=item_35, Colour=swatch)
tag_8 = TextTag(Location=move_14.Geometry, Text=item_34, Colour=swatch)
tag_9 = TextTag(Location=move_15.Geometry, Text=concat, Colour=swatch)
tag_10 = TextTag(Location=move_16.Geometry, Text=concat_3, Colour=swatch)
panel_11 = Panel("{0;0}")  # disabled

# ----
# Template Settings
panel_12 = Panel("D:\Users\zoelh\GitRepos\ml-for-building-energy-modeling\ml-for-bem\data\")
python_10 = GhPythonScript(index=item_14, path=panel_12)  # -> schedules
# ---------- python_10: Python ----------
__author__ = "zoelh"
__version__ = "2023.11.18"

import rhinoscriptsyntax as rs
import csv
import ghpythonlib.treehelpers as th

schedules = []
l = ["EquipmentAvailabilitySchedule.csv", "LightsAvailabilitySchedule.csv", "OccupancySchedule.csv"]
for file in l:
    filename = path + file
    with open(filename) as csvfile:
        reader = csv.reader(csvfile)
        rows = list(reader)
        row = rows[int(index)+1]
        schedules.append([row[1:]])
schedules = th.list_to_tree(schedules)
# ---------- end python_10 ----------
bang = ExplodeTree(Data=python_10)  # -> Branch0, Branch1, Branch2
year_schedule = ConstructCSYearSchedule(Name="Lights", Type=0, Category=0, DaysHours=bang.Branch1)  # -> Sched, Values
year_schedule_2 = ConstructCSYearSchedule(Name="Occupancy", Type=0, Category=0, DaysHours=bang.Branch2)  # -> Sched, Values
year_schedule_3 = ConstructCSYearSchedule(Name="Equip", Type=0, Category=0, DaysHours=bang.Branch0)  # -> Sched, Values
econ_2 = ValueList({"NoEconomizer", "DifferentialEnthalpy"}, selected="NoEconomizer")
list = ValueList({"Residential", "Kitchen", "Office", "MeetingRoom", "HotelRoom", "ClassRoom", "Library", "LectureHall", "SuperMarket", "Shopping", "ScienceLab"}, selected="Office")
infiltrationmethod = ValueList({"ACH", "Flow Per Exterior Area": "FlowExtArea"}, selected="Flow Per Exterior Area")
hrv_2 = ValueList({"None", "Sensible", "Enthalpy"}, selected="None")
simple_window = ConstructCSSimpleWindow(Name="windowtest", Shgf=item_10, Uval=item_11, Tvis=tvis)
zonetemplate = GetZoneTemplate(SearchZoneTemplate=list, Selection="Office")
infiltration_ach = Slider(0, range=0..1)
heating_coolingconstant = BooleanToggle(True)
people_equip_lightson = BooleanToggle(True)
scheduledventilationon = BooleanToggle(False)
heating_coolingon = BooleanToggle(True)
scheduledventilationon_2 = BooleanToggle(False)
mechventon = BooleanToggle(True)
humidistaton = BooleanToggle(False)
item_36 = ListItem(List=zonetemplate, Index=0, Wrap=True)
infiltrationon = BooleanToggle(True)
fanenergy = BooleanToggle(False)
natventon = BooleanToggle(False)
shadingon = BooleanToggle(False)
dhwon = BooleanToggle(True)
hasframe = BooleanToggle(False)
panel_13 = Panel("Airspeed 0")
occupancy = Data(year_schedule_2.Sched)
dimmingtype = Panel("Off")
wset = CSWindowSettings(
    Name="SimpleWindowSettings",
    Type="External",
    ShadingSystemIsOn=shadingon,
    GlazingConstruction=simple_window,
    OperableArea="0",
    HasFrame=hasframe,
    AFNWindowAvailability="AllOff",
    Input_0_Hidden=False,
    Input_0_Name="Name",
    Input_10_Hidden=True,
    Input_10_Name="ShadingThickness",
    Input_11_Hidden=True,
    Input_11_Name="ShadeGlassDistance",
    Input_12_Hidden=True,
    Input_12_Name="TopBottomEdgeOpeningMultiplier",
    Input_13_Hidden=True,
    Input_13_Name="Analysis Mesh Resolution",
    Input_14_Hidden=True,
    Input_14_Name="ZoneMixingIsOn",
    Input_15_Hidden=True,
    Input_15_Name="ZoneMixingDeltaTemperature",
    Input_16_Hidden=True,
    Input_16_Name="ZoneMixingFlowRate",
    Input_17_Hidden=False,
    Input_17_Name="Glazing Construction",
    Input_18_Hidden=False,
    Input_18_Name="OperableArea",
    Input_19_Hidden=True,
    Input_19_Name="ZoneMixingAvailibilitySchedule",
    Input_1_Hidden=False,
    Input_1_Name="WindowSettings",
    Input_20_Hidden=False,
    Input_20_Name="HasFrame",
    Input_21_Hidden=True,
    Input_21_Name="FrameWidth",
    Input_22_Hidden=True,
    Input_22_Name="FrameProjection"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)

material = ConstructCSOpaqueMaterial(
    Name="Partition Plaster",
    Conductivity=1,
    Density=2000,
    Roughness="Rough",
    SpecificHeat=1130,
    ThermalAbsorptance=0.9,
    SolarAbsorptance=0.7,
    VisibleAbsorptance=0.7,
    Type="Finishes",
    Input_0_Hidden=False,
    Input_0_Name="Name",
    Input_10_Hidden=True,
    Input_10_Name="TemperatureCoefficientThermalConductivity",
    Input_11_Hidden=True,
    Input_11_Name="TemperatureArray",
    Input_12_Hidden=True,
    Input_12_Name="EnthalpyArray",
    Input_13_Hidden=True,
    Input_13_Name="VariableConductivityArray",
    Input_14_Hidden=False,
    Input_14_Name="Type",
    Input_15_Hidden=True,
    Input_15_Name="EmbodiedEnergy",
    Input_16_Hidden=True,
    Input_16_Name="EmbodiedCarbon",
    Input_17_Hidden=True,
    Input_17_Name="Cost",
    Input_18_Hidden=True,
    Input_18_Name="Life",
    Input_1_Hidden=False,
    Input_1_Name="Conductivity",
    Input_2_Hidden=False,
    Input_2_Name="Density",
    Input_3_Hidden=False,
    Input_3_Name="Roughness",
    Input_4_Hidden=False,
    Input_4_Name="SpecificHeat",
    Input_5_Hidden=False,
    Input_5_Name="ThermalAbsorptance"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)
material_2 = ConstructCSOpaqueMaterial(
    Name="Stucco",
    Conductivity=0.72,
    Density=1856,
    Roughness="Rough",
    SpecificHeat=840,
    ThermalAbsorptance=0.9,
    SolarAbsorptance=0.7,
    VisibleAbsorptance=0.7,
    Type="Sealing",
    Input_0_Hidden=False,
    Input_0_Name="Name",
    Input_10_Hidden=True,
    Input_10_Name="TemperatureCoefficientThermalConductivity",
    Input_11_Hidden=True,
    Input_11_Name="TemperatureArray",
    Input_12_Hidden=True,
    Input_12_Name="EnthalpyArray",
    Input_13_Hidden=True,
    Input_13_Name="VariableConductivityArray",
    Input_14_Hidden=False,
    Input_14_Name="Type",
    Input_15_Hidden=True,
    Input_15_Name="EmbodiedEnergy",
    Input_16_Hidden=True,
    Input_16_Name="EmbodiedCarbon",
    Input_17_Hidden=True,
    Input_17_Name="Cost",
    Input_18_Hidden=True,
    Input_18_Name="Life",
    Input_1_Hidden=False,
    Input_1_Name="Conductivity",
    Input_2_Hidden=False,
    Input_2_Name="Density",
    Input_3_Hidden=False,
    Input_3_Name="Roughness",
    Input_4_Hidden=False,
    Input_4_Name="SpecificHeat",
    Input_5_Hidden=False,
    Input_5_Name="ThermalAbsorptance"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)
material_3 = ConstructCSOpaqueMaterial(
    Name="Plaster",
    Conductivity=1,
    Density=2000,
    Roughness="Rough",
    SpecificHeat=1130,
    ThermalAbsorptance=0.9,
    SolarAbsorptance=0.7,
    VisibleAbsorptance=0.7,
    Type="Sealing",
    Input_0_Hidden=False,
    Input_0_Name="Name",
    Input_10_Hidden=True,
    Input_10_Name="TemperatureCoefficientThermalConductivity",
    Input_11_Hidden=True,
    Input_11_Name="TemperatureArray",
    Input_12_Hidden=True,
    Input_12_Name="EnthalpyArray",
    Input_13_Hidden=True,
    Input_13_Name="VariableConductivityArray",
    Input_14_Hidden=False,
    Input_14_Name="Type",
    Input_15_Hidden=True,
    Input_15_Name="EmbodiedEnergy",
    Input_16_Hidden=True,
    Input_16_Name="EmbodiedCarbon",
    Input_17_Hidden=True,
    Input_17_Name="Cost",
    Input_18_Hidden=True,
    Input_18_Name="Life",
    Input_1_Hidden=False,
    Input_1_Name="Conductivity",
    Input_2_Hidden=False,
    Input_2_Name="Density",
    Input_3_Hidden=False,
    Input_3_Name="Roughness",
    Input_4_Hidden=False,
    Input_4_Name="SpecificHeat",
    Input_5_Hidden=False,
    Input_5_Name="ThermalAbsorptance"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)
material_4 = ConstructCSOpaqueMaterial(
    Name="Carpet",
    Conductivity=0.6,
    Density=288,
    Roughness="Rough",
    SpecificHeat=1380,
    ThermalAbsorptance=0.9,
    SolarAbsorptance=0.7,
    VisibleAbsorptance=0.7,
    Type="Finishes",
    Input_0_Hidden=False,
    Input_0_Name="Name",
    Input_10_Hidden=True,
    Input_10_Name="TemperatureCoefficientThermalConductivity",
    Input_11_Hidden=True,
    Input_11_Name="TemperatureArray",
    Input_12_Hidden=True,
    Input_12_Name="EnthalpyArray",
    Input_13_Hidden=True,
    Input_13_Name="VariableConductivityArray",
    Input_14_Hidden=False,
    Input_14_Name="Type",
    Input_15_Hidden=True,
    Input_15_Name="EmbodiedEnergy",
    Input_16_Hidden=True,
    Input_16_Name="EmbodiedCarbon",
    Input_17_Hidden=True,
    Input_17_Name="Cost",
    Input_18_Hidden=True,
    Input_18_Name="Life",
    Input_1_Hidden=False,
    Input_1_Name="Conductivity",
    Input_2_Hidden=False,
    Input_2_Name="Density",
    Input_3_Hidden=False,
    Input_3_Name="Roughness",
    Input_4_Hidden=False,
    Input_4_Name="SpecificHeat",
    Input_5_Hidden=False,
    Input_5_Name="ThermalAbsorptance"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)
material_5 = ConstructCSOpaqueMaterial(
    Name="Mineral Wool",
    Conductivity=multiplication_6,
    Density=155,
    Roughness="Rough",
    SpecificHeat=1130,
    ThermalAbsorptance=0.9,
    SolarAbsorptance=0.7,
    VisibleAbsorptance=0.7,
    Type="Sealing",
    Input_0_Hidden=False,
    Input_0_Name="Name",
    Input_10_Hidden=True,
    Input_10_Name="TemperatureCoefficientThermalConductivity",
    Input_11_Hidden=True,
    Input_11_Name="TemperatureArray",
    Input_12_Hidden=True,
    Input_12_Name="EnthalpyArray",
    Input_13_Hidden=True,
    Input_13_Name="VariableConductivityArray",
    Input_14_Hidden=False,
    Input_14_Name="Type",
    Input_15_Hidden=True,
    Input_15_Name="EmbodiedEnergy",
    Input_16_Hidden=True,
    Input_16_Name="EmbodiedCarbon",
    Input_17_Hidden=True,
    Input_17_Name="Cost",
    Input_18_Hidden=True,
    Input_18_Name="Life",
    Input_1_Hidden=False,
    Input_1_Name="Conductivity",
    Input_2_Hidden=False,
    Input_2_Name="Density",
    Input_3_Hidden=False,
    Input_3_Name="Roughness",
    Input_4_Hidden=False,
    Input_4_Name="SpecificHeat",
    Input_5_Hidden=False,
    Input_5_Name="ThermalAbsorptance"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)
material_6 = ConstructCSOpaqueMaterial(
    Name="WallConcrete",
    Conductivity=2,
    Density=2400,
    Roughness="Rough",
    SpecificHeat=950,
    ThermalAbsorptance=0.9,
    SolarAbsorptance=0.7,
    VisibleAbsorptance=0.7,
    Type="Concrete",
    Input_0_Hidden=False,
    Input_0_Name="Name",
    Input_10_Hidden=True,
    Input_10_Name="TemperatureCoefficientThermalConductivity",
    Input_11_Hidden=True,
    Input_11_Name="TemperatureArray",
    Input_12_Hidden=True,
    Input_12_Name="EnthalpyArray",
    Input_13_Hidden=True,
    Input_13_Name="VariableConductivityArray",
    Input_14_Hidden=False,
    Input_14_Name="Type",
    Input_15_Hidden=True,
    Input_15_Name="EmbodiedEnergy",
    Input_16_Hidden=True,
    Input_16_Name="EmbodiedCarbon",
    Input_17_Hidden=True,
    Input_17_Name="Cost",
    Input_18_Hidden=True,
    Input_18_Name="Life",
    Input_1_Hidden=False,
    Input_1_Name="Conductivity",
    Input_2_Hidden=False,
    Input_2_Name="Density",
    Input_3_Hidden=False,
    Input_3_Name="Roughness",
    Input_4_Hidden=False,
    Input_4_Name="SpecificHeat",
    Input_5_Hidden=False,
    Input_5_Name="ThermalAbsorptance"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)
material_7 = ConstructCSOpaqueMaterial(
    Name="Felt",
    Conductivity=0.9,
    Density=0.5,
    Roughness="Rough",
    SpecificHeat=1800,
    ThermalAbsorptance=0.9,
    SolarAbsorptance=0.7,
    VisibleAbsorptance=0.7,
    Type="Sealing",
    Input_0_Hidden=False,
    Input_0_Name="Name",
    Input_10_Hidden=True,
    Input_10_Name="TemperatureCoefficientThermalConductivity",
    Input_11_Hidden=True,
    Input_11_Name="TemperatureArray",
    Input_12_Hidden=True,
    Input_12_Name="EnthalpyArray",
    Input_13_Hidden=True,
    Input_13_Name="VariableConductivityArray",
    Input_14_Hidden=False,
    Input_14_Name="Type",
    Input_15_Hidden=True,
    Input_15_Name="EmbodiedEnergy",
    Input_16_Hidden=True,
    Input_16_Name="EmbodiedCarbon",
    Input_17_Hidden=True,
    Input_17_Name="Cost",
    Input_18_Hidden=True,
    Input_18_Name="Life",
    Input_1_Hidden=False,
    Input_1_Name="Conductivity",
    Input_2_Hidden=False,
    Input_2_Name="Density",
    Input_3_Hidden=False,
    Input_3_Name="Roughness",
    Input_4_Hidden=False,
    Input_4_Name="SpecificHeat",
    Input_5_Hidden=False,
    Input_5_Name="ThermalAbsorptance"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)
material_8 = ConstructCSOpaqueMaterial(
    Name="Concrete",
    Conductivity=2,
    Density=2100,
    Roughness="Rough",
    SpecificHeat=1040,
    ThermalAbsorptance=0.9,
    SolarAbsorptance=0.7,
    VisibleAbsorptance=0.7,
    Type="Concrete",
    Input_0_Hidden=False,
    Input_0_Name="Name",
    Input_10_Hidden=True,
    Input_10_Name="TemperatureCoefficientThermalConductivity",
    Input_11_Hidden=True,
    Input_11_Name="TemperatureArray",
    Input_12_Hidden=True,
    Input_12_Name="EnthalpyArray",
    Input_13_Hidden=True,
    Input_13_Name="VariableConductivityArray",
    Input_14_Hidden=False,
    Input_14_Name="Type",
    Input_15_Hidden=True,
    Input_15_Name="EmbodiedEnergy",
    Input_16_Hidden=True,
    Input_16_Name="EmbodiedCarbon",
    Input_17_Hidden=True,
    Input_17_Name="Cost",
    Input_18_Hidden=True,
    Input_18_Name="Life",
    Input_1_Hidden=False,
    Input_1_Name="Conductivity",
    Input_2_Hidden=False,
    Input_2_Name="Density",
    Input_3_Hidden=False,
    Input_3_Name="Roughness",
    Input_4_Hidden=False,
    Input_4_Name="SpecificHeat",
    Input_5_Hidden=False,
    Input_5_Name="ThermalAbsorptance"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)
material_9 = ConstructCSOpaqueMaterial(
    Name="AcousticTile",
    Conductivity=0.06,
    Density=368,
    Roughness="Rough",
    SpecificHeat=590,
    ThermalAbsorptance=0.9,
    SolarAbsorptance=0.7,
    VisibleAbsorptance=0.7,
    Type="Finishes",
    Input_0_Hidden=False,
    Input_0_Name="Name",
    Input_10_Hidden=True,
    Input_10_Name="TemperatureCoefficientThermalConductivity",
    Input_11_Hidden=True,
    Input_11_Name="TemperatureArray",
    Input_12_Hidden=True,
    Input_12_Name="EnthalpyArray",
    Input_13_Hidden=True,
    Input_13_Name="VariableConductivityArray",
    Input_14_Hidden=False,
    Input_14_Name="Type",
    Input_15_Hidden=True,
    Input_15_Name="EmbodiedEnergy",
    Input_16_Hidden=True,
    Input_16_Name="EmbodiedCarbon",
    Input_17_Hidden=True,
    Input_17_Name="Cost",
    Input_18_Hidden=True,
    Input_18_Name="Life",
    Input_1_Hidden=False,
    Input_1_Name="Conductivity",
    Input_2_Hidden=False,
    Input_2_Name="Density",
    Input_3_Hidden=False,
    Input_3_Name="Roughness",
    Input_4_Hidden=False,
    Input_4_Name="SpecificHeat",
    Input_5_Hidden=False,
    Input_5_Name="ThermalAbsorptance"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)
material_10 = ConstructCSOpaqueMaterial(
    Name="XPS",
    Conductivity=xps_con,
    Density=35,
    Roughness="Rough",
    SpecificHeat=1400,
    ThermalAbsorptance=0.9,
    SolarAbsorptance=0.7,
    VisibleAbsorptance=0.7,
    Type="Insulation",
    Input_0_Hidden=False,
    Input_0_Name="Name",
    Input_10_Hidden=True,
    Input_10_Name="TemperatureCoefficientThermalConductivity",
    Input_11_Hidden=True,
    Input_11_Name="TemperatureArray",
    Input_12_Hidden=True,
    Input_12_Name="EnthalpyArray",
    Input_13_Hidden=True,
    Input_13_Name="VariableConductivityArray",
    Input_14_Hidden=False,
    Input_14_Name="Type",
    Input_15_Hidden=True,
    Input_15_Name="EmbodiedEnergy",
    Input_16_Hidden=True,
    Input_16_Name="EmbodiedCarbon",
    Input_17_Hidden=True,
    Input_17_Name="Cost",
    Input_18_Hidden=True,
    Input_18_Name="Life",
    Input_1_Hidden=False,
    Input_1_Name="Conductivity",
    Input_2_Hidden=False,
    Input_2_Name="Density",
    Input_3_Hidden=False,
    Input_3_Name="Roughness",
    Input_4_Hidden=False,
    Input_4_Name="SpecificHeat",
    Input_5_Hidden=False,
    Input_5_Name="ThermalAbsorptance"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)

# ---- group: WallInsul
layer = ConstructCSLayer(Material=material_3, Thickness="0.013")

# ---- group: WallConcrete
layer_2 = ConstructCSLayer(Material=material_6, Thickness=item_19)

# ---- group: WallInsul
layer_3 = ConstructCSLayer(Material=material_5, Thickness=item_17)

layer_4 = ConstructCSLayer(Material=material_2, Thickness="0.025")

# ---- group: RoofFelt
layer_5 = ConstructCSLayer(Material=material_7, Thickness="0.003")

# ---- group: RoofConcrete
layer_6 = ConstructCSLayer(Material=material_8, Thickness=item_18)

# ---- group: RoofTile
layer_7 = ConstructCSLayer(Material=material_9, Thickness="0.005")

# ---- group: RoofXPS
layer_8 = ConstructCSLayer(Material=material_10, Thickness=item_15)

# ---- group: GroundCarpet
layer_9 = ConstructCSLayer(Material=material, Thickness="0.013")

# ---- group: GroundConcrete
layer_10 = ConstructCSLayer(Material=material_6, Thickness="0.203")

# ---- group: GroundCarpet
layer_11 = ConstructCSLayer(Material=material_4, Thickness="0.02")

# ---- group: GroundXPS
layer_12 = ConstructCSLayer(Material=material_10, Thickness=item_16)

# ----
relay = Relay([layer_8, layer_6, layer_7, layer_5])
panel_14 = Panel(relay)
mats = Data([material_10, material_8, material_9, material_7, material_6, material_5, material_3, material_2, material_4, material])

dup = DuplicateData(Data=layer_9, Number=2, Order=True)
construction = ConstructCSConstruction(
    Name="CustomExteriorRoof",
    Category="Roof",
    Layers=flatten(relay),
    Input_0_Hidden=False,
    Input_0_Name="Name",
    Input_1_Hidden=False,
    Input_1_Name="Category",
    Input_2_Hidden=False,
    Input_2_Name="Layers",
    Input_3_Hidden=True,
    Input_3_Name="EmbodiedEnergy",
    Input_4_Hidden=True,
    Input_4_Name="EmbodiedCarbon",
    Input_5_Hidden=True,
    Input_5_Name="Cost",
    Input_6_Hidden=True,
    Input_6_Name="Life",
    UnitSystem=4,
    Input_3_GHParam_Branch0_Path="{0}",
    Input_3_GHParam_Branch0_Item0_number=0,
    Input_4_GHParam_Branch0_Path="{0}",
    Input_4_GHParam_Branch0_Item0_number=0,
    Input_5_GHParam_Branch0_Path="{0}",
    Input_5_GHParam_Branch0_Item0_number=0,
    Input_6_GHParam_Branch0_Path="{0}",
    Input_6_GHParam_Branch0_Item0_number=10)  # -> Construction, ConstructionInformation
construction_2 = ConstructCSConstruction(
    Name="CustomGroundSlab",
    Category="GroundFloor",
    Layers=flatten([layer_12, layer_10, layer_11]),
    Input_0_Hidden=False,
    Input_0_Name="Name",
    Input_1_Hidden=False,
    Input_1_Name="Category",
    Input_2_Hidden=False,
    Input_2_Name="Layers",
    Input_3_Hidden=True,
    Input_3_Name="EmbodiedEnergy",
    Input_4_Hidden=True,
    Input_4_Name="EmbodiedCarbon",
    Input_5_Hidden=True,
    Input_5_Name="Cost",
    Input_6_Hidden=True,
    Input_6_Name="Life",
    UnitSystem=4,
    Input_3_GHParam_Branch0_Path="{0}",
    Input_3_GHParam_Branch0_Item0_number=0,
    Input_4_GHParam_Branch0_Path="{0}",
    Input_4_GHParam_Branch0_Item0_number=0,
    Input_5_GHParam_Branch0_Path="{0}",
    Input_5_GHParam_Branch0_Item0_number=0,
    Input_6_GHParam_Branch0_Path="{0}",
    Input_6_GHParam_Branch0_Item0_number=10)  # -> Construction, ConstructionInformation
construction_3 = ConstructCSConstruction(
    Name="CustomInteriorPartition",
    Category="Facade",
    Layers=flatten(dup),
    Input_0_Hidden=False,
    Input_0_Name="Name",
    Input_1_Hidden=False,
    Input_1_Name="Category",
    Input_2_Hidden=False,
    Input_2_Name="Layers",
    Input_3_Hidden=True,
    Input_3_Name="EmbodiedEnergy",
    Input_4_Hidden=True,
    Input_4_Name="EmbodiedCarbon",
    Input_5_Hidden=True,
    Input_5_Name="Cost",
    Input_6_Hidden=True,
    Input_6_Name="Life",
    UnitSystem=4,
    Input_3_GHParam_Branch0_Path="{0}",
    Input_3_GHParam_Branch0_Item0_number=0,
    Input_4_GHParam_Branch0_Path="{0}",
    Input_4_GHParam_Branch0_Item0_number=0,
    Input_5_GHParam_Branch0_Path="{0}",
    Input_5_GHParam_Branch0_Item0_number=0,
    Input_6_GHParam_Branch0_Path="{0}",
    Input_6_GHParam_Branch0_Item0_number=10)  # -> Construction, ConstructionInformation
construction_4 = ConstructCSConstruction(
    Name="CustomExteriorWall",
    Category="Roof",
    Layers=flatten([layer_2, layer_3, layer, layer_4]),
    Input_0_Hidden=False,
    Input_0_Name="Name",
    Input_1_Hidden=False,
    Input_1_Name="Category",
    Input_2_Hidden=False,
    Input_2_Name="Layers",
    Input_3_Hidden=True,
    Input_3_Name="EmbodiedEnergy",
    Input_4_Hidden=True,
    Input_4_Name="EmbodiedCarbon",
    Input_5_Hidden=True,
    Input_5_Name="Cost",
    Input_6_Hidden=True,
    Input_6_Name="Life",
    UnitSystem=4,
    Input_3_GHParam_Branch0_Path="{0}",
    Input_3_GHParam_Branch0_Item0_number=0,
    Input_4_GHParam_Branch0_Path="{0}",
    Input_4_GHParam_Branch0_Item0_number=0,
    Input_5_GHParam_Branch0_Path="{0}",
    Input_5_GHParam_Branch0_Item0_number=0,
    Input_6_GHParam_Branch0_Path="{0}",
    Input_6_GHParam_Branch0_Item0_number=10)  # -> Construction, ConstructionInformation
python_11 = GhPythonScript(x=construction_2.ConstructionInformation)  # -> Rval, mass
# ---------- python_11: Python ----------
__author__ = "zoelh"
__version__ = "2023.11.21"

import rhinoscriptsyntax as rs
import re

Rval = None

s = re.sub(r'[^\w.\n]+', ' ', x)
s=s.replace(" ", '')
print(s)
Rval = float(s.split("RValuemKW")[1].split("\n")[0])
mass = float(s.split("CapacitancekJKm")[1].split("\n")[0])
print(Rval)
print(mass)
# ---------- end python_11 ----------

# ---- group: ROOF CONSTRUCTION
panel_15 = Panel(construction.ConstructionInformation)
exteriorroof = Data(construction.Construction)

# ---- group: SLAB CONSTRUCTION
panel_16 = Panel(construction_2.ConstructionInformation)
slab = Data(construction_2.Construction)

# ---- group: FACADE CONSTRUCTION
panel_17 = Panel(construction_4.ConstructionInformation)
exteriorwall = Data(construction_4.Construction)

# ---- group: PARTITION CONSTRUCTION
panel_18 = Panel(construction_3.ConstructionInformation)
partition_5 = Data(construction_3.Construction)

# ----
zset = CSZoneSettings(
    Name="ParametricZoneSettings",
    ZoneSettings=item_36,
    RoofConstruction=exteriorroof,
    FacadeConstruction=exteriorwall,
    SlabConstruction=slab,
    PartitionConstruction=partition_5,
    ExternalFloorConstruction=slab,
    InternalMassConstruction=partition_5,
    InternalMassExposedArea=Slider(0, range=0..1),
    GroundSlabConstruction=slab,
    PeopleDensity=item_6,
    AirspeedSchedule="AirSpeed 0",
    EquipmentPowerDensity=item_4,
    LightingPowerDensity=item_5,
    OccupancySchedule=year_schedule_2.Sched,
    EquipmentAvailabilitySchedule=year_schedule_3.Sched,
    LightsAvailabilitySchedule=year_schedule.Sched,
    DimmingType=dimmingtype,
    PeopleIsOn=people_equip_lightson,
    EquipmentIsOn=people_equip_lightson,
    LightsIsOn=people_equip_lightson,
    CoolingCOP=Slider(1, range=0.6..6),
    HeatingCOP=Slider(1, range=0.6..6),
    HeatingSetpoint=item_2,
    CoolingSetpoint=item_3,
    HeatingSetpointConstant=heating_coolingconstant,
    CoolingSetpointConstant=heating_coolingconstant,
    HeatingSetpointSchedule="S21 B18 8to18",
    CoolingSetpointSchedule="S25 B30 8to18",
    HeatIsOn=heating_coolingon,
    CoolIsOn=heating_coolingon,
    MechVentIsOn=mechventon,
    HumidistatIsOn=humidistaton,
    HeatingLimitType="NoLimit",
    CoolingLimitType="LimitFlowRateAndCapacity",
    MaxHeatingCapacity=100,
    MaxCoolingCapacity=100,
    MaxHeatFlow=100,
    MaxCoolFlow=100,
    HeatingSchedule="AllOn",
    CoolingSchedule="AllOn",
    MechVentSchedule=occupancy,
    MinFreshAirPerson=multiplication_14,
    MinFreshAirArea=multiplication_13,
    EconomizerType=python_2,
    HeatRecoveryType=python_3,
    HeatRecoveryEfficiencySensible="0.7",
    HeatRecoveryEfficiencyLatent="0.65",
    MinHumidity="20",
    MaxHumidity="80",
    TurnOnEMSFanEnergy=fanenergy,
    FanPressureRise=1000,
    MaxHeatSupplyAirTemp="30",
    MinCoolSupplyAirTemp="18",
    HeatingSizingFactor=1.2,
    CoolingSizingFactore=1.2,
    NatVentIsOn=natventon,
    SchedVentIsOn=scheduledventilationon,
    ScheduledVentilationAvailability="Off",
    NaturalVentilationSchedule="Off",
    StackDrivenFlow=scheduledventilationon_2,
    Crossventilation=scheduledventilationon_2,
    InfiltrationIsOn=infiltrationon,
    InfiltrationAch=infiltration_ach,
    InfiltrationFlowExtArea=item_9,
    InfiltrationCalculationMethod=infiltrationmethod,
    AFNAirMassFlowCoefficientCrack=0.001,
    FlowRatePerPerson="0",
    DHWOn=dhwon,
    Input_0_Hidden=False,
    Input_0_Name="Name",
    Input_100_Hidden=True,
    Input_100_Name="Interior Vertical Insulation Depth",
    Input_101_Hidden=True,
    Input_101_Name="Exterior Horizontal Insulation Depth",
    Input_102_Hidden=True,
    Input_102_Name="Exterior Horizontal Insulation Width",
    Input_103_Hidden=True,
    Input_103_Name="Footing Thickness",
    Input_104_Hidden=True,
    Input_104_Name="Footing Depth",
    Input_105_Hidden=True,
    Input_105_Name="ElectricityCO2",
    Input_106_Hidden=True,
    Input_106_Name="ElectricityCost",
    Input_107_Hidden=True,
    Input_107_Name="HotWaterCO2",
    Input_108_Hidden=True,
    Input_108_Name="HotWaterCost",
    Input_109_Hidden=True,
    Input_109_Name="CoolingCO2",
    Input_10_Hidden=True,
    Input_10_Name="Ground Wall Construction",
    Input_110_Hidden=True,
    Input_110_Name="HeatingCO2",
    Input_111_Hidden=True,
    Input_111_Name="CoolingCost",
    Input_112_Hidden=True,
    Input_112_Name="HeatingCost"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)
library = CSLibrary(AddObjects=flatten([year_schedule_3.Sched, year_schedule.Sched, year_schedule_2.Sched, simple_window, exteriorroof, exteriorwall, slab, partition_5, mats]))
python_12 = GhPythonScript(x=construction.ConstructionInformation)  # -> Rval, mass; same code as python_11
python_13 = GhPythonScript(x=construction_4.ConstructionInformation)  # -> Rval, mass; same code as python_11

# ----
# Save building settings
expression_5 = Expression(x=filename, Expression="Format(\"{0}_geomdef.json\", x)")
dejson = DeserializeJson(JSON=zset, OutputsLocked=False)  # -> Constructions, Loads, Conditioning, HotWater, NaturalVentilation, Foundation, Infiltration, CostEmissions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
panel_19 = Panel(expression_5)
expression_6 = Expression(x=expression, Expression="Format(\"{0}_templates.json\", x)")
panel_20 = Panel(expression_6)

python_14 = GhPythonScript(
    f2f_height=item_25,
    sb_w=item_26,
    pd=item_27,
    cd=item_28,
    wwr=item_29,
    uval=item_11,
    shgc=item_10,
    sched=item_14,
    RoofRval=python_12.Rval,
    RoofMass=python_12.mass,
    WallRval=python_13.Rval,
    WallMass=python_13.mass,
    SlabRval=python_11.Rval,
    econ=item_12,
    hrv=item_13,
    Conditioning=dejson.Conditioning,
    Loads=dejson.Loads,
    Infiltration=dejson.Infiltration)  # -> sb_dict
# ---------- python_14: Python ----------
__author__ = "zoelh"
__version__ = "2023.11.18"

import rhinoscriptsyntax as rs
import json
d = {}

d=ShoeboxConfig = dict(
    width=float(sb_w),
    height=float(f2f_height),
    perim_depth=float(pd),
    core_depth=float(cd),
    wwr = float(wwr),
    cop_heating= 1,
    cop_cooling= 1,
    HeatingSetpoint=float(Conditioning["HeatingSetpoint"]),
    CoolingSetpoint=float(Conditioning["CoolingSetpoint"]),
    LightingPowerDensity=float(Loads["LightingPowerDensity"]),
    EquipmentPowerDensity=float(Loads["EquipmentPowerDensity"]),
    PeopleDensity=float(Loads["PeopleDensity"]),
    Infiltration=float(Infiltration["InfiltrationFlowPerExteriorSurfaceArea"]),
    VentilationPerArea=float(Conditioning["MinFreshAirArea"]) / 1000,
    VentilationPerPerson=float(Conditioning["MinFreshAirPerson"]) / 1000,
    VentilationMode = 2,
    FacadeMass = float(WallMass),
    RoofMass = float(RoofMass),
    FacadeRValue = float(WallRval),
    RoofRValue = float(RoofRval),
    SlabRValue = float(SlabRval),
    WindowUValue = float(uval),
    WindowShgc = float(shgc),
    EconomizerSettings=int(econ),
    RecoverySettings=int(hrv),
    template_idx=int(sched),
)

#for i, id in enumerate(ids):
#    id = int(id)
#    d[id]=dict(ShoeboxConfig = dict(
#        FacadeMass = float(WallMass[i]),
#        RoofMass = float(RoofMass[i]),
#        FacadeRValue = float(WallRval[i]),
#        RoofRValue = float(RoofRval[i]),
#        SlabRValue = float(SlabRval[i]),
#        WindowUValue = float(uval[i]),
#        WindowShgc = float(shgc[i]),
#        wwr = float(wwr[i]),
#        template_idx=int(sched[i]),
#        width=float(sb_w),
#        height=float(f2f_height[i]),
#        perim_depth=float(pd[i]),
#        core_depth=float(cd[i])
#    ))

sb_dict = json.dumps(d)
# ---------- end python_14 ----------

pln = Plane(points)
pi = Pi(Factor="-1")
number_slider_5 = Slider(110, range=0..150)
prot = RotatePlane(Plane=pln, Angle=angle.OrientationsRads)
dom = ConstructDomain(DomainStart=0, DomainEnd=pi)
arc = Arc(Plane=prot, Radius=number_slider_5, Angle=dom)  # -> Arc, Length
area_13 = Area(Geometry=item_30)  # -> Area, Centroid
multiplication_24 = Multiplication(A=Slider(12, range=0..100), B=4)
circle = CircleCNR(Center=area_13.Centroid, Normal=Vector(0, 0, 1), Radius=number_slider_5)
divide = DivideCurve(Curve=circle, Count=multiplication_24, Kinks=False)  # -> Points, Tangents, Parameters
shift = ShiftList(List=divide.Points, Shift=1, Wrap=True)
dom_2 = ConstructDomain(DomainStart=0, DomainEnd=Slider(100, range=0..100))
ln_2 = Line(StartPoint=divide.Points, EndPoint=shift)

lng_6 = ListLength(List=circle)
multiplication_25 = Multiplication(A=lng_6, B=multiplication_24)

random_29 = Random(Range=dom_2, Number=multiplication_25, Seed=number_slider_3)
Z_10 = UnitZ(Factor=random_29)
extr_4 = Extrude(Base=ln_2, Direction=Z_10)  # -> simplify(Extrusion)

branch_8 = TreeBranch(Tree=simplify(extr_4), Path=number_slider, MaintainPaths=True)

# ----
# Simplify shading context for energy simulations
list_2 = ValueList({"Mask": 0, "Horizon": 1, "Visible Surfs": 2}, selected="Horizon")
shading_mask = ShadingMask(
    Pt=graft(points),
    Dir=graft(normals),
    Radius=number_slider_5,
    HAng=5,
    VAng=5,
    Scene=extr_4,
    Full=Toggle(False),
    Mode=list_2)
preview_6 = CustomPreview(Geometry=shading_mask, Material=ColourSwatch(SwatchColor=RGB(0, 0, 0)))

# ----
# Model Setup
window_settings = Data(wset)
zone_settings = Data(zset)
zone = CSEnergyZone(
    Brep=flatten(branch_7),
    Name=flatten(branch),
    Settings=zone_settings,
    UsedLibraryObjects="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")  # -> Zones, Settings
zone_2 = CSEnergyZone(
    Brep=flatten(branch_6),
    Name=flatten(branch_2),
    Settings=zone_settings,
    UsedLibraryObjects="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")  # -> Zones, Settings
bco = CSBoundaryObject(Brep=item_31, type="GROUND")
window = CSWindow(Surface=branch_5, Settings=window_settings, UsedLibraryObjects="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")  # -> Window, Settings
expression_7 = Expression(x=expression, Expression="Format(\"{0}_Autozoner\", x)")
panel_21 = Panel(expression_7)
model = CSModelMaker(
    Zones=flatten([zone.Zones, zone_2.Zones]),
    Windows=flatten(window.Window),
    Boundaries=bco,
    Shading=flatten(branch_8),
    Library=library)  # -> Model, Invalid
run_e = RunCSEnergyModel(
    Model=model.Model,
    Name=panel_21,
    Directory=output_directory,
    Location=path,
    Run=run_eplus,
    NorthOffset=0,
    settings="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")  # -> Model, Settings, Result

panel_22 = Panel(zone_2.Zones)
shading_heights = Data(random_29)

python_15 = GhPythonScript(
    ids=python.a,
    edge_lengths=simplify(len_4),
    edge_weights=simplify(edge_weights),
    orientations=simplify(orientation_radians),
    total_areas=multiplication_23,
    bldg_core_areas=simplify(area_8.Area),
    bldg_perim_areas=simplify(area_7.Area),
    perim_depths=simplify(perim_depths),
    core_depths=core_depths,
    footprint_areas=footprint_areas,
    wwrs=wwr,
    n_floors=floors,
    f2f_heights=floor_to_floor_height,
    normals=simplify(vec2pt_4.Vector),
    shading=simplify(shading_heights),
    fname=panel_19,
    outpath=output_directory,
    save=Button())  # -> out, output_data; inputs ids: list, edge_lengths: tree, edge_weights: tree, orientations: tree, total_areas: list, bldg_core_areas: tree, bldg_perim_areas: tree, perim_depths: list, core_depths: list, footprint_areas: list, wwrs: list, n_floors: list of Int32, f2f_heights: list, normals: tree of Vector3d, shading: tree
# ---------- python_15: Python ----------
__author__ = "szvsw"
__version__ = "2023.11.15"

import rhinoscriptsyntax as rs
import ghpythonlib.treehelpers as th
import json

output_data = {}

perima_idx = 0
for b, id in enumerate(ids):
    bldg_data = {
        "building_area": float(total_areas[b]),
        "perim_depth": float(perim_depths[b]),
        "core_depth": float(core_depths[b]),
        "footprint_area": float(footprint_areas[b]),
        "wwr": float(wwrs[b]),
        "heights": float(f2f_heights[b]),
        "n_floors": int(n_floors[b]),
        "perims": [],
        "cores": [],
        "shading": []
    }
    core_dict = {}
    perim_dict = {}
    
    for f in range(n_floors[b]):
        core_dict["core_floor_"+str(f)+"_n_1"] = {
            "core_area": bldg_core_areas.Branch(b)[f],
            "floor": f
        }
#    bldg_data["cores"].append(core_dict)
    bldg_data["cores"] = core_dict
    
    for i in range(4):
        pas = bldg_perim_areas.Branch(perima_idx+i)
        for f, area in enumerate(pas):
            perim_dict["perim_floor_"+str(f)+"_n_"+str(i)] = {
                "perim_area": area,
                "facade_length": float(edge_lengths.Branch(b)[i]),
                "orientation": float(orientations.Branch(b)[i]),
                "facade_normal": tuple([normals.Branch(b)[i][j] for j in range(3)]),
                "floor": f
            }
    perima_idx += 4
    bldg_data["perims"] = perim_dict

    shading_data = shading.Branch(i)
    bldg_data["shading"].extend([float(val) for val in shading_data])
    output_data[id] = bldg_data

print(json.dumps(output_data,indent=4))

if save:
    with open(str(outpath)+str(fname),"w") as f:
        json.dump(output_data,f,indent=4)


#output_data = {
#    "building_ids": [float(val) for val in ids],
#    "building_areas": [float(val) for val in total_areas],
#    "building_core_areas": [float(val) for val in bldg_core_areas],
#    "building_perim_areas": [float(val) for val in bldg_perim_areas],
#    "perim_depths": [float(val) for val in perim_depths],
#    "core_depths": [float(val) for val in core_depths],
#    "footprint_areas": [float(val) for val in footprint_areas],
#    "wwrs": [float(val) for val in wwrs],
#    "heights": [float(val) for val in f2f_heights],
#    "n_floors": [int(val) for val in n_floors],
#    "perims": []
#    "orientations": [],
#    "edge_weights": [],
#    "edge_lengths": [],
#    "normals": [],
#    "shading": []
#}
#
#for i in range(len(perim_depths)):
#    orientation_data = orientations.Branch(i)
#    output_data["orientations"].append([float(val) for val in orientation_data])
#    edge_weight_data = edge_weights.Branch(i)
#    output_data["edge_weights"].append([float(val) for val in edge_weight_data])
#    edge_length_data = edge_lengths.Branch(i)
#    output_data["edge_lengths"].append([float(val) for val in edge_length_data])
#    normal_data = normals.Branch(i)
#    output_data["normals"].append([val[0] for val in normal_data])
#    shading_data = shading.Branch(i)
#    output_data["shading"].append([float(val) for val in shading_data])

#################

#output_data = {
#    "building_ids": [float(val) for val in ids],
#    "building_areas": [float(val) for val in total_areas],
#    "perim_depths": [float(val) for val in perim_depths],
#    "core_depths": [float(val) for val in core_depths],
#    "footprint_areas": [float(val) for val in footprint_areas],
#    "wwrs": [float(val) for val in wwrs],
#    "heights": [float(val) for val in f2f_heights],
#    "n_floors": [int(val) for val in n_floors],
#    "perims": [],
#    "cores": [],
#    "shading": []
#}
#
#
#for b, id in enumerate(ids):
#    core_dict = {}
#    n_floors = len(bldg_core_areas.Branch(b))
#    for f in range(n_floors):
#        core_dict["core_floor_"+str(f)+"_n_1"] = {"area": bldg_core_areas.Branch(b)[f]} 
#    output_data["cores"].append({id:core_dict})
#
#for b, id in enumerate(ids):
##    print("Building", b)
#    perim_dict = {}
#    for i in range(4):
#        pas = bldg_perim_areas.Branch((b+1)*i)
#        for f, area in enumerate(pas):
#            perim_dict["perim_floor_"+str(f)+"_n_"+str(i)] = {
#                "area": area,
#                "facade_l": float(edge_lengths.Branch(b)[i]),
#                "facade_orientation": float(orientations.Branch(b)[i]),
#                "facade_normal": tuple([normals.Branch(b)[i][j] for j in range(3)]),
#            }
#    output_data["perims"].append({id:perim_dict})
#
#for i in range(len(perim_depths)):
#    shading_data = shading.Branch(i)
#    output_data["shading"].append([float(val) for val in shading_data])
#
#print(json.dumps(output_data,indent=4))
# ---------- end python_15 ----------
panel_23 = Panel(python_14)
panel_24 = Panel(python_15.out)
python_16 = GhPythonScript(set=python_14, name=panel_20, dir=output_directory, save=falsestart)
# ---------- python_16: Python ----------
__author__ = "zoelh"
__version__ = "2023.11.18"

import rhinoscriptsyntax as rs
import json

if save:
    fname = dir + name
    print(fname)
    with open(fname, "w") as f:
        json.dump(json.loads(set), f, indent=4)
# ---------- end python_16 ----------

area_14 = Area(Geometry=extr_4)  # -> Area, Centroid; disabled
pdecon = Deconstruct(Point=area_14.Centroid)  # -> XComponent, YComponent, ZComponent; disabled
pt = ConstructPoint(XCoordinate=pdecon.XComponent, YCoordinate=pdecon.YComponent, ZCoordinate=shading_heights)  # -> simplify(Point); disabled
pt_2 = ConstructPoint(XCoordinate=pdecon.XComponent, YCoordinate=pdecon.YComponent, ZCoordinate=0)  # -> simplify(Point); disabled
python_17 = GhPythonScript(shd_pts=pt, base_pts=facade_centroids, norms=facade_normals)  # -> out, a, check, lengths; inputs shd_pts: list of Point3d, base_pts: list of Point3d, norms: list of Vector3d; disabled
# ---------- python_17: Python ----------
__author__ = "zoelh"
__version__ = "2024.01.03"

import rhinoscriptsyntax as rs
import scriptcontext as sc
import math
import ghpythonlib.treehelpers as th

def dot(v1, v2):
    return sum(x*y for x, y in zip(v1, v2))
    
def norm(p):
    return math.sqrt(sum(x**2 for x in p))
    
def azimuth(p1, p2s):
    return [math.acos(dot(p1, p2) / norm(p1) / norm(p2)) for p2 in p2s]

# Check if centroids and points are same length
assert len(base_pts) == len(norms)

heights = [x.Z for x in shd_pts]

norms_flat = [(x.X, x.Y) for x in norms]
shd_vect_flat = []
for p in base_pts:
    shd_vect_flat.append([(x.X-p.X, x.Y-p.Y) for x in shd_pts])

azims = [azimuth(x, y) for x, y in zip(norms_flat, shd_vect_flat)]

a = []
check = []
lengths = []
for i, azim_set in enumerate(azims):
    alpha = []
    for j, azim in enumerate(azim_set):
        if azim < 1.57: #90 degrees
            dist = norm(shd_pts[j]-base_pts[i])
            alpha.append(math.asin(heights[j] / dist))
            check.append(rs.AddLine(base_pts[i], shd_pts[j]))
#    check.extend(alpha)
    lengths.append(len(alpha))
    print(len(alpha))
    a.append(alpha)
print(len(a))

a = [str(x) for x in a]
# ---------- end python_17 ----------
angle_2 = Angle(VectorA=graft(facade_normals), VectorB=pt_2, Plane=xy_2)  # -> Angle, Reflex; disabled
angle_3 = Angle(VectorA=pt, VectorB=pt_2)  # -> Angle, Reflex; disabled
python_18 = GhPythonScript(x=angle_2.Angle)  # -> a; disabled
# ---------- python_18: Python ----------
__author__ = "zoelh"
__version__ = "2024.01.03"

import rhinoscriptsyntax as rs

if x < 1.5708 or x > 4.71239:
    a = True
else:
    a = False
# ---------- end python_18 ----------
viewer = ParamViewer(python_17.check)  # disabled
branch_9 = TreeBranch(Tree=python_17.check, Path=panel_10, MaintainPaths=True)  # disabled
dispatch = Dispatch(List=pt, DispatchPattern=python_18)  # -> ListA, ListB; disabled
branch_10 = TreeBranch(Tree=dispatch.ListA, Path=panel_11, MaintainPaths=True)  # disabled
panel_25 = Panel(python_17.a)  # disabled
panel_26 = Panel(dispatch.ListA)  # disabled

# ==== cluster WinShdGen
zone_geometry = ClusterInput()
debrep = DeconstructBrep(ZoneGeometry=zone_geometry)  # -> Faces, Edges, Vertices
area = Area(Geometry=debrep.Faces)  # -> Area, Centroid
evalsrf = EvaluateSurface(Surface=debrep.Faces, Point=area.Centroid)  # -> Point, Normal, UDirection, VDirection, Frame
Z = UnitZ(Factor=1)
dprod = DotProduct(VectorA=evalsrf.Normal, VectorB=Z, Unitize=False)
wwr = ClusterInput()  # WWR (N,E,S,W)
abs = Absolute(Value=dprod)
smaller = SmallerThan(FirstNumber=abs, SecondNumber=".9")  # -> SmallerThan, OrEqualTo
dispatch = Dispatch(List=debrep.Faces, DispatchPattern=smaller.SmallerThan)  # -> ListA, ListB
srf = Surface(dispatch.ListA)
cluster = Cluster_2(srf=srf)
srf_2 = Surface(flatten(cluster))
item = ListItem(List=wwr, Index="0", Wrap=True)
item_2 = ListItem(List=wwr, Index="1", Wrap=True)
item_3 = ListItem(List=wwr, Index="2", Wrap=True)
item_4 = ListItem(List=wwr, Index="3", Wrap=True)
Y = UnitY(Factor=1)
X = UnitX(Factor=1)
Y_2 = UnitY(Factor="-1")
X_2 = UnitX(Factor="-1")
cluster_2 = Cluster(S=srf, dir=X, wwr=item_2)
cluster_3 = Cluster(S=srf, dir=Y_2, wwr=item_3)
cluster_4 = Cluster(S=srf, dir=X_2, wwr=item_4)
cluster_5 = Cluster(S=srf, dir=Y, wwr=item)
geo_n = Geometry(cluster_5)
geo_e = Geometry(cluster_2)
geo_s = Geometry(cluster_3)
geo_w = Geometry(cluster_4)
merge = Merge(Data1=geo_n, Data2=geo_e, Data3=geo_s, Data4=geo_w)
clean = CleanTree(RemoveNulls=True, RemoveInvalid=True, RemoveEmpty=False, Tree=merge)  # -> flatten(Tree)
T = ClusterOutput(clean)

# ==== cluster Cluster_3
floorheight = ClusterInput()
numfloors = ClusterInput()
xlen = ClusterInput()
ylen = ClusterInput()
offset = ClusterInput()

floorheight_2 = Number(floorheight)
numfloors_2 = Number(numfloors)
xlen_2 = Number(xlen)
ylen_2 = Number(ylen)
xy = XYPlane(Origin=Point(0, 0, 0))
Z = UnitZ(Factor=expr("x*0.5", floorheight_2))
footprintcurve = Rectangle(Plane=xy, XSize=xlen_2, YSize=ylen_2, Radius=0)  # -> FootprintBaseCurve, Length
Z_2 = UnitZ(Factor=floorheight_2)
move = Move(Geometry=xy, Motion=Z)  # -> Geometry, Transform
az = Autozoner(FloorPlanOutlines=footprintcurve.FootprintBaseCurve, Offset=offset)  # -> Outline, PerimeterPolylines, CorePolylines, SkeletonPolylines
box = CenterBox(Base=move.Geometry, X=xlen_2, Y=ylen_2, Z=expr("x*0.5", floorheight_2))
series = Series(Start=0, Step=floorheight_2, Count=numfloors_2)
pcol = PolylineCollapse(Polyline=az.PerimeterPolylines, Tolerance=1)  # -> Polyline, Count
pcol_2 = PolylineCollapse(Polyline=az.CorePolylines, Tolerance=1)  # -> Polyline, Count
floorzmove = UnitZ(Factor=series)
extr = Extrude(Base=pcol.Polyline, Direction=Z_2)
extr_2 = Extrude(Base=pcol_2.Polyline, Direction=Z_2)
cap = CapHoles(Brep=extr_2)
cap_2 = CapHoles(Brep=extr)  # -> graft(Brep)
move_2 = Move(Geometry=cap_2, Motion=floorzmove)  # -> Geometry, Transform
move_3 = Move(Geometry=cap, Motion=floorzmove)  # -> Geometry, Transform
ground_plane = Surface(footprintcurve.FootprintBaseCurve)
perimeter = Geometry(move_2.Geometry)
core = Geometry(move_3.Geometry)

footprintbasecurve = ClusterOutput(footprintcurve.FootprintBaseCurve)
f2fzaxismovementvec = ClusterOutput(Z_2)
floorzaxismovementvec = ClusterOutput(floorzmove)
ground_plane_2 = ClusterOutput(ground_plane)
perimeter_2 = ClusterOutput(perimeter)
core_2 = ClusterOutput(core)
panel = Panel("""South
East
North
West""")
series_2 = Series(Start=0, Step=1, Count=numfloors_2)
ins = InsertItems(List=graft(series_2), Item="Core", Indices=0, Wrap=True)  # -> simplify(List)
stack = StackData(Data=graft(panel), Stack=numfloors_2)
stack_2 = StackData(Data=graft(series_2), Stack="4")
join = TextJoin(Text=ins, Join="_Level_")  # -> flatten(Core_Names)
panel_2 = Panel(stack)
flip = FlipMatrix(Data=stack_2)
panel_3 = Panel(flip)
core_names = ClusterOutput(join)
merge = Merge(Data1=simplify(graft(panel_2)), Data2=simplify(graft(panel_3)))
join_2 = TextJoin(Text=merge, Join="_Level_")
panel_4 = Panel(join_2)
trim = TrimTree(Tree=panel_4, Depth="1")
perimnames = ClusterOutput(trim)

# ==== cluster Cluster
wwr = ClusterInput()  # WWR
dir = ClusterInput()  # Dir
S = ClusterInput()  # S

# ----
# north south gets priority
Y = UnitY(Factor=1)
dprod = DotProduct(VectorA=dir, VectorB=Y, Unitize=False)
abs = Absolute(Value=dprod)
int = Integer(abs)
item = ListItem(List=[".71", ".7"], Index=int, Wrap=True)

area = Area(Geometry=S)  # -> Area, Centroid
evalsrf = EvaluateSurface(Surface=S, Point=area.Centroid)  # -> Point, Normal, UDirection, VDirection, Frame
dprod_2 = DotProduct(VectorA=evalsrf.Normal, VectorB=dir, Unitize=False)
larger = LargerThan(FirstNumber=dprod_2, SecondNumber=item)  # -> LargerThan, OrEqualTo
panel = Panel(evalsrf.Normal)
dispatch = Dispatch(List=S, DispatchPattern=larger.LargerThan)  # -> WallsNORTH, ListB
wall_geometry = Geometry(dispatch.WallsNORTH)

# ---- group: User-Defined WWR Scale
division = Division(NorthScaleInput=wwr, B="100")

# ---- group: Centroids of Walls
area_2 = Area(Geometry=wall_geometry)  # -> Area, Centroid

# ----
sqrt = SquareRoot(Value=division)
scale = Scale(Geometry=wall_geometry, Center=area_2.Centroid, Factor=sqrt)  # -> flatten(NORTHWindows), Transform
area_3 = Area(Geometry=scale.NORTHWindows)  # -> Area, Centroid; disabled
division_2 = Division(A=area_3.Area, B=area_2.Area)  # disabled
panel_2 = Panel(division_2)  # disabled
north_windows = ClusterOutput(scale.NORTHWindows)

# ==== cluster Cluster_2
srf = ClusterInput()
srf_2 = Surface(srf)
crv = Curve(srf_2)
crv_2 = Curve(srf_2)  # disabled
srf_3 = Surface(crv_2)  # disabled
area = Area(Geometry=srf_2)  # -> Area, Centroid; disabled
srf_4 = Surface(crv)
area_2 = Area(Geometry=srf_3)  # -> Area, Centroid; disabled
flip = Flip(Surface=srf_4, Guide=srf_2)  # -> Surface, Result
evalsrf = EvaluateSurface(Surface=srf_2, Point=area.Centroid)  # -> Point, Normal, UDirection, VDirection, Frame; disabled
evalsrf_2 = EvaluateSurface(Surface=srf_3, Point=area_2.Centroid)  # -> Point, Normal, UDirection, VDirection, Frame; disabled
panel = Panel(flip.Result)
vdis = VectorDisplay(Anchor=area_2.Centroid)  # disabled
dprod = DotProduct(VectorA=evalsrf.Normal, VectorB=evalsrf_2.Normal, Unitize=False)  # disabled
vdis_2 = VectorDisplay(Anchor=area.Centroid, Vector=expr("x*10", evalsrf.Normal))  # disabled
panel_2 = Panel(".9")  # disabled
smaller = SmallerThan(FirstNumber=dprod, SecondNumber=panel_2)  # -> SmallerThan, OrEqualTo; disabled
dispatch = Dispatch(List=srf_3, DispatchPattern=smaller.SmallerThan)  # -> ListA, ListB; disabled
flip_2 = Flip(Surface=dispatch.ListA)  # -> Surface, Result; disabled
srf_5 = Surface(flatten([flip_2.Surface, dispatch.ListB]))  # disabled
S = ClusterOutput(flip.Surface)
