# Grasshopper definition AutozoneContextGeneratorSingle.gh (Grasshopper 1.0.7)
# plug-ins: Autozoner, ClimateStudioGH, LadybugGrasshopper, jSwan

# ---- group: Weather File
path = FilePath("C:\ProgramData\Solemma\Common\WeatherData\EPW\USA_NY_New.York-LaGuardia.AP.725030_TMYx.2004-2018.epw")

# ----
panel = Panel(path)

# ----
# Unit Converter
# Internalized Geometry is
# modeled in meters.
toggle = BooleanToggle(True)
unit = CSUnitScale(
    From="Meters",
    To="ActiveRhinoDocUnits",
    Listener=toggle,
    Input_0_Hidden=False,
    Input_0_Name="From",
    Input_1_Hidden=False,
    Input_1_Name="To",
    Input_2_Hidden=False,
    Input_2_Name="Listener",
    UnitSystem=4)

run_eplus = Button()
falsestart = LBFalseStartToggle(True)

# ----
# RUN
button = Button()

filename = Panel("test")
output_directory = Panel("D:\DATA\ShadingAutozoner\")
int = Integer(Slider(999, range=0..999))

# ----
# Building Generation Parameters
bldg_dim_m = Panel("10 to 70")
corner_pertub_m = Panel("0 to 0")
f2f_height_m = Panel("3 to 5")
n_floors = Panel("1 to 10")
wwr_frac = Panel("0.1 to 0.8")
perim_offset = Slider(4.5, range=3..7)
n_buildings = Slider(1000, range=1..1000)

number_slider = Slider(42, range=0..100)

# ---- group: BUILDING IDS
id = Panel("0 to 999999999")
random = Random(Range=id, Number=n_buildings, Seed=number_slider)
python = GhPythonScript(x=random)  # -> out, a
# ---------- python: Python ----------
__author__ = "zoelh"
__version__ = "2023.12.15"

import rhinoscriptsyntax as rs

a = "%09d" % (int(x), )
# ---------- end python ----------

# ----
item = ListItem(List=python.a, Index=int, Wrap=True)
expression = Expression(x=filename, y=item, Expression="Format(\"{0}_{1}\", x, y)")
panel_2 = Panel(expression)

heating_sp = Panel("14 to 24")
cooling_sp = Panel("22 to 30")
epd = Panel("0 to 60")
lpd = Panel("0 to 30")
people_density = Panel("0 to 0.5")
infiltration = Panel("0 to 0.001")
ventperarea = Panel("0 to 0.005")
ventperperson = Panel("0 to 0.005")
uval = Panel("0.3 to 7.0")
ventmode = Panel("0 to 2")  # disabled
roofmass = Panel("0 to 3")
facademass = Panel("0 to 3")
slabr = Panel("0.3 to 15")
roofr = Panel("0.3 to 18")
shgc = Panel("0.05 to 0.99")
econ = Panel("0 to 1")
hrv = Panel("0 to 2")
facader = Panel("0.3 to 15")
schedule = Panel("0 to 15")
random_2 = Random(Range=uval, Number=n_buildings, Seed=number_slider)
random_3 = Random(Range=shgc, Number=n_buildings, Seed=number_slider)
random_4 = Random(Range=slabr, Number=n_buildings, Seed=number_slider)
random_5 = Random(Range=heating_sp, Number=n_buildings, Seed=number_slider)
random_6 = Random(Range=facademass, Number=n_buildings, Seed=expr("x+1", number_slider))
random_7 = Random(Range=roofmass, Number=n_buildings, Seed=number_slider)
random_8 = Random(Range=roofr, Number=n_buildings, Seed=number_slider)
random_9 = Random(Range=cooling_sp, Number=n_buildings, Seed=number_slider)
random_10 = Random(Range=epd, Number=n_buildings, Seed=number_slider)
random_11 = Random(Range=econ, Number=n_buildings, Seed=number_slider)
random_12 = Random(Range=hrv, Number=n_buildings, Seed=number_slider)
random_13 = Random(Range=facader, Number=n_buildings, Seed=number_slider)
random_14 = Random(Range=ventperarea, Number=n_buildings, Seed=number_slider)
random_15 = Random(Range=lpd, Number=n_buildings, Seed=number_slider)
random_16 = Random(Range=people_density, Number=n_buildings, Seed=number_slider)
random_17 = Random(Range=infiltration, Number=n_buildings, Seed=number_slider)
random_18 = Random(Range=ventperperson, Number=n_buildings, Seed=number_slider)
random_19 = Random(Range=ventmode, Number=n_buildings, Seed=number_slider)  # disabled
random_20 = Random(Range=schedule, Number=n_buildings, Seed=number_slider)
int_2 = Integer(random_7)
minwood_con = Panel("0.041")
item_2 = ListItem(List=random_5, Index=int, Wrap=True)
item_3 = ListItem(List=random_9, Index=int, Wrap=True)
item_4 = ListItem(List=random_10, Index=int, Wrap=True)
int_3 = Integer(random_11)
int_4 = Integer(random_12)
item_5 = ListItem(List=random_15, Index=int, Wrap=True)
item_6 = ListItem(List=random_16, Index=int, Wrap=True)
item_7 = ListItem(List=random_14, Index=int, Wrap=True)
item_8 = ListItem(List=random_18, Index=int, Wrap=True)
item_9 = ListItem(List=random_17, Index=int, Wrap=True)
int_5 = Integer(random_6)
item_10 = ListItem(List=random_3, Index=int, Wrap=True)
int_6 = Integer(random_20)
xps_con = Panel("0.034")
item_11 = ListItem(List=random_2, Index=int, Wrap=True)
item_12 = ListItem(List=int_3, Index=int, Wrap=True)
item_13 = ListItem(List=int_4, Index=int, Wrap=True)
concrete_den = Panel("2100")
concrete_sh = Panel("1040")
item_14 = ListItem(List=int_6, Index=int, Wrap=True)
multiplication = Multiplication(A=random_4, B=xps_con)
multiplication_2 = Multiplication(A=random_13, B=minwood_con)
multiplication_3 = Multiplication(A=random_8, B=xps_con)
python_2 = GhPythonScript(x=item_12)  # -> econstr
# ---------- python_2: Python ----------
__author__ = "zoelh"
__version__ = "2023.12.16"

import rhinoscriptsyntax as rs

l = ["NoEconomizer", "DifferentialEnthalpy"]
econstr = l[x]
# ---------- end python_2 ----------
python_3 = GhPythonScript(x=item_13)  # -> hrvstr
# ---------- python_3: Python ----------
__author__ = "zoelh"
__version__ = "2023.12.16"

import rhinoscriptsyntax as rs

l = ["None", "Sensible", "Enthalpy"]
hrvstr = l[x]
# ---------- end python_3 ----------
python_4 = GhPythonScript(x=int_5, specific_heat=concrete_sh, density=concrete_den)  # -> t
# ---------- python_4: Python ----------
__author__ = "zoelh"
__version__ = "2023.12.16"

import rhinoscriptsyntax as rs

tm_list = [450000, 100000, 50000, 20000]

needed_tm = tm_list[x]

t = needed_tm / float(specific_heat) / float(density)
# ---------- end python_4 ----------
python_5 = GhPythonScript(x=int_2, specific_heat=concrete_sh, density=concrete_den)  # -> t; same code as python_4
item_15 = ListItem(List=multiplication_3, Index=int, Wrap=True)
item_16 = ListItem(List=multiplication, Index=int, Wrap=True)
item_17 = ListItem(List=multiplication_2, Index=int, Wrap=True)
item_18 = ListItem(List=python_5, Index=int, Wrap=True)
item_19 = ListItem(List=python_4, Index=int, Wrap=True)

panel_3 = Panel(random_8)
panel_4 = Panel(multiplication_2)
panel_5 = Panel(item_17)

random_21 = Random(Range=bldg_dim_m, Number=n_buildings, Seed=expr("x+1", number_slider))
random_22 = Random(Range=bldg_dim_m, Number=n_buildings, Seed=number_slider)
multiplication_4 = Multiplication(A=n_buildings, B="4")
rectangle = Rectangle(Plane=PlaneXY(0, 0, 0), XSize=random_22, YSize=random_21, Radius=0)  # -> Rectangle, Length
random_23 = Random(Range="2*pi", Number=multiplication_4, Seed=Slider(64, range=0..100))
random_24 = Random(Range=corner_pertub_m, Number=multiplication_4, Seed=Slider(68, range=0..100))
partition = PartitionList(List=random_23, Size="4")
partition_2 = PartitionList(List=random_24, Size="4")
disc = Discontinuity(Curve=rectangle.Rectangle, Level=1)  # -> Points, Parameters
Z = UnitZ(Factor=1)
X = UnitX(Factor=1)
vrot = Rotate(Vector=X, Axis=Z, Angle=partition)
multiplication_5 = Multiplication(A=vrot, B=partition_2)
move = Move(Geometry=disc.Points, Motion=multiplication_5)  # -> Geometry, Transform
pline = PolyLine(Vertices=move.Geometry, Closed=True)  # -> simplify(flatten(Polyline))
area = Area(Geometry=pline)  # -> Area, Centroid
random_25 = Random(Range="2*pi", Number=n_buildings, Seed=Slider(76, range=0..100))
rotate = Rotate(Geometry=pline, Angle=random_25, Plane=area.Centroid)  # -> Geometry, Transform
cx = CurveSelf(Curve=rotate.Geometry)  # -> Points, Params
lng = ListLength(List=cx.Points)  # -> flatten(Length)
equals = Equality(FirstNumber=lng, SecondNumber="0")  # -> Equality, Inequality
cull = CullPattern(List=rotate.Geometry, CullPattern=equals.Equality)
az = Autozoner(FloorPlanOutlines=graft(cull), Offset=perim_offset)  # -> Outline, PerimeterPolylines, CorePolylines, SkeletonPolylines
lng_2 = ListLength(List=cull)
geo = Geometry(az.Outline)
geo_2 = Geometry(az.PerimeterPolylines)
geo_3 = Geometry(az.CorePolylines)
random_26 = Random(Range=f2f_height_m, Number=lng_2, Seed=Slider(87, range=0..100))
random_27 = Random(Range=n_floors, Number=lng_2, Seed=Slider(11, range=0..100), Integers=True)
random_28 = Random(Range=wwr_frac, Number=lng_2, Seed=Slider(25, range=0..100))
srf = Surface(graft(geo_2))
srf_2 = Surface(simplify(geo_3))
trim = TrimTree(Tree=srf, Depth=1)
Z_2 = UnitZ(Factor=random_26)
extr = Extrude(Base=srf_2, Direction=graft(Z_2))  # -> simplify(Extrusion)
extr_2 = Extrude(Base=trim, Direction=graft(Z_2))  # -> simplify(Extrusion)
series = Series(Start=0, Step=graft(random_26), Count=graft(random_27))  # -> simplify(Series)
division = Division(A=random_26, B=2)
Z_3 = UnitZ(Factor=division)
Z_4 = UnitZ(Factor=series)
move_2 = Move(Geometry=cull, Motion=Z_3)  # -> Geometry, Transform
explode = Explode(Curve=move_2.Geometry, Recursive=True)  # -> Segments, Vertices
lng_3 = ListLength(List=Z_4)  # -> flatten(Length)
end = EndPoints(Curve=explode.Segments)  # -> Start, End
move_3 = Move(Geometry=extr, Motion=Z_4)  # -> Geometry, Transform
multiplication_6 = Multiplication(A=random_26, B=random_28)
python_6 = GhPythonScript(x=extr_2, y=Z_4)  # -> out, a; inputs x: list of Brep, y: list of Vector3d
# ---------- python_6: Python ----------
__author__ = "szvsw"
__version__ = "2023.11.14"

import rhinoscriptsyntax as rs
import ghpythonlib.components as ghcomp
import ghpythonlib.treehelpers as th
breps = x
vecs = y
breps_out = []

for brep in breps:
    for vec in vecs:
        new_brep,_ = ghcomp.Move(brep,vec)
        breps_out.append(new_brep)

a = th.list_to_tree(breps_out)
# ---------- end python_6 ----------
midpt = CurveMiddle(Curve=explode.Segments)
geo_4 = Geometry(move_3.Geometry)
geo_5 = Geometry(python_6.a)
vec2pt = Vector2Pt(PointA=end.End, PointB=midpt, Unitize=invert(False))  # -> Vector, Length
vec2pt_2 = Vector2Pt(PointA=end.Start, PointB=midpt, Unitize=invert(False))  # -> Vector, Length
stack = StackData(Data=lng_3, Stack="4")
division_2 = Division(A=multiplication_6, B=2)
multiplication_7 = Multiplication(A=vec2pt.Vector, B="0.1")
multiplication_8 = Multiplication(A=vec2pt_2.Vector, B="0.1")
Z_5 = UnitZ(Factor=division_2)
move_4 = Move(Geometry=end.End, Motion=multiplication_7)  # -> Geometry, Transform
move_5 = Move(Geometry=end.Start, Motion=multiplication_8)  # -> Geometry, Transform
partition_3 = PartitionList(List=geo_5, Size=stack)  # -> simplify(Chunks)
neg = Negative(Value=Z_5)
ln = Line(StartPoint=move_5.Geometry, EndPoint=move_4.Geometry)
path_mapper = PathMapper(partition_3, source="{a}[i]", target="{floor(a/4);a%4}[i]")
move_6 = Move(Geometry=ln, Motion=graft(Z_5))  # -> Geometry, Transform
move_7 = Move(Geometry=ln, Motion=graft(neg))  # -> Geometry, Transform
geo_6 = Geometry(path_mapper)
merge = Merge(Data1=graft(move_6.Geometry), Data2=graft(move_7.Geometry))  # -> simplify(Result)
loft = Loft(Curves=merge, Options={Adjust=False, Closed=False, LoftEnds=0, LoftSimp=0, LoftType=0, Rebuild=10, Refit=0.01})
trim_2 = TrimTree(Tree=loft, Depth=1)
python_7 = GhPythonScript(x=trim_2, y=Z_4)  # -> out, a; inputs x: list of Brep, y: list of Vector3d; same code as python_6
geo_7 = Geometry(python_7.a)
partition_4 = PartitionList(List=geo_7, Size=stack)  # -> simplify(Chunks)
path_mapper_2 = PathMapper(partition_4, source="{a}[i]", target="{floor(a/4);a%4}[i]")
geo_8 = Geometry(path_mapper_2)

# ---- group: Windows
tvis = Panel("0.8")

# ----
multiplication_9 = Multiplication(A=item_8, B="1000")
multiplication_10 = Multiplication(A=item_7, B="1000")

srf_3 = Surface(az.CorePolylines)
srf_4 = Surface(az.Outline)
srf_5 = Surface(az.PerimeterPolylines)
area_2 = Area(Geometry=srf_4)  # -> flatten(FootprintArea), Centroid
len = Length(Curve=geo)  # -> flatten(PerimeterLengths)
shoebox_width = Panel("3")
floor_to_floor_heights = Number(random_26)
area_3 = Area(Geometry=srf_3)  # -> flatten(CoreAreas), Centroid
area_4 = Area(Geometry=srf_5)  # -> PerimAreas, Centroid
ma = MassAddition(Input=area_4.PerimAreas)  # -> flatten(TotalPerimArea), PartialResults
multiplication_11 = Multiplication(A=floor_to_floor_heights, B=len)
multiplication_12 = Multiplication(ShoeboxWidth=shoebox_width, FloorToFloorHeights=floor_to_floor_heights)
division_3 = Division(PerimOffset=perim_offset, FloorToFloorHeight=floor_to_floor_heights)
facade_area = Division(TotalPerimArea=ma.TotalPerimArea, FacadeArea=multiplication_11)
division_4 = Division(CoreAreas=area_3.CoreAreas, TotalPerimAreas=ma.TotalPerimArea)
panel_6 = Panel(division_3)
panel_7 = Panel(facade_area)
panel_8 = Panel(division_4)
multiplication_13 = Multiplication(SBFacadeArea=multiplication_12, PerimAreaToFacadeArea=facade_area)
division_5 = Division(ShoeboxAreas=multiplication_13, ShoeboxWidths=shoebox_width)
perim_depths = Panel(division_5)
multiplication_14 = Multiplication(PerimDepths=division_5, CoreAreaToPerimArea=division_4)
core_depths = Panel(multiplication_14)
footprint_areas = Panel(area_2.FootprintArea)

explode_2 = Explode(Curve=cull, Recursive=True)  # -> Segments, Vertices
midpt_2 = CurveMiddle(Curve=explode_2.Segments)
len_2 = Length(Curve=explode_2.Segments)
end_2 = EndPoints(Curve=explode_2.Segments)  # -> Start, End
len_3 = Length(Curve=cull)
vec2pt_3 = Vector2Pt(PointA=end_2.Start, PointB=midpt_2, Unitize=False)  # -> Vector, Length
division_6 = Division(A=len_2, B=graft(len_3))  # -> simplify(EdgeWeights)
move_8 = Move(Geometry=explode_2.Segments, Motion=vec2pt_3.Vector)  # -> Geometry, Transform
rotate_2 = Rotate(Geometry=move_8.Geometry, Angle="-PI/2", Plane=midpt_2)  # -> Geometry, Transform
end_3 = EndPoints(Curve=rotate_2.Geometry)  # -> Start, End
Y = UnitY(Factor=1)
vec2pt_4 = Vector2Pt(PointA=end_3.Start, PointB=end_3.End, Unitize=False)  # -> Vector, Length
neg_2 = Negative(Value=Y)
xy = XYPlane(Origin=Point(0, 0, 0))
angle = Angle(VectorA=neg_2, VectorB=vec2pt_4.Vector, Plane=xy)  # -> OrientationsRads, Reflex
multiplication_15 = Multiplication(A=angle.OrientationsRads, B=57.29577951)
round = Round(Number=multiplication_15)  # -> Nearest, Floor, Ceiling
merge_2 = Merge(Data1=simplify(graft(round.Nearest)), Data2=simplify(graft(division_6)))
join = TextJoin(Text=merge_2, Join="deg, weight:")  # -> simplify(Result)
ins = InsertItems(List=graft(random_26), Item="f2fHeight (m)", Indices="1", Wrap=True)
ins_2 = InsertItems(List=graft(random_27), Item="floors", Indices="1", Wrap=True)
ins_3 = InsertItems(List=graft(random_28), Item="WWRs", Indices="1", Wrap=True)
# For each edge, save normal in json (see gen city tester for geom stuff)
line = LineSDL(Start=end_3.Start, Direction=vec2pt_4.Vector, Length="10")
join_2 = TextJoin(Text=ins, Join=" ")  # -> flatten(Result)
join_3 = TextJoin(Text=ins_2, Join=" ")  # -> flatten(Result)
join_4 = TextJoin(Text=ins_3, Join=" ")  # -> flatten(Result)
end_4 = EndPoints(Curve=line)  # -> Start, End
trim_3 = TrimTree(Tree=join, Depth=1)
tag = TextTag(Location=end_4.End, Text=trim_3)
item_20 = ListItem(List=end_4.End, Index=0, Wrap=True)  # -> flatten(Item)
tag_2 = TextTag(Location=item_20, Text=join_2)
tag_3 = TextTag(Location=item_20, Text=join_3)
tag_4 = TextTag(Location=item_20, Text=join_4)
wwr = Panel(random_28)
edge_weights = Panel(division_6)
orientation_radians = Panel(angle.OrientationsRads)
floor_to_floor_height = Panel(random_26)
floors = Panel(random_27)

area_5 = Area(Geometry=cull)  # -> Area, Centroid
explode_3 = Explode(Curve=cull, Recursive=True)  # -> simplify(Segments), Vertices
len_4 = Length(Curve=explode_3.Segments)
edge_lengths = Panel(len_4)
area_6 = Area(Geometry=geo_6)  # -> simplify(Area), Centroid
area_7 = Area(Geometry=geo_4)  # -> Area, Centroid
perim_area = Panel(area_6.Area)
corearea = Panel(area_7.Area)

# ---- group: ZONE NAMES
lng_4 = ListLength(List=geo_6)
trim_4 = TrimTree(Tree=lng_4, Depth=1)
lng_5 = ListLength(List=geo_4)
python_8 = GhPythonScript(x="core", y=lng_5)  # -> simplify(names); inputs y: tree
# ---------- python_8: Python ----------
__author__ = "zoelh"
__version__ = "2023.12.16"

import rhinoscriptsyntax as rs
import ghpythonlib.treehelpers as th

names = []

for i, branch in enumerate(y.Branches):
    n = []
    print(branch)
    for k in range(len(branch)):
        n.append([x+"_floor_"+str(j)+"_n_"+str(k) for j in range(branch[k])])
    names.append(n)
     
print(names)
names = th.list_to_tree(names, source=[0,0])
#names = [x+"_"+str(i) for i in range(y)]
# ---------- end python_8 ----------
python_9 = GhPythonScript(x="perim", y=trim_4)  # -> simplify(names); inputs y: tree; same code as python_8
trim_5 = TrimTree(Tree=python_9, Depth=1)
branch = TreeBranch(Tree=simplify(python_8), Path=int, MaintainPaths=True)
branch_2 = TreeBranch(Tree=simplify(trim_5), Path=int, MaintainPaths=True)

# ----
centroid = Data(area_5.Centroid)
normals = Geometry(line)
points = Data(end_3.Start)

windows = Geometry(flatten(geo_8))
perim = Geometry(flatten(geo_6))
core = Geometry(flatten(geo_4))
ground = Surface(cull)
preview = CustomPreview(Geometry=perim, Material=ColourSwatch(SwatchColor=RGB(222, 171, 144)))
preview_2 = CustomPreview(Geometry=windows, Material=ColourSwatch(SwatchColor=RGB(144, 204, 222)))
preview_3 = CustomPreview(Geometry=core, Material=ColourSwatch(SwatchColor=RGB(201, 222, 144)))
preview_4 = CustomPreview(Geometry=ground, Material=ColourSwatch(SwatchColor=RGB(102, 53, 0)))

area_8 = Area(Geometry=ground)  # -> Area, Centroid
multiplication_16 = Multiplication(A=area_8.Area, B=random_27)
total_area = Panel(multiplication_16)
centers = Data(simplify(graft(centroid)))
trim_6 = TrimTree(Tree=geo_8, Depth=1)
trim_7 = TrimTree(Tree=geo_6, Depth=1)
branch_3 = TreeBranch(Tree=simplify(trim_6), Path=int, MaintainPaths=True)
branch_4 = TreeBranch(Tree=simplify(trim_7), Path=int, MaintainPaths=True)
area_9 = Area(Geometry=branch_4)  # -> Area, Centroid
tag_5 = TextTag(Location=area_9.Centroid, Text=branch_2)
branch_5 = TreeBranch(Tree=simplify(geo_4), Path=int, MaintainPaths=True)
item_21 = ListItem(List=ground, Index=int, Wrap=True)
button_2 = Button()
dist = Distance(PointA=graft(area_5.Centroid), PointB=points)  # -> simplify(Distance)
data = Data(simplify(orientation_radians))
area_10 = Area(Geometry=geo_4)  # -> Area, Centroid
wires = BrepWireframe(Brep=perim, Density=-1)
area_11 = Area(Geometry=geo_6)  # -> Area, Centroid
concat = Concatenate(FragmentA="Orient: ", FragmentB=data)  # -> graft(Result)
concat_2 = Concatenate(FragmentA="Area: ", FragmentB=perim_area)
item_22 = ListItem(List=area_10.Centroid, Index=-1, Wrap=True)
item_23 = ListItem(List=area_11.Centroid, Index=0, Wrap=True)
item_24 = ListItem(List=concat_2, Index=0, Wrap=True)
concat_3 = Concatenate(FragmentA="Length: ", FragmentB=edge_lengths)  # -> graft(Result)
data_2 = Data(simplify(graft(python.a)))
Z_6 = UnitZ(Factor=1)
move_9 = Move(Geometry=item_23, Motion=simplify(graft(vec2pt_4.Vector)))  # -> Geometry, Transform
move_10 = Move(Geometry=item_22, Motion=expr("x*10", Z_6))  # -> Geometry, Transform
swatch = ColourSwatch(SwatchColor=RGB(0, 0, 0))
Z_7 = UnitZ(Factor="-10")
Z_8 = UnitZ(Factor="-20")
Z_9 = UnitZ(Factor="-30")
item_25 = ListItem(List=python_9, Index=0, Wrap=True)
move_11 = Move(Geometry=move_9.Geometry, Motion=Z_7)  # -> Geometry, Transform
move_12 = Move(Geometry=move_9.Geometry, Motion=Z_8)  # -> Geometry, Transform
move_13 = Move(Geometry=move_9.Geometry, Motion=Z_9)  # -> Geometry, Transform
preview_5 = CustomPreview(
    Geometry=wires,
    Material={diffuse=RGB(221, 160, 221), emission=RGB(66, 48, 66), shine=0.5, specular=RGB(255, 255, 255), transparency=0})
tag_6 = TextTag(Location=move_10.Geometry, Text=data_2, Colour=ColourSwatch(SwatchColor=RGB(5, 114, 247)))
tag_7 = TextTag(Location=move_9.Geometry, Text=item_25, Colour=swatch)
tag_8 = TextTag(Location=move_11.Geometry, Text=item_24, Colour=swatch)
tag_9 = TextTag(Location=move_12.Geometry, Text=concat, Colour=swatch)
tag_10 = TextTag(Location=move_13.Geometry, Text=concat_3, Colour=swatch)

# ----
# Template Settings
panel_9 = Panel("D:\Users\zoelh\GitRepos\ml-for-building-energy-modeling\ml-for-bem\data\")
python_10 = GhPythonScript(index=item_14, path=panel_9)  # -> schedules
# ---------- python_10: Python ----------
__author__ = "zoelh"
__version__ = "2023.11.18"

import rhinoscriptsyntax as rs
import csv
import ghpythonlib.treehelpers as th

schedules = []
l = ["EquipmentAvailabilitySchedule.csv", "LightsAvailabilitySchedule.csv", "OccupancySchedule.csv"]
for file in l:
    filename = path + file
    with open(filename) as csvfile:
        reader = csv.reader(csvfile)
        rows = list(reader)
        row = rows[int(index)+1]
        schedules.append([row[1:]])
schedules = th.list_to_tree(schedules)
# ---------- end python_10 ----------
bang = ExplodeTree(Data=python_10)  # -> Branch0, Branch1, Branch2
year_schedule = ConstructCSYearSchedule(Name="Lights", Type=0, Category=0, DaysHours=bang.Branch1)  # -> Sched, Values
year_schedule_2 = ConstructCSYearSchedule(Name="Occupancy", Type=0, Category=0, DaysHours=bang.Branch2)  # -> Sched, Values
year_schedule_3 = ConstructCSYearSchedule(Name="Equip", Type=0, Category=0, DaysHours=bang.Branch0)  # -> Sched, Values
econ_2 = ValueList({"NoEconomizer", "DifferentialEnthalpy"}, selected="NoEconomizer")
list = ValueList({"Residential", "Kitchen", "Office", "MeetingRoom", "HotelRoom", "ClassRoom", "Library", "LectureHall", "SuperMarket", "Shopping", "ScienceLab"}, selected="Office")
infiltrationmethod = ValueList({"ACH", "Flow Per Exterior Area": "FlowExtArea"}, selected="Flow Per Exterior Area")
hrv_2 = ValueList({"None", "Sensible", "Enthalpy"}, selected="None")
simple_window = ConstructCSSimpleWindow(Name="windowtest", Shgf=item_10, Uval=item_11, Tvis=tvis)
zonetemplate = GetZoneTemplate(SearchZoneTemplate=list, Selection="Office")
infiltration_ach = Slider(0, range=0..1)
heating_coolingconstant = BooleanToggle(True)
people_equip_lightson = BooleanToggle(True)
scheduledventilationon = BooleanToggle(False)
heating_coolingon = BooleanToggle(True)
scheduledventilationon_2 = BooleanToggle(False)
mechventon = BooleanToggle(True)
humidistaton = BooleanToggle(False)
item_26 = ListItem(List=zonetemplate, Index=0, Wrap=True)
infiltrationon = BooleanToggle(True)
fanenergy = BooleanToggle(False)
natventon = BooleanToggle(False)
shadingon = BooleanToggle(False)
dhwon = BooleanToggle(True)
hasframe = BooleanToggle(False)
panel_10 = Panel("Airspeed 0")
occupancy = Data(year_schedule_2.Sched)
dimmingtype = Panel("Off")
wset = CSWindowSettings(
    Name="SimpleWindowSettings",
    Type="External",
    ShadingSystemIsOn=shadingon,
    GlazingConstruction=simple_window,
    OperableArea="0",
    HasFrame=hasframe,
    AFNWindowAvailability="AllOff",
    Input_0_Hidden=False,
    Input_0_Name="Name",
    Input_10_Hidden=True,
    Input_10_Name="ShadingThickness",
    Input_11_Hidden=True,
    Input_11_Name="ShadeGlassDistance",
    Input_12_Hidden=True,
    Input_12_Name="TopBottomEdgeOpeningMultiplier",
    Input_13_Hidden=True,
    Input_13_Name="Analysis Mesh Resolution",
    Input_14_Hidden=True,
    Input_14_Name="ZoneMixingIsOn",
    Input_15_Hidden=True,
    Input_15_Name="ZoneMixingDeltaTemperature",
    Input_16_Hidden=True,
    Input_16_Name="ZoneMixingFlowRate",
    Input_17_Hidden=False,
    Input_17_Name="Glazing Construction",
    Input_18_Hidden=False,
    Input_18_Name="OperableArea",
    Input_19_Hidden=True,
    Input_19_Name="ZoneMixingAvailibilitySchedule",
    Input_1_Hidden=False,
    Input_1_Name="WindowSettings",
    Input_20_Hidden=False,
    Input_20_Name="HasFrame",
    Input_21_Hidden=True,
    Input_21_Name="FrameWidth",
    Input_22_Hidden=True,
    Input_22_Name="FrameProjection"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)

material = ConstructCSOpaqueMaterial(
    Name="Partition Plaster",
    Conductivity=1,
    Density=2000,
    Roughness="Rough",
    SpecificHeat=1130,
    ThermalAbsorptance=0.9,
    SolarAbsorptance=0.7,
    VisibleAbsorptance=0.7,
    Type="Finishes",
    Input_0_Hidden=False,
    Input_0_Name="Name",
    Input_10_Hidden=True,
    Input_10_Name="TemperatureCoefficientThermalConductivity",
    Input_11_Hidden=True,
    Input_11_Name="TemperatureArray",
    Input_12_Hidden=True,
    Input_12_Name="EnthalpyArray",
    Input_13_Hidden=True,
    Input_13_Name="VariableConductivityArray",
    Input_14_Hidden=False,
    Input_14_Name="Type",
    Input_15_Hidden=True,
    Input_15_Name="EmbodiedEnergy",
    Input_16_Hidden=True,
    Input_16_Name="EmbodiedCarbon",
    Input_17_Hidden=True,
    Input_17_Name="Cost",
    Input_18_Hidden=True,
    Input_18_Name="Life",
    Input_1_Hidden=False,
    Input_1_Name="Conductivity",
    Input_2_Hidden=False,
    Input_2_Name="Density",
    Input_3_Hidden=False,
    Input_3_Name="Roughness",
    Input_4_Hidden=False,
    Input_4_Name="SpecificHeat",
    Input_5_Hidden=False,
    Input_5_Name="ThermalAbsorptance"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)
material_2 = ConstructCSOpaqueMaterial(
    Name="Stucco",
    Conductivity=0.72,
    Density=1856,
    Roughness="Rough",
    SpecificHeat=840,
    ThermalAbsorptance=0.9,
    SolarAbsorptance=0.7,
    VisibleAbsorptance=0.7,
    Type="Sealing",
    Input_0_Hidden=False,
    Input_0_Name="Name",
    Input_10_Hidden=True,
    Input_10_Name="TemperatureCoefficientThermalConductivity",
    Input_11_Hidden=True,
    Input_11_Name="TemperatureArray",
    Input_12_Hidden=True,
    Input_12_Name="EnthalpyArray",
    Input_13_Hidden=True,
    Input_13_Name="VariableConductivityArray",
    Input_14_Hidden=False,
    Input_14_Name="Type",
    Input_15_Hidden=True,
    Input_15_Name="EmbodiedEnergy",
    Input_16_Hidden=True,
    Input_16_Name="EmbodiedCarbon",
    Input_17_Hidden=True,
    Input_17_Name="Cost",
    Input_18_Hidden=True,
    Input_18_Name="Life",
    Input_1_Hidden=False,
    Input_1_Name="Conductivity",
    Input_2_Hidden=False,
    Input_2_Name="Density",
    Input_3_Hidden=False,
    Input_3_Name="Roughness",
    Input_4_Hidden=False,
    Input_4_Name="SpecificHeat",
    Input_5_Hidden=False,
    Input_5_Name="ThermalAbsorptance"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)
material_3 = ConstructCSOpaqueMaterial(
    Name="Plaster",
    Conductivity=1,
    Density=2000,
    Roughness="Rough",
    SpecificHeat=1130,
    ThermalAbsorptance=0.9,
    SolarAbsorptance=0.7,
    VisibleAbsorptance=0.7,
    Type="Sealing",
    Input_0_Hidden=False,
    Input_0_Name="Name",
    Input_10_Hidden=True,
    Input_10_Name="TemperatureCoefficientThermalConductivity",
    Input_11_Hidden=True,
    Input_11_Name="TemperatureArray",
    Input_12_Hidden=True,
    Input_12_Name="EnthalpyArray",
    Input_13_Hidden=True,
    Input_13_Name="VariableConductivityArray",
    Input_14_Hidden=False,
    Input_14_Name="Type",
    Input_15_Hidden=True,
    Input_15_Name="EmbodiedEnergy",
    Input_16_Hidden=True,
    Input_16_Name="EmbodiedCarbon",
    Input_17_Hidden=True,
    Input_17_Name="Cost",
    Input_18_Hidden=True,
    Input_18_Name="Life",
    Input_1_Hidden=False,
    Input_1_Name="Conductivity",
    Input_2_Hidden=False,
    Input_2_Name="Density",
    Input_3_Hidden=False,
    Input_3_Name="Roughness",
    Input_4_Hidden=False,
    Input_4_Name="SpecificHeat",
    Input_5_Hidden=False,
    Input_5_Name="ThermalAbsorptance"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)
material_4 = ConstructCSOpaqueMaterial(
    Name="Carpet",
    Conductivity=0.6,
    Density=288,
    Roughness="Rough",
    SpecificHeat=1380,
    ThermalAbsorptance=0.9,
    SolarAbsorptance=0.7,
    VisibleAbsorptance=0.7,
    Type="Finishes",
    Input_0_Hidden=False,
    Input_0_Name="Name",
    Input_10_Hidden=True,
    Input_10_Name="TemperatureCoefficientThermalConductivity",
    Input_11_Hidden=True,
    Input_11_Name="TemperatureArray",
    Input_12_Hidden=True,
    Input_12_Name="EnthalpyArray",
    Input_13_Hidden=True,
    Input_13_Name="VariableConductivityArray",
    Input_14_Hidden=False,
    Input_14_Name="Type",
    Input_15_Hidden=True,
    Input_15_Name="EmbodiedEnergy",
    Input_16_Hidden=True,
    Input_16_Name="EmbodiedCarbon",
    Input_17_Hidden=True,
    Input_17_Name="Cost",
    Input_18_Hidden=True,
    Input_18_Name="Life",
    Input_1_Hidden=False,
    Input_1_Name="Conductivity",
    Input_2_Hidden=False,
    Input_2_Name="Density",
    Input_3_Hidden=False,
    Input_3_Name="Roughness",
    Input_4_Hidden=False,
    Input_4_Name="SpecificHeat",
    Input_5_Hidden=False,
    Input_5_Name="ThermalAbsorptance"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)
material_5 = ConstructCSOpaqueMaterial(
    Name="Mineral Wool",
    Conductivity=multiplication_2,
    Density=155,
    Roughness="Rough",
    SpecificHeat=1130,
    ThermalAbsorptance=0.9,
    SolarAbsorptance=0.7,
    VisibleAbsorptance=0.7,
    Type="Sealing",
    Input_0_Hidden=False,
    Input_0_Name="Name",
    Input_10_Hidden=True,
    Input_10_Name="TemperatureCoefficientThermalConductivity",
    Input_11_Hidden=True,
    Input_11_Name="TemperatureArray",
    Input_12_Hidden=True,
    Input_12_Name="EnthalpyArray",
    Input_13_Hidden=True,
    Input_13_Name="VariableConductivityArray",
    Input_14_Hidden=False,
    Input_14_Name="Type",
    Input_15_Hidden=True,
    Input_15_Name="EmbodiedEnergy",
    Input_16_Hidden=True,
    Input_16_Name="EmbodiedCarbon",
    Input_17_Hidden=True,
    Input_17_Name="Cost",
    Input_18_Hidden=True,
    Input_18_Name="Life",
    Input_1_Hidden=False,
    Input_1_Name="Conductivity",
    Input_2_Hidden=False,
    Input_2_Name="Density",
    Input_3_Hidden=False,
    Input_3_Name="Roughness",
    Input_4_Hidden=False,
    Input_4_Name="SpecificHeat",
    Input_5_Hidden=False,
    Input_5_Name="ThermalAbsorptance"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)
material_6 = ConstructCSOpaqueMaterial(
    Name="WallConcrete",
    Conductivity=2,
    Density=2400,
    Roughness="Rough",
    SpecificHeat=950,
    ThermalAbsorptance=0.9,
    SolarAbsorptance=0.7,
    VisibleAbsorptance=0.7,
    Type="Concrete",
    Input_0_Hidden=False,
    Input_0_Name="Name",
    Input_10_Hidden=True,
    Input_10_Name="TemperatureCoefficientThermalConductivity",
    Input_11_Hidden=True,
    Input_11_Name="TemperatureArray",
    Input_12_Hidden=True,
    Input_12_Name="EnthalpyArray",
    Input_13_Hidden=True,
    Input_13_Name="VariableConductivityArray",
    Input_14_Hidden=False,
    Input_14_Name="Type",
    Input_15_Hidden=True,
    Input_15_Name="EmbodiedEnergy",
    Input_16_Hidden=True,
    Input_16_Name="EmbodiedCarbon",
    Input_17_Hidden=True,
    Input_17_Name="Cost",
    Input_18_Hidden=True,
    Input_18_Name="Life",
    Input_1_Hidden=False,
    Input_1_Name="Conductivity",
    Input_2_Hidden=False,
    Input_2_Name="Density",
    Input_3_Hidden=False,
    Input_3_Name="Roughness",
    Input_4_Hidden=False,
    Input_4_Name="SpecificHeat",
    Input_5_Hidden=False,
    Input_5_Name="ThermalAbsorptance"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)
material_7 = ConstructCSOpaqueMaterial(
    Name="Felt",
    Conductivity=0.9,
    Density=0.5,
    Roughness="Rough",
    SpecificHeat=1800,
    ThermalAbsorptance=0.9,
    SolarAbsorptance=0.7,
    VisibleAbsorptance=0.7,
    Type="Sealing",
    Input_0_Hidden=False,
    Input_0_Name="Name",
    Input_10_Hidden=True,
    Input_10_Name="TemperatureCoefficientThermalConductivity",
    Input_11_Hidden=True,
    Input_11_Name="TemperatureArray",
    Input_12_Hidden=True,
    Input_12_Name="EnthalpyArray",
    Input_13_Hidden=True,
    Input_13_Name="VariableConductivityArray",
    Input_14_Hidden=False,
    Input_14_Name="Type",
    Input_15_Hidden=True,
    Input_15_Name="EmbodiedEnergy",
    Input_16_Hidden=True,
    Input_16_Name="EmbodiedCarbon",
    Input_17_Hidden=True,
    Input_17_Name="Cost",
    Input_18_Hidden=True,
    Input_18_Name="Life",
    Input_1_Hidden=False,
    Input_1_Name="Conductivity",
    Input_2_Hidden=False,
    Input_2_Name="Density",
    Input_3_Hidden=False,
    Input_3_Name="Roughness",
    Input_4_Hidden=False,
    Input_4_Name="SpecificHeat",
    Input_5_Hidden=False,
    Input_5_Name="ThermalAbsorptance"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)
material_8 = ConstructCSOpaqueMaterial(
    Name="Concrete",
    Conductivity=2,
    Density=2100,
    Roughness="Rough",
    SpecificHeat=1040,
    ThermalAbsorptance=0.9,
    SolarAbsorptance=0.7,
    VisibleAbsorptance=0.7,
    Type="Concrete",
    Input_0_Hidden=False,
    Input_0_Name="Name",
    Input_10_Hidden=True,
    Input_10_Name="TemperatureCoefficientThermalConductivity",
    Input_11_Hidden=True,
    Input_11_Name="TemperatureArray",
    Input_12_Hidden=True,
    Input_12_Name="EnthalpyArray",
    Input_13_Hidden=True,
    Input_13_Name="VariableConductivityArray",
    Input_14_Hidden=False,
    Input_14_Name="Type",
    Input_15_Hidden=True,
    Input_15_Name="EmbodiedEnergy",
    Input_16_Hidden=True,
    Input_16_Name="EmbodiedCarbon",
    Input_17_Hidden=True,
    Input_17_Name="Cost",
    Input_18_Hidden=True,
    Input_18_Name="Life",
    Input_1_Hidden=False,
    Input_1_Name="Conductivity",
    Input_2_Hidden=False,
    Input_2_Name="Density",
    Input_3_Hidden=False,
    Input_3_Name="Roughness",
    Input_4_Hidden=False,
    Input_4_Name="SpecificHeat",
    Input_5_Hidden=False,
    Input_5_Name="ThermalAbsorptance"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)
material_9 = ConstructCSOpaqueMaterial(
    Name="AcousticTile",
    Conductivity=0.06,
    Density=368,
    Roughness="Rough",
    SpecificHeat=590,
    ThermalAbsorptance=0.9,
    SolarAbsorptance=0.7,
    VisibleAbsorptance=0.7,
    Type="Finishes",
    Input_0_Hidden=False,
    Input_0_Name="Name",
    Input_10_Hidden=True,
    Input_10_Name="TemperatureCoefficientThermalConductivity",
    Input_11_Hidden=True,
    Input_11_Name="TemperatureArray",
    Input_12_Hidden=True,
    Input_12_Name="EnthalpyArray",
    Input_13_Hidden=True,
    Input_13_Name="VariableConductivityArray",
    Input_14_Hidden=False,
    Input_14_Name="Type",
    Input_15_Hidden=True,
    Input_15_Name="EmbodiedEnergy",
    Input_16_Hidden=True,
    Input_16_Name="EmbodiedCarbon",
    Input_17_Hidden=True,
    Input_17_Name="Cost",
    Input_18_Hidden=True,
    Input_18_Name="Life",
    Input_1_Hidden=False,
    Input_1_Name="Conductivity",
    Input_2_Hidden=False,
    Input_2_Name="Density",
    Input_3_Hidden=False,
    Input_3_Name="Roughness",
    Input_4_Hidden=False,
    Input_4_Name="SpecificHeat",
    Input_5_Hidden=False,
    Input_5_Name="ThermalAbsorptance"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)
material_10 = ConstructCSOpaqueMaterial(
    Name="XPS",
    Conductivity=xps_con,
    Density=35,
    Roughness="Rough",
    SpecificHeat=1400,
    ThermalAbsorptance=0.9,
    SolarAbsorptance=0.7,
    VisibleAbsorptance=0.7,
    Type="Insulation",
    Input_0_Hidden=False,
    Input_0_Name="Name",
    Input_10_Hidden=True,
    Input_10_Name="TemperatureCoefficientThermalConductivity",
    Input_11_Hidden=True,
    Input_11_Name="TemperatureArray",
    Input_12_Hidden=True,
    Input_12_Name="EnthalpyArray",
    Input_13_Hidden=True,
    Input_13_Name="VariableConductivityArray",
    Input_14_Hidden=False,
    Input_14_Name="Type",
    Input_15_Hidden=True,
    Input_15_Name="EmbodiedEnergy",
    Input_16_Hidden=True,
    Input_16_Name="EmbodiedCarbon",
    Input_17_Hidden=True,
    Input_17_Name="Cost",
    Input_18_Hidden=True,
    Input_18_Name="Life",
    Input_1_Hidden=False,
    Input_1_Name="Conductivity",
    Input_2_Hidden=False,
    Input_2_Name="Density",
    Input_3_Hidden=False,
    Input_3_Name="Roughness",
    Input_4_Hidden=False,
    Input_4_Name="SpecificHeat",
    Input_5_Hidden=False,
    Input_5_Name="ThermalAbsorptance"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)

# ---- group: WallInsul
layer = ConstructCSLayer(Material=material_3, Thickness="0.013")

# ---- group: WallConcrete
layer_2 = ConstructCSLayer(Material=material_6, Thickness=item_19)

# ---- group: WallInsul
layer_3 = ConstructCSLayer(Material=material_5, Thickness=item_17)

layer_4 = ConstructCSLayer(Material=material_2, Thickness="0.025")

# ---- group: RoofFelt
layer_5 = ConstructCSLayer(Material=material_7, Thickness="0.003")

# ---- group: RoofConcrete
layer_6 = ConstructCSLayer(Material=material_8, Thickness=item_18)

# ---- group: RoofTile
layer_7 = ConstructCSLayer(Material=material_9, Thickness="0.005")

# ---- group: RoofXPS
layer_8 = ConstructCSLayer(Material=material_10, Thickness=item_15)

# ---- group: GroundCarpet
layer_9 = ConstructCSLayer(Material=material, Thickness="0.013")

# ---- group: GroundConcrete
layer_10 = ConstructCSLayer(Material=material_6, Thickness="0.203")

# ---- group: GroundCarpet
layer_11 = ConstructCSLayer(Material=material_4, Thickness="0.02")

# ---- group: GroundXPS
layer_12 = ConstructCSLayer(Material=material_10, Thickness=item_16)

# ----
relay = Relay([layer_8, layer_6, layer_7, layer_5])
panel_11 = Panel(relay)
mats = Data([material_10, material_8, material_9, material_7, material_6, material_5, material_3, material_2, material_4, material])

dup = DuplicateData(Data=layer_9, Number=2, Order=True)
construction = ConstructCSConstruction(
    Name="CustomExteriorRoof",
    Category="Roof",
    Layers=flatten(relay),
    Input_0_Hidden=False,
    Input_0_Name="Name",
    Input_1_Hidden=False,
    Input_1_Name="Category",
    Input_2_Hidden=False,
    Input_2_Name="Layers",
    Input_3_Hidden=True,
    Input_3_Name="EmbodiedEnergy",
    Input_4_Hidden=True,
    Input_4_Name="EmbodiedCarbon",
    Input_5_Hidden=True,
    Input_5_Name="Cost",
    Input_6_Hidden=True,
    Input_6_Name="Life",
    UnitSystem=4,
    Input_3_GHParam_Branch0_Path="{0}",
    Input_3_GHParam_Branch0_Item0_number=0,
    Input_4_GHParam_Branch0_Path="{0}",
    Input_4_GHParam_Branch0_Item0_number=0,
    Input_5_GHParam_Branch0_Path="{0}",
    Input_5_GHParam_Branch0_Item0_number=0,
    Input_6_GHParam_Branch0_Path="{0}",
    Input_6_GHParam_Branch0_Item0_number=10)  # -> Construction, ConstructionInformation
construction_2 = ConstructCSConstruction(
    Name="CustomGroundSlab",
    Category="GroundFloor",
    Layers=flatten([layer_12, layer_10, layer_11]),
    Input_0_Hidden=False,
    Input_0_Name="Name",
    Input_1_Hidden=False,
    Input_1_Name="Category",
    Input_2_Hidden=False,
    Input_2_Name="Layers",
    Input_3_Hidden=True,
    Input_3_Name="EmbodiedEnergy",
    Input_4_Hidden=True,
    Input_4_Name="EmbodiedCarbon",
    Input_5_Hidden=True,
    Input_5_Name="Cost",
    Input_6_Hidden=True,
    Input_6_Name="Life",
    UnitSystem=4,
    Input_3_GHParam_Branch0_Path="{0}",
    Input_3_GHParam_Branch0_Item0_number=0,
    Input_4_GHParam_Branch0_Path="{0}",
    Input_4_GHParam_Branch0_Item0_number=0,
    Input_5_GHParam_Branch0_Path="{0}",
    Input_5_GHParam_Branch0_Item0_number=0,
    Input_6_GHParam_Branch0_Path="{0}",
    Input_6_GHParam_Branch0_Item0_number=10)  # -> Construction, ConstructionInformation
construction_3 = ConstructCSConstruction(
    Name="CustomInteriorPartition",
    Category="Facade",
    Layers=flatten(dup),
    Input_0_Hidden=False,
    Input_0_Name="Name",
    Input_1_Hidden=False,
    Input_1_Name="Category",
    Input_2_Hidden=False,
    Input_2_Name="Layers",
    Input_3_Hidden=True,
    Input_3_Name="EmbodiedEnergy",
    Input_4_Hidden=True,
    Input_4_Name="EmbodiedCarbon",
    Input_5_Hidden=True,
    Input_5_Name="Cost",
    Input_6_Hidden=True,
    Input_6_Name="Life",
    UnitSystem=4,
    Input_3_GHParam_Branch0_Path="{0}",
    Input_3_GHParam_Branch0_Item0_number=0,
    Input_4_GHParam_Branch0_Path="{0}",
    Input_4_GHParam_Branch0_Item0_number=0,
    Input_5_GHParam_Branch0_Path="{0}",
    Input_5_GHParam_Branch0_Item0_number=0,
    Input_6_GHParam_Branch0_Path="{0}",
    Input_6_GHParam_Branch0_Item0_number=10)  # -> Construction, ConstructionInformation
construction_4 = ConstructCSConstruction(
    Name="CustomExteriorWall",
    Category="Roof",
    Layers=flatten([layer_2, layer_3, layer, layer_4]),
    Input_0_Hidden=False,
    Input_0_Name="Name",
    Input_1_Hidden=False,
    Input_1_Name="Category",
    Input_2_Hidden=False,
    Input_2_Name="Layers",
    Input_3_Hidden=True,
    Input_3_Name="EmbodiedEnergy",
    Input_4_Hidden=True,
    Input_4_Name="EmbodiedCarbon",
    Input_5_Hidden=True,
    Input_5_Name="Cost",
    Input_6_Hidden=True,
    Input_6_Name="Life",
    UnitSystem=4,
    Input_3_GHParam_Branch0_Path="{0}",
    Input_3_GHParam_Branch0_Item0_number=0,
    Input_4_GHParam_Branch0_Path="{0}",
    Input_4_GHParam_Branch0_Item0_number=0,
    Input_5_GHParam_Branch0_Path="{0}",
    Input_5_GHParam_Branch0_Item0_number=0,
    Input_6_GHParam_Branch0_Path="{0}",
    Input_6_GHParam_Branch0_Item0_number=10)  # -> Construction, ConstructionInformation
python_11 = GhPythonScript(x=construction_2.ConstructionInformation)  # -> Rval, mass
# ---------- python_11: Python ----------
__author__ = "zoelh"
__version__ = "2023.11.21"

import rhinoscriptsyntax as rs
import re

Rval = None

s = re.sub(r'[^\w.\n]+', ' ', x)
s=s.replace(" ", '')
print(s)
Rval = float(s.split("RValuemKW")[1].split("\n")[0])
mass = float(s.split("CapacitancekJKm")[1].split("\n")[0])
print(Rval)
print(mass)
# ---------- end python_11 ----------

# ---- group: ROOF CONSTRUCTION
panel_12 = Panel(construction.ConstructionInformation)
exteriorroof = Data(construction.Construction)

# ---- group: SLAB CONSTRUCTION
panel_13 = Panel(construction_2.ConstructionInformation)
slab = Data(construction_2.Construction)

# ---- group: FACADE CONSTRUCTION
panel_14 = Panel(construction_4.ConstructionInformation)
exteriorwall = Data(construction_4.Construction)

# ---- group: PARTITION CONSTRUCTION
panel_15 = Panel(construction_3.ConstructionInformation)
partition_5 = Data(construction_3.Construction)

# ----
zset = CSZoneSettings(
    Name="ParametricZoneSettings",
    ZoneSettings=item_26,
    RoofConstruction=exteriorroof,
    FacadeConstruction=exteriorwall,
    SlabConstruction=slab,
    PartitionConstruction=partition_5,
    ExternalFloorConstruction=slab,
    InternalMassConstruction=partition_5,
    InternalMassExposedArea=Slider(0, range=0..1),
    GroundSlabConstruction=slab,
    PeopleDensity=item_6,
    AirspeedSchedule="AirSpeed 0",
    EquipmentPowerDensity=item_4,
    LightingPowerDensity=item_5,
    OccupancySchedule=year_schedule_2.Sched,
    EquipmentAvailabilitySchedule=year_schedule_3.Sched,
    LightsAvailabilitySchedule=year_schedule.Sched,
    DimmingType=dimmingtype,
    PeopleIsOn=people_equip_lightson,
    EquipmentIsOn=people_equip_lightson,
    LightsIsOn=people_equip_lightson,
    CoolingCOP=Slider(1, range=0.6..6),
    HeatingCOP=Slider(1, range=0.6..6),
    HeatingSetpoint=item_2,
    CoolingSetpoint=item_3,
    HeatingSetpointConstant=heating_coolingconstant,
    CoolingSetpointConstant=heating_coolingconstant,
    HeatingSetpointSchedule="S21 B18 8to18",
    CoolingSetpointSchedule="S25 B30 8to18",
    HeatIsOn=heating_coolingon,
    CoolIsOn=heating_coolingon,
    MechVentIsOn=mechventon,
    HumidistatIsOn=humidistaton,
    HeatingLimitType="NoLimit",
    CoolingLimitType="LimitFlowRateAndCapacity",
    MaxHeatingCapacity=100,
    MaxCoolingCapacity=100,
    MaxHeatFlow=100,
    MaxCoolFlow=100,
    HeatingSchedule="AllOn",
    CoolingSchedule="AllOn",
    MechVentSchedule=occupancy,
    MinFreshAirPerson=multiplication_10,
    MinFreshAirArea=multiplication_9,
    EconomizerType=python_2,
    HeatRecoveryType=python_3,
    HeatRecoveryEfficiencySensible="0.7",
    HeatRecoveryEfficiencyLatent="0.65",
    MinHumidity="20",
    MaxHumidity="80",
    TurnOnEMSFanEnergy=fanenergy,
    FanPressureRise=1000,
    MaxHeatSupplyAirTemp="30",
    MinCoolSupplyAirTemp="18",
    HeatingSizingFactor=1.2,
    CoolingSizingFactore=1.2,
    NatVentIsOn=natventon,
    SchedVentIsOn=scheduledventilationon,
    ScheduledVentilationAvailability="Off",
    NaturalVentilationSchedule="Off",
    StackDrivenFlow=scheduledventilationon_2,
    Crossventilation=scheduledventilationon_2,
    InfiltrationIsOn=infiltrationon,
    InfiltrationAch=infiltration_ach,
    InfiltrationFlowExtArea=item_9,
    InfiltrationCalculationMethod=infiltrationmethod,
    AFNAirMassFlowCoefficientCrack=0.001,
    FlowRatePerPerson="0",
    DHWOn=dhwon,
    Input_0_Hidden=False,
    Input_0_Name="Name",
    Input_100_Hidden=True,
    Input_100_Name="Interior Vertical Insulation Depth",
    Input_101_Hidden=True,
    Input_101_Name="Exterior Horizontal Insulation Depth",
    Input_102_Hidden=True,
    Input_102_Name="Exterior Horizontal Insulation Width",
    Input_103_Hidden=True,
    Input_103_Name="Footing Thickness",
    Input_104_Hidden=True,
    Input_104_Name="Footing Depth",
    Input_105_Hidden=True,
    Input_105_Name="ElectricityCO2",
    Input_106_Hidden=True,
    Input_106_Name="ElectricityCost",
    Input_107_Hidden=True,
    Input_107_Name="HotWaterCO2",
    Input_108_Hidden=True,
    Input_108_Name="HotWaterCost",
    Input_109_Hidden=True,
    Input_109_Name="CoolingCO2",
    Input_10_Hidden=True,
    Input_10_Name="Ground Wall Construction",
    Input_110_Hidden=True,
    Input_110_Name="HeatingCO2",
    Input_111_Hidden=True,
    Input_111_Name="CoolingCost",
    Input_112_Hidden=True,
    Input_112_Name="HeatingCost"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)
library = CSLibrary(AddObjects=flatten([year_schedule_3.Sched, year_schedule.Sched, year_schedule_2.Sched, simple_window, exteriorroof, exteriorwall, slab, partition_5, mats]))
python_12 = GhPythonScript(x=construction.ConstructionInformation)  # -> Rval, mass; same code as python_11
python_13 = GhPythonScript(x=construction_4.ConstructionInformation)  # -> Rval, mass; same code as python_11

pln = Plane(points)
pi = Pi(Factor="-1")
number_slider_2 = Slider(110, range=0..150)
prot = RotatePlane(Plane=pln, Angle=angle.OrientationsRads)
dom = ConstructDomain(DomainStart=0, DomainEnd=pi)
arc = Arc(Plane=prot, Radius=number_slider_2, Angle=dom)  # -> Arc, Length
multiplication_17 = Multiplication(A=Slider(6, range=0..100), B=4)
circle = CircleCNR(Center=simplify(graft(centers)), Normal=Vector(0, 0, 1), Radius=number_slider_2)
expression_2 = Expression(Expression="80*π/180")
divide = DivideCurve(Curve=circle, Count=multiplication_17, Kinks=False)  # -> Points, Tangents, Parameters
shift = ShiftList(List=divide.Points, Shift=1, Wrap=True)
dom_2 = ConstructDomain(DomainStart=0, DomainEnd=expression_2)
ln_2 = Line(StartPoint=divide.Points, EndPoint=shift)

lng_6 = ListLength(List=circle)
multiplication_18 = Multiplication(A=lng_6, B=multiplication_17)
item_27 = ListItem(List=divide.Points, Index=0, Wrap=True)  # -> simplify(Item)
vec2pt_5 = Vector2Pt(PointA=centers, PointB=item_27, Unitize=False)  # -> Vector, Length

# ----
# Save building settings
expression_3 = Expression(x=expression, Expression="Format(\"{0}_geometry.json\", x)")
panel_16 = Panel(expression_3)
dejson = DeserializeJson(JSON=zset, OutputsLocked=False)  # -> Constructions, Loads, Conditioning, HotWater, NaturalVentilation, Foundation, Infiltration, CostEmissions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
item_28 = ListItem(List=floor_to_floor_heights, Index=int, Wrap=True)
item_29 = ListItem(List=shoebox_width, Index=int, Wrap=True)
item_30 = ListItem(List=perim_depths, Index=int, Wrap=True)
item_31 = ListItem(List=core_depths, Index=int, Wrap=True)
item_32 = ListItem(List=random_28, Index=int, Wrap=True)
expression_4 = Expression(x=expression, Expression="Format(\"{0}_templates.json\", x)")
panel_17 = Panel(expression_4)
python_14 = GhPythonScript(
    f2f_height=item_28,
    sb_w=item_29,
    pd=item_30,
    cd=item_31,
    wwr=item_32,
    uval=item_11,
    shgc=item_10,
    sched=item_14,
    RoofRval=python_12.Rval,
    RoofMass=python_12.mass,
    WallRval=python_13.Rval,
    WallMass=python_13.mass,
    SlabRval=python_11.Rval,
    econ=item_12,
    hrv=item_13,
    Conditioning=dejson.Conditioning,
    Loads=dejson.Loads,
    Infiltration=dejson.Infiltration)  # -> sb_dict
# ---------- python_14: Python ----------
__author__ = "zoelh"
__version__ = "2023.11.18"

import rhinoscriptsyntax as rs
import json
d = {}

d=ShoeboxConfig = dict(
    width=float(sb_w),
    height=float(f2f_height),
    perim_depth=float(pd),
    core_depth=float(cd),
    wwr = float(wwr),
    cop_heating= 1,
    cop_cooling= 1,
    HeatingSetpoint=float(Conditioning["HeatingSetpoint"]),
    CoolingSetpoint=float(Conditioning["CoolingSetpoint"]),
    LightingPowerDensity=float(Loads["LightingPowerDensity"]),
    EquipmentPowerDensity=float(Loads["EquipmentPowerDensity"]),
    PeopleDensity=float(Loads["PeopleDensity"]),
    Infiltration=float(Infiltration["InfiltrationFlowPerExteriorSurfaceArea"]),
    VentilationPerArea=float(Conditioning["MinFreshAirArea"]) / 1000,
    VentilationPerPerson=float(Conditioning["MinFreshAirPerson"]) / 1000,
    VentilationMode = 2,
    FacadeMass = float(WallMass),
    RoofMass = float(RoofMass),
    FacadeRValue = float(WallRval),
    RoofRValue = float(RoofRval),
    SlabRValue = float(SlabRval),
    WindowUValue = float(uval),
    WindowShgc = float(shgc),
    EconomizerSettings=int(econ),
    RecoverySettings=int(hrv),
    template_idx=int(sched),
)

#for i, id in enumerate(ids):
#    id = int(id)
#    d[id]=dict(ShoeboxConfig = dict(
#        FacadeMass = float(WallMass[i]),
#        RoofMass = float(RoofMass[i]),
#        FacadeRValue = float(WallRval[i]),
#        RoofRValue = float(RoofRval[i]),
#        SlabRValue = float(SlabRval[i]),
#        WindowUValue = float(uval[i]),
#        WindowShgc = float(shgc[i]),
#        wwr = float(wwr[i]),
#        template_idx=int(sched[i]),
#        width=float(sb_w),
#        height=float(f2f_height[i]),
#        perim_depth=float(pd[i]),
#        core_depth=float(cd[i])
#    ))

sb_dict = json.dumps(d)
# ---------- end python_14 ----------
python_15 = GhPythonScript(set=python_14, name=panel_17, dir=output_directory, save=falsestart)
# ---------- python_15: Python ----------
__author__ = "zoelh"
__version__ = "2023.11.18"

import rhinoscriptsyntax as rs
import json

if save:
    fname = dir + name
    print(fname)
    with open(fname, "w") as f:
        json.dump(json.loads(set), f, indent=4)
# ---------- end python_15 ----------

# ----
# Model Setup
window_settings = Data(wset)
zone_settings = Data(zset)
zone = CSEnergyZone(
    Brep=flatten(branch_5),
    Name=flatten(branch),
    Settings=zone_settings,
    UsedLibraryObjects="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")  # -> Zones, Settings
zone_2 = CSEnergyZone(
    Brep=flatten(branch_4),
    Name=flatten(branch_2),
    Settings=zone_settings,
    UsedLibraryObjects="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")  # -> Zones, Settings
bco = CSBoundaryObject(Brep=item_21, type="GROUND")
window = CSWindow(Surface=branch_3, Settings=window_settings, UsedLibraryObjects="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")  # -> Window, Settings
expression_5 = Expression(x=expression, Expression="Format(\"{0}_Autozoner\", x)")
panel_18 = Panel(expression_5)

panel_19 = Panel(zone_2.Zones)

random_29 = Random(Range=dom_2, Number=multiplication_18, Seed=int)

expression_6 = Expression(a=random_29, r=number_slider_2, Expression="r*tan(a)")  # -> simplify(R)
shading_heights = Data(expression_6)

Z_10 = UnitZ(Factor=expression_6)
extr_3 = Extrude(Base=ln_2, Direction=Z_10)  # -> simplify(Extrusion)

branch_6 = TreeBranch(Tree=simplify(extr_3), Path=int, MaintainPaths=True)

model = CSModelMaker(
    Zones=flatten([zone.Zones, zone_2.Zones]),
    Windows=flatten(window.Window),
    Boundaries=bco,
    Shading=flatten(branch_6),
    Library=library)  # -> Model, Invalid
run_e = RunCSEnergyModel(
    Model=model.Model,
    Name=panel_18,
    Directory=output_directory,
    Location=path,
    Run=run_eplus,
    NorthOffset=0,
    settings="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")  # -> Model, Settings, Result

expression_7 = Expression(Expression="0.5*π - 15/2*π/180")
line_2 = LineSDL(Start=end_3.Start, Direction=vec2pt_4.Vector, Length=number_slider_2)  # -> simplify(Line)
xy_2 = XYPlane(Origin=points)
crv = Curve(circle)
dup_2 = DuplicateData(Data=centers, Number="4", Order=True)  # -> simplify(graft(Data))
dup_3 = DuplicateData(Data=vec2pt_5.Vector, Number="4", Order=True)  # -> simplify(graft(Data))
dup_4 = DuplicateData(Data=crv, Number="4", Order=True)  # -> simplify(graft(Data))
xy_3 = XYPlane(Origin=simplify(points))
rotate_3 = Rotate(Geometry=simplify(line_2), Angle=expression_7, Plane=simplify(xy_2))  # -> Geometry, Transform
expression_8 = Expression(Expression="-π")
arrpolar = PolarArray(Geometry=simplify(rotate_3.Geometry), Plane=xy_3, Count="12", Angle=expression_8)  # -> Geometry, Transform
end_5 = EndPoints(Curve=arrpolar.Geometry)  # -> Start, End
crv_cp = CurveClosestPoint(Point=simplify(end_5.End), Curve=simplify(dup_4))  # -> Point, Parameter, Distance
vec2pt_6 = Vector2Pt(PointA=dup_2, PointB=crv_cp.Point, Unitize=False)  # -> Vector, Length
xy_4 = XYPlane(Origin=Point(0, 0, 0))
expression_9 = Expression(H=shading_heights, r=number_slider_2, Expression="atan(H/r)")  # -> simplify(R); disabled
panel_20 = Panel("{2;2}")  # disabled
angle_2 = Angle(VectorA=dup_3, VectorB=vec2pt_6.Vector, Plane=xy_4)  # -> Angle, Reflex
branch_7 = TreeBranch(Tree=arrpolar.Geometry, Path=panel_20, MaintainPaths=True)  # disabled
expression_10 = Expression(x=angle_2.Angle, Expression="x/(15*π/180)")
branch_8 = TreeBranch(Tree=arrpolar.Geometry, Path=panel_20, MaintainPaths=True)  # disabled
round_2 = Round(Number=expression_10)  # -> Nearest, Floor, Ceiling
item_33 = ListItem(List=simplify(expression_9), Index=round_2.Floor, Wrap=True)  # disabled
branch_9 = TreeBranch(Tree=item_33, Path=panel_20, MaintainPaths=True)  # disabled
original_angle = Panel(branch_9)  # disabled
item_34 = ListItem(List=shading_heights, Index=round_2.Floor, Wrap=True)
pdecon = Deconstruct(Point=crv_cp.Point)  # -> XComponent, YComponent, ZComponent
pt = ConstructPoint(XCoordinate=pdecon.XComponent, YCoordinate=pdecon.YComponent, ZCoordinate=item_34)
branch_10 = TreeBranch(Tree=pt, Path=panel_20, MaintainPaths=True)  # disabled
vec2pt_7 = Vector2Pt(PointA=simplify(points), PointB=pt, Unitize=False)  # -> Vector, Length
vec = Vector(arrpolar.Geometry)
angle_3 = Angle(VectorA=vec, VectorB=vec2pt_7.Vector)  # -> Angle, Reflex

python_16 = GhPythonScript(
    index=int,
    ids=python.a,
    edge_lengths=simplify(len_4),
    edge_weights=simplify(edge_weights),
    orientations=simplify(orientation_radians),
    total_areas=multiplication_16,
    bldg_core_areas=simplify(area_7.Area),
    bldg_perim_areas=simplify(area_6.Area),
    perim_depths=simplify(perim_depths),
    core_depths=core_depths,
    footprint_areas=footprint_areas,
    wwrs=wwr,
    n_floors=floors,
    f2f_heights=floor_to_floor_height,
    normals=simplify(vec2pt_4.Vector),
    dist_to_c=dist,
    shading=simplify(angle_3.Angle),
    fname=panel_16,
    outpath=output_directory,
    save=falsestart)  # -> out, output_data; inputs ids: list, edge_lengths: tree, edge_weights: tree, orientations: tree, total_areas: list, bldg_core_areas: tree, bldg_perim_areas: tree, perim_depths: list, core_depths: list, footprint_areas: list, wwrs: list, n_floors: list of Int32, f2f_heights: list, normals: tree of Vector3d, dist_to_c: tree, shading: tree
# ---------- python_16: Python ----------
__author__ = "szvsw"
__version__ = "2023.11.15"

import rhinoscriptsyntax as rs
import ghpythonlib.treehelpers as th
import json

output_data = {}

perima_idx = 0

id = ids[int(index)]
b = int(index)

bldg_data = {
    "building_area": float(total_areas[b]),
    "perim_depth": float(perim_depths[b]),
    "core_depth": float(core_depths[b]),
    "footprint_area": float(footprint_areas[b]),
    "wwr": float(wwrs[b]),
    "height": float(f2f_heights[b]),
    "n_floors": int(n_floors[b]),
    "perims": [],
    "cores": [],
    "shading": []
}
core_dict = {}
perim_dict = {}
shading_dict = {}

for f in range(n_floors[b]):
    core_dict["core_floor_"+str(f)+"_n_1"] = {
        "core_area": bldg_core_areas.Branch(b)[f],
        "floor": f
    }
#    bldg_data["cores"].append(core_dict)
bldg_data["cores"] = core_dict

for i in range(4):
    pas = bldg_perim_areas.Branch(perima_idx+i)
    for f, area in enumerate(pas):
        perim_dict["perim_floor_"+str(f)+"_n_"+str(i)] = {
            "perim_area": area,
            "facade_length": float(edge_lengths.Branch(b)[i]),
            "orientation": float(orientations.Branch(b)[i]),
            "facade_normal": tuple([normals.Branch(b)[i][j] for j in range(3)]),
            "floor": f,
            "distance_to_bldg_cent":float(dist_to_c.Branch(b)[i])
        }
    shading_dict["n_"+str(i)] = [float(val) for val in shading.Branch(perima_idx+i)]
perima_idx += 4
bldg_data["perims"] = perim_dict
bldg_data["shading"] = shading_dict
output_data[id] = bldg_data

print(json.dumps(output_data,indent=4))

if save:
    with open(str(outpath)+str(fname),"w") as f:
        json.dump(output_data,f,indent=4)
# ---------- end python_16 ----------

panel_21 = Panel(python_16.out)
facade_angle = Panel(angle_3.Angle)  # disabled
