# Grasshopper definition AutozoneValidate.gh (Grasshopper 1.0.7)
# plug-ins: Autozoner, ClimateStudioGH, jSwan

# ----
# Unit Converter
# Internalized Geometry is
# modeled in meters.
toggle = BooleanToggle(True)
unit = CSUnitScale(
    From="Meters",
    To="ActiveRhinoDocUnits",
    Listener=toggle,
    Input_0_Hidden=False,
    Input_0_Name="From",
    Input_1_Hidden=False,
    Input_1_Name="To",
    Input_2_Hidden=False,
    Input_2_Name="Listener",
    UnitSystem=4)

save_geom = Button()
run_eplus = Button()
# RUN
toggle_2 = BooleanToggle(True)
schedule_locs = Panel("C:\Users\szvsw\repos\ml-for-building-energy-modeling\ml-for-bem\data\")
start = Panel("0")
output_directory = Panel("C:\Users\szvsw\repos\ml-for-building-energy-modeling\ml-for-bem\data\temp\validation\v3\")

# ---- group: Weather File
path = FilePath("C:\Users\szvsw\repos\ml-for-building-energy-modeling\ml-for-bem\data\epws\validation_epws\USA_WA_Seattle-Tacoma.Intl.AP.727930_TMYx.2007-2021.epw")

# ----
panel = Panel(path)
addition = Addition(A=Slider(999, range=0..999), B=start)
total_num = Panel("10000")  # disabled

# ---- group: BUILDING IDS
id = Panel("0 to 999999999")  # disabled
random = Random(Range=id, Number=total_num, Seed=total_num)  # disabled
python = GhPythonScript(x=random)  # -> out, a; disabled
# ---------- python: Python ----------
__author__ = "zoelh"
__version__ = "2023.12.15"

import rhinoscriptsyntax as rs

a = "%09d" % (int(x), )
# ---------- end python ----------

# ----
int = Integer(addition)
python_2 = GhPythonScript(x=int)  # -> out, a; same code as python
ventilationmode = Panel("0 to 2")
random_seeds = Panel("200")

# ----
# Building Generation Parameters
bldg_dim_m = Panel("10 to 50")
corner_pertub_m = Panel("0 to 0")
f2f_height_m = Panel("3 to 5")
n_floors = Panel("1 to 10")
wwr_frac = Panel("0.1 to 0.8")
perim_offset = Slider(4.5, range=3..7)
n_buildings = Slider(1, range=1..1000)

random_2 = Random(Range="0 to 999999", Number=random_seeds, Seed=int)
int_2 = Integer(random_2)
item = ListItem(List=int_2, Index=0, Wrap=True)  # -> Item, Item1, Item2, Item3, Item4, Item5, Item6, Item7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

heating_sp = Panel("14 to 24")
cooling_sp = Panel("22 to 30")
lpd = Panel("0 to 15")
epd = Panel("0 to 30")
people_density = Panel("0 to 0.2")
infiltration = Panel("0 to 0.001")
ventperarea = Panel("0 to 0.001")
ventperperson = Panel("0 to 0.005")
uval = Panel("0.3 to 7.0")
roofmass = Panel("0 to 3")
facademass = Panel("0 to 3")
slabr = Panel("0.5 to 14")
roofr = Panel("0.5 to 17")
shgc = Panel("0.3 to 0.6")
econ = Panel("0 to 1")
hrv = Panel("0 to 2")
facader = Panel("0.5 to 14")
schedule = Panel("0 to 15")
random_3 = Random(Range=heating_sp, Number=n_buildings, Seed=item.Item)
random_4 = Random(Range=uval, Number=n_buildings, Seed=item.Item11)
random_5 = Random(Range=shgc, Number=n_buildings, Seed=item.Item12)
random_6 = Random(Range=slabr, Number=n_buildings, Seed=item.Item17)
random_7 = Random(Range=roofmass, Number=n_buildings, Seed=item.Item13)
random_8 = Random(Range=roofr, Number=n_buildings, Seed=item.Item15)
random_9 = Random(Range=cooling_sp, Number=n_buildings, Seed=item.Item1)
random_10 = Random(Range=epd, Number=n_buildings, Seed=item.Item3)
random_11 = Random(Range=econ, Number=n_buildings, Seed=item.Item8)
random_12 = Random(Range=hrv, Number=n_buildings, Seed=item.Item9)
random_13 = Random(Range=facader, Number=n_buildings, Seed=item.Item16)
random_14 = Random(Range=ventperarea, Number=n_buildings, Seed=item.Item6)
random_15 = Random(Range=lpd, Number=n_buildings, Seed=item.Item2)
random_16 = Random(Range=people_density, Number=n_buildings, Seed=item.Item4)
random_17 = Random(Range=infiltration, Number=n_buildings, Seed=item.Item5)
random_18 = Random(Range=ventperperson, Number=n_buildings, Seed=item.Item7)
random_19 = Random(Range=facademass, Number=n_buildings, Seed=item.Item14)
random_20 = Random(Range=schedule, Number=n_buildings, Seed=item.Item10)
int_3 = Integer(random_7)
minwood_con = Panel("0.041")
int_4 = Integer(random_11)
int_5 = Integer(random_12)
int_6 = Integer(random_19)
int_7 = Integer(random_20)
xps_con = Panel("0.034")
concrete_den = Panel("2100")
concrete_sh = Panel("1040")
multiplication = Multiplication(A=random_6, B=xps_con)
multiplication_2 = Multiplication(A=random_13, B=minwood_con)
multiplication_3 = Multiplication(A=random_8, B=xps_con)
python_3 = GhPythonScript(x=int_4)  # -> econstr
# ---------- python_3: Python ----------
__author__ = "zoelh"
__version__ = "2023.12.16"

import rhinoscriptsyntax as rs

l = ["NoEconomizer", "DifferentialEnthalpy"]
econstr = l[x]
# ---------- end python_3 ----------
python_4 = GhPythonScript(x=int_3, specific_heat=concrete_sh, density=concrete_den)  # -> t
# ---------- python_4: Python ----------
__author__ = "zoelh"
__version__ = "2023.12.16"

import rhinoscriptsyntax as rs

tm_list = [550000, 200000, 55000, 18000]

needed_tm = tm_list[x]

t = needed_tm / float(specific_heat) / float(density)
# ---------- end python_4 ----------
python_5 = GhPythonScript(x=int_6, specific_heat=concrete_sh, density=concrete_den)  # -> t; same code as python_4
python_6 = GhPythonScript(x=int_5)  # -> hrvstr
# ---------- python_6: Python ----------
__author__ = "zoelh"
__version__ = "2023.12.16"

import rhinoscriptsyntax as rs

l = ["None", "Sensible", "Enthalpy"]
hrvstr = l[x]
# ---------- end python_6 ----------

random_21 = Random(Range=ventilationmode, Number=n_buildings, Seed=item.Item27)
int_8 = Integer(random_21)
min = Minimum(A=random_3, B=random_9)
max = Maximum(A=random_3, B=random_9)

random_22 = Random(Range=bldg_dim_m, Number=n_buildings, Seed=item.Item18)
random_23 = Random(Range=bldg_dim_m, Number=n_buildings, Seed=item.Item25)
multiplication_4 = Multiplication(A=n_buildings, B="4")
rectangle = Rectangle(Plane=PlaneXY(0, 0, 0), XSize=random_22, YSize=random_23, Radius=0)  # -> Rectangle, Length
random_24 = Random(Range="2*pi", Number=multiplication_4, Seed=item.Item19)
random_25 = Random(Range=corner_pertub_m, Number=multiplication_4, Seed=item.Item20)
partition = PartitionList(List=random_24, Size="4")
partition_2 = PartitionList(List=random_25, Size="4")
disc = Discontinuity(Curve=rectangle.Rectangle, Level=1)  # -> Points, Parameters
Z = UnitZ(Factor=1)
X = UnitX(Factor=1)
vrot = Rotate(Vector=X, Axis=Z, Angle=partition)
multiplication_5 = Multiplication(A=vrot, B=partition_2)
move = Move(Geometry=disc.Points, Motion=multiplication_5)  # -> Geometry, Transform
pline = PolyLine(Vertices=move.Geometry, Closed=True)  # -> simplify(flatten(Polyline))
area = Area(Geometry=pline)  # -> Area, Centroid
random_26 = Random(Range="2*pi", Number=n_buildings, Seed=item.Item21)
rotate = Rotate(Geometry=pline, Angle=random_26, Plane=area.Centroid)  # -> Geometry, Transform
cx = CurveSelf(Curve=rotate.Geometry)  # -> Points, Params
lng = ListLength(List=cx.Points)  # -> flatten(Length)
equals = Equality(FirstNumber=lng, SecondNumber="0")  # -> Equality, Inequality
cull = CullPattern(List=rotate.Geometry, CullPattern=equals.Equality)
az = Autozoner(FloorPlanOutlines=graft(cull), Offset=perim_offset)  # -> Outline, PerimeterPolylines, CorePolylines, SkeletonPolylines
lng_2 = ListLength(List=cull)
geo_perim = Geometry(az.Outline)
geo_zones = Geometry(az.PerimeterPolylines)
geo_core = Geometry(az.CorePolylines)
random_27 = Random(Range=f2f_height_m, Number=lng_2, Seed=item.Item22)
random_28 = Random(Range=n_floors, Number=lng_2, Seed=item.Item23, Integers=True)
random_29 = Random(Range=wwr_frac, Number=lng_2, Seed=item.Item24)
srf = Surface(graft(geo_zones))
srf_2 = Surface(simplify(geo_core))
trim = TrimTree(Tree=srf, Depth=1)
Z_2 = UnitZ(Factor=random_27)
extr = Extrude(Base=srf_2, Direction=graft(Z_2))  # -> simplify(Extrusion)
extr_2 = Extrude(Base=trim, Direction=graft(Z_2))  # -> simplify(Extrusion)
series = Series(Start=0, Step=graft(random_27), Count=graft(random_28))  # -> simplify(Series)
division = Division(A=random_27, B=2)
Z_3 = UnitZ(Factor=division)
Z_4 = UnitZ(Factor=series)
move_2 = Move(Geometry=cull, Motion=Z_3)  # -> Geometry, Transform
explode = Explode(Curve=move_2.Geometry, Recursive=True)  # -> Segments, Vertices
lng_3 = ListLength(List=Z_4)  # -> flatten(Length)
end = EndPoints(Curve=explode.Segments)  # -> Start, End
move_3 = Move(Geometry=extr, Motion=Z_4)  # -> Geometry, Transform
multiplication_6 = Multiplication(A=random_27, B=random_29)
python_7 = GhPythonScript(x=extr_2, y=Z_4)  # -> out, a; inputs x: list of Brep, y: list of Vector3d
# ---------- python_7: Python ----------
__author__ = "szvsw"
__version__ = "2023.11.14"

import rhinoscriptsyntax as rs
import ghpythonlib.components as ghcomp
import ghpythonlib.treehelpers as th
breps = x
vecs = y
breps_out = []

for brep in breps:
    for vec in vecs:
        new_brep,_ = ghcomp.Move(brep,vec)
        breps_out.append(new_brep)

a = th.list_to_tree(breps_out)
# ---------- end python_7 ----------
midpt = CurveMiddle(Curve=explode.Segments)
geo = Geometry(move_3.Geometry)
geo_2 = Geometry(python_7.a)
vec2pt = Vector2Pt(PointA=end.End, PointB=midpt, Unitize=invert(False))  # -> Vector, Length
vec2pt_2 = Vector2Pt(PointA=end.Start, PointB=midpt, Unitize=invert(False))  # -> Vector, Length
stack = StackData(Data=lng_3, Stack="4")
division_2 = Division(A=multiplication_6, B=2)
multiplication_7 = Multiplication(A=vec2pt.Vector, B="0.1")
multiplication_8 = Multiplication(A=vec2pt_2.Vector, B="0.1")
Z_5 = UnitZ(Factor=division_2)
move_4 = Move(Geometry=end.End, Motion=multiplication_7)  # -> Geometry, Transform
move_5 = Move(Geometry=end.Start, Motion=multiplication_8)  # -> Geometry, Transform
partition_3 = PartitionList(List=geo_2, Size=stack)  # -> simplify(Chunks)
neg = Negative(Value=Z_5)
ln = Line(StartPoint=move_5.Geometry, EndPoint=move_4.Geometry)
path_mapper = PathMapper(partition_3, source="{a}[i]", target="{floor(a/4);a%4}[i]")
move_6 = Move(Geometry=ln, Motion=graft(Z_5))  # -> Geometry, Transform
move_7 = Move(Geometry=ln, Motion=graft(neg))  # -> Geometry, Transform
geo_3 = Geometry(path_mapper)
merge = Merge(Data1=graft(move_6.Geometry), Data2=graft(move_7.Geometry))  # -> simplify(Result)
loft = Loft(Curves=merge, Options={Adjust=False, Closed=False, LoftEnds=0, LoftSimp=0, LoftType=0, Rebuild=10, Refit=0.01})
python_8 = GhPythonScript(x=loft, y=Z_4)  # -> out, a; inputs x: list of Brep, y: list of Vector3d; same code as python_7
geo_4 = Geometry(python_8.a)
partition_4 = PartitionList(List=geo_4, Size=stack)  # -> simplify(Chunks)
path_mapper_2 = PathMapper(partition_4, source="{a}[i]", target="{floor(a/4);a%4}[i]")
geo_5 = Geometry(path_mapper_2)

# ---- group: Windows
tvis = Panel("0.8")

# ----
multiplication_9 = Multiplication(A=random_18, B="1000")
multiplication_10 = Multiplication(A=random_14, B="1000")

srf_3 = Surface(az.CorePolylines)
srf_4 = Surface(az.Outline)
srf_5 = Surface(az.PerimeterPolylines)
area_2 = Area(Geometry=srf_4)  # -> flatten(FootprintArea), Centroid
len = Length(Curve=geo_perim)  # -> flatten(PerimeterLengths)
shoebox_width = Panel("3")
floor_to_floor_heights = Number(random_27)
area_3 = Area(Geometry=srf_3)  # -> flatten(CoreAreas), Centroid
area_4 = Area(Geometry=srf_5)  # -> PerimAreas, Centroid
ma = MassAddition(Input=area_4.PerimAreas)  # -> flatten(TotalPerimArea), PartialResults
multiplication_11 = Multiplication(A=floor_to_floor_heights, B=len)
multiplication_12 = Multiplication(ShoeboxWidth=shoebox_width, FloorToFloorHeights=floor_to_floor_heights)
division_3 = Division(PerimOffset=perim_offset, FloorToFloorHeight=floor_to_floor_heights)
facade_area = Division(TotalPerimArea=ma.TotalPerimArea, FacadeArea=multiplication_11)
division_4 = Division(CoreAreas=area_3.CoreAreas, TotalPerimAreas=ma.TotalPerimArea)
panel_2 = Panel(division_3)
panel_3 = Panel(facade_area)
panel_4 = Panel(division_4)
multiplication_13 = Multiplication(SBFacadeArea=multiplication_12, PerimAreaToFacadeArea=facade_area)
division_5 = Division(ShoeboxAreas=multiplication_13, ShoeboxWidths=shoebox_width)
perim_depths = Panel(division_5)
multiplication_14 = Multiplication(PerimDepths=division_5, CoreAreaToPerimArea=division_4)
core_depths = Panel(multiplication_14)
footprint_areas = Panel(area_2.FootprintArea)

explode_2 = Explode(Curve=cull, Recursive=True)  # -> Segments, Vertices
midpt_2 = CurveMiddle(Curve=explode_2.Segments)
len_2 = Length(Curve=explode_2.Segments)
end_2 = EndPoints(Curve=explode_2.Segments)  # -> Start, End
len_3 = Length(Curve=cull)
vec2pt_3 = Vector2Pt(PointA=end_2.Start, PointB=midpt_2, Unitize=False)  # -> Vector, Length
division_6 = Division(A=len_2, B=graft(len_3))  # -> simplify(EdgeWeights)
move_8 = Move(Geometry=explode_2.Segments, Motion=vec2pt_3.Vector)  # -> Geometry, Transform
rotate_2 = Rotate(Geometry=move_8.Geometry, Angle="-PI/2", Plane=midpt_2)  # -> Geometry, Transform
end_3 = EndPoints(Curve=rotate_2.Geometry)  # -> Start, End
Y = UnitY(Factor=1)
vec2pt_4 = Vector2Pt(PointA=end_3.Start, PointB=end_3.End, Unitize=False)  # -> Vector, Length
neg_2 = Negative(Value=Y)
xy = XYPlane(Origin=Point(0, 0, 0))
angle = Angle(VectorA=neg_2, VectorB=vec2pt_4.Vector, Plane=xy)  # -> OrientationsRads, Reflex
multiplication_15 = Multiplication(A=angle.OrientationsRads, B=57.29577951)
round = Round(Number=multiplication_15)  # -> Nearest, Floor, Ceiling
merge_2 = Merge(Data1=simplify(graft(round.Nearest)), Data2=simplify(graft(division_6)))
join = TextJoin(Text=merge_2, Join="deg, weight:")  # -> simplify(Result)
ins = InsertItems(List=graft(random_27), Item="f2fHeight (m)", Indices="1", Wrap=True)
ins_2 = InsertItems(List=graft(random_28), Item="floors", Indices="1", Wrap=True)
ins_3 = InsertItems(List=graft(random_29), Item="WWRs", Indices="1", Wrap=True)
# For each edge, save normal in json (see gen city tester for geom stuff)
line = LineSDL(Start=end_3.Start, Direction=vec2pt_4.Vector, Length="10")
join_2 = TextJoin(Text=ins, Join=" ")  # -> flatten(Result)
join_3 = TextJoin(Text=ins_2, Join=" ")  # -> flatten(Result)
join_4 = TextJoin(Text=ins_3, Join=" ")  # -> flatten(Result)
end_4 = EndPoints(Curve=line)  # -> Start, End
tag = TextTag(Location=end_4.End, Text=join)
item_2 = ListItem(List=end_4.End, Index=0, Wrap=True)  # -> flatten(Item)
tag_2 = TextTag(Location=item_2, Text=join_2)
tag_3 = TextTag(Location=item_2, Text=join_3)
tag_4 = TextTag(Location=item_2, Text=join_4)
edge_weights = Panel(division_6)  # disabled
wwr = Panel(random_29)  # disabled
floor_to_floor_height = Panel(random_27)  # disabled
floors = Panel(random_28)  # disabled
orientation_radians = Panel(angle.OrientationsRads)  # disabled

area_5 = Area(Geometry=cull)  # -> Area, Centroid
explode_3 = Explode(Curve=cull, Recursive=True)  # -> simplify(Segments), Vertices
len_4 = Length(Curve=explode_3.Segments)
edge_lengths = Panel(len_4)  # disabled
area_6 = Area(Geometry=geo_zones)  # -> simplify(Area), Centroid
area_7 = Area(Geometry=geo_core)  # -> Area, Centroid
perim_area = Panel(area_6.Area)  # disabled
corearea = Panel(area_7.Area)  # disabled

# ---- group: ZONE NAMES
lng_4 = ListLength(List=geo_3)
trim_2 = TrimTree(Tree=lng_4, Depth=1)
lng_5 = ListLength(List=geo)
python_9 = GhPythonScript(x="core", y=lng_5)  # -> simplify(names); inputs y: tree
# ---------- python_9: Python ----------
__author__ = "zoelh"
__version__ = "2023.12.16"

import rhinoscriptsyntax as rs
import ghpythonlib.treehelpers as th

names = []

for i, branch in enumerate(y.Branches):
    n = []
    print(branch)
    for k in range(len(branch)):
        n.append([x+"_floor_"+str(j)+"_n_"+str(k) for j in range(branch[k])])
    names.append(n)
     
print(names)
names = th.list_to_tree(names, source=[0,0])
#names = [x+"_"+str(i) for i in range(y)]
# ---------- end python_9 ----------
python_10 = GhPythonScript(x="perim", y=trim_2)  # -> simplify(names); inputs y: tree; same code as python_9

# ----
centroid = Data(area_5.Centroid)
normals = Geometry(line)
points = Data(end_3.Start)
trim_3 = TrimTree(Tree=geo_3, Depth=1)
area_8 = Area(Geometry=trim_3)  # -> Area, Centroid; disabled
trim_4 = TrimTree(Tree=geo_5, Depth=1)

windows = Geometry(flatten(geo_5))
perim = Geometry(flatten(geo_3))
core = Geometry(flatten(geo))
ground = Surface(cull)
swatch = ColourSwatch(SwatchColor=RGB(222, 171, 144))  # disabled
swatch_2 = ColourSwatch(SwatchColor=RGB(102, 53, 0))  # disabled
swatch_3 = ColourSwatch(SwatchColor=RGB(144, 204, 222))  # disabled
swatch_4 = ColourSwatch(SwatchColor=RGB(201, 222, 144))  # disabled
preview = CustomPreview(Geometry=perim, Material=swatch)  # disabled
preview_2 = CustomPreview(Geometry=windows, Material=swatch_3)  # disabled
preview_3 = CustomPreview(Geometry=core, Material=swatch_4)  # disabled
preview_4 = CustomPreview(Geometry=ground, Material=swatch_2)  # disabled

area_9 = Area(Geometry=ground)  # -> Area, Centroid
multiplication_16 = Multiplication(A=area_9.Area, B=random_28)
total_area = Panel(multiplication_16)  # disabled
centers = Data(simplify(graft(centroid)))
tag_5 = TextTag(Location=area_8.Centroid)  # disabled
item_3 = ListItem(List=ground, Index=int, Wrap=True)
dist = Distance(PointA=graft(area_5.Centroid), PointB=points)  # -> simplify(Distance)
int_9 = Integer(int_8)
expression = Expression(x=output_directory, Expression="Format(\"{0}features\\\", x)")
expression_2 = Expression(x=output_directory, Expression="Format(\"{0}idf\\\", x)")
data = Data(simplify(angle.OrientationsRads))  # disabled
panel_5 = Panel("Orient: ")  # disabled
panel_6 = Panel("Area: ")  # disabled
area_10 = Area(Geometry=geo)  # -> Area, Centroid; disabled
wires = BrepWireframe(Brep=perim, Density=-1)  # disabled
area_11 = Area(Geometry=geo_3)  # -> Area, Centroid
concat = Concatenate(FragmentA=panel_5, FragmentB=data)  # -> graft(Result); disabled
concat_2 = Concatenate(FragmentA=panel_6, FragmentB=perim_area)  # disabled
panel_7 = Panel("Length: ")  # disabled
toggle_3 = BooleanToggle(False)  # disabled
item_4 = ListItem(List=area_10.Centroid, Index=-1, Wrap=True)  # disabled
item_5 = ListItem(List=area_11.Centroid, Index=0, Wrap=True)  # disabled
item_6 = ListItem(List=concat_2, Index=0, Wrap=True)  # disabled
concat_3 = Concatenate(FragmentA=panel_7, FragmentB=len_4)  # -> graft(Result); disabled
data_2 = Data(simplify(graft(python_2.a)))  # disabled
Z_6 = UnitZ(Factor=1)  # disabled
move_9 = Move(Geometry=item_5, Motion=simplify(graft(vec2pt_4.Vector)))  # -> Geometry, Transform; disabled
swatch_5 = ColourSwatch(SwatchColor=RGB(5, 114, 247))  # disabled
move_10 = Move(Geometry=item_4, Motion=expr("x*10", Z_6))  # -> Geometry, Transform; disabled

python_11 = GhPythonScript(heights=random_27, floors=random_28)  # -> out, simplify(z_vects); inputs heights: list, floors: list
# ---------- python_11: Python ----------
__author__ = "zoelh"
__version__ = "2024.01.17"

import rhinoscriptsyntax as rs
import ghpythonlib.treehelpers as th

z_vects = []
for i, h in enumerate(heights):
    z_vects_temp = []
    for f in range(floors[i]):
        z_vects_temp.append(h*f)
    if len(z_vects_temp) == 0:
        z_vects_temp = [0]
    print(z_vects_temp)
    z_vects.append(z_vects_temp)

z_vects = th.list_to_tree(z_vects)
# ---------- end python_11 ----------
Z_7 = UnitZ(Factor=python_11.z_vects)  # -> simplify(UnitVector)

panel_8 = Panel("-10")  # disabled
panel_9 = Panel("-20")  # disabled
panel_10 = Panel("-30")  # disabled
swatch_6 = ColourSwatch(SwatchColor=RGB(0, 0, 0))  # disabled
Z_8 = UnitZ(Factor=panel_8)  # disabled
Z_9 = UnitZ(Factor=panel_9)  # disabled
Z_10 = UnitZ(Factor=panel_10)  # disabled
item_7 = ListItem(List=python_10, Index=0, Wrap=True)  # disabled
move_11 = Move(Geometry=move_9.Geometry, Motion=Z_8)  # -> Geometry, Transform; disabled
move_12 = Move(Geometry=move_9.Geometry, Motion=Z_9)  # -> Geometry, Transform; disabled
move_13 = Move(Geometry=move_9.Geometry, Motion=Z_10)  # -> Geometry, Transform; disabled
preview_5 = CustomPreview(
    Geometry=wires,
    Material={diffuse=RGB(221, 160, 221), emission=RGB(66, 48, 66), shine=0.5, specular=RGB(255, 255, 255), transparency=0})  # disabled
tag_6 = TextTag(Location=move_10.Geometry, Text=data_2, Colour=swatch_5)  # disabled
tag_7 = TextTag(Location=move_9.Geometry, Text=item_7, Colour=swatch_6)  # disabled
tag_8 = TextTag(Location=move_11.Geometry, Text=item_6, Colour=swatch_6)  # disabled
tag_9 = TextTag(Location=move_12.Geometry, Text=concat, Colour=swatch_6)  # disabled
tag_10 = TextTag(Location=move_13.Geometry, Text=concat_3, Colour=swatch_6)  # disabled

# ----
# Template Settings
panel_11 = Panel("mlforbem_Equipment")
python_12 = GhPythonScript(index=int_7, path=schedule_locs)  # -> schedules
# ---------- python_12: Python ----------
__author__ = "zoelh"
__version__ = "2023.11.18"

import rhinoscriptsyntax as rs
import csv
import ghpythonlib.treehelpers as th

schedules = []
l = ["EquipmentAvailabilitySchedule.csv", "LightsAvailabilitySchedule.csv", "OccupancySchedule.csv"]
for file in l:
    filename = path + file
    with open(filename) as csvfile:
        reader = csv.reader(csvfile)
        rows = list(reader)
        row = rows[int(index)+1]
        schedules.append([row[1:]])
schedules = th.list_to_tree(schedules)
# ---------- end python_12 ----------
bang = ExplodeTree(Data=python_12)  # -> Branch0, Branch1, Branch2
econ_2 = ValueList({"NoEconomizer", "DifferentialEnthalpy"}, selected="NoEconomizer")
list = ValueList({"Residential", "Kitchen", "Office", "MeetingRoom", "HotelRoom", "ClassRoom", "Library", "LectureHall", "SuperMarket", "Shopping", "ScienceLab"}, selected="Office")
infiltrationmethod = ValueList({"ACH", "Flow Per Exterior Area": "FlowExtArea"}, selected="Flow Per Exterior Area")
hrv_2 = ValueList({"None", "Sensible", "Enthalpy"}, selected="None")
zonetemplate = GetZoneTemplate(SearchZoneTemplate=list, Selection="Office")
infiltration_ach = Slider(0, range=0..1)
heating_coolingconstant = BooleanToggle(True)
people_equip_lightson = BooleanToggle(True)
scheduledventilationon = BooleanToggle(False)
heating_coolingon = BooleanToggle(True)
scheduledventilationon_2 = BooleanToggle(False)
mechventon = BooleanToggle(True)
humidistaton = BooleanToggle(False)
item_8 = ListItem(List=zonetemplate, Index=0, Wrap=True)
infiltrationon = BooleanToggle(True)
fanenergy = BooleanToggle(False)
natventon = BooleanToggle(False)
shadingon = BooleanToggle(False)
dhwon = BooleanToggle(False)
hasframe = BooleanToggle(False)
dimmingtype = Panel("Off")

expression_3 = Expression(x="mlforbem_Occupancy", y=int, Expression="Format(\"{0}_{1}\", x,y)")
expression_4 = Expression(x="mlforbem_Lights", y=int, Expression="Format(\"{0}_{1}\", x,y)")
expression_5 = Expression(x=panel_11, y=int, Expression="Format(\"{0}_{1}\", x,y)")
expression_6 = Expression(x="mlforbem_window", y=int, Expression="Format(\"{0}_{1}\", x,y)")
expression_7 = Expression(x="mlforbem_ParametricZoneSettings", y=int, Expression="Format(\"{0}_{1}\", x,y)")
expression_8 = Expression(x="mlforbem_SimpleWindowSettings", y=int, Expression="Format(\"{0}_{1}\", x,y)")
expression_9 = Expression(x="mlforbem_Carpet", y=int, Expression="Format(\"{0}_{1}\", x,y)")
expression_10 = Expression(x="mlforbem_WallConcrete", y=int, Expression="Format(\"{0}_{1}\", x,y)")
expression_11 = Expression(x="mlforbem_Stucco", y=int, Expression="Format(\"{0}_{1}\", x,y)")
expression_12 = Expression(x="mlforbem_Plaster", y=int, Expression="Format(\"{0}_{1}\", x,y)")
expression_13 = Expression(x="mlforbem_Mineral_Wool", y=int, Expression="Format(\"{0}_{1}\", x,y)")
expression_14 = Expression(x="mlforbem_Felt", y=int, Expression="Format(\"{0}_{1}\", x,y)")
expression_15 = Expression(x="mlforbem_Partition_Plaster", y=int, Expression="Format(\"{0}_{1}\", x,y)")
expression_16 = Expression(x="mlforbem_AcousticTile", y=int, Expression="Format(\"{0}_{1}\", x,y)")
expression_17 = Expression(x="mlforbem_Concrete", y=int, Expression="Format(\"{0}_{1}\", x,y)")
expression_18 = Expression(x="mlforbem_XPS", y=int, Expression="Format(\"{0}_{1}\", x,y)")
expression_19 = Expression(x="mlforbem_CustomInteriorPartition", y=int, Expression="Format(\"{0}_{1}\", x,y)")
expression_20 = Expression(x="mlforbem_CustomExteriorRoof", y=int, Expression="Format(\"{0}_{1}\", x,y)")
expression_21 = Expression(x="mlforbem_CustomGroundSlab", y=int, Expression="Format(\"{0}_{1}\", x,y)")
expression_22 = Expression(x="mlforbem_CustomExteriorWall", y=int, Expression="Format(\"{0}_{1}\", x,y)")

year_schedule = ConstructCSYearSchedule(Name=expression_3, Type=0, Category=0, DaysHours=bang.Branch2)  # -> Sched, Values
year_schedule_2 = ConstructCSYearSchedule(Name=expression_4, Type=0, Category=0, DaysHours=bang.Branch1)  # -> Sched, Values
year_schedule_3 = ConstructCSYearSchedule(Name=expression_5, Type=0, Category=0, DaysHours=bang.Branch0)  # -> Sched, Values
simple_window = ConstructCSSimpleWindow(Name=expression_6, Shgf=random_5, Uval=random_4, Tvis=tvis)
occupancy = Data(year_schedule.Sched)
wset = CSWindowSettings(
    Name=expression_8,
    Type="External",
    ShadingSystemIsOn=shadingon,
    GlazingConstruction=simple_window,
    OperableArea="0",
    HasFrame=hasframe,
    AFNWindowAvailability="AllOff",
    Input_0_Hidden=False,
    Input_0_Name="Name",
    Input_10_Hidden=True,
    Input_10_Name="ShadingThickness",
    Input_11_Hidden=True,
    Input_11_Name="ShadeGlassDistance",
    Input_12_Hidden=True,
    Input_12_Name="TopBottomEdgeOpeningMultiplier",
    Input_13_Hidden=True,
    Input_13_Name="Analysis Mesh Resolution",
    Input_14_Hidden=True,
    Input_14_Name="ZoneMixingIsOn",
    Input_15_Hidden=True,
    Input_15_Name="ZoneMixingDeltaTemperature",
    Input_16_Hidden=True,
    Input_16_Name="ZoneMixingFlowRate",
    Input_17_Hidden=False,
    Input_17_Name="Glazing Construction",
    Input_18_Hidden=False,
    Input_18_Name="OperableArea",
    Input_19_Hidden=True,
    Input_19_Name="ZoneMixingAvailibilitySchedule",
    Input_1_Hidden=False,
    Input_1_Name="WindowSettings",
    Input_20_Hidden=False,
    Input_20_Name="HasFrame",
    Input_21_Hidden=True,
    Input_21_Name="FrameWidth",
    Input_22_Hidden=True,
    Input_22_Name="FrameProjection"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)

material = ConstructCSOpaqueMaterial(
    Name=expression_15,
    Conductivity=1,
    Density=2000,
    Roughness="Rough",
    SpecificHeat=1130,
    ThermalAbsorptance=0.9,
    SolarAbsorptance=0.7,
    VisibleAbsorptance=0.7,
    Type="Finishes",
    Input_0_Hidden=False,
    Input_0_Name="Name",
    Input_10_Hidden=True,
    Input_10_Name="TemperatureCoefficientThermalConductivity",
    Input_11_Hidden=True,
    Input_11_Name="TemperatureArray",
    Input_12_Hidden=True,
    Input_12_Name="EnthalpyArray",
    Input_13_Hidden=True,
    Input_13_Name="VariableConductivityArray",
    Input_14_Hidden=False,
    Input_14_Name="Type",
    Input_15_Hidden=True,
    Input_15_Name="EmbodiedEnergy",
    Input_16_Hidden=True,
    Input_16_Name="EmbodiedCarbon",
    Input_17_Hidden=True,
    Input_17_Name="Cost",
    Input_18_Hidden=True,
    Input_18_Name="Life",
    Input_1_Hidden=False,
    Input_1_Name="Conductivity",
    Input_2_Hidden=False,
    Input_2_Name="Density",
    Input_3_Hidden=False,
    Input_3_Name="Roughness",
    Input_4_Hidden=False,
    Input_4_Name="SpecificHeat",
    Input_5_Hidden=False,
    Input_5_Name="ThermalAbsorptance"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)
material_2 = ConstructCSOpaqueMaterial(
    Name=expression_11,
    Conductivity=0.72,
    Density=1856,
    Roughness="Rough",
    SpecificHeat=840,
    ThermalAbsorptance=0.9,
    SolarAbsorptance=0.7,
    VisibleAbsorptance=0.7,
    Type="Sealing",
    Input_0_Hidden=False,
    Input_0_Name="Name",
    Input_10_Hidden=True,
    Input_10_Name="TemperatureCoefficientThermalConductivity",
    Input_11_Hidden=True,
    Input_11_Name="TemperatureArray",
    Input_12_Hidden=True,
    Input_12_Name="EnthalpyArray",
    Input_13_Hidden=True,
    Input_13_Name="VariableConductivityArray",
    Input_14_Hidden=False,
    Input_14_Name="Type",
    Input_15_Hidden=True,
    Input_15_Name="EmbodiedEnergy",
    Input_16_Hidden=True,
    Input_16_Name="EmbodiedCarbon",
    Input_17_Hidden=True,
    Input_17_Name="Cost",
    Input_18_Hidden=True,
    Input_18_Name="Life",
    Input_1_Hidden=False,
    Input_1_Name="Conductivity",
    Input_2_Hidden=False,
    Input_2_Name="Density",
    Input_3_Hidden=False,
    Input_3_Name="Roughness",
    Input_4_Hidden=False,
    Input_4_Name="SpecificHeat",
    Input_5_Hidden=False,
    Input_5_Name="ThermalAbsorptance"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)
material_3 = ConstructCSOpaqueMaterial(
    Name=expression_12,
    Conductivity=1,
    Density=2000,
    Roughness="Rough",
    SpecificHeat=1130,
    ThermalAbsorptance=0.9,
    SolarAbsorptance=0.7,
    VisibleAbsorptance=0.7,
    Type="Sealing",
    Input_0_Hidden=False,
    Input_0_Name="Name",
    Input_10_Hidden=True,
    Input_10_Name="TemperatureCoefficientThermalConductivity",
    Input_11_Hidden=True,
    Input_11_Name="TemperatureArray",
    Input_12_Hidden=True,
    Input_12_Name="EnthalpyArray",
    Input_13_Hidden=True,
    Input_13_Name="VariableConductivityArray",
    Input_14_Hidden=False,
    Input_14_Name="Type",
    Input_15_Hidden=True,
    Input_15_Name="EmbodiedEnergy",
    Input_16_Hidden=True,
    Input_16_Name="EmbodiedCarbon",
    Input_17_Hidden=True,
    Input_17_Name="Cost",
    Input_18_Hidden=True,
    Input_18_Name="Life",
    Input_1_Hidden=False,
    Input_1_Name="Conductivity",
    Input_2_Hidden=False,
    Input_2_Name="Density",
    Input_3_Hidden=False,
    Input_3_Name="Roughness",
    Input_4_Hidden=False,
    Input_4_Name="SpecificHeat",
    Input_5_Hidden=False,
    Input_5_Name="ThermalAbsorptance"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)
material_4 = ConstructCSOpaqueMaterial(
    Name=expression_9,
    Conductivity=0.6,
    Density=288,
    Roughness="Rough",
    SpecificHeat=1380,
    ThermalAbsorptance=0.9,
    SolarAbsorptance=0.7,
    VisibleAbsorptance=0.7,
    Type="Finishes",
    Input_0_Hidden=False,
    Input_0_Name="Name",
    Input_10_Hidden=True,
    Input_10_Name="TemperatureCoefficientThermalConductivity",
    Input_11_Hidden=True,
    Input_11_Name="TemperatureArray",
    Input_12_Hidden=True,
    Input_12_Name="EnthalpyArray",
    Input_13_Hidden=True,
    Input_13_Name="VariableConductivityArray",
    Input_14_Hidden=False,
    Input_14_Name="Type",
    Input_15_Hidden=True,
    Input_15_Name="EmbodiedEnergy",
    Input_16_Hidden=True,
    Input_16_Name="EmbodiedCarbon",
    Input_17_Hidden=True,
    Input_17_Name="Cost",
    Input_18_Hidden=True,
    Input_18_Name="Life",
    Input_1_Hidden=False,
    Input_1_Name="Conductivity",
    Input_2_Hidden=False,
    Input_2_Name="Density",
    Input_3_Hidden=False,
    Input_3_Name="Roughness",
    Input_4_Hidden=False,
    Input_4_Name="SpecificHeat",
    Input_5_Hidden=False,
    Input_5_Name="ThermalAbsorptance"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)
material_5 = ConstructCSOpaqueMaterial(
    Name=expression_13,
    Conductivity=0.041,
    Density=155,
    Roughness="Rough",
    SpecificHeat=1130,
    ThermalAbsorptance=0.9,
    SolarAbsorptance=0.7,
    VisibleAbsorptance=0.7,
    Type="Sealing",
    Input_0_Hidden=False,
    Input_0_Name="Name",
    Input_10_Hidden=True,
    Input_10_Name="TemperatureCoefficientThermalConductivity",
    Input_11_Hidden=True,
    Input_11_Name="TemperatureArray",
    Input_12_Hidden=True,
    Input_12_Name="EnthalpyArray",
    Input_13_Hidden=True,
    Input_13_Name="VariableConductivityArray",
    Input_14_Hidden=False,
    Input_14_Name="Type",
    Input_15_Hidden=True,
    Input_15_Name="EmbodiedEnergy",
    Input_16_Hidden=True,
    Input_16_Name="EmbodiedCarbon",
    Input_17_Hidden=True,
    Input_17_Name="Cost",
    Input_18_Hidden=True,
    Input_18_Name="Life",
    Input_1_Hidden=False,
    Input_1_Name="Conductivity",
    Input_2_Hidden=False,
    Input_2_Name="Density",
    Input_3_Hidden=False,
    Input_3_Name="Roughness",
    Input_4_Hidden=False,
    Input_4_Name="SpecificHeat",
    Input_5_Hidden=False,
    Input_5_Name="ThermalAbsorptance"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)
material_6 = ConstructCSOpaqueMaterial(
    Name=expression_10,
    Conductivity=2,
    Density=2400,
    Roughness="Rough",
    SpecificHeat=950,
    ThermalAbsorptance=0.9,
    SolarAbsorptance=0.7,
    VisibleAbsorptance=0.7,
    Type="Concrete",
    Input_0_Hidden=False,
    Input_0_Name="Name",
    Input_10_Hidden=True,
    Input_10_Name="TemperatureCoefficientThermalConductivity",
    Input_11_Hidden=True,
    Input_11_Name="TemperatureArray",
    Input_12_Hidden=True,
    Input_12_Name="EnthalpyArray",
    Input_13_Hidden=True,
    Input_13_Name="VariableConductivityArray",
    Input_14_Hidden=False,
    Input_14_Name="Type",
    Input_15_Hidden=True,
    Input_15_Name="EmbodiedEnergy",
    Input_16_Hidden=True,
    Input_16_Name="EmbodiedCarbon",
    Input_17_Hidden=True,
    Input_17_Name="Cost",
    Input_18_Hidden=True,
    Input_18_Name="Life",
    Input_1_Hidden=False,
    Input_1_Name="Conductivity",
    Input_2_Hidden=False,
    Input_2_Name="Density",
    Input_3_Hidden=False,
    Input_3_Name="Roughness",
    Input_4_Hidden=False,
    Input_4_Name="SpecificHeat",
    Input_5_Hidden=False,
    Input_5_Name="ThermalAbsorptance"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)
material_7 = ConstructCSOpaqueMaterial(
    Name=expression_14,
    Conductivity=0.9,
    Density=0.5,
    Roughness="Rough",
    SpecificHeat=1800,
    ThermalAbsorptance=0.9,
    SolarAbsorptance=0.7,
    VisibleAbsorptance=0.7,
    Type="Sealing",
    Input_0_Hidden=False,
    Input_0_Name="Name",
    Input_10_Hidden=True,
    Input_10_Name="TemperatureCoefficientThermalConductivity",
    Input_11_Hidden=True,
    Input_11_Name="TemperatureArray",
    Input_12_Hidden=True,
    Input_12_Name="EnthalpyArray",
    Input_13_Hidden=True,
    Input_13_Name="VariableConductivityArray",
    Input_14_Hidden=False,
    Input_14_Name="Type",
    Input_15_Hidden=True,
    Input_15_Name="EmbodiedEnergy",
    Input_16_Hidden=True,
    Input_16_Name="EmbodiedCarbon",
    Input_17_Hidden=True,
    Input_17_Name="Cost",
    Input_18_Hidden=True,
    Input_18_Name="Life",
    Input_1_Hidden=False,
    Input_1_Name="Conductivity",
    Input_2_Hidden=False,
    Input_2_Name="Density",
    Input_3_Hidden=False,
    Input_3_Name="Roughness",
    Input_4_Hidden=False,
    Input_4_Name="SpecificHeat",
    Input_5_Hidden=False,
    Input_5_Name="ThermalAbsorptance"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)
material_8 = ConstructCSOpaqueMaterial(
    Name=expression_17,
    Conductivity=2,
    Density=2100,
    Roughness="Rough",
    SpecificHeat=1040,
    ThermalAbsorptance=0.9,
    SolarAbsorptance=0.7,
    VisibleAbsorptance=0.7,
    Type="Concrete",
    Input_0_Hidden=False,
    Input_0_Name="Name",
    Input_10_Hidden=True,
    Input_10_Name="TemperatureCoefficientThermalConductivity",
    Input_11_Hidden=True,
    Input_11_Name="TemperatureArray",
    Input_12_Hidden=True,
    Input_12_Name="EnthalpyArray",
    Input_13_Hidden=True,
    Input_13_Name="VariableConductivityArray",
    Input_14_Hidden=False,
    Input_14_Name="Type",
    Input_15_Hidden=True,
    Input_15_Name="EmbodiedEnergy",
    Input_16_Hidden=True,
    Input_16_Name="EmbodiedCarbon",
    Input_17_Hidden=True,
    Input_17_Name="Cost",
    Input_18_Hidden=True,
    Input_18_Name="Life",
    Input_1_Hidden=False,
    Input_1_Name="Conductivity",
    Input_2_Hidden=False,
    Input_2_Name="Density",
    Input_3_Hidden=False,
    Input_3_Name="Roughness",
    Input_4_Hidden=False,
    Input_4_Name="SpecificHeat",
    Input_5_Hidden=False,
    Input_5_Name="ThermalAbsorptance"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)
material_9 = ConstructCSOpaqueMaterial(
    Name=expression_16,
    Conductivity=0.06,
    Density=368,
    Roughness="Rough",
    SpecificHeat=590,
    ThermalAbsorptance=0.9,
    SolarAbsorptance=0.7,
    VisibleAbsorptance=0.7,
    Type="Finishes",
    Input_0_Hidden=False,
    Input_0_Name="Name",
    Input_10_Hidden=True,
    Input_10_Name="TemperatureCoefficientThermalConductivity",
    Input_11_Hidden=True,
    Input_11_Name="TemperatureArray",
    Input_12_Hidden=True,
    Input_12_Name="EnthalpyArray",
    Input_13_Hidden=True,
    Input_13_Name="VariableConductivityArray",
    Input_14_Hidden=False,
    Input_14_Name="Type",
    Input_15_Hidden=True,
    Input_15_Name="EmbodiedEnergy",
    Input_16_Hidden=True,
    Input_16_Name="EmbodiedCarbon",
    Input_17_Hidden=True,
    Input_17_Name="Cost",
    Input_18_Hidden=True,
    Input_18_Name="Life",
    Input_1_Hidden=False,
    Input_1_Name="Conductivity",
    Input_2_Hidden=False,
    Input_2_Name="Density",
    Input_3_Hidden=False,
    Input_3_Name="Roughness",
    Input_4_Hidden=False,
    Input_4_Name="SpecificHeat",
    Input_5_Hidden=False,
    Input_5_Name="ThermalAbsorptance"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)
material_10 = ConstructCSOpaqueMaterial(
    Name=expression_18,
    Conductivity=xps_con,
    Density=35,
    Roughness="Rough",
    SpecificHeat=1400,
    ThermalAbsorptance=0.9,
    SolarAbsorptance=0.7,
    VisibleAbsorptance=0.7,
    Type="Insulation",
    Input_0_Hidden=False,
    Input_0_Name="Name",
    Input_10_Hidden=True,
    Input_10_Name="TemperatureCoefficientThermalConductivity",
    Input_11_Hidden=True,
    Input_11_Name="TemperatureArray",
    Input_12_Hidden=True,
    Input_12_Name="EnthalpyArray",
    Input_13_Hidden=True,
    Input_13_Name="VariableConductivityArray",
    Input_14_Hidden=False,
    Input_14_Name="Type",
    Input_15_Hidden=True,
    Input_15_Name="EmbodiedEnergy",
    Input_16_Hidden=True,
    Input_16_Name="EmbodiedCarbon",
    Input_17_Hidden=True,
    Input_17_Name="Cost",
    Input_18_Hidden=True,
    Input_18_Name="Life",
    Input_1_Hidden=False,
    Input_1_Name="Conductivity",
    Input_2_Hidden=False,
    Input_2_Name="Density",
    Input_3_Hidden=False,
    Input_3_Name="Roughness",
    Input_4_Hidden=False,
    Input_4_Name="SpecificHeat",
    Input_5_Hidden=False,
    Input_5_Name="ThermalAbsorptance"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)

# ---- group: WallInsul
layer = ConstructCSLayer(Material=material_3, Thickness="0.013")

# ---- group: WallConcrete
layer_2 = ConstructCSLayer(Material=material_6, Thickness=python_5)

# ---- group: WallInsul
layer_3 = ConstructCSLayer(Material=material_5, Thickness=multiplication_2)

layer_4 = ConstructCSLayer(Material=material_2, Thickness="0.025")

# ---- group: RoofFelt
layer_5 = ConstructCSLayer(Material=material_7, Thickness="0.003")

# ---- group: RoofConcrete
layer_6 = ConstructCSLayer(Material=material_8, Thickness=python_4)

# ---- group: RoofTile
layer_7 = ConstructCSLayer(Material=material_9, Thickness="0.005")

# ---- group: RoofXPS
layer_8 = ConstructCSLayer(Material=material_10, Thickness=multiplication_3)

# ---- group: GroundCarpet
layer_9 = ConstructCSLayer(Material=material, Thickness="0.013")

# ---- group: GroundConcrete
layer_10 = ConstructCSLayer(Material=material_6, Thickness="0.203")

# ---- group: GroundCarpet
layer_11 = ConstructCSLayer(Material=material_4, Thickness="0.02")

# ---- group: GroundXPS
layer_12 = ConstructCSLayer(Material=material_10, Thickness=multiplication)

# ----
relay = Relay([layer_2, layer_3, layer, layer_4])
panel_12 = Panel(relay)

relay_2 = Relay([layer_8, layer_6, layer_7, layer_5])
panel_13 = Panel(relay_2)
mats = Data([material_10, material_8, material_9, material_7, material_6, material_5, material_3, material_2, material_4, material])

dup = DuplicateData(Data=layer_9, Number=2, Order=True)
construction = ConstructCSConstruction(
    Name=expression_20,
    Category="Roof",
    Layers=flatten(relay_2),
    Input_0_Hidden=False,
    Input_0_Name="Name",
    Input_1_Hidden=False,
    Input_1_Name="Category",
    Input_2_Hidden=False,
    Input_2_Name="Layers",
    Input_3_Hidden=True,
    Input_3_Name="EmbodiedEnergy",
    Input_4_Hidden=True,
    Input_4_Name="EmbodiedCarbon",
    Input_5_Hidden=True,
    Input_5_Name="Cost",
    Input_6_Hidden=True,
    Input_6_Name="Life",
    UnitSystem=4,
    Input_3_GHParam_Branch0_Path="{0}",
    Input_3_GHParam_Branch0_Item0_number=0,
    Input_4_GHParam_Branch0_Path="{0}",
    Input_4_GHParam_Branch0_Item0_number=0,
    Input_5_GHParam_Branch0_Path="{0}",
    Input_5_GHParam_Branch0_Item0_number=0,
    Input_6_GHParam_Branch0_Path="{0}",
    Input_6_GHParam_Branch0_Item0_number=10)  # -> Construction, ConstructionInformation
construction_2 = ConstructCSConstruction(
    Name=expression_21,
    Category="GroundFloor",
    Layers=flatten([layer_12, layer_10, layer_11]),
    Input_0_Hidden=False,
    Input_0_Name="Name",
    Input_1_Hidden=False,
    Input_1_Name="Category",
    Input_2_Hidden=False,
    Input_2_Name="Layers",
    Input_3_Hidden=True,
    Input_3_Name="EmbodiedEnergy",
    Input_4_Hidden=True,
    Input_4_Name="EmbodiedCarbon",
    Input_5_Hidden=True,
    Input_5_Name="Cost",
    Input_6_Hidden=True,
    Input_6_Name="Life",
    UnitSystem=4,
    Input_3_GHParam_Branch0_Path="{0}",
    Input_3_GHParam_Branch0_Item0_number=0,
    Input_4_GHParam_Branch0_Path="{0}",
    Input_4_GHParam_Branch0_Item0_number=0,
    Input_5_GHParam_Branch0_Path="{0}",
    Input_5_GHParam_Branch0_Item0_number=0,
    Input_6_GHParam_Branch0_Path="{0}",
    Input_6_GHParam_Branch0_Item0_number=10)  # -> Construction, ConstructionInformation
construction_3 = ConstructCSConstruction(
    Name=expression_19,
    Category="Facade",
    Layers=flatten(dup),
    Input_0_Hidden=False,
    Input_0_Name="Name",
    Input_1_Hidden=False,
    Input_1_Name="Category",
    Input_2_Hidden=False,
    Input_2_Name="Layers",
    Input_3_Hidden=True,
    Input_3_Name="EmbodiedEnergy",
    Input_4_Hidden=True,
    Input_4_Name="EmbodiedCarbon",
    Input_5_Hidden=True,
    Input_5_Name="Cost",
    Input_6_Hidden=True,
    Input_6_Name="Life",
    UnitSystem=4,
    Input_3_GHParam_Branch0_Path="{0}",
    Input_3_GHParam_Branch0_Item0_number=0,
    Input_4_GHParam_Branch0_Path="{0}",
    Input_4_GHParam_Branch0_Item0_number=0,
    Input_5_GHParam_Branch0_Path="{0}",
    Input_5_GHParam_Branch0_Item0_number=0,
    Input_6_GHParam_Branch0_Path="{0}",
    Input_6_GHParam_Branch0_Item0_number=10)  # -> Construction, ConstructionInformation
construction_4 = ConstructCSConstruction(
    Name=expression_22,
    Category="Roof",
    Layers=flatten(relay),
    Input_0_Hidden=False,
    Input_0_Name="Name",
    Input_1_Hidden=False,
    Input_1_Name="Category",
    Input_2_Hidden=False,
    Input_2_Name="Layers",
    Input_3_Hidden=True,
    Input_3_Name="EmbodiedEnergy",
    Input_4_Hidden=True,
    Input_4_Name="EmbodiedCarbon",
    Input_5_Hidden=True,
    Input_5_Name="Cost",
    Input_6_Hidden=True,
    Input_6_Name="Life",
    UnitSystem=4,
    Input_3_GHParam_Branch0_Path="{0}",
    Input_3_GHParam_Branch0_Item0_number=0,
    Input_4_GHParam_Branch0_Path="{0}",
    Input_4_GHParam_Branch0_Item0_number=0,
    Input_5_GHParam_Branch0_Path="{0}",
    Input_5_GHParam_Branch0_Item0_number=0,
    Input_6_GHParam_Branch0_Path="{0}",
    Input_6_GHParam_Branch0_Item0_number=10)  # -> Construction, ConstructionInformation
python_13 = GhPythonScript(x=construction_2.ConstructionInformation)  # -> Rval, mass
# ---------- python_13: Python ----------
__author__ = "zoelh"
__version__ = "2023.11.21"

import rhinoscriptsyntax as rs
import re

Rval = None

s = re.sub(r'[^\w.\n]+', ' ', x)
s=s.replace(" ", '')
print(s)
Rval = float(s.split("RValuemKW")[1].split("\n")[0])
mass = float(s.split("CapacitancekJKm")[1].split("\n")[0])
print(Rval)
print(mass)
# ---------- end python_13 ----------

# ---- group: ROOF CONSTRUCTION
panel_14 = Panel(construction.ConstructionInformation)
exteriorroof = Data(construction.Construction)

# ---- group: SLAB CONSTRUCTION
panel_15 = Panel(construction_2.ConstructionInformation)
slab = Data(construction_2.Construction)

# ---- group: FACADE CONSTRUCTION
panel_16 = Panel(construction_4.ConstructionInformation)
exteriorwall = Data(construction_4.Construction)

# ---- group: PARTITION CONSTRUCTION
panel_17 = Panel(construction_3.ConstructionInformation)
partition_5 = Data(construction_3.Construction)

# ----
zset = CSZoneSettings(
    Name=expression_7,
    ZoneSettings=item_8,
    RoofConstruction=exteriorroof,
    FacadeConstruction=exteriorwall,
    SlabConstruction=slab,
    PartitionConstruction=partition_5,
    ExternalFloorConstruction=slab,
    InternalMassConstruction=partition_5,
    InternalMassExposedArea=Slider(0, range=0..1),
    GroundSlabConstruction=slab,
    PeopleDensity=random_16,
    AirspeedSchedule="AirSpeed 0",
    EquipmentPowerDensity=random_10,
    LightingPowerDensity=random_15,
    OccupancySchedule=year_schedule.Sched,
    EquipmentAvailabilitySchedule=year_schedule_3.Sched,
    LightsAvailabilitySchedule=year_schedule_2.Sched,
    DimmingType=dimmingtype,
    PeopleIsOn=people_equip_lightson,
    EquipmentIsOn=people_equip_lightson,
    LightsIsOn=people_equip_lightson,
    CoolingCOP=Slider(1, range=0.6..6),
    HeatingCOP=Slider(1, range=0.6..6),
    HeatingSetpoint=min,
    CoolingSetpoint=max,
    HeatingSetpointConstant=heating_coolingconstant,
    CoolingSetpointConstant=heating_coolingconstant,
    HeatingSetpointSchedule="S21 B18 8to18",
    CoolingSetpointSchedule="S25 B30 8to18",
    HeatIsOn=heating_coolingon,
    CoolIsOn=heating_coolingon,
    MechVentIsOn=mechventon,
    HumidistatIsOn=humidistaton,
    HeatingLimitType="NoLimit",
    CoolingLimitType="LimitFlowRateAndCapacity",
    MaxHeatingCapacity=100,
    MaxCoolingCapacity=100,
    MaxHeatFlow=100,
    MaxCoolFlow=100,
    HeatingSchedule="AllOn",
    CoolingSchedule="AllOn",
    MechVentSchedule=occupancy,
    MinFreshAirPerson=multiplication_9,
    MinFreshAirArea=multiplication_10,
    EconomizerType=python_3,
    HeatRecoveryType=python_6,
    HeatRecoveryEfficiencySensible="0.7",
    HeatRecoveryEfficiencyLatent="0.65",
    MinHumidity="20",
    MaxHumidity="80",
    TurnOnEMSFanEnergy=fanenergy,
    FanPressureRise=1000,
    MaxHeatSupplyAirTemp="30",
    MinCoolSupplyAirTemp="18",
    HeatingSizingFactor=1.2,
    CoolingSizingFactore=1.2,
    NatVentIsOn=natventon,
    SchedVentIsOn=scheduledventilationon,
    ScheduledVentilationAvailability="Off",
    NaturalVentilationSchedule="Off",
    StackDrivenFlow=scheduledventilationon_2,
    Crossventilation=scheduledventilationon_2,
    InfiltrationIsOn=infiltrationon,
    InfiltrationAch=infiltration_ach,
    InfiltrationFlowExtArea=random_17,
    InfiltrationCalculationMethod=infiltrationmethod,
    AFNAirMassFlowCoefficientCrack=0.001,
    FlowRatePerPerson="0",
    DHWOn=dhwon,
    Input_0_Hidden=False,
    Input_0_Name="Name",
    Input_100_Hidden=True,
    Input_100_Name="Interior Vertical Insulation Depth",
    Input_101_Hidden=True,
    Input_101_Name="Exterior Horizontal Insulation Depth",
    Input_102_Hidden=True,
    Input_102_Name="Exterior Horizontal Insulation Width",
    Input_103_Hidden=True,
    Input_103_Name="Footing Thickness",
    Input_104_Hidden=True,
    Input_104_Name="Footing Depth",
    Input_105_Hidden=True,
    Input_105_Name="ElectricityCO2",
    Input_106_Hidden=True,
    Input_106_Name="ElectricityCost",
    Input_107_Hidden=True,
    Input_107_Name="HotWaterCO2",
    Input_108_Hidden=True,
    Input_108_Name="HotWaterCost",
    Input_109_Hidden=True,
    Input_109_Name="CoolingCO2",
    Input_10_Hidden=True,
    Input_10_Name="Ground Wall Construction",
    Input_110_Hidden=True,
    Input_110_Name="HeatingCO2",
    Input_111_Hidden=True,
    Input_111_Name="CoolingCost",
    Input_112_Hidden=True,
    Input_112_Name="HeatingCost"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)
library = CSLibrary(AddObjects=flatten([year_schedule_3.Sched, year_schedule_2.Sched, year_schedule.Sched, simple_window, exteriorroof, exteriorwall, slab, partition_5, mats]))
python_14 = GhPythonScript(x=construction.ConstructionInformation)  # -> Rval, mass
# ---------- python_14: Python ----------
__author__ = "zoelh"
__version__ = "2023.11.21"

import rhinoscriptsyntax as rs
import re

Rval = None

s = re.sub(r'[^\w.\n]+', ' ', x)
s=s.replace(" ", '')
print(s)
Rval = float(s.split("RValuemKW")[1].split("\n")[0])
mass = float(s.split("CapacitancekJKm")[1].split("\n")[0])*1000
print(Rval)
print(mass)
# ---------- end python_14 ----------
python_15 = GhPythonScript(x=construction_4.ConstructionInformation)  # -> Rval, mass; same code as python_14

number_slider = Slider(110, range=0..150)
multiplication_17 = Multiplication(A=Slider(6, range=0..100), B=4)
circle = CircleCNR(Center=simplify(graft(centers)), Normal=Vector(0, 0, 1), Radius=number_slider)
expression_23 = Expression(Expression="60*π/180")
divide = DivideCurve(Curve=circle, Count=multiplication_17, Kinks=False)  # -> Points, Tangents, Parameters
shift = ShiftList(List=divide.Points, Shift=1, Wrap=True)
dom = ConstructDomain(DomainStart=0, DomainEnd=expression_23)
ln_2 = Line(StartPoint=divide.Points, EndPoint=shift)

lng_6 = ListLength(List=circle)
multiplication_18 = Multiplication(A=lng_6, B=multiplication_17)
item_9 = ListItem(List=divide.Points, Index=0, Wrap=True)  # -> simplify(Item)
vec2pt_5 = Vector2Pt(PointA=centers, PointB=item_9, Unitize=False)  # -> Vector, Length

# ----
# Save building settings
dejson = DeserializeJson(JSON=zset, OutputsLocked=False)  # -> Constructions, Loads, Conditioning, HotWater, NaturalVentilation, Foundation, Infiltration, CostEmissions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
item_10 = ListItem(List=floor_to_floor_heights, Index=int, Wrap=True)
item_11 = ListItem(List=shoebox_width, Index=int, Wrap=True)
item_12 = ListItem(List=perim_depths, Index=int, Wrap=True)
item_13 = ListItem(List=core_depths, Index=int, Wrap=True)
item_14 = ListItem(List=random_29, Index=int, Wrap=True)
expression_24 = Expression(x=output_directory, Expression="Format(\"{0}template\\\", x)")
python_16 = GhPythonScript(
    f2f_height=item_10,
    sb_w=item_11,
    pd=item_12,
    cd=item_13,
    wwr=item_14,
    uval=random_4,
    shgc=random_5,
    sched=int_7,
    RoofRval=python_14.Rval,
    RoofMass=python_14.mass,
    WallRval=python_15.Rval,
    WallMass=python_15.mass,
    SlabRval=python_13.Rval,
    econ=int_4,
    hrv=int_5,
    Conditioning=dejson.Conditioning,
    Loads=dejson.Loads,
    Infiltration=dejson.Infiltration,
    VentilationMode=int_9)  # -> sb_dict
# ---------- python_16: Python ----------
__author__ = "zoelh"
__version__ = "2023.11.18"

import rhinoscriptsyntax as rs
import json
d = {}

d=ShoeboxConfig = dict(
    width=float(sb_w),
    height=float(f2f_height),
    perim_depth=float(pd),
    core_depth=float(cd),
    wwr = float(wwr),
    cop_heating= 1,
    cop_cooling= 1,
    HeatingSetpoint=float(Conditioning["HeatingSetpoint"]),
    CoolingSetpoint=float(Conditioning["CoolingSetpoint"]),
    LightingPowerDensity=float(Loads["LightingPowerDensity"]),
    EquipmentPowerDensity=float(Loads["EquipmentPowerDensity"]),
    PeopleDensity=float(Loads["PeopleDensity"]),
    Infiltration=float(Infiltration["InfiltrationFlowPerExteriorSurfaceArea"]),
    VentilationPerArea=float(Conditioning["MinFreshAirArea"]) / 1000,
    VentilationPerPerson=float(Conditioning["MinFreshAirPerson"]) / 1000,
    VentilationMode = int(VentilationMode),
    FacadeMass = float(WallMass),
    RoofMass = float(RoofMass),
    FacadeRValue = float(WallRval),
    RoofRValue = float(RoofRval),
    SlabRValue = float(SlabRval),
    WindowUValue = float(uval),
    WindowShgc = float(shgc),
    EconomizerSettings=int(econ),
    RecoverySettings=int(hrv),
    template_idx=int(sched),
)
print(Conditioning["MinFreshAirArea"])
print(Conditioning["MinFreshAirPerson"])
#for i, id in enumerate(ids):
#    id = int(id)
#    d[id]=dict(ShoeboxConfig = dict(
#        FacadeMass = float(WallMass[i]),
#        RoofMass = float(RoofMass[i]),
#        FacadeRValue = float(WallRval[i]),
#        RoofRValue = float(RoofRval[i]),
#        SlabRValue = float(SlabRval[i]),
#        WindowUValue = float(uval[i]),
#        WindowShgc = float(shgc[i]),
#        wwr = float(wwr[i]),
#        template_idx=int(sched[i]),
#        width=float(sb_w),
#        height=float(f2f_height[i]),
#        perim_depth=float(pd[i]),
#        core_depth=float(cd[i])
#    ))

sb_dict = json.dumps(d)
# ---------- end python_16 ----------
panel_18 = Panel(expression_24)
python_17 = GhPythonScript(set=python_16, name=python_2.a, dir=panel_18, save=toggle_2)
# ---------- python_17: Python ----------
__author__ = "zoelh"
__version__ = "2023.11.18"

import rhinoscriptsyntax as rs
import json

if save:
    fname = dir + name + ".json"
    print(fname)
    with open(fname, "w") as f:
        json.dump(json.loads(set), f, indent=4)
# ---------- end python_17 ----------

# ----
# Model Setup
window_settings = Data(wset)
zone_settings = Data(zset)
zone = CSEnergyZone(
    Brep=flatten(geo),
    Name=flatten(python_9),
    Settings=zone_settings,
    UsedLibraryObjects="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")  # -> Zones, Settings
zone_2 = CSEnergyZone(
    Brep=flatten(trim_3),
    Name=flatten(python_10),
    Settings=zone_settings,
    UsedLibraryObjects="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")  # -> Zones, Settings
bco = CSBoundaryObject(Brep=item_3, type="GROUND")
window = CSWindow(Surface=trim_4, Settings=window_settings, UsedLibraryObjects="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")  # -> Window, Settings
panel_19 = Panel(python_2.a)

panel_20 = Panel(zone_2.Zones)  # disabled

random_30 = Random(Range=dom, Number=multiplication_18, Seed=item.Item26)

expression_25 = Expression(a=random_30, r=number_slider, Expression="r*tan(a)")  # -> simplify(R)

Z_11 = UnitZ(Factor=expression_25)
extr_3 = Extrude(Base=ln_2, Direction=Z_11)  # -> simplify(Extrusion)

shading_heights = Data(expression_25)

model = CSModelMaker(
    Zones=flatten([zone.Zones, zone_2.Zones]),
    Windows=flatten(window.Window),
    Boundaries=bco,
    Shading=flatten(extr_3),
    Library=library)  # -> Model, Invalid
run_e = RunCSEnergyModel(
    Model=model.Model,
    Name=panel_19,
    Directory=expression_2,
    Location=path,
    Run=run_eplus,
    NorthOffset=0,
    settings="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")  # -> Model, Settings, Result

energy_results = LoadCSEnergyResult(ThermalModel=run_e.Model, Mode=0, Resolution=0, Toggle=toggle_3)  # -> TotalEUI, Baseline, TotalCO2, TotalCost, FloorArea, Data, Labels, Months, Colors, CSR; disabled
plotter = CSPlotter(
    Type=0,
    Width=550,
    Height=450,
    X_rot=0,
    Y_data=energy_results.Data,
    Colors=energy_results.Colors,
    Show_xgrid=False,
    Show_ygrid=True,
    Legend=0,
    PreviewDimension=1,
    InfinateZoomDisplay=True,
    UnitSystem=4)  # disabled

explode_4 = Explode(Curve=rotate.Geometry, Recursive=True)  # -> Segments, Vertices
end_5 = EndPoints(Curve=explode_4.Segments)  # -> Start, End
midpt_3 = CurveMiddle(Curve=explode_4.Segments)
expression_26 = Expression(Expression="π/24")
ln_3 = Line(StartPoint=midpt_3, EndPoint=end_5.Start)
xy_2 = XYPlane(Origin=midpt_3)
vec2pt_6 = Vector2Pt(PointA=midpt_3, PointB=end_5.Start, Unitize=False)  # -> Vector, Length
vrot_2 = Rotate(Vector=vec2pt_6.Vector, Axis=xy_2, Angle=expression_26)
expression_27 = Expression(Expression="π/12")
series_2 = Series(Start=0, Step=expression_27, Count="12")  # -> graft(Series)
vrot_3 = Rotate(Vector=vrot_2, Axis=xy_2, Angle=series_2)
line_2 = LineSDL(Start=midpt_3, Direction=vrot_3, Length=Slider(20, range=0..100))  # -> simplify(Line)
move_14 = Move(Geometry=graft(end_3.Start), Motion=Z_7)  # -> Geometry, Transform
flip = FlipMatrix(Data=line_2)
Z_12 = UnitZ(Factor=python_11.z_vects)  # -> simplify(UnitVector)
move_15 = Move(Geometry=graft(flip), Motion=Z_12)  # -> Geometry, Transform
path_mapper_3 = PathMapper(move_15.Geometry, source="{A;B}(i)", target="{i;A}[B]")
shad_bases = Data(ln_2)
project = Project(Geometry=path_mapper_3, Plane=PlaneXY(0, 0, 0))  # -> Geometry, Transform
join_5 = JoinCurves(Curves=shad_bases, Preserve=False)
clx = CurveLine(Curve=reparameterize(join_5), Line=project.Geometry)  # -> simplify(Points), simplify(Params), Count
end_6 = EndPoints(Curve=path_mapper_3)  # -> Start, End
dist_2 = Distance(PointA=graft(end_6.Start), PointB=clx.Points)
pdecon = Deconstruct(Point=end_6.Start)  # -> XComponent, YComponent, ZComponent
sort = SortList(Keys=dist_2, ValuesA=clx.Params)  # -> Keys, ValuesA
sort_2 = SortList(Keys=dist_2, ValuesA=clx.Points)  # -> Keys, ValuesA
item_15 = ListItem(List=sort_2.ValuesA, Index=0, Wrap=True)
item_16 = ListItem(List=sort.ValuesA, Index=0, Wrap=True)
trim_5 = TrimTree(Tree=item_16, Depth=1)
multiplication_19 = Multiplication(A=trim_5, B="24")
round_2 = Round(Number=multiplication_19)  # -> Nearest, Floor, Ceiling
int_10 = Integer(simplify(multiplication_19))
trim_6 = TrimTree(Tree=item_15, Depth=1)
pdecon_2 = Deconstruct(Point=trim_6)  # -> XComponent, YComponent, ZComponent
heights = Data(shading_heights)
addition_2 = Addition(A=round_2.Floor, B=Slider(23, range=0..24))
item_17 = ListItem(List=heights, Index=addition_2, Wrap=True)
pt = ConstructPoint(XCoordinate=pdecon_2.XComponent, YCoordinate=pdecon_2.YComponent, ZCoordinate=item_17)  # -> simplify(Point)
pdecon_3 = Deconstruct(Point=pt)  # -> XComponent, YComponent, ZComponent
pt_2 = ConstructPoint(XCoordinate=pdecon_3.XComponent, YCoordinate=pdecon_3.YComponent, ZCoordinate=pdecon.ZComponent)  # -> simplify(Point)
number_slider_2 = Slider(40, range=0..100)  # disabled
vec2pt_7 = Vector2Pt(PointA=end_6.Start, PointB=pt, Unitize=False)  # -> Vector, Length
vec2pt_8 = Vector2Pt(PointA=end_6.Start, PointB=pt_2, Unitize=False)  # -> Vector, Length
ln_4 = Line(StartPoint=end_6.Start, EndPoint=pt)
ln_5 = Line(StartPoint=end_6.Start, EndPoint=pt_2)
xprod = CrossProduct(VectorA=vec2pt_8.Vector, VectorB=vec2pt_7.Vector, Unitize=False)  # -> Vector, Length
line_3 = LineSDL(Start=end_6.Start, Direction=vec2pt_7.Vector, Length=number_slider_2)  # disabled
pl = PlaneNormal(Origin=end_6.Start, ZAxis=xprod.Vector)
angle_2 = Angle(VectorA=vec2pt_8.Vector, VectorB=vec2pt_7.Vector, Plane=pl)  # -> Angle, Reflex
number_slider_3 = Slider(3, range=0..3)  # disabled
number_slider_4 = Slider(3, range=0..6)  # disabled
smaller = SmallerThan(FirstNumber=pdecon.ZComponent, SecondNumber=pdecon_3.ZComponent)  # -> SmallerThan, OrEqualTo
path_2 = ConstructPath(Indices=[number_slider_4, number_slider_3])  # disabled
number_slider_5 = Slider(6, range=0..11)  # disabled
branch = TreeBranch(Tree=ln_5, Path=path_2, MaintainPaths=True)  # disabled
branch_2 = TreeBranch(Tree=ln_4, Path=path_2, MaintainPaths=True)  # disabled
item_18 = ListItem(List=branch_2, Index=number_slider_5, Wrap=True)  # disabled
item_19 = ListItem(List=branch, Index=number_slider_5, Wrap=True)  # disabled
sort_3 = SortList(Keys=flatten(angle_2.Angle))  # -> Keys, ValuesA; disabled
item_20 = ListItem(List=sort_3.Keys, Index=0, Wrap=True)  # -> Item1, Item; disabled
panel_21 = Panel([item_20.Item1, item_20.Item])  # disabled

# ---- group: ANGLES
multiplication_20 = Multiplication(A=angle_2.Angle, B=smaller.SmallerThan)

# ----
python_18 = GhPythonScript(
    id=python_2.a,
    edge_lengths=len_4,
    orientations=angle.OrientationsRads,
    total_area=multiplication_16,
    bldg_core_area=area_7.Area,
    bldg_perim_areas=area_6.Area,
    footprint_area=footprint_areas,
    wwr=random_29,
    n_floors=random_28,
    f2f_height=random_27,
    shading=simplify(multiplication_20),
    outpath=output_directory,
    save=Toggle(False))  # -> out, perim_array; inputs edge_lengths: list, orientations: list, bldg_perim_areas: list, n_floors: Int32, shading: tree
# ---------- python_18: Python ----------
__author__ = "szvsw"
__version__ = "2023.11.15"

import rhinoscriptsyntax as rs
import ghpythonlib.treehelpers as th
import json

shd_lst = th.tree_to_list(shading, None)
if n_floors == 1:
    shd_lst = [shd_lst]
total_perim_len = sum(edge_lengths)

output_data = {}

bldg_data = {
    "building_id": int(id),
    "gfa": float(total_area),
    "footprint_area": float(footprint_area),
    "wwr": float(wwr),
    "height": float(f2f_height),
    "n_floors": n_floors,
    "core_area": bldg_core_area,
    "total_perimeter_length": total_perim_len,
}

perim_array = []
for floor_ix in range(n_floors):
    for orient_ix in range(4):
        edge_len = float(edge_lengths[orient_ix])
        perim_zone_dict = {
            "zone_perimeter_area": float(bldg_perim_areas[orient_ix]),
            "zone_edge_length": edge_len,
            "edge_weight": edge_len / total_perim_len,
            "weight": edge_len / total_perim_len / n_floors,
            "orientation": float(orientations[orient_ix]),
            "floor": floor_ix,
#            "shading": shd_lst[floor_ix][orient_ix],
            "name": "perim_floor_"+str(floor_ix)+"_n_"+str(orient_ix),
        }
        for shad_ix in range(12):
             perim_zone_dict["shading_"+str(shad_ix)] = shd_lst[floor_ix][orient_ix][shad_ix]
        perim_zone_dict.update(bldg_data)
        perim_array.append(perim_zone_dict)
        
        
print(json.dumps(perim_array,indent=4))

if save:
    with open(str(outpath)+"geometry/"+str(id)+".json","w") as f:
        json.dump(perim_array,f,indent=4)
# ---------- end python_18 ----------

python_19 = GhPythonScript(id=python_2.a, outpath=expression, perim_array=python_18.perim_array, template_dict=python_16)  # -> out, a; inputs perim_array: list
# ---------- python_19: Python ----------
__author__ = "zoelh"
__version__ = "2024.01.21"

import rhinoscriptsyntax as rs
import json

template_dict = json.loads(template_dict)
for i, zone_dict in enumerate(perim_array):
    zone_dict.update(template_dict)

with open(str(outpath)+str(id)+".json","w") as f:
    json.dump(perim_array,f,indent=4)
# ---------- end python_19 ----------

sort_4 = SortList(Keys=flatten(multiplication_20))  # -> Keys, ValuesA; disabled
item_21 = ListItem(List=sort_4.Keys, Index=0, Wrap=True)  # -> Item1, Item; disabled
panel_22 = Panel([item_21.Item1, item_21.Item])  # disabled
