# Grasshopper definition GenerativeCityABTester.gh (Grasshopper 1.0.7)
# plug-ins: ClimateStudioGH, Autozoner

number_slider = Slider(42, range=0..100)

# ---- group: Weather File
path = FilePath("C:\ProgramData\Solemma\Common\WeatherData\EPW\USA_MA_Boston-Logan.Intl.AP.725090_TMYx.2004-2018.epw")

# ---- group: config output path
path_2 = FilePath("C:\Users\szvsw\repos\ml-for-building-energy-modeling\ml-for-bem\grasshopper\")

# ----
# RUN
button = Button()

series = Series(Start=0, Step="1/24 * 2*pi", Count="8760")
expression = Expression(x=series, Expression="-cos(x)*0.5+0.5")

# ---- group: CS Output Path
path_3 = FilePath("C:\surrogate-val-runs\")

# ----
wwr_frac = Panel("0.1 to 0.8")
corner_pertub_m = Panel("0 to 0")
f2f_height_m = Panel("3 to 5")
n_floors = Panel("1 to 10")
bldg_dim_m = Panel("10 to 70")
n_buildings = Slider(100, range=0..100)
x_spread = Slider(100, range=0..100)
perim_offset = Slider(3.5, range=3..7)

random = Random(Range=bldg_dim_m, Number=n_buildings, Seed=expr("x+1", number_slider))
random_2 = Random(Range=bldg_dim_m, Number=n_buildings, Seed=number_slider)
rectangle = Rectangle(Plane=PlaneXY(0, 0, 0), XSize=random_2, YSize=random, Radius=0)  # -> Rectangle, Length
ma = MassAddition(Input=random_2)  # -> Result, PartialResults
series_2 = Series(Start=0, Step=x_spread, Count=n_buildings)
series_3 = Series(Start=0, Step=x_spread, Count=n_buildings)
ins = InsertItems(List=ma.PartialResults, Item="0", Indices="0", Wrap=True)
Y = UnitY(Factor=series_3)
subtraction = Subtraction(A=n_buildings, B=1)
subset = SubList(List=ins, Domain=subtraction, Wrap=True)  # -> List, Index
addition = Addition(A=subset.List, B=series_2)
X = UnitX(Factor=addition)
move = Move(Geometry=rectangle.Rectangle, Motion=X)  # -> Geometry, Transform
year_schedule = ConstructCSYearSchedule(Name="MLForBem-Sinusoid", Type=0, Category=0, DaysHours=expression)  # -> Sched, Values
move_2 = Move(Geometry=move.Geometry, Motion=Y)  # -> Geometry, Transform

ventilationperperson_l_s_person = Slider(1, range=0..10)
ventilationperarea_l_s_m2 = Slider(0.1, range=0..5)
coolingsetpoint_degc = Slider(24, range=16..30)
heatingsetpoint_degc = Slider(20, range=10..24)
econ = ValueList({"NoEconomizer", "DifferentialEnthalpy"}, selected="NoEconomizer")
mechventon = BooleanToggle(True)
hrv = ValueList({"None", "Sensible", "Enthalpy"}, selected="None")

infiltrationmethod = ValueList({"ACH", "Flow Per Exterior Area": "FlowExtArea"}, selected="Flow Per Exterior Area")
infiltration_m3_s_m2 = Slider(0.0006, range=0..0.001)
infiltration_ach = Slider(0, range=0..1)

multiplication = Multiplication(A=n_buildings, B="4")

# ---- group: Loads
lpd_w_m2 = Slider(10, range=0..50)
epd_w_m2 = Slider(7, range=0..50)
peopledensity_ppl_m2 = Slider(0.025, range=0..0.5)

# ---- group: Windows
number_slider_2 = Slider(0.7, range=0..1)
number_slider_3 = Slider(4, range=0.6..7)
tvis = Panel("0.75")

# ----
random_3 = Random(Range="2*pi", Number=multiplication, Seed=Slider(64, range=0..100))
disc = Discontinuity(Curve=move_2.Geometry, Level=1)  # -> Points, Parameters
random_4 = Random(Range=corner_pertub_m, Number=multiplication, Seed=Slider(68, range=0..100))

# ---- group: Roof
list = ValueList({"UVal_0.4", "UVal_0.3", "UVal_0.2", "UVal_0.1"}, selected="UVal_0.4")
list_2 = ValueList({"Light": "_Light", "Mass": "_Mass"}, selected="Light")

# ---- group: Facade
list_3 = ValueList({"UVal_0.4", "UVal_0.3", "UVal_0.2", "UVal_0.1"}, selected="UVal_0.4")
list_4 = ValueList({"Light": "_Light", "Mass": "_Mass"}, selected="Light")

# ---- group: Ground Slab
list_5 = ValueList({"UVal_0.4", "UVal_0.3", "UVal_0.2", "UVal_0.1"}, selected="UVal_0.4")
list_6 = ValueList({"Light": "_Light", "Mass": "_Mass"}, selected="Light")

# ---- group: MechVentilationSchedule
sched = GetCSYearSchedule(UnitSystem=4)
panel = Panel("AllOn")

# ----
partition = PartitionList(List=random_3, Size="4")
partition_2 = PartitionList(List=random_4, Size="4")
Z = UnitZ(Factor=1)
X_2 = UnitX(Factor=1)
vrot = Rotate(Vector=X_2, Axis=Z, Angle=partition)
multiplication_2 = Multiplication(A=vrot, B=partition_2)
move_3 = Move(Geometry=disc.Points, Motion=multiplication_2)  # -> Geometry, Transform
merge = Merge(Data1=list, Data2=list_2)
merge_2 = Merge(Data1=list_3, Data2=list_4)
merge_3 = Merge(Data1=list_5, Data2=list_6)
pline = PolyLine(Vertices=move_3.Geometry, Closed=True)  # -> simplify(flatten(Polyline))
random_5 = Random(Range="2*pi", Number=n_buildings, Seed=Slider(76, range=0..100))
list_7 = ValueList({"Residential", "Kitchen", "Office", "MeetingRoom", "HotelRoom", "ClassRoom", "Library", "LectureHall", "SuperMarket", "Shopping", "ScienceLab"}, selected="Office")
simple_window = ConstructCSSimpleWindow(Name="MLForBem-SimpleWindowConstruction", Shgf=number_slider_2, Uval=number_slider_3, Tvis=tvis)
area = Area(Geometry=pline)  # -> Area, Centroid
zonetemplate = GetZoneTemplate(SearchZoneTemplate=list_7, Selection="Office")
join = TextJoin(Text=merge)
rotate = Rotate(Geometry=pline, Angle=random_5, Plane=area.Centroid)  # -> Geometry, Transform
heating_coolingconstant = BooleanToggle(True)
join_2 = TextJoin(Text=merge_2)
scheduledventilationon = BooleanToggle(False)
join_3 = TextJoin(Text=merge_3)
people_equip_lightson = BooleanToggle(True)

panel_2 = Panel("Airspeed 0")
sched_2 = GetCSYearSchedule(UnitSystem=4)

heating_coolingon = BooleanToggle(True)
humidistaton = BooleanToggle(True)
infiltrationon = BooleanToggle(True)

sched_3 = GetCSYearSchedule(UnitSystem=4)

item = ListItem(List=zonetemplate, Index=0, Wrap=True)
fanenergy = BooleanToggle(False)
shadingon = BooleanToggle(False)
hasframe = BooleanToggle(False)
cx = CurveSelf(Curve=rotate.Geometry)  # -> Points, Params
dhwon = BooleanToggle(False)
dhwon_2 = BooleanToggle(False)
construction = GetCSConstruction(SearchConstructions=join)
construction_2 = GetCSConstruction(SearchConstructions=join_2)
construction_3 = GetCSConstruction(SearchConstructions=join_3)
dimmingtype = Panel("Off")
lng = ListLength(List=cx.Points)  # -> flatten(Length)
equals = Equality(FirstNumber=lng, SecondNumber="0")  # -> Equality, Inequality
# Major jank to prevent autozoner bug far from the origin
panel_4 = Panel("0,0,0")
cull = CullPattern(List=rotate.Geometry, CullPattern=equals.Equality)
area_2 = Area(Geometry=cull)  # -> Area, Centroid
vec2pt = Vector2Pt(PointA=area_2.Centroid, PointB=panel_4, Unitize=False)  # -> Vector, Length
move_4 = Move(Geometry=cull, Motion=vec2pt.Vector)  # -> Geometry, Transform
az = Autozoner(FloorPlanOutlines=graft(move_4.Geometry), Offset=perim_offset)  # -> Outline, PerimeterPolylines, CorePolylines, SkeletonPolylines
neg = Negative(Value=vec2pt.Vector)
lng_2 = ListLength(List=cull)
move_5 = Move(Geometry=az.Outline, Motion=graft(neg))  # -> Geometry, Transform
move_6 = Move(Geometry=az.PerimeterPolylines, Motion=graft(neg))  # -> Geometry, Transform
area_3 = Area(Geometry=move_6.Geometry)  # -> Area, Centroid
panel_5 = Panel(area_3.Area)
move_7 = Move(Geometry=az.CorePolylines, Motion=graft(neg))  # -> Geometry, Transform
area_4 = Area(Geometry=move_7.Geometry)  # -> Area, Centroid
geo = Geometry(move_5.Geometry)
geo_2 = Geometry(move_6.Geometry)
zset = CSZoneSettings(
    Name="ParametricZoneSettings",
    ZoneSettings=item,
    RoofConstruction=construction,
    FacadeConstruction=construction_2,
    SlabConstruction=construction_3,
    ExternalFloorConstruction=construction_3,
    GroundSlabConstruction=construction_3,
    PeopleDensity=peopledensity_ppl_m2,
    AirspeedSchedule=sched_2,
    EquipmentPowerDensity=epd_w_m2,
    LightingPowerDensity=lpd_w_m2,
    OccupancySchedule=year_schedule.Sched,
    EquipmentAvailabilitySchedule=year_schedule.Sched,
    LightsAvailabilitySchedule=year_schedule.Sched,
    DimmingType=dimmingtype,
    PeopleIsOn=people_equip_lightson,
    EquipmentIsOn=people_equip_lightson,
    LightsIsOn=people_equip_lightson,
    CoolingCOP=Slider(1, range=0.6..6),
    HeatingCOP=Slider(1, range=0.6..6),
    HeatingSetpoint=heatingsetpoint_degc,
    CoolingSetpoint=coolingsetpoint_degc,
    HeatingSetpointConstant=heating_coolingconstant,
    CoolingSetpointConstant=heating_coolingconstant,
    HeatIsOn=heating_coolingon,
    CoolIsOn=heating_coolingon,
    MechVentIsOn=mechventon,
    HumidistatIsOn=humidistaton,
    HeatingLimitType="NoLimit",
    CoolingLimitType="NoLimit",
    HeatingSchedule=sched_3,
    CoolingSchedule=sched_3,
    MechVentSchedule=sched,
    MinFreshAirPerson=ventilationperperson_l_s_person,
    MinFreshAirArea=ventilationperarea_l_s_m2,
    EconomizerType=econ,
    HeatRecoveryType=hrv,
    HeatRecoveryEfficiencySensible="0.7",
    HeatRecoveryEfficiencyLatent="0.65",
    MinHumidity="20",
    MaxHumidity="80",
    TurnOnEMSFanEnergy=fanenergy,
    MaxHeatSupplyAirTemp="30",
    MinCoolSupplyAirTemp="18",
    NatVentIsOn=dhwon,
    SchedVentIsOn=scheduledventilationon,
    InfiltrationIsOn=infiltrationon,
    InfiltrationAch=infiltration_ach,
    InfiltrationFlowExtArea=infiltration_m3_s_m2,
    InfiltrationCalculationMethod=infiltrationmethod,
    DHWOn=dhwon_2,
    Input_0_Hidden=False,
    Input_0_Name="Name",
    Input_100_Hidden=True,
    Input_100_Name="Interior Vertical Insulation Depth",
    Input_101_Hidden=True,
    Input_101_Name="Exterior Horizontal Insulation Depth",
    Input_102_Hidden=True,
    Input_102_Name="Exterior Horizontal Insulation Width",
    Input_103_Hidden=True,
    Input_103_Name="Footing Thickness",
    Input_104_Hidden=True,
    Input_104_Name="Footing Depth",
    Input_105_Hidden=True,
    Input_105_Name="ElectricityCO2",
    Input_106_Hidden=True,
    Input_106_Name="ElectricityCost",
    Input_107_Hidden=True,
    Input_107_Name="HotWaterCO2",
    Input_108_Hidden=True,
    Input_108_Name="HotWaterCost",
    Input_109_Hidden=True,
    Input_109_Name="CoolingCO2",
    Input_10_Hidden=True,
    Input_10_Name="Ground Wall Construction",
    Input_110_Hidden=True,
    Input_110_Name="HeatingCO2",
    Input_111_Hidden=True,
    Input_111_Name="CoolingCost",
    Input_112_Hidden=True,
    Input_112_Name="HeatingCost"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)
geo_3 = Geometry(move_7.Geometry)
wset = CSWindowSettings(
    Name="MLForBem-SimpleWindowSettings",
    Type="External",
    ShadingSystemIsOn=shadingon,
    GlazingConstruction=simple_window,
    OperableArea="0",
    HasFrame=hasframe,
    AFNWindowAvailability="AllOff",
    Input_0_Hidden=False,
    Input_0_Name="Name",
    Input_10_Hidden=True,
    Input_10_Name="ShadingThickness",
    Input_11_Hidden=True,
    Input_11_Name="ShadeGlassDistance",
    Input_12_Hidden=True,
    Input_12_Name="TopBottomEdgeOpeningMultiplier",
    Input_13_Hidden=True,
    Input_13_Name="Analysis Mesh Resolution",
    Input_14_Hidden=True,
    Input_14_Name="ZoneMixingIsOn",
    Input_15_Hidden=True,
    Input_15_Name="ZoneMixingDeltaTemperature",
    Input_16_Hidden=True,
    Input_16_Name="ZoneMixingFlowRate",
    Input_17_Hidden=False,
    Input_17_Name="Glazing Construction",
    Input_18_Hidden=False,
    Input_18_Name="OperableArea",
    Input_19_Hidden=True,
    Input_19_Name="ZoneMixingAvailibilitySchedule",
    Input_1_Hidden=False,
    Input_1_Name="WindowSettings",
    Input_20_Hidden=False,
    Input_20_Name="HasFrame",
    Input_21_Hidden=True,
    Input_21_Name="FrameWidth",
    Input_22_Hidden=True,
    Input_22_Name="FrameProjection"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)
library = CSLibrary(AddObjects=flatten([year_schedule.Sched, simple_window]))
random_6 = Random(Range=f2f_height_m, Number=lng_2, Seed=Slider(87, range=0..100))
random_7 = Random(Range=n_floors, Number=lng_2, Seed=Slider(11, range=0..100), Integers=True)
srf = Surface(graft(geo_2))
random_8 = Random(Range=wwr_frac, Number=lng_2, Seed=Slider(25, range=0..100))
srf_2 = Surface(simplify(geo_3))
Z_2 = UnitZ(Factor=random_6)
division = Division(A=random_6, B=2)
trim = TrimTree(Tree=srf, Depth=1)
Z_3 = UnitZ(Factor=division)
move_8 = Move(Geometry=cull, Motion=Z_3)  # -> Geometry, Transform
extr = Extrude(Base=trim, Direction=graft(Z_2))  # -> simplify(Extrusion)
extr_2 = Extrude(Base=srf_2, Direction=graft(Z_2))  # -> simplify(Extrusion)
series_4 = Series(Start=0, Step=graft(random_6), Count=graft(random_7))  # -> simplify(Series)
explode = Explode(Curve=move_8.Geometry, Recursive=True)  # -> Segments, Vertices
Z_4 = UnitZ(Factor=series_4)
multiplication_3 = Multiplication(A=random_6, B=random_8)
python = GhPythonScript(x=extr, y=Z_4)  # -> out, a; inputs x: list of Brep, y: list of Vector3d
# ---------- python: Python ----------
__author__ = "szvsw"
__version__ = "2023.11.14"

import rhinoscriptsyntax as rs
import ghpythonlib.components as ghcomp
import ghpythonlib.treehelpers as th
breps = x
vecs = y
breps_out = []

for brep in breps:
    for vec in vecs:
        new_brep,_ = ghcomp.Move(brep,vec)
        breps_out.append(new_brep)

a = th.list_to_tree(breps_out)
# ---------- end python ----------
midpt = CurveMiddle(Curve=explode.Segments)
end = EndPoints(Curve=explode.Segments)  # -> Start, End
move_9 = Move(Geometry=extr_2, Motion=Z_4)  # -> Geometry, Transform
vec2pt_2 = Vector2Pt(PointA=end.End, PointB=midpt, Unitize=invert(False))  # -> Vector, Length
vec2pt_3 = Vector2Pt(PointA=end.Start, PointB=midpt, Unitize=invert(False))  # -> Vector, Length
lng_3 = ListLength(List=Z_4)  # -> flatten(Length)
division_2 = Division(A=multiplication_3, B=2)
geo_4 = Geometry(python.a)
multiplication_4 = Multiplication(A=vec2pt_2.Vector, B="0.1")
lng_4 = ListLength(List=lng_3)
multiplication_5 = Multiplication(A=vec2pt_3.Vector, B="0.1")
Z_5 = UnitZ(Factor=division_2)
subtraction_2 = Subtraction(A=lng_4, B=1)
subset_2 = SubList(List=lng_3, Domain=subtraction_2, Wrap=True)  # -> List, Index

srf_3 = Surface(move_5.Geometry)
srf_4 = Surface(move_6.Geometry)
srf_5 = Surface(move_7.Geometry)
area_5 = Area(Geometry=srf_3)  # -> flatten(FootprintArea), Centroid
len = Length(Curve=geo)  # -> flatten(PerimeterLengths)
area_6 = Area(Geometry=srf_4)  # -> PerimAreas, Centroid
area_7 = Area(Geometry=srf_5)  # -> flatten(CoreAreas), Centroid
floor_to_floor_heights = Number(random_6)
ma_2 = MassAddition(Input=area_6.PerimAreas)  # -> flatten(TotalPerimArea), PartialResults
multiplication_6 = Multiplication(A=floor_to_floor_heights, B=len)
shoebox_width = Panel("3")
multiplication_7 = Multiplication(ShoeboxWidth=shoebox_width, FloorToFloorHeights=floor_to_floor_heights)
division_3 = Division(PerimOffset=perim_offset, FloorToFloorHeight=floor_to_floor_heights)
facade_area = Division(TotalPerimArea=ma_2.TotalPerimArea, FacadeArea=multiplication_6)
division_4 = Division(CoreAreas=area_7.CoreAreas, TotalPerimAreas=ma_2.TotalPerimArea)
multiplication_8 = Multiplication(SBFacadeArea=multiplication_7, PerimAreaToFacadeArea=facade_area)
panel_6 = Panel(division_4)
panel_7 = Panel(facade_area)
panel_8 = Panel(division_3)
division_5 = Division(ShoeboxAreas=multiplication_8, ShoeboxWidths=shoebox_width)
multiplication_9 = Multiplication(PerimDepths=division_5, CoreAreaToPerimArea=division_4)
perim_depths = Panel(division_5)
footprint_areas = Panel(area_5.FootprintArea)
core_depths = Panel(multiplication_9)

explode_2 = Explode(Curve=cull, Recursive=True)  # -> Segments, Vertices
end_2 = EndPoints(Curve=explode_2.Segments)  # -> Start, End
midpt_2 = CurveMiddle(Curve=explode_2.Segments)
vec2pt_4 = Vector2Pt(PointA=end_2.Start, PointB=midpt_2, Unitize=False)  # -> Vector, Length
move_10 = Move(Geometry=explode_2.Segments, Motion=vec2pt_4.Vector)  # -> Geometry, Transform
rotate_2 = Rotate(Geometry=move_10.Geometry, Angle="-PI/2", Plane=midpt_2)  # -> Geometry, Transform
len_2 = Length(Curve=cull)
end_3 = EndPoints(Curve=rotate_2.Geometry)  # -> Start, End
len_3 = Length(Curve=explode_2.Segments)
vec2pt_5 = Vector2Pt(PointA=end_3.Start, PointB=end_3.End, Unitize=False)  # -> Vector, Length
Y_2 = UnitY(Factor=1)
neg_2 = Negative(Value=Y_2)
xy = XYPlane(Origin=Point(0, 0, 0))
division_6 = Division(A=len_3, B=graft(len_2))  # -> simplify(EdgeWeights)
angle = Angle(VectorA=neg_2, VectorB=vec2pt_5.Vector, Plane=xy)  # -> OrientationsRads, Reflex
multiplication_10 = Multiplication(A=angle.OrientationsRads, B=57.29577951)
round = Round(Number=multiplication_10)  # -> Nearest, Floor, Ceiling
merge_4 = Merge(Data1=simplify(graft(round.Nearest)), Data2=simplify(graft(division_6)))
join_4 = TextJoin(Text=merge_4, Join="deg, weight:")  # -> simplify(Result)
ins_2 = InsertItems(List=graft(random_6), Item="f2fHeight (m)", Indices="1", Wrap=True)
ins_3 = InsertItems(List=graft(random_7), Item="floors", Indices="1", Wrap=True)
line = LineSDL(Start=end_3.Start, Direction=vec2pt_5.Vector, Length="10")
ins_4 = InsertItems(List=graft(random_8), Item="WWRs", Indices="1", Wrap=True)
end_4 = EndPoints(Curve=line)  # -> Start, End
trim_2 = TrimTree(Tree=join_4, Depth=1)
join_5 = TextJoin(Text=ins_2, Join=" ")  # -> flatten(Result)
join_6 = TextJoin(Text=ins_3, Join=" ")  # -> flatten(Result)
join_7 = TextJoin(Text=ins_4, Join=" ")  # -> flatten(Result)
orientation_radians = Panel(angle.OrientationsRads)
edge_weights = Panel(division_6)
wwr = Panel(random_8)
floor_to_floor_height = Panel(random_6)
tag = TextTag(Location=end_4.End, Text=trim_2)
floors = Panel(random_7)
geo_5 = Geometry(line)
item_2 = ListItem(List=end_4.End, Index=0, Wrap=True)  # -> flatten(Item)
tag_2 = TextTag(Location=item_2, Text=join_6)
tag_3 = TextTag(Location=item_2, Text=join_7)
tag_4 = TextTag(Location=item_2, Text=join_5)

move_11 = Move(Geometry=end.End, Motion=multiplication_4)  # -> Geometry, Transform
lng_5 = ListLength(List=lng_3)
move_12 = Move(Geometry=end.Start, Motion=multiplication_5)  # -> Geometry, Transform
neg_3 = Negative(Value=Z_5)
series_5 = Series(Start=0, Step=1, Count=lng_5)
stack = StackData(Data=lng_3, Stack="4")
partition_3 = PartitionList(List=geo_4, Size=stack)  # -> simplify(Chunks)
ln = Line(StartPoint=move_12.Geometry, EndPoint=move_11.Geometry)
move_13 = Move(Geometry=ln, Motion=graft(neg_3))  # -> Geometry, Transform
move_14 = Move(Geometry=ln, Motion=graft(Z_5))  # -> Geometry, Transform
stack_2 = StackData(Data=series_5, Stack="4")
path_mapper = PathMapper(partition_3, source="{a}[i]", target="{floor(a/4);a%4}[i]")
panel_9 = Panel("Bldg")
merge_5 = Merge(Data1=graft(move_14.Geometry), Data2=graft(move_13.Geometry))  # -> simplify(Result)
geo_6 = Geometry(move_9.Geometry)
loft = Loft(Curves=merge_5, Options={Adjust=False, Closed=False, LoftEnds=0, LoftSimp=0, LoftType=0, Rebuild=10, Refit=0.01})
geo_7 = Geometry(path_mapper)
trim_3 = TrimTree(Tree=loft, Depth=1)
preview = CustomPreview(Geometry=geo_7, Material=ColourSwatch(SwatchColor=RGB(222, 171, 144)))
preview_2 = CustomPreview(Geometry=geo_6, Material=ColourSwatch(SwatchColor=RGB(201, 222, 144)))
python_2 = GhPythonScript(x=trim_3, y=Z_4)  # -> out, a; inputs x: list of Brep, y: list of Vector3d; same code as python
viewer = ParamViewer(path_mapper)
geo_8 = Geometry(python_2.a)
panel_10 = Panel(viewer)
partition_4 = PartitionList(List=geo_8, Size=stack)  # -> simplify(Chunks)
split = TextSplit(Text=panel_10, Separators="{,;,}")
path_mapper_2 = PathMapper(partition_4, source="{a}[i]", target="{floor(a/4);a%4}[i]")
cull_2 = CullPattern(List=split, CullPattern=[False, True, True, False])
ins_5 = InsertItems(List=cull_2, Item="building", Indices="0", Wrap=True)
geo_9 = Geometry(path_mapper_2)
preview_3 = CustomPreview(Geometry=geo_9, Material=ColourSwatch(SwatchColor=RGB(144, 204, 222)))
ins_6 = InsertItems(List=ins_5, Item="edge", Indices="2", Wrap=True)
join_8 = TextJoin(Text=ins_6, Join="_")  # -> flatten(Result)
stack_3 = StackData(Data=join_8, Stack=stack)
partition_5 = PartitionList(List=join_8, Size="4")  # -> simplify(Chunks)
panel_11 = Panel(join_8)
stack_4 = StackData(Data=partition_5, Stack=graft(lng_3))
python_3 = GhPythonScript(
    edge_weights=simplify(edge_weights),
    orientations=simplify(orientation_radians),
    perim_depths=simplify(perim_depths),
    core_depths=simplify(core_depths),
    footprint_areas=simplify(footprint_areas),
    wwrs=simplify(wwr),
    n_floors=simplify(floors),
    f2f_heights=simplify(floor_to_floor_height),
    outpath=path_2)  # -> out, a; inputs edge_weights: tree, orientations: tree, perim_depths: tree, core_depths: tree, footprint_areas: tree, wwrs: tree, n_floors: tree of Int32, f2f_heights: tree
# ---------- python_3: Python ----------
__author__ = "szvsw"
__version__ = "2023.11.15"

import rhinoscriptsyntax as rs
import ghpythonlib.treehelpers as th

perim_depths = perim_depths.Branch(0)
core_depths = core_depths.Branch(0)
footprint_areas = footprint_areas.Branch(0)
wwrs = wwrs.Branch(0)
f2f_heights = f2f_heights.Branch(0)
n_floors = n_floors.Branch(0)
output_data = {
    "perim_depths": [float(val) for val in perim_depths],
    "core_depths": [float(val) for val in core_depths],
    "footprint_areas": [float(val) for val in footprint_areas],
    "wwrs": [float(val) for val in wwrs],
    "heights": [float(val) for val in f2f_heights],
    "n_floors": [int(val) for val in n_floors],
    "orientations": [],
    "edge_weights": []
}

for i in range(len(perim_depths)):
    orientation_data = orientations.Branch(i)
    output_data["orientations"].append([float(val) for val in orientation_data])
    edge_weight_data = edge_weights.Branch(i)
    output_data["edge_weights"].append([float(val) for val in edge_weight_data])

import json

with open(str(outpath)+"geom-def.json","w") as f:
    json.dump(output_data,f,indent=4)
# ---------- end python_3 ----------
item_3 = ListItem(List=stack_4, Index=0, Wrap=True)
partition_6 = PartitionList(Size=[3, 2])
panel_12 = Panel(item_3)
python_4 = GhPythonScript(floor_counts=lng_3)  # -> out, perim_names, core_names; inputs floor_counts: list of Int32
# ---------- python_4: Python ----------
__author__ = "szvsw"
__version__ = "2023.11.20"

import rhinoscriptsyntax as rs

perim_names = []
core_names = []
for i, floor_count in enumerate(floor_counts):
    for edge_ix in range(4):
        

        for floor_ix in range(floor_count):
            perim_names.append("perim_building_"+str(i)+"_floor_"+str(floor_ix)+"_edge_"+str(edge_ix))
            if edge_ix == 0:
                core_names.append("core_building_"+str(i)+"_floor_"+str(floor_ix))
# ---------- end python_4 ----------
geo_10 = Geometry(geo_7)
geo_11 = Geometry(flatten(geo_6))
volume = Volume(Geometry=geo_11)  # -> Volume, Centroid
viewer_2 = ParamViewer(geo_10)
geo_12 = Geometry(flatten(geo_7))
tag_5 = TextTag(Location=volume.Centroid, Text=python_4.core_names)
geo_13 = Geometry(flatten(geo_9))
item_4 = ListItem(List=geo_12, Index=Slider(59, range=0..100), Wrap=True)
panel_13 = Panel(viewer_2)
srf_6 = Surface(cull)

# ----
# Model Setup
zone = CSEnergyZone(
    Brep=flatten(geo_12),
    Name=flatten(python_4.perim_names),
    Settings=zset,
    UsedLibraryObjects="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")  # -> Zones, Settings
zone_2 = CSEnergyZone(Brep=geo_11, Name=python_4.core_names, Settings=zset, UsedLibraryObjects="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")  # -> Zones, Settings
bco = CSBoundaryObject(Brep=srf_6, type="GROUND")
window = CSWindow(Surface=geo_13, Settings=wset, UsedLibraryObjects="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")  # -> Window, Settings
model = CSModelMaker(Zones=flatten([zone_2.Zones, zone.Zones]), Windows=window.Window, Boundaries=bco, Library=library)  # -> Model, Invalid
run_e = RunCSEnergyModel(
    Model=model.Model,
    Name="GenerativeCity",
    Directory=path_3,
    Location=path,
    Run=button,
    NorthOffset=0,
    settings="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")  # -> Model, Settings, Result

toggle = BooleanToggle(True)
energy_results = LoadCSEnergyResult(ThermalModel=run_e.Model, Mode=0, Resolution=0, Toggle=Toggle(True))  # -> TotalEUI, Baseline, TotalCO2, TotalCost, FloorArea, Data, Labels, Months, Colors, CSR
load_zone_results = LoadCSZoneResults(
    ThermalModel=run_e.Model,
    Toggle=toggle,
    byzone="True",
    settings="""{
  "zoneIDs": [],
  "output2Display": [
    {
      "key": "Zone Ideal Loads Supply Air Total Heating Energy",
      "unit": "HVAC Sum [J]",
      "type": 0
    }
  ],
  "normalizeByFloorArea": false
}""")  # -> ResultsPerZone, Labels, Name, Zone
load_zone_results_2 = LoadCSZoneResults(
    ThermalModel=run_e.Model,
    Toggle=toggle,
    byzone="True",
    settings="""{
  "zoneIDs": [],
  "output2Display": [
    {
      "key": "Zone Ideal Loads Supply Air Total Cooling Energy",
      "unit": "HVAC Sum [J]",
      "type": 0
    }
  ],
  "normalizeByFloorArea": false
}""")  # -> ResultsPerZone, Labels, Name, Zone
panel_14 = Panel(energy_results.Data)
debrep = DeconstructBrep(Brep=load_zone_results.Zone)  # -> Faces, Edges, Vertices
panel_15 = Panel(load_zone_results_2.ResultsPerZone)
panel_16 = Panel(load_zone_results.ResultsPerZone)
item_5 = ListItem(List=debrep.Faces, Index=0, Wrap=True)
branch = TreeBranch(Tree=energy_results.Data, Path="{5}", MaintainPaths=True)
branch_2 = TreeBranch(Tree=energy_results.Data, Path="{4}", MaintainPaths=True)
area_8 = Area(Geometry=item_5)  # -> flatten(Area), Centroid
plotter = CSPlotter(
    Type=0,
    Width=550,
    Height=450,
    X_labels=energy_results.Months,
    X_rot=0,
    Y_data=energy_results.Data,
    Colors=energy_results.Colors,
    Names=energy_results.Labels,
    Show_xgrid=False,
    Show_ygrid=True,
    Legend=0,
    PreviewDimension=1,
    InfinateZoomDisplay=True,
    UnitSystem=4)
panel_17 = Panel(branch)
panel_18 = Panel(branch_2)
python_5 = GhPythonScript(
    heating=simplify(panel_18),
    cooling=simplify(panel_17),
    outpath=path_2,
    zone_heating=simplify(panel_16),
    zone_cooling=simplify(panel_15),
    zone_area=simplify(area_8.Area),
    zone_names=simplify(load_zone_results.Name))  # -> out, a; inputs heating: tree, cooling: tree, zone_heating: tree, zone_cooling: tree, zone_area: tree, zone_names: tree
# ---------- python_5: Python ----------
__author__ = "szvsw"
__version__ = "2023.11.15"

import rhinoscriptsyntax as rs
import ghpythonlib.treehelpers as th

heating = heating.Branch(0)
cooling = cooling.Branch(0)
output_data = {
    "heating": [float(val) for val in heating],
    "cooling": [float(val) for val in cooling],
}

zone_heat = []
zone_cool = []
for i in range(zone_heating.BranchCount):
    zone_heat.append([float(val) for val in zone_heating.Branch(i)])
    zone_cool.append([float(val) for val in zone_cooling.Branch(i)])
zone_area = [float(val) for val in zone_area.Branch(0)]
zone_names = [str(val) for val in zone_names.Branch(0)]
output_data["zone_results"] = {
    "heating": zone_heat,
    "cooling": zone_cool,
    "area": zone_area,
    "name": zone_names,
}

import json
with open(str(outpath)+"results-out.json","w") as f:
    json.dump(output_data,f,indent=4)
# ---------- end python_5 ----------
