# Grasshopper definition UmiAsCSTester.gh (Grasshopper 1.0.7)
# plug-ins: ClimateStudioGH, jSwan, LadybugGrasshopper

# ----
# Schedule Select
panel = Panel("Occupancy")
number_slider = Slider(5, range=0..15)
panel_2 = Panel("D:\Users\zoelh\GitRepos\ml-for-building-energy-modeling\ml-for-bem\data\")
python = GhPythonScript(index=number_slider, path=panel_2)  # -> schedules
# ---------- python: Python ----------
__author__ = "zoelh"
__version__ = "2023.11.18"

import rhinoscriptsyntax as rs
import csv
import ghpythonlib.treehelpers as th

schedules = []
l = ["EquipmentAvailabilitySchedule.csv", "LightsAvailabilitySchedule.csv", "OccupancySchedule.csv"]
for file in l:
    filename = path + file
    with open(filename) as csvfile:
        reader = csv.reader(csvfile)
        rows = list(reader)
        row = rows[int(index)+1]
        schedules.append([row[1:]])
schedules = th.list_to_tree(schedules)
# ---------- end python ----------
bang = ExplodeTree(Data=python)  # -> Branch0, Branch1, Branch2
year_schedule = ConstructCSYearSchedule(Name=panel, Type=0, Category=0, DaysHours=bang.Branch2)  # -> Sched, Values
year_schedule_2 = ConstructCSYearSchedule(Name="Equip", Type=0, Category=0, DaysHours=bang.Branch0)  # -> Sched, Values
year_schedule_3 = ConstructCSYearSchedule(Name="Lights", Type=0, Category=0, DaysHours=bang.Branch1)  # -> Sched, Values

# ----
# REMINDER: Set name for individual buildings
run_name = Panel("CSboston")
# EPW: D:\Users\zoelh\Dropbox (MIT)\Thesis Work\Building Energy References\ReferenceBuildings\USA_FL-MIAMI.722020_TMY2-12839.epw
output = Panel("D:\DATA\FlorianopolisBase\BostonBaseline\")

floor_to_foor_height = Panel("3")
perim_offset = Panel("3")

# ----
# RUN
button = Button()

# ---- group: MechVentilationSchedule
occupancy = Data(year_schedule.Sched)
panel_3 = Panel("AllOn")

# ----
save_building_settings = Button()
save_results = LBFalseStartToggle(False)
getsublayerobjects = GhPythonScript(Parent="umi::Buildings")  # -> simplify(Subs), Names
# ---------- getsublayerobjects: Python ----------
__author__ = "zoelh"
__version__ = "2023.11.15"

import rhinoscriptsyntax as rs
import scriptcontext as sc
import Rhino
#import GhPython as gp
import ghpythonlib.treehelpers as th

sc.doc = Rhino.RhinoDoc.ActiveDoc
layernames = []

if Parent:
    for layername in rs.LayerNames():
        if layername.startswith(Parent+"::"):
            layernames.append(layername)
print(layernames)
layerTree = [list() for _ in layernames]
for i, layername in enumerate(layernames):
    objs = rs.ObjectsByLayer(layername)
    if objs:
        layerTree[i].append(objs)
layerTree = th.list_to_tree(layerTree)
Subs = layerTree
Names = [x.split("::")[-1] for x in layernames]
# ---------- end getsublayerobjects ----------

# ----
# Window Settings
wwr = Slider(0.4, range=0.1..0.9)
simple_window = ConstructCSSimpleWindow(Name="DOE2004", Shgf="0.65", Uval="1.0", Tvis="4.8")
shadingon = BooleanToggle(False)
hasframe = BooleanToggle(False)
wset = CSWindowSettings(
    Name="SimpleWindow",
    Type="External",
    ShadingSystemIsOn=shadingon,
    GlazingConstruction=simple_window,
    OperableArea="0",
    HasFrame=hasframe,
    AFNWindowAvailability="AllOff",
    Input_0_Hidden=False,
    Input_0_Name="Name",
    Input_10_Hidden=True,
    Input_10_Name="ShadingThickness",
    Input_11_Hidden=True,
    Input_11_Name="ShadeGlassDistance",
    Input_12_Hidden=True,
    Input_12_Name="TopBottomEdgeOpeningMultiplier",
    Input_13_Hidden=True,
    Input_13_Name="Analysis Mesh Resolution",
    Input_14_Hidden=True,
    Input_14_Name="ZoneMixingIsOn",
    Input_15_Hidden=True,
    Input_15_Name="ZoneMixingDeltaTemperature",
    Input_16_Hidden=True,
    Input_16_Name="ZoneMixingFlowRate",
    Input_17_Hidden=False,
    Input_17_Name="Glazing Construction",
    Input_18_Hidden=False,
    Input_18_Name="OperableArea",
    Input_19_Hidden=True,
    Input_19_Name="ZoneMixingAvailibilitySchedule",
    Input_1_Hidden=False,
    Input_1_Name="WindowSettings",
    Input_20_Hidden=False,
    Input_20_Name="HasFrame",
    Input_21_Hidden=True,
    Input_21_Name="FrameWidth",
    Input_22_Hidden=True,
    Input_22_Name="FrameProjection"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)

data = Data(flatten(getsublayerobjects.Subs))
bang_2 = ExplodeTree(Data=getsublayerobjects.Subs)  # -> Branch0, Branch1, Branch2, Branch3, Branch4, Branch5, Branch6, Branch7, Branch8, Branch9
panel_4 = Panel(getsublayerobjects.Names)

# ---- group: AirspeedSched
sched = GetCSYearSchedule(UnitSystem=4)

# ----
# Zone Settings
recovery = ValueList({"None", "Sensible", "Enthalpy"}, selected="None")
people_density = Slider(0.02, range=0..0.1)
epd = Slider(32.59, range=0..60)
heating_setpoint = Slider(19, range=15..35)
lpd = Slider(9.35, range=0..30)
mechventon = BooleanToggle(False)
cooling_setpoint = Slider(26, range=15..35)
infilflowperarea = Slider(0.001, range=0..0.5)
list = ValueList({"NoEconomizer", "DifferentialDryBulb"}, selected="NoEconomizer")
ventperarea_l_s_m2 = Slider(0.3, range=0..1)
ventperperson_l_s_p = Slider(3.5, range=0.5..4)
zone_template = GetCSZoneTemplate(SearchZoneTemplate="*MediumOffice*1A", Selection="90.1-2019 MidriseApartment - Apartment_topfloor_WE CZ 2")
heating_coolingconstant = BooleanToggle(True)
scheduledventilationon = BooleanToggle(False)
people_equip_lightson = BooleanToggle(True)
heating_coolingon = BooleanToggle(True)
humidistaton = BooleanToggle(False)
infiltrationon = BooleanToggle(True)
natventon = BooleanToggle(False)
fanenergy = BooleanToggle(False)
dhwon = BooleanToggle(True)
heating_cop = Panel("1")
dimmingtype = Panel("Off")

# ---- group: ROOF CONSTRUCTION
# Constructions
roof_xps_thickness = Panel("0.16")
roof_concrete_thickness = Panel("0.203")

# ---- group: FACADE CONSTRUCTION
wall_concrete_thickness = Panel("0.203")
wall_insul_thickness = Panel("0.194")

# ---- group: SLAB CONSTRUCTION
slab_insul_thickness = Panel("0.151")

# ----
by_template_layer = Data(bang_2.Branch2)
all_buildings = Data(simplify(graft(data)))

item = ListItem(List=data, Index=Slider(92, range=0..92), Wrap=True)

single_building = Data(simplify(graft(item)))

python_2 = GhPythonScript(x=all_buildings)  # -> guid
# ---------- python_2: Python ----------
__author__ = "zoelh"
__version__ = "2023.11.17"

import rhinoscriptsyntax as rs

#sc.doc = rc.RhnoDoc.ActiveDoc
#
#allObjects = rs.AllObjects()

guid = str(x)
# ---------- end python_2 ----------
panel_5 = Panel(python_2)
cluster = Cluster(brep=all_buildings, B_2=floor_to_foor_height, offset=perim_offset, B=wwr)  # -> perim, core, ground, roof, windows
trim = TrimTree(Tree=cluster.core, Depth=1)
trim_2 = TrimTree(Tree=cluster.perim, Depth=1)
lng = ListLength(List=trim)  # -> flatten(Length)
lng_2 = ListLength(List=trim_2)  # -> flatten(Length)

material = ConstructCSOpaqueMaterial(
    Name="Partition Plaster",
    Conductivity=1,
    Density=2000,
    Roughness="Rough",
    SpecificHeat=1130,
    ThermalAbsorptance=0.9,
    SolarAbsorptance=0.7,
    VisibleAbsorptance=0.7,
    Type="Finishes",
    Input_0_Hidden=False,
    Input_0_Name="Name",
    Input_10_Hidden=True,
    Input_10_Name="TemperatureCoefficientThermalConductivity",
    Input_11_Hidden=True,
    Input_11_Name="TemperatureArray",
    Input_12_Hidden=True,
    Input_12_Name="EnthalpyArray",
    Input_13_Hidden=True,
    Input_13_Name="VariableConductivityArray",
    Input_14_Hidden=False,
    Input_14_Name="Type",
    Input_15_Hidden=True,
    Input_15_Name="EmbodiedEnergy",
    Input_16_Hidden=True,
    Input_16_Name="EmbodiedCarbon",
    Input_17_Hidden=True,
    Input_17_Name="Cost",
    Input_18_Hidden=True,
    Input_18_Name="Life",
    Input_1_Hidden=False,
    Input_1_Name="Conductivity",
    Input_2_Hidden=False,
    Input_2_Name="Density",
    Input_3_Hidden=False,
    Input_3_Name="Roughness",
    Input_4_Hidden=False,
    Input_4_Name="SpecificHeat",
    Input_5_Hidden=False,
    Input_5_Name="ThermalAbsorptance"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)
material_2 = ConstructCSOpaqueMaterial(
    Name="Carpet",
    Conductivity=0.6,
    Density=288,
    Roughness="Rough",
    SpecificHeat=1380,
    ThermalAbsorptance=0.9,
    SolarAbsorptance=0.7,
    VisibleAbsorptance=0.7,
    Type="Finishes",
    Input_0_Hidden=False,
    Input_0_Name="Name",
    Input_10_Hidden=True,
    Input_10_Name="TemperatureCoefficientThermalConductivity",
    Input_11_Hidden=True,
    Input_11_Name="TemperatureArray",
    Input_12_Hidden=True,
    Input_12_Name="EnthalpyArray",
    Input_13_Hidden=True,
    Input_13_Name="VariableConductivityArray",
    Input_14_Hidden=False,
    Input_14_Name="Type",
    Input_15_Hidden=True,
    Input_15_Name="EmbodiedEnergy",
    Input_16_Hidden=True,
    Input_16_Name="EmbodiedCarbon",
    Input_17_Hidden=True,
    Input_17_Name="Cost",
    Input_18_Hidden=True,
    Input_18_Name="Life",
    Input_1_Hidden=False,
    Input_1_Name="Conductivity",
    Input_2_Hidden=False,
    Input_2_Name="Density",
    Input_3_Hidden=False,
    Input_3_Name="Roughness",
    Input_4_Hidden=False,
    Input_4_Name="SpecificHeat",
    Input_5_Hidden=False,
    Input_5_Name="ThermalAbsorptance"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)
material_3 = ConstructCSOpaqueMaterial(
    Name="Stucco",
    Conductivity=0.72,
    Density=1856,
    Roughness="Rough",
    SpecificHeat=840,
    ThermalAbsorptance=0.9,
    SolarAbsorptance=0.7,
    VisibleAbsorptance=0.7,
    Type="Sealing",
    Input_0_Hidden=False,
    Input_0_Name="Name",
    Input_10_Hidden=True,
    Input_10_Name="TemperatureCoefficientThermalConductivity",
    Input_11_Hidden=True,
    Input_11_Name="TemperatureArray",
    Input_12_Hidden=True,
    Input_12_Name="EnthalpyArray",
    Input_13_Hidden=True,
    Input_13_Name="VariableConductivityArray",
    Input_14_Hidden=False,
    Input_14_Name="Type",
    Input_15_Hidden=True,
    Input_15_Name="EmbodiedEnergy",
    Input_16_Hidden=True,
    Input_16_Name="EmbodiedCarbon",
    Input_17_Hidden=True,
    Input_17_Name="Cost",
    Input_18_Hidden=True,
    Input_18_Name="Life",
    Input_1_Hidden=False,
    Input_1_Name="Conductivity",
    Input_2_Hidden=False,
    Input_2_Name="Density",
    Input_3_Hidden=False,
    Input_3_Name="Roughness",
    Input_4_Hidden=False,
    Input_4_Name="SpecificHeat",
    Input_5_Hidden=False,
    Input_5_Name="ThermalAbsorptance"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)
material_4 = ConstructCSOpaqueMaterial(
    Name="Plaster",
    Conductivity=1,
    Density=2000,
    Roughness="Rough",
    SpecificHeat=1130,
    ThermalAbsorptance=0.9,
    SolarAbsorptance=0.7,
    VisibleAbsorptance=0.7,
    Type="Plaster",
    Input_0_Hidden=False,
    Input_0_Name="Name",
    Input_10_Hidden=True,
    Input_10_Name="TemperatureCoefficientThermalConductivity",
    Input_11_Hidden=True,
    Input_11_Name="TemperatureArray",
    Input_12_Hidden=True,
    Input_12_Name="EnthalpyArray",
    Input_13_Hidden=True,
    Input_13_Name="VariableConductivityArray",
    Input_14_Hidden=False,
    Input_14_Name="Type",
    Input_15_Hidden=True,
    Input_15_Name="EmbodiedEnergy",
    Input_16_Hidden=True,
    Input_16_Name="EmbodiedCarbon",
    Input_17_Hidden=True,
    Input_17_Name="Cost",
    Input_18_Hidden=True,
    Input_18_Name="Life",
    Input_1_Hidden=False,
    Input_1_Name="Conductivity",
    Input_2_Hidden=False,
    Input_2_Name="Density",
    Input_3_Hidden=False,
    Input_3_Name="Roughness",
    Input_4_Hidden=False,
    Input_4_Name="SpecificHeat",
    Input_5_Hidden=False,
    Input_5_Name="ThermalAbsorptance"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)
material_5 = ConstructCSOpaqueMaterial(
    Name="Mineral Wool",
    Conductivity=0.041,
    Density=155,
    Roughness="Rough",
    SpecificHeat=1130,
    ThermalAbsorptance=0.9,
    SolarAbsorptance=0.7,
    VisibleAbsorptance=0.7,
    Type="Insulation",
    Input_0_Hidden=False,
    Input_0_Name="Name",
    Input_10_Hidden=True,
    Input_10_Name="TemperatureCoefficientThermalConductivity",
    Input_11_Hidden=True,
    Input_11_Name="TemperatureArray",
    Input_12_Hidden=True,
    Input_12_Name="EnthalpyArray",
    Input_13_Hidden=True,
    Input_13_Name="VariableConductivityArray",
    Input_14_Hidden=False,
    Input_14_Name="Type",
    Input_15_Hidden=True,
    Input_15_Name="EmbodiedEnergy",
    Input_16_Hidden=True,
    Input_16_Name="EmbodiedCarbon",
    Input_17_Hidden=True,
    Input_17_Name="Cost",
    Input_18_Hidden=True,
    Input_18_Name="Life",
    Input_1_Hidden=False,
    Input_1_Name="Conductivity",
    Input_2_Hidden=False,
    Input_2_Name="Density",
    Input_3_Hidden=False,
    Input_3_Name="Roughness",
    Input_4_Hidden=False,
    Input_4_Name="SpecificHeat",
    Input_5_Hidden=False,
    Input_5_Name="ThermalAbsorptance"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)
material_6 = ConstructCSOpaqueMaterial(
    Name="WallConcrete",
    Conductivity=2,
    Density=2400,
    Roughness="Rough",
    SpecificHeat=950,
    ThermalAbsorptance=0.9,
    SolarAbsorptance=0.7,
    VisibleAbsorptance=0.7,
    Type="Concrete",
    Input_0_Hidden=False,
    Input_0_Name="Name",
    Input_10_Hidden=True,
    Input_10_Name="TemperatureCoefficientThermalConductivity",
    Input_11_Hidden=True,
    Input_11_Name="TemperatureArray",
    Input_12_Hidden=True,
    Input_12_Name="EnthalpyArray",
    Input_13_Hidden=True,
    Input_13_Name="VariableConductivityArray",
    Input_14_Hidden=False,
    Input_14_Name="Type",
    Input_15_Hidden=True,
    Input_15_Name="EmbodiedEnergy",
    Input_16_Hidden=True,
    Input_16_Name="EmbodiedCarbon",
    Input_17_Hidden=True,
    Input_17_Name="Cost",
    Input_18_Hidden=True,
    Input_18_Name="Life",
    Input_1_Hidden=False,
    Input_1_Name="Conductivity",
    Input_2_Hidden=False,
    Input_2_Name="Density",
    Input_3_Hidden=False,
    Input_3_Name="Roughness",
    Input_4_Hidden=False,
    Input_4_Name="SpecificHeat",
    Input_5_Hidden=False,
    Input_5_Name="ThermalAbsorptance"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)
material_7 = ConstructCSOpaqueMaterial(
    Name="Felt",
    Conductivity=0.9,
    Density=0.5,
    Roughness="Rough",
    SpecificHeat=1800,
    ThermalAbsorptance=0.9,
    SolarAbsorptance=0.7,
    VisibleAbsorptance=0.7,
    Type="Insulation",
    Input_0_Hidden=False,
    Input_0_Name="Name",
    Input_10_Hidden=True,
    Input_10_Name="TemperatureCoefficientThermalConductivity",
    Input_11_Hidden=True,
    Input_11_Name="TemperatureArray",
    Input_12_Hidden=True,
    Input_12_Name="EnthalpyArray",
    Input_13_Hidden=True,
    Input_13_Name="VariableConductivityArray",
    Input_14_Hidden=False,
    Input_14_Name="Type",
    Input_15_Hidden=True,
    Input_15_Name="EmbodiedEnergy",
    Input_16_Hidden=True,
    Input_16_Name="EmbodiedCarbon",
    Input_17_Hidden=True,
    Input_17_Name="Cost",
    Input_18_Hidden=True,
    Input_18_Name="Life",
    Input_1_Hidden=False,
    Input_1_Name="Conductivity",
    Input_2_Hidden=False,
    Input_2_Name="Density",
    Input_3_Hidden=False,
    Input_3_Name="Roughness",
    Input_4_Hidden=False,
    Input_4_Name="SpecificHeat",
    Input_5_Hidden=False,
    Input_5_Name="ThermalAbsorptance"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)
material_8 = ConstructCSOpaqueMaterial(
    Name="Concrete",
    Conductivity=2,
    Density=2100,
    Roughness="Rough",
    SpecificHeat=1040,
    ThermalAbsorptance=0.9,
    SolarAbsorptance=0.7,
    VisibleAbsorptance=0.7,
    Type="Concrete",
    Input_0_Hidden=False,
    Input_0_Name="Name",
    Input_10_Hidden=True,
    Input_10_Name="TemperatureCoefficientThermalConductivity",
    Input_11_Hidden=True,
    Input_11_Name="TemperatureArray",
    Input_12_Hidden=True,
    Input_12_Name="EnthalpyArray",
    Input_13_Hidden=True,
    Input_13_Name="VariableConductivityArray",
    Input_14_Hidden=False,
    Input_14_Name="Type",
    Input_15_Hidden=True,
    Input_15_Name="EmbodiedEnergy",
    Input_16_Hidden=True,
    Input_16_Name="EmbodiedCarbon",
    Input_17_Hidden=True,
    Input_17_Name="Cost",
    Input_18_Hidden=True,
    Input_18_Name="Life",
    Input_1_Hidden=False,
    Input_1_Name="Conductivity",
    Input_2_Hidden=False,
    Input_2_Name="Density",
    Input_3_Hidden=False,
    Input_3_Name="Roughness",
    Input_4_Hidden=False,
    Input_4_Name="SpecificHeat",
    Input_5_Hidden=False,
    Input_5_Name="ThermalAbsorptance"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)
material_9 = ConstructCSOpaqueMaterial(
    Name="AcousticTile",
    Conductivity=0.06,
    Density=368,
    Roughness="Rough",
    SpecificHeat=590,
    ThermalAbsorptance=0.9,
    SolarAbsorptance=0.7,
    VisibleAbsorptance=0.7,
    Type="Finishes",
    Input_0_Hidden=False,
    Input_0_Name="Name",
    Input_10_Hidden=True,
    Input_10_Name="TemperatureCoefficientThermalConductivity",
    Input_11_Hidden=True,
    Input_11_Name="TemperatureArray",
    Input_12_Hidden=True,
    Input_12_Name="EnthalpyArray",
    Input_13_Hidden=True,
    Input_13_Name="VariableConductivityArray",
    Input_14_Hidden=False,
    Input_14_Name="Type",
    Input_15_Hidden=True,
    Input_15_Name="EmbodiedEnergy",
    Input_16_Hidden=True,
    Input_16_Name="EmbodiedCarbon",
    Input_17_Hidden=True,
    Input_17_Name="Cost",
    Input_18_Hidden=True,
    Input_18_Name="Life",
    Input_1_Hidden=False,
    Input_1_Name="Conductivity",
    Input_2_Hidden=False,
    Input_2_Name="Density",
    Input_3_Hidden=False,
    Input_3_Name="Roughness",
    Input_4_Hidden=False,
    Input_4_Name="SpecificHeat",
    Input_5_Hidden=False,
    Input_5_Name="ThermalAbsorptance"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)
material_10 = ConstructCSOpaqueMaterial(
    Name="XPS",
    Conductivity=0.034,
    Density=35,
    Roughness="Rough",
    SpecificHeat=1400,
    ThermalAbsorptance=0.9,
    SolarAbsorptance=0.7,
    VisibleAbsorptance=0.7,
    Type="Insulation",
    Input_0_Hidden=False,
    Input_0_Name="Name",
    Input_10_Hidden=True,
    Input_10_Name="TemperatureCoefficientThermalConductivity",
    Input_11_Hidden=True,
    Input_11_Name="TemperatureArray",
    Input_12_Hidden=True,
    Input_12_Name="EnthalpyArray",
    Input_13_Hidden=True,
    Input_13_Name="VariableConductivityArray",
    Input_14_Hidden=False,
    Input_14_Name="Type",
    Input_15_Hidden=True,
    Input_15_Name="EmbodiedEnergy",
    Input_16_Hidden=True,
    Input_16_Name="EmbodiedCarbon",
    Input_17_Hidden=True,
    Input_17_Name="Cost",
    Input_18_Hidden=True,
    Input_18_Name="Life",
    Input_1_Hidden=False,
    Input_1_Name="Conductivity",
    Input_2_Hidden=False,
    Input_2_Name="Density",
    Input_3_Hidden=False,
    Input_3_Name="Roughness",
    Input_4_Hidden=False,
    Input_4_Name="SpecificHeat",
    Input_5_Hidden=False,
    Input_5_Name="ThermalAbsorptance"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)

# ---- group: WallInsul
layer = ConstructCSLayer(Material=material_4, Thickness="0.013")

# ---- group: WallConcrete
layer_2 = ConstructCSLayer(Material=material_6, Thickness=wall_concrete_thickness)

# ---- group: WallInsul
layer_3 = ConstructCSLayer(Material=material_5, Thickness=roof_xps_thickness)

layer_4 = ConstructCSLayer(Material=material_3, Thickness="0.025")

# ---- group: RoofFelt
layer_5 = ConstructCSLayer(Material=material_7, Thickness="0.003")

# ---- group: GroundCarpet
layer_6 = ConstructCSLayer(Material=material, Thickness="0.013")

# ---- group: RoofConcrete
layer_7 = ConstructCSLayer(Material=material_8, Thickness=roof_concrete_thickness)

# ---- group: RoofTile
layer_8 = ConstructCSLayer(Material=material_9, Thickness="0.005")

# ---- group: RoofXPS
layer_9 = ConstructCSLayer(Material=material_10, Thickness=roof_xps_thickness)

# ---- group: GroundConcrete
layer_10 = ConstructCSLayer(Material=material_6, Thickness="0.203")

# ---- group: GroundCarpet
layer_11 = ConstructCSLayer(Material=material_2, Thickness="0.02")

# ---- group: GroundXPS
layer_12 = ConstructCSLayer(Material=material_10, Thickness=slab_insul_thickness)

# ----
dup = DuplicateData(Data=layer_6, Number=2, Order=True)
construction = ConstructCSConstruction(
    Name="ExteriorRoof",
    Category="Roof",
    Layers=flatten([layer_9, layer_7, layer_8, layer_5]),
    Input_0_Hidden=False,
    Input_0_Name="Name",
    Input_1_Hidden=False,
    Input_1_Name="Category",
    Input_2_Hidden=False,
    Input_2_Name="Layers",
    Input_3_Hidden=True,
    Input_3_Name="EmbodiedEnergy",
    Input_4_Hidden=True,
    Input_4_Name="EmbodiedCarbon",
    Input_5_Hidden=True,
    Input_5_Name="Cost",
    Input_6_Hidden=True,
    Input_6_Name="Life",
    UnitSystem=4,
    Input_3_GHParam_Branch0_Path="{0}",
    Input_3_GHParam_Branch0_Item0_number=0,
    Input_4_GHParam_Branch0_Path="{0}",
    Input_4_GHParam_Branch0_Item0_number=0,
    Input_5_GHParam_Branch0_Path="{0}",
    Input_5_GHParam_Branch0_Item0_number=0,
    Input_6_GHParam_Branch0_Path="{0}",
    Input_6_GHParam_Branch0_Item0_number=10)  # -> Construction, ConstructionInformation
construction_2 = ConstructCSConstruction(
    Name="GroundSlab",
    Category="GroundFloor",
    Layers=flatten([layer_12, layer_10, layer_11]),
    Input_0_Hidden=False,
    Input_0_Name="Name",
    Input_1_Hidden=False,
    Input_1_Name="Category",
    Input_2_Hidden=False,
    Input_2_Name="Layers",
    Input_3_Hidden=True,
    Input_3_Name="EmbodiedEnergy",
    Input_4_Hidden=True,
    Input_4_Name="EmbodiedCarbon",
    Input_5_Hidden=True,
    Input_5_Name="Cost",
    Input_6_Hidden=True,
    Input_6_Name="Life",
    UnitSystem=4,
    Input_3_GHParam_Branch0_Path="{0}",
    Input_3_GHParam_Branch0_Item0_number=0,
    Input_4_GHParam_Branch0_Path="{0}",
    Input_4_GHParam_Branch0_Item0_number=0,
    Input_5_GHParam_Branch0_Path="{0}",
    Input_5_GHParam_Branch0_Item0_number=0,
    Input_6_GHParam_Branch0_Path="{0}",
    Input_6_GHParam_Branch0_Item0_number=10)  # -> Construction, ConstructionInformation
construction_3 = ConstructCSConstruction(
    Name="ExteriorWall",
    Category="Facade",
    Layers=flatten([layer_2, layer_3, layer, layer_4]),
    Input_0_Hidden=False,
    Input_0_Name="Name",
    Input_1_Hidden=False,
    Input_1_Name="Category",
    Input_2_Hidden=False,
    Input_2_Name="Layers",
    Input_3_Hidden=True,
    Input_3_Name="EmbodiedEnergy",
    Input_4_Hidden=True,
    Input_4_Name="EmbodiedCarbon",
    Input_5_Hidden=True,
    Input_5_Name="Cost",
    Input_6_Hidden=True,
    Input_6_Name="Life",
    UnitSystem=4,
    Input_3_GHParam_Branch0_Path="{0}",
    Input_3_GHParam_Branch0_Item0_number=0,
    Input_4_GHParam_Branch0_Path="{0}",
    Input_4_GHParam_Branch0_Item0_number=0,
    Input_5_GHParam_Branch0_Path="{0}",
    Input_5_GHParam_Branch0_Item0_number=0,
    Input_6_GHParam_Branch0_Path="{0}",
    Input_6_GHParam_Branch0_Item0_number=10)  # -> Construction, ConstructionInformation
construction_4 = ConstructCSConstruction(
    Name="Interior Partition",
    Category="Facade",
    Layers=flatten(dup),
    Input_0_Hidden=False,
    Input_0_Name="Name",
    Input_1_Hidden=False,
    Input_1_Name="Category",
    Input_2_Hidden=False,
    Input_2_Name="Layers",
    Input_3_Hidden=True,
    Input_3_Name="EmbodiedEnergy",
    Input_4_Hidden=True,
    Input_4_Name="EmbodiedCarbon",
    Input_5_Hidden=True,
    Input_5_Name="Cost",
    Input_6_Hidden=True,
    Input_6_Name="Life",
    UnitSystem=4,
    Input_3_GHParam_Branch0_Path="{0}",
    Input_3_GHParam_Branch0_Item0_number=0,
    Input_4_GHParam_Branch0_Path="{0}",
    Input_4_GHParam_Branch0_Item0_number=0,
    Input_5_GHParam_Branch0_Path="{0}",
    Input_5_GHParam_Branch0_Item0_number=0,
    Input_6_GHParam_Branch0_Path="{0}",
    Input_6_GHParam_Branch0_Item0_number=10)  # -> Construction, ConstructionInformation

# ---- group: PARTITION CONSTRUCTION
panel_6 = Panel(construction_4.ConstructionInformation)
partition = Data(construction_4.Construction)

# ---- group: ROOF CONSTRUCTION (continued)
panel_7 = Panel(construction.ConstructionInformation)
exteriorroof = Data(construction.Construction)

# ---- group: FACADE CONSTRUCTION (continued)
panel_8 = Panel(construction_3.ConstructionInformation)
exteriorwall = Data(construction_3.Construction)

# ---- group: SLAB CONSTRUCTION (continued)
panel_9 = Panel(construction_2.ConstructionInformation)
slab = Data(construction_2.Construction)

# ----
zset = CSZoneSettings(
    Name="ParametricZoneSettings",
    ZoneSettings=zone_template,
    RoofConstruction=exteriorroof,
    FacadeConstruction=exteriorwall,
    SlabConstruction=slab,
    PartitionConstruction=partition,
    ExternalFloorConstruction=slab,
    InternalMassConstruction=partition,
    InternalMassExposedArea=Slider(1, range=0..1),
    GroundSlabConstruction=slab,
    PeopleDensity=people_density,
    AirspeedSchedule=sched,
    EquipmentPowerDensity=epd,
    LightingPowerDensity=lpd,
    OccupancySchedule=year_schedule.Sched,
    EquipmentAvailabilitySchedule=year_schedule_2.Sched,
    LightsAvailabilitySchedule=year_schedule_3.Sched,
    DimmingType=dimmingtype,
    PeopleIsOn=people_equip_lightson,
    EquipmentIsOn=people_equip_lightson,
    LightsIsOn=people_equip_lightson,
    CoolingCOP=heating_cop,
    HeatingCOP=heating_cop,
    HeatingSetpoint=heating_setpoint,
    CoolingSetpoint=cooling_setpoint,
    HeatingSetpointConstant=heating_coolingconstant,
    CoolingSetpointConstant=heating_coolingconstant,
    HeatIsOn=heating_coolingon,
    CoolIsOn=heating_coolingon,
    MechVentIsOn=mechventon,
    HumidistatIsOn=humidistaton,
    HeatingLimitType="NoLimit",
    CoolingLimitType="LimitFlowRateAndCapacity",
    HeatingSchedule="AllOn",
    CoolingSchedule="AllOn",
    MechVentSchedule=panel_3,
    MinFreshAirPerson=ventperperson_l_s_p,
    MinFreshAirArea=ventperarea_l_s_m2,
    EconomizerType=list,
    HeatRecoveryType=recovery,
    HeatRecoveryEfficiencySensible="0.7",
    HeatRecoveryEfficiencyLatent="0.65",
    MinHumidity="20",
    MaxHumidity="80",
    TurnOnEMSFanEnergy=fanenergy,
    MaxHeatSupplyAirTemp="30",
    MinCoolSupplyAirTemp="18",
    NatVentIsOn=natventon,
    SchedVentIsOn=scheduledventilationon,
    InfiltrationIsOn=infiltrationon,
    InfiltrationAch="0",
    InfiltrationFlowExtArea=infilflowperarea,
    InfiltrationCalculationMethod="FlowExtArea",
    FlowRatePerPerson="0",
    DHWOn=dhwon,
    Input_0_Hidden=False,
    Input_0_Name="Name",
    Input_100_Hidden=True,
    Input_100_Name="Interior Vertical Insulation Depth",
    Input_101_Hidden=True,
    Input_101_Name="Exterior Horizontal Insulation Depth",
    Input_102_Hidden=True,
    Input_102_Name="Exterior Horizontal Insulation Width",
    Input_103_Hidden=True,
    Input_103_Name="Footing Thickness",
    Input_104_Hidden=True,
    Input_104_Name="Footing Depth",
    Input_105_Hidden=True,
    Input_105_Name="ElectricityCO2",
    Input_106_Hidden=True,
    Input_106_Name="ElectricityCost",
    Input_107_Hidden=True,
    Input_107_Name="HotWaterCO2",
    Input_108_Hidden=True,
    Input_108_Name="HotWaterCost",
    Input_109_Hidden=True,
    Input_109_Name="CoolingCO2",
    Input_10_Hidden=True,
    Input_10_Name="Ground Wall Construction",
    Input_110_Hidden=True,
    Input_110_Name="HeatingCO2",
    Input_111_Hidden=True,
    Input_111_Name="CoolingCost",
    Input_112_Hidden=True,
    Input_112_Name="HeatingCost"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)
dejson = DeserializeJson(JSON=zset, OutputsLocked=False)  # -> Constructions, Loads, Conditioning, HotWater, NaturalVentilation, Foundation, Infiltration, CostEmissions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

# ----
# Model Setup
python_3 = GhPythonScript(Zones=lng_2, Type="Perim")  # -> Names; inputs Zones: list of Int32
# ---------- python_3: Python ----------
__author__ = "zoelh"
__version__ = "2023.11.17"

import rhinoscriptsyntax as rs
import ghpythonlib.treehelpers as th

nms = []

for i, item in enumerate(Zones):
    print(item)
    for j in range(item):
        n = "bldg_" + str(i) +"_"+Type+"_" + "_zone_" + str(j)
        print(n)
        nms.append(n)
        
Names = nms
# ---------- end python_3 ----------
python_4 = GhPythonScript(Zones=lng, Type="Core")  # -> Names; inputs Zones: list of Int32; same code as python_3
library = CSLibrary(AddObjects=[simple_window, zset, exteriorroof, exteriorwall, partition, slab])
zone = ThermalZone(Brep=flatten(cluster.perim), Name=python_3, Settings=zset, UsedLibraryObjects="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")  # -> Zones, Settings
zone_2 = ThermalZone(Brep=flatten(cluster.core), Name=python_4, Settings=zset, UsedLibraryObjects="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")  # -> Zones, Settings
window = Window(
    Surface=flatten(cluster.windows),
    Settings="gn0U+QEAAAAAAAD4P4ECAAAAAAAA4D8KFFdpbmRvdyBOb24tcmVzIEZpeGVkOgNBbGw=",
    UsedLibraryObjects="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")  # -> Window, Settings
bc = BoundaryCondition(Brep=flatten(cluster.ground), FFactor=0.2, CFactor=0.2, type="GROUND")
expression = Expression(x="all", y=run_name, Expression="Format(\"{1}_{0}\", x,y)")
expression_2 = Expression(x="all", y=run_name, Expression="Format(\"results-out_{1}_{0}.json\", x, y)")
networker = Networker(
    Zones=flatten([zone_2.Zones, zone.Zones]),
    Windows=window.Window,
    Boundaries=bc,
    preview_displayAdia=True,
    preview_displayExtFloor=True,
    preview_displayFacades=True,
    preview_displayGround=True,
    preview_displayParts=True,
    preview_displayRoofs=True,
    preview_displayShade=True,
    preview_displaySlabs=True,
    preview_displayWins=True)
run_e = RunCSEnergyModel(
    Model=networker,
    Name=expression,
    Directory=output,
    Location="USA_MA_Boston-Logan.Intl.AP.725090_TMYx.2004-2018",
    Run=button,
    settings="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")  # -> Model, Settings, Result

python_5 = GhPythonScript(x=construction.ConstructionInformation)  # -> Rval, mass
# ---------- python_5: Python ----------
__author__ = "zoelh"
__version__ = "2023.11.21"

import rhinoscriptsyntax as rs
import re

Rval = None

s = re.sub(r'[^\w.\n]+', ' ', x)
s=s.replace(" ", '')
print(s)
Rval = float(s.split("RValuemKW")[1].split("\n")[0])
mass = float(s.split("CapacitancekJKm")[1].split("\n")[0])
print(Rval)
print(mass)
# ---------- end python_5 ----------
python_6 = GhPythonScript(x=construction_2.ConstructionInformation)  # -> Rval, mass; same code as python_5
python_7 = GhPythonScript(x=construction_3.ConstructionInformation)  # -> Rval, mass; same code as python_5

# ----
# Save building settings
expression_3 = Expression(x="ParametricZoneSettings", y=run_name, Expression="Format(\"epjsonsettings_{1}_{0}.json\", x, y)")
python_8 = GhPythonScript(
    guid=python_2,
    wwr=wwr,
    sched=number_slider,
    RoofRval=python_5.Rval,
    RoofMass=python_5.mass,
    WallRval=python_7.Rval,
    WallMass=python_7.mass,
    SlabRval=python_6.Rval)  # -> d
# ---------- python_8: Python ----------
__author__ = "zoelh"
__version__ = "2023.11.18"

import rhinoscriptsyntax as rs
import json

d= dict(
    ShoeboxConfig=dict(
        guid=guid,
        wwr=wwr,
        schedule_index=int(sched),
        RoofRValue = RoofRval,
        RoofMass = RoofMass,
        FacadeRValue = WallRval,
        FacadeMass = WallMass,
        SlabRValue = SlabRval,
    )
)
d = json.dumps(d)
print(d)
# ---------- end python_8 ----------
python_9 = GhPythonScript(name="SimpleWindow", shgc="0.65", uval="1.0", tvis="4.8")  # -> d
# ---------- python_9: Python ----------
__author__ = "zoelh"
__version__ = "2023.11.18"

import rhinoscriptsyntax as rs
import json

d= dict(
    SimpleWindow=dict(
        Name=name,
        shgc=shgc,
        uval=uval,
        tvis=tvis,
    )
)
d = json.dumps(d)
print(d)
# ---------- end python_9 ----------
jmerge = MergeJson(SourceJson=zset, OverrideJson=python_9)
jmerge_2 = MergeJson(SourceJson=python_8, OverrideJson=jmerge)  # -> simplify(MergedJson)
panel_10 = Panel(jmerge_2)
python_10 = GhPythonScript(set=jmerge_2, name=expression_3, dir=output, save=save_building_settings)
# ---------- python_10: Python ----------
__author__ = "zoelh"
__version__ = "2023.11.18"

import rhinoscriptsyntax as rs
import json

fname = dir + name
print(fname)
if save:
    with open(fname, "w") as f:
        json.dump(json.loads(set), f, indent=4)
# ---------- end python_10 ----------
panel_11 = Panel(expression_3)

energy_results = LoadCSEnergyResult(ThermalModel=run_e.Model, Mode=0, Resolution=0, Toggle=Toggle(True))  # -> TotalEUI, Baseline, TotalCO2, TotalCost, FloorArea, Data, Labels, Months, Colors, CSR
branch = TreeBranch(Tree=energy_results.Data, Path="{4}", MaintainPaths=True)
branch_2 = TreeBranch(Tree=energy_results.Data, Path="{5}", MaintainPaths=True)
energy_results_2 = LoadCSRResultFile(ThermalModel=run_e.Model, Mode=0, Toggle=Toggle(True))  # -> TotalEUI, Baseline, TotalCO2, TotalCost, FloorArea, Data, Labels, Months, Colors, CSR
energy_results_3 = LoadCSRResultFile(ThermalModel=run_e.Model, Mode=2, Toggle=Toggle(True))  # -> TotalEUI, Baseline, TotalCO2, TotalCost, FloorArea, Data, Labels, Months, Colors, CSR
panel_12 = Panel(branch)
panel_13 = Panel(branch_2)
xyplot = XYPlot(
    Type=2,
    Width=550,
    Height=450,
    Title="Loads",
    Y_title="[kWh]",
    X_labels=energy_results_3.Months,
    X_rot=0,
    Y_data=energy_results_3.Data,
    Colors=energy_results_3.Colors,
    Names=energy_results_3.Labels,
    Show_xgrid=False,
    Show_ygrid=True,
    Legend=0)
xyplot_2 = XYPlot(
    Type=2,
    Width=550,
    Height=450,
    Title="EUI",
    Y_title="[kWh/m2/yr]",
    X_labels=energy_results_2.Months,
    X_rot=0,
    Y_data=energy_results_2.Data,
    Colors=energy_results_2.Colors,
    Names=energy_results_2.Labels,
    Show_xgrid=False,
    Show_ygrid=True,
    Legend=0)
plotter = CSPlotter(
    Type=0,
    Width=550,
    Height=450,
    X_labels=energy_results.Months,
    X_rot=0,
    Y_data=energy_results.Data,
    Colors=energy_results.Colors,
    Names=energy_results.Labels,
    Show_xgrid=False,
    Show_ygrid=True,
    Legend=0,
    PreviewDimension=1,
    InfinateZoomDisplay=True,
    UnitSystem=4)
panel_14 = Panel(expression_2)
python_11 = GhPythonScript(heating=simplify(panel_12), cooling=simplify(panel_13), outpath=output, name=expression_2, save=save_results)  # -> out, a; inputs heating: tree, cooling: tree
# ---------- python_11: Python ----------
__author__ = "szvsw"
__version__ = "2023.11.15"

import rhinoscriptsyntax as rs
import ghpythonlib.treehelpers as th

heating = heating.Branch(0)
cooling = cooling.Branch(0)
output_data = {
    "heating": [float(val) for val in heating],
    "cooling": [float(val) for val in cooling],
}

import json
if save:
    with open(str(outpath)+name,"w") as f:
        json.dump(output_data,f,indent=4)
# ---------- end python_11 ----------
eval = Evaluate(F="Round(x,1)", x=energy_results_2.TotalEUI)
eval_2 = Evaluate(F="Round(x,1)", x=energy_results_2.Baseline)
eval_3 = Evaluate(F="Round(x,1)", x=energy_results_2.TotalCost)
eval_4 = Evaluate(F="Round(x,1)", x=energy_results_2.TotalCO2)
kg_co2_m2_a = Panel(eval_4)
aia_site_eui_baseline_kwh_pe_m2_a = Panel(eval_2)
m2_a = Panel(eval_3)
site_eui_kwh_m2_a = Panel(eval)
load_zone_results = LoadCSZoneResults(ThermalModel=run_e.Model, Toggle=Toggle(True), byzone="True", settings="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")  # -> ResultsPerZone, Labels, Name, Zone

# ==== cluster Cluster
brep = ClusterInput()
brep_2 = Brep(brep)
B = ClusterInput()
debrep = DeconstructBrep(Brep=brep_2)  # -> Faces, Edges, Vertices
pdecon = Deconstruct(Point=debrep.Vertices)  # -> XComponent, YComponent, ZComponent
debox = DeconstructBox(Box=brep_2)  # -> Plane, X, Y, Z
data = Data(debrep.Edges)
B_2 = ClusterInput()
equals = Equality(FirstNumber=pdecon.ZComponent, SecondNumber=0)  # -> Equality, Inequality
dedomain = DeconstructDomain(Domain=debox.Z)  # -> Start, End
dispatch = Dispatch(List=debrep.Vertices, DispatchPattern=equals.Equality)  # -> ListA, ListB
division = Division(A=dedomain.End, B=B_2)
round = Round(Number=division)  # -> Nearest, Floor, Ceiling
expression = Expression(x=round.Floor, Expression="If(x<1, 1, x)")
shift = ShiftList(List=dispatch.ListA, Shift=-1, Wrap=True)
item = ListItem(List=shift, Index=0, Wrap=True)
division_2 = Division(A=dedomain.End, B=expression)
heights = Data(division_2)
Z = UnitZ(Factor=heights)
multiplication = Multiplication(A=Z)
ins = InsertItems(List=dispatch.ListA, Item=item, Indices=0, Wrap=True)
python = GhPythonScript(h=division_2, c=expression)  # -> l
# ---------- python: Python ----------
__author__ = "zoelh"
__version__ = "2023.11.16"

import ghpythonlib.treehelpers as th
import rhinoscriptsyntax as rs

l = []
for i in range(c):
    l.append(round(i*h, 6))
#l = th.list_to_tree(l)
# ---------- end python ----------
multiplication_2 = Multiplication(A=multiplication, B=B)  # -> simplify(Result)
intcrv = Interpolate(Vertices=ins, Degree=1, Periodic=False, KnotStyle=1)  # -> Curve, Length, Domain
offset = ClusterInput()
project = Project(Geometry=intcrv.Curve, Plane=PlaneXY(0, 0, 0))  # -> Geometry, Transform
division_3 = Division(A=heights, B=4)
ground_contour = Data(project.Geometry)
explode = Explode(Curve=ground_contour, Recursive=True)  # -> Segments, Vertices
extr = Extrude(Base=explode.Segments, Direction=graft(multiplication_2))  # -> simplify(Extrusion)
addition = Addition(A=simplify(python), B=simplify(graft(division_3)))
az = Autozoner(FloorPlanOutlines=ground_contour, Offset=offset)  # -> Outline, simplify(PerimeterPolylines), simplify(CorePolylines), SkeletonPolylines
group = Group(Objects=extr)
Z_2 = UnitZ(Factor=addition)
srf = Surface(ground_contour)
data_2 = Data(simplify(graft(heights)))
move = Move(Geometry=group, Motion=Z_2)  # -> Geometry, Transform
Z_3 = UnitZ(Factor=python)  # -> simplify(UnitVector)
Z_4 = UnitZ(Factor=data_2)
ungroup = Ungroup(Group=move.Geometry)
pcol = PolylineCollapse(Polyline=az.CorePolylines, Tolerance=1)  # -> Polyline, Count
pcol_2 = PolylineCollapse(Polyline=az.PerimeterPolylines, Tolerance=1)  # -> Polyline, Count
data_3 = Data(Z_3)
srf_2 = Surface(pcol.Polyline)
srf_3 = Surface(pcol_2.Polyline)
Z_5 = UnitZ(Factor=debox.Z)
extr_2 = Extrude(Base=srf_3, Direction=Z_4)
area = Area(Geometry=ungroup)  # -> Area, Centroid
extr_3 = Extrude(Base=srf_2, Direction=Z_4)
move_2 = Move(Geometry=srf, Motion=simplify(graft(Z_5)))  # -> Geometry, Transform
panel = Panel(division_2)
cap = CapHoles(Brep=extr_2)
cap_2 = CapHoles(Brep=extr_3)
scale = Scale(Geometry=ungroup, Center=area.Centroid, Factor=Slider(0.99, range=0..1))  # -> Geometry, Transform
group_2 = Group(Objects=cap)
group_3 = Group(Objects=cap_2)
trim = TrimTree(Tree=scale.Geometry, Depth=1)
move_3 = Move(Geometry=group_2, Motion=data_3)  # -> Geometry, Transform
move_4 = Move(Geometry=group_3, Motion=data_3)  # -> Geometry, Transform
ungroup_2 = Ungroup(Group=move_3.Geometry)  # -> simplify(Objects)
windows = ClusterOutput(trim)
ungroup_3 = Ungroup(Group=move_4.Geometry)
roof = ClusterOutput(move_2.Geometry)
ground = ClusterOutput(srf)
core = ClusterOutput(ungroup_3)
perim = ClusterOutput(ungroup_2)
