# Grasshopper definition autozone_for_big_validation.gh (Grasshopper 1.0.7)
# plug-ins: ClimateStudioGH, Autozoner, jSwan, LadybugGrasshopper

number_slider = Slider(1.25, range=1.25..12)

# ---- group: Weather File
path = FilePath("C:\ProgramData\Solemma\Common\WeatherData\EPW\USA_NY_New.York-LaGuardia.AP.725030_TMYx.2004-2018.epw")

# ----
panel = Panel(path)

# ----
# Building Generation Parameters
bldg_dim_m = Panel("15 to 70")
corner_pertub_m = Panel("0 to 0")
f2f_height_m = Panel("3 to 5")
n_floors = Panel("5 to 10")
wwr_frac = Panel("0.1 to 0.8")
perim_offset = Slider(4.5, range=3..7)
n_buildings = Slider(20, range=0..100)
x_spread = Slider(100, range=0..100)

# ----
# Unit Converter
# Internalized Geometry is
# modeled in meters.
toggle = BooleanToggle(True)
unit = CSUnitScale(
    From="Meters",
    To="ActiveRhinoDocUnits",
    Listener=toggle,
    Input_0_Hidden=False,
    Input_0_Name="From",
    Input_1_Hidden=False,
    Input_1_Name="To",
    Input_2_Hidden=False,
    Input_2_Name="Listener",
    UnitSystem=4)

# ---- group: 15-Zone Dimensions
f2f_height_meters = Panel("4")
perim_offset_2 = Panel(number_slider)
n_floors_2 = Slider(3, range=2..15)
y_axis_meters = Panel("40")
x_axis_meters = Panel("40")

# ----
falsestart = LBFalseStartToggle(False)

# ----
# RUN
button = Button()

# ---- group: Unit Conversion for 15 zone dimensions
multiplication = Multiplication(A=f2f_height_meters, B=unit)  # disabled
multiplication_2 = Multiplication(A=x_axis_meters, B=unit)  # disabled
multiplication_3 = Multiplication(A=y_axis_meters, B=unit)  # disabled
multiplication_4 = Multiplication(A=perim_offset_2, B=unit)  # disabled

# ----
number_slider_2 = Slider(42, range=0..100)
number_slider_3 = Slider(68, range=0..100)

filename = Panel("perimoffset")
output_directory = Panel("D:\DATA\AutozonerTests\")
python = GhPythonScript(y=number_slider)  # -> f
# ---------- python: Python ----------
__author__ = "zoelh"
__version__ = "2023.12.06"

import rhinoscriptsyntax as rs

f = str(y).replace(".", "p")
print(f)
# ---------- end python ----------

# ----
# 5-Zone Builder
expression = Expression(
    width=multiplication_2,
    len=multiplication_3,
    f2f_h=multiplication,
    floors=n_floors_2,
    Expression="(2*width + 2*len)*floors*f2f_h")  # disabled
expression_2 = Expression(
    width=multiplication_2,
    len=multiplication_3,
    f2f_h=multiplication,
    floors=n_floors_2,
    Expression="(2*width + 2*len)*f2f_h")  # disabled
expression_3 = Expression(width=multiplication_2, len=multiplication_3, floors=n_floors_2, Expression="width*len*floors")  # disabled
division = Division(A=expression_3, B=expression)  # disabled
cluster = Cluster_3(numfloors=n_floors_2, floorheight=multiplication, xlen=multiplication_2, ylen=multiplication_3, offset=multiplication_4)  # -> floorzaxismovementvec, perimnames, perimeter_2, core_names, f2fzaxismovementvec, core_2, footprintbasecurve, ground_plane_2; disabled
explode = Explode(Curve=cluster.footprintbasecurve, Recursive=True)  # -> Segments, Vertices; disabled
wwr_n = Number()  # disabled
item = ListItem(List=flatten(cluster.core_2), Index=0, Wrap=True)  # disabled
flip = FlipMatrix(Data=cluster.perimeter_2)  # disabled
extr = Extrude(Base=explode.Segments, Direction=cluster.f2fzaxismovementvec)  # -> graft(Extrusion); disabled
debrep = DeconstructBrep(Brep=flip)  # -> Faces, Edges, Vertices; disabled
debrep_2 = DeconstructBrep(Brep=item)  # -> Faces, Edges, Vertices; disabled
number_slider_4 = Slider(5, range=0..5)  # disabled
item_2 = ListItem(List=debrep.Faces, Index=number_slider_4, Wrap=True)  # disabled
trim = TrimTree(Tree=item_2, Depth=1)  # disabled
area = Area(Geometry=trim)  # -> Area, Centroid; disabled
merge = Merge(Data1=wwr_n, Data2=wwr_n, Data3=wwr_n, Data4=wwr_n)  # -> simplify(flatten(Result)); disabled
move = Move(Geometry=extr, Motion=cluster.floorzaxismovementvec)  # -> simplify(flatten(Geometry)), Transform; disabled
ma = MassAddition(Input=area.Area)  # -> flatten(Result), PartialResults; disabled
item_3 = ListItem(List=debrep_2.Faces, Index=number_slider_4, Wrap=True)  # disabled
item_4 = ListItem(List=ma.Result, Index=0, Wrap=True)  # disabled
area_2 = Area(Geometry=item_3)  # -> Core_area, Centroid; disabled
winshdgen = WinShdGen(zone_geometry=move.Geometry, wwr=merge)  # disabled
total_perim_area = Number(item_4)  # disabled
addition = Addition(Total_perim_area=total_perim_area, Total_core_area=area_2.Core_area)  # disabled
division_2 = Division(Total_core_area=area_2.Core_area, Total_perim_area=total_perim_area)  # disabled
division_3 = Division(Total_perim_area=total_perim_area, Total_facade_area=expression_2)  # disabled
division_4 = Division(Total_perim_area=total_perim_area, Footprint_area=addition)  # disabled
division_5 = Division(Total_core_area=area_2.Core_area, Footprint_area=addition)  # disabled
zone_names = Data(cluster.perimnames)  # disabled
zones = Data(cluster.perimeter_2)  # disabled
windows = Geometry(winshdgen)  # disabled

# ---- group: 15-zone model computed properties
perim_area_to_facade_area_unitless = Panel(division_3)
core_fraction_core_footprint = Panel(division_5)
building_core_to_perim_ratio_unitless = Panel(division_2)
core_fraction_core_footprint_2 = Panel(division_4)
gfa_facade_area_unitless = Panel(division)
gfa_m2 = Panel(expression_3)
facade_area_m2 = Panel(expression)

# ---- group: shoebox dimensions
perim_depth = Slider(3.6, range=2..10)
width = Slider(3, range=1..15)
core_depth = Slider(6.4, range=2..60)

# ---- group: computed shoebox information
shoebox_height_m_driven = Panel(multiplication)

# ---- group: perim_to_facade desired properties
desired_perim_area_m2 = Panel("""South
East
North
West""")

# ----
expression_4 = Expression(x=filename, y=python, Expression="Format(\"{0}_{1}\", x, y)")
addition_2 = Addition(A=perim_offset_2, B=core_depth)
multiplication_5 = Multiplication(A=width, B=perim_offset_2)

ventilationperperson_l_s_person = Slider(6.9, range=0..10)
ventilationperarea_l_s_m2 = Slider(0.1, range=0..5)
coolingsetpoint_degc = Slider(25, range=16..30)
heatingsetpoint_degc = Slider(19, range=10..24)
econ = ValueList({"NoEconomizer", "DifferentialEnthalpy"}, selected="NoEconomizer")
mechventon = BooleanToggle(True)
hrv = ValueList({"None", "Sensible", "Enthalpy"}, selected="None")

multiplication_6 = Multiplication(A=width, B=core_depth)
multiplication_7 = Multiplication(A=width, B=addition_2)

# ---- group: perim_to_facade desired properties
actual_perim_area_m2 = Panel(multiplication_5)
actual_core_area_m2 = Panel(multiplication_6)
actual_shoebox_total_area_m2 = Panel(multiplication_7)

# ----
infiltrationmethod = ValueList({"ACH", "Flow Per Exterior Area": "FlowExtArea"}, selected="Flow Per Exterior Area")
infiltration_m3_s_m2 = Slider(5e-05, range=0..0.0005)
infiltration_ach = Slider(0, range=0..1)

panel_2 = Panel(expression_4)

# ---- group: Loads
lpd_w_m2 = Slider(0, range=0..50)
epd_w_m2 = Slider(0, range=0..50)
peopledensity_ppl_m2 = Slider(0.025, range=0..0.5)

# ---- group: Windows
number_slider_5 = Slider(0.65, range=0..1)
number_slider_6 = Slider(4, range=0.6..7)
tvis = Panel("0.8")

# ----
random = Random(Range=bldg_dim_m, Number=n_buildings, Seed=expr("x+1", number_slider_2))
random_2 = Random(Range=bldg_dim_m, Number=n_buildings, Seed=number_slider_2)
subtraction = Subtraction(A=n_buildings, B=1)
series = Series(Start=0, Step=x_spread, Count=n_buildings)
series_2 = Series(Start=0, Step=x_spread, Count=n_buildings)
Y = UnitY(Factor=series_2)
ma_2 = MassAddition(Input=random_2)  # -> Result, PartialResults
rectangle = Rectangle(Plane=PlaneXY(0, 0, 0), XSize=random_2, YSize=random, Radius=0)  # -> Rectangle, Length
ins = InsertItems(List=ma_2.PartialResults, Item="0", Indices="0", Wrap=True)
subset = SubList(List=ins, Domain=subtraction, Wrap=True)  # -> List, Index
addition_3 = Addition(A=subset.List, B=series)
X = UnitX(Factor=addition_3)
multiplication_8 = Multiplication(A=n_buildings, B="4")
move_2 = Move(Geometry=rectangle.Rectangle, Motion=X)  # -> Geometry, Transform
random_3 = Random(Range="2*pi", Number=multiplication_8, Seed=Slider(64, range=0..100))
random_4 = Random(Range=corner_pertub_m, Number=multiplication_8, Seed=number_slider_3)
move_3 = Move(Geometry=move_2.Geometry, Motion=Y)  # -> Geometry, Transform
partition = PartitionList(List=random_3, Size="4")
partition_2 = PartitionList(List=random_4, Size="4")
disc = Discontinuity(Curve=move_3.Geometry, Level=1)  # -> Points, Parameters
Z = UnitZ(Factor=1)
X_2 = UnitX(Factor=1)
vrot = Rotate(Vector=X_2, Axis=Z, Angle=partition)
multiplication_9 = Multiplication(A=vrot, B=partition_2)
move_4 = Move(Geometry=disc.Points, Motion=multiplication_9)  # -> Geometry, Transform
pline = PolyLine(Vertices=move_4.Geometry, Closed=True)  # -> simplify(flatten(Polyline))
area_3 = Area(Geometry=pline)  # -> Area, Centroid
random_5 = Random(Range="2*pi", Number=n_buildings, Seed=Slider(76, range=0..100))
rotate = Rotate(Geometry=pline, Angle=random_5, Plane=area_3.Centroid)  # -> Geometry, Transform
cx = CurveSelf(Curve=rotate.Geometry)  # -> Points, Params
lng = ListLength(List=cx.Points)  # -> flatten(Length)
equals = Equality(FirstNumber=lng, SecondNumber="0")  # -> Equality, Inequality
cull = CullPattern(List=rotate.Geometry, CullPattern=equals.Equality)
az = Autozoner(FloorPlanOutlines=graft(cull), Offset=perim_offset)  # -> Outline, PerimeterPolylines, CorePolylines, SkeletonPolylines
lng_2 = ListLength(List=cull)
geo = Geometry(az.Outline)
geo_2 = Geometry(az.PerimeterPolylines)
geo_3 = Geometry(az.CorePolylines)
random_6 = Random(Range=f2f_height_m, Number=lng_2, Seed=Slider(87, range=0..100))
random_7 = Random(Range=n_floors, Number=lng_2, Seed=Slider(11, range=0..100), Integers=True)
random_8 = Random(Range=wwr_frac, Number=lng_2, Seed=Slider(25, range=0..100))
srf = Surface(graft(geo_2))
srf_2 = Surface(simplify(geo_3))
trim_2 = TrimTree(Tree=srf, Depth=1)
Z_2 = UnitZ(Factor=random_6)
extr_2 = Extrude(Base=srf_2, Direction=graft(Z_2))  # -> simplify(Extrusion)
extr_3 = Extrude(Base=trim_2, Direction=graft(Z_2))  # -> simplify(Extrusion)
series_3 = Series(Start=0, Step=graft(random_6), Count=graft(random_7))  # -> simplify(Series)
division_6 = Division(A=random_6, B=2)
Z_3 = UnitZ(Factor=division_6)
Z_4 = UnitZ(Factor=series_3)
move_5 = Move(Geometry=cull, Motion=Z_3)  # -> Geometry, Transform
explode_2 = Explode(Curve=move_5.Geometry, Recursive=True)  # -> Segments, Vertices
lng_3 = ListLength(List=Z_4)  # -> flatten(Length)
end = EndPoints(Curve=explode_2.Segments)  # -> Start, End
move_6 = Move(Geometry=extr_2, Motion=Z_4)  # -> Geometry, Transform
multiplication_10 = Multiplication(A=random_6, B=random_8)
python_2 = GhPythonScript(x=extr_3, y=Z_4)  # -> out, a; inputs x: list of Brep, y: list of Vector3d
# ---------- python_2: Python ----------
__author__ = "szvsw"
__version__ = "2023.11.14"

import rhinoscriptsyntax as rs
import ghpythonlib.components as ghcomp
import ghpythonlib.treehelpers as th
breps = x
vecs = y
breps_out = []

for brep in breps:
    for vec in vecs:
        new_brep,_ = ghcomp.Move(brep,vec)
        breps_out.append(new_brep)

a = th.list_to_tree(breps_out)
# ---------- end python_2 ----------
midpt = CurveMiddle(Curve=explode_2.Segments)
geo_4 = Geometry(move_6.Geometry)
geo_5 = Geometry(python_2.a)
vec2pt = Vector2Pt(PointA=end.End, PointB=midpt, Unitize=invert(False))  # -> Vector, Length
vec2pt_2 = Vector2Pt(PointA=end.Start, PointB=midpt, Unitize=invert(False))  # -> Vector, Length
stack = StackData(Data=lng_3, Stack="4")
division_7 = Division(A=multiplication_10, B=2)
multiplication_11 = Multiplication(A=vec2pt.Vector, B="0.1")
multiplication_12 = Multiplication(A=vec2pt_2.Vector, B="0.1")
Z_5 = UnitZ(Factor=division_7)
move_7 = Move(Geometry=end.End, Motion=multiplication_11)  # -> Geometry, Transform
move_8 = Move(Geometry=end.Start, Motion=multiplication_12)  # -> Geometry, Transform
partition_3 = PartitionList(List=geo_5, Size=stack)  # -> simplify(Chunks)
neg = Negative(Value=Z_5)
ln = Line(StartPoint=move_8.Geometry, EndPoint=move_7.Geometry)
path_mapper = PathMapper(partition_3, source="{a}[i]", target="{floor(a/4);a%4}[i]")
move_9 = Move(Geometry=ln, Motion=graft(Z_5))  # -> Geometry, Transform
move_10 = Move(Geometry=ln, Motion=graft(neg))  # -> Geometry, Transform
geo_6 = Geometry(path_mapper)
merge_2 = Merge(Data1=graft(move_9.Geometry), Data2=graft(move_10.Geometry))  # -> simplify(Result)
loft = Loft(Curves=merge_2, Options={Adjust=False, Closed=False, LoftEnds=0, LoftSimp=0, LoftType=0, Rebuild=10, Refit=0.01})
trim_3 = TrimTree(Tree=loft, Depth=1)
python_3 = GhPythonScript(x=trim_3, y=Z_4)  # -> out, a; inputs x: list of Brep, y: list of Vector3d; same code as python_2
geo_7 = Geometry(python_3.a)
partition_4 = PartitionList(List=geo_7, Size=stack)  # -> simplify(Chunks)
path_mapper_2 = PathMapper(partition_4, source="{a}[i]", target="{floor(a/4);a%4}[i]")
geo_8 = Geometry(path_mapper_2)

# ---- group: MechVentilationSchedule
panel_3 = Panel("AllOn")

# ----
srf_3 = Surface(az.CorePolylines)
srf_4 = Surface(az.Outline)
srf_5 = Surface(az.PerimeterPolylines)
area_4 = Area(Geometry=srf_4)  # -> flatten(FootprintArea), Centroid
len = Length(Curve=geo)  # -> flatten(PerimeterLengths)
shoebox_width = Panel("3")
floor_to_floor_heights = Number(random_6)
area_5 = Area(Geometry=srf_3)  # -> flatten(CoreAreas), Centroid
area_6 = Area(Geometry=srf_5)  # -> PerimAreas, Centroid
ma_3 = MassAddition(Input=area_6.PerimAreas)  # -> flatten(TotalPerimArea), PartialResults
multiplication_13 = Multiplication(A=floor_to_floor_heights, B=len)
multiplication_14 = Multiplication(ShoeboxWidth=shoebox_width, FloorToFloorHeights=floor_to_floor_heights)
division_8 = Division(PerimOffset=perim_offset, FloorToFloorHeight=floor_to_floor_heights)
facade_area = Division(TotalPerimArea=ma_3.TotalPerimArea, FacadeArea=multiplication_13)
division_9 = Division(CoreAreas=area_5.CoreAreas, TotalPerimAreas=ma_3.TotalPerimArea)
panel_4 = Panel(division_8)
panel_5 = Panel(facade_area)
panel_6 = Panel(division_9)
multiplication_15 = Multiplication(SBFacadeArea=multiplication_14, PerimAreaToFacadeArea=facade_area)
division_10 = Division(ShoeboxAreas=multiplication_15, ShoeboxWidths=shoebox_width)
perim_depths = Panel(division_10)
multiplication_16 = Multiplication(PerimDepths=division_10, CoreAreaToPerimArea=division_9)
core_depths = Panel(multiplication_16)
footprint_areas = Panel(area_4.FootprintArea)

explode_3 = Explode(Curve=cull, Recursive=True)  # -> Segments, Vertices
midpt_2 = CurveMiddle(Curve=explode_3.Segments)
len_2 = Length(Curve=explode_3.Segments)
end_2 = EndPoints(Curve=explode_3.Segments)  # -> Start, End
len_3 = Length(Curve=cull)
vec2pt_3 = Vector2Pt(PointA=end_2.Start, PointB=midpt_2, Unitize=False)  # -> Vector, Length
division_11 = Division(A=len_2, B=graft(len_3))  # -> simplify(EdgeWeights)
move_11 = Move(Geometry=explode_3.Segments, Motion=vec2pt_3.Vector)  # -> Geometry, Transform
rotate_2 = Rotate(Geometry=move_11.Geometry, Angle="-PI/2", Plane=midpt_2)  # -> Geometry, Transform
end_3 = EndPoints(Curve=rotate_2.Geometry)  # -> Start, End
Y_2 = UnitY(Factor=1)
vec2pt_4 = Vector2Pt(PointA=end_3.Start, PointB=end_3.End, Unitize=False)  # -> Vector, Length
neg_2 = Negative(Value=Y_2)
xy = XYPlane(Origin=Point(0, 0, 0))
angle = Angle(VectorA=neg_2, VectorB=vec2pt_4.Vector, Plane=xy)  # -> OrientationsRads, Reflex
multiplication_17 = Multiplication(A=angle.OrientationsRads, B=57.29577951)
round = Round(Number=multiplication_17)  # -> Nearest, Floor, Ceiling
merge_3 = Merge(Data1=simplify(graft(round.Nearest)), Data2=simplify(graft(division_11)))
join = TextJoin(Text=merge_3, Join="deg, weight:")  # -> simplify(Result)
ins_2 = InsertItems(List=graft(random_6), Item="f2fHeight (m)", Indices="1", Wrap=True)
ins_3 = InsertItems(List=graft(random_7), Item="floors", Indices="1", Wrap=True)
ins_4 = InsertItems(List=graft(random_8), Item="WWRs", Indices="1", Wrap=True)
# For each edge, save normal in json (see gen city tester for geom stuff)
line = LineSDL(Start=end_3.Start, Direction=vec2pt_4.Vector, Length="10")
join_2 = TextJoin(Text=ins_2, Join=" ")  # -> flatten(Result)
join_3 = TextJoin(Text=ins_3, Join=" ")  # -> flatten(Result)
trim_4 = TrimTree(Tree=join, Depth=1)
end_4 = EndPoints(Curve=line)  # -> Start, End
join_4 = TextJoin(Text=ins_4, Join=" ")  # -> flatten(Result)
tag = TextTag(Location=end_4.End, Text=trim_4)
item_5 = ListItem(List=end_4.End, Index=0, Wrap=True)  # -> flatten(Item)
tag_2 = TextTag(Location=item_5, Text=join_2)
tag_3 = TextTag(Location=item_5, Text=join_3)
tag_4 = TextTag(Location=item_5, Text=join_4)
wwr = Panel(random_8)
edge_weights = Panel(division_11)
orientation_radians = Panel(angle.OrientationsRads)
floor_to_floor_height = Panel(random_6)
floors = Panel(random_7)

python_4 = GhPythonScript(
    edge_weights=simplify(edge_weights),
    orientations=simplify(orientation_radians),
    perim_depths=simplify(perim_depths),
    core_depths=simplify(core_depths),
    footprint_areas=simplify(footprint_areas),
    wwrs=simplify(wwr),
    n_floors=simplify(floors),
    f2f_heights=simplify(floor_to_floor_height))  # -> out, a; inputs edge_weights: tree, orientations: tree, perim_depths: tree, core_depths: tree, footprint_areas: tree, wwrs: tree, n_floors: tree of Int32, f2f_heights: tree
# ---------- python_4: Python ----------
__author__ = "szvsw"
__version__ = "2023.11.15"

import rhinoscriptsyntax as rs
import ghpythonlib.treehelpers as th

perim_depths = perim_depths.Branch(0)
core_depths = core_depths.Branch(0)
footprint_areas = footprint_areas.Branch(0)
wwrs = wwrs.Branch(0)
f2f_heights = f2f_heights.Branch(0)
n_floors = n_floors.Branch(0)
output_data = {
    "perim_depths": [float(val) for val in perim_depths],
    "core_depths": [float(val) for val in core_depths],
    "footprint_areas": [float(val) for val in footprint_areas],
    "wwrs": [float(val) for val in wwrs],
    "heights": [float(val) for val in f2f_heights],
    "n_floors": [int(val) for val in n_floors],
    "orientations": [],
    "edge_weights": []
}

for i in range(len(perim_depths)):
    orientation_data = orientations.Branch(i)
    output_data["orientations"].append([float(val) for val in orientation_data])
    edge_weight_data = edge_weights.Branch(i)
    output_data["edge_weights"].append([float(val) for val in edge_weight_data])

import json

with open(str(outpath)+"geom-def.json","w") as f:
    json.dump(output_data,f,indent=4)
# ---------- end python_4 ----------
number_slider_7 = Slider(0, range=0..100)

windows_2 = Geometry(flatten(geo_8))
perim = Geometry(flatten(geo_6))
core = Geometry(flatten(geo_4))
ground = Surface(cull)
preview = CustomPreview(Geometry=perim, Material=ColourSwatch(SwatchColor=RGB(222, 171, 144)))
preview_2 = CustomPreview(Geometry=windows_2, Material=ColourSwatch(SwatchColor=RGB(144, 204, 222)))
preview_3 = CustomPreview(Geometry=core, Material=ColourSwatch(SwatchColor=RGB(201, 222, 144)))
preview_4 = CustomPreview(Geometry=ground, Material=ColourSwatch(SwatchColor=RGB(102, 53, 0)))

normals = Geometry(line)
item_6 = ListItem(List=windows_2, Index=number_slider_7, Wrap=True)
item_7 = ListItem(List=perim, Index=number_slider_7, Wrap=True)
item_8 = ListItem(List=core, Index=number_slider_7, Wrap=True)
item_9 = ListItem(List=ground, Index=number_slider_7, Wrap=True)
branch = TreeBranch(Tree=simplify(end_3.Start), Path=number_slider_7, MaintainPaths=True)
branch_2 = TreeBranch(Tree=simplify(normals), Path=number_slider_7, MaintainPaths=True)
viewer = ParamViewer(path_mapper)
lng_4 = ListLength(List=lng_3)
subtraction_2 = Subtraction(A=lng_4, B=1)
pln = Plane(end_3.Start)
subset_2 = SubList(List=lng_3, Domain=subtraction_2, Wrap=True)  # -> List, Index
number_slider_8 = Slider(110, range=0..150)
pi = Pi(Factor="-1")
prot = RotatePlane(Plane=pln, Angle=angle.OrientationsRads)
panel_7 = Panel(viewer)
dom = ConstructDomain(DomainStart=0, DomainEnd=pi)
arc = Arc(Plane=prot, Radius=number_slider_8, Angle=dom)  # -> Arc, Length
multiplication_18 = Multiplication(A=Slider(12, range=0..100), B=4)
area_7 = Area(Geometry=item_8)  # -> Area, Centroid
circle = CircleCNR(Center=area_7.Centroid, Normal=Vector(0, 0, 1), Radius=number_slider_8)
split = TextSplit(Text=panel_7, Separators="{,;,}")
divide = DivideCurve(Curve=circle, Count=multiplication_18, Kinks=False)  # -> Points, Tangents, Parameters
shift = ShiftList(List=divide.Points, Shift=1, Wrap=True)
cull_2 = CullPattern(List=split, CullPattern=[False, True, True, False])
dom_2 = ConstructDomain(DomainStart=0, DomainEnd=Slider(100, range=0..100))
ln_2 = Line(StartPoint=divide.Points, EndPoint=shift)
ins_5 = InsertItems(List=cull_2, Item="building", Indices="0", Wrap=True)
random_9 = Random(Range=dom_2, Number=multiplication_18, Seed=number_slider_3)
Z_6 = UnitZ(Factor=random_9)
ins_6 = InsertItems(List=ins_5, Item="edge", Indices="2", Wrap=True)
extr_4 = Extrude(Base=ln_2, Direction=Z_6)

# ----
# Simplify shading context for energy simulations
list = ValueList({"Mask": 0, "Horizon": 1, "Visible Surfs": 2}, selected="Horizon")
shading_mask = ShadingMask(
    Pt=graft(branch),
    Dir=graft(branch_2),
    Radius=number_slider_8,
    HAng=5,
    VAng=5,
    Scene=extr_4,
    Full=Toggle(False),
    Mode=list)
preview_5 = CustomPreview(Geometry=shading_mask, Material=ColourSwatch(SwatchColor=RGB(0, 0, 0)))

join_5 = TextJoin(Text=ins_6, Join="_")  # -> flatten(Result)
panel_8 = Panel(join_5)

# ---- group: ROOF CONSTRUCTION
roof_concrete_thickness = Panel("0.203")
roof_xps_thickness = Panel("0.4")

# ---- group: FACADE CONSTRUCTION
wall_concrete_thickness = Panel("0.203")
wall_insul_thickness = Panel("0.05")

# ---- group: SLAB CONSTRUCTION
slab_insul_thickness = Panel("0.151")

# ----
# Template Settings
panel_9 = Panel("Occupancy")
number_slider_9 = Slider(5, range=0..15)
panel_10 = Panel("D:\Users\zoelh\GitRepos\ml-for-building-energy-modeling\ml-for-bem\data\")
python_5 = GhPythonScript(index=number_slider_9, path=panel_10)  # -> schedules
# ---------- python_5: Python ----------
__author__ = "zoelh"
__version__ = "2023.11.18"

import rhinoscriptsyntax as rs
import csv
import ghpythonlib.treehelpers as th

schedules = []
l = ["EquipmentAvailabilitySchedule.csv", "LightsAvailabilitySchedule.csv", "OccupancySchedule.csv"]
for file in l:
    filename = path + file
    with open(filename) as csvfile:
        reader = csv.reader(csvfile)
        rows = list(reader)
        row = rows[int(index)+1]
        schedules.append([row[1:]])
schedules = th.list_to_tree(schedules)
# ---------- end python_5 ----------
bang = ExplodeTree(Data=python_5)  # -> Branch0, Branch1, Branch2
year_schedule = ConstructCSYearSchedule(Name=panel_9, Type=0, Category=0, DaysHours=bang.Branch2)  # -> Sched, Values
year_schedule_2 = ConstructCSYearSchedule(Name="Equip", Type=0, Category=0, DaysHours=bang.Branch0)  # -> Sched, Values
year_schedule_3 = ConstructCSYearSchedule(Name="Lights", Type=0, Category=0, DaysHours=bang.Branch1)  # -> Sched, Values
wwr_2 = Slider(40, range=0..100)
occupancy = Data(year_schedule.Sched)
list_2 = ValueList({"Residential", "Kitchen", "Office", "MeetingRoom", "HotelRoom", "ClassRoom", "Library", "LectureHall", "SuperMarket", "Shopping", "ScienceLab"}, selected="Office")
simple_window = ConstructCSSimpleWindow(Name="windowtest", Shgf=number_slider_5, Uval=number_slider_6, Tvis=tvis)
zonetemplate = GetZoneTemplate(SearchZoneTemplate=list_2, Selection="Office")
heating_coolingconstant = BooleanToggle(True)
scheduledventilationon = BooleanToggle(False)
scheduledventilationon_2 = BooleanToggle(False)
people_equip_lightson = BooleanToggle(True)
heating_coolingon = BooleanToggle(True)
humidistaton = BooleanToggle(False)
item_10 = ListItem(List=zonetemplate, Index=0, Wrap=True)
infiltrationon = BooleanToggle(True)
natventon = BooleanToggle(False)
fanenergy = BooleanToggle(False)
dhwon = BooleanToggle(True)
shadingon = BooleanToggle(False)
hasframe = BooleanToggle(False)
panel_11 = Panel("Airspeed 0")
dimmingtype = Panel("Off")
wset = CSWindowSettings(
    Name="SimpleWindowSettings",
    Type="External",
    ShadingSystemIsOn=shadingon,
    GlazingConstruction=simple_window,
    OperableArea="0",
    HasFrame=hasframe,
    AFNWindowAvailability="AllOff",
    Input_0_Hidden=False,
    Input_0_Name="Name",
    Input_10_Hidden=True,
    Input_10_Name="ShadingThickness",
    Input_11_Hidden=True,
    Input_11_Name="ShadeGlassDistance",
    Input_12_Hidden=True,
    Input_12_Name="TopBottomEdgeOpeningMultiplier",
    Input_13_Hidden=True,
    Input_13_Name="Analysis Mesh Resolution",
    Input_14_Hidden=True,
    Input_14_Name="ZoneMixingIsOn",
    Input_15_Hidden=True,
    Input_15_Name="ZoneMixingDeltaTemperature",
    Input_16_Hidden=True,
    Input_16_Name="ZoneMixingFlowRate",
    Input_17_Hidden=False,
    Input_17_Name="Glazing Construction",
    Input_18_Hidden=False,
    Input_18_Name="OperableArea",
    Input_19_Hidden=True,
    Input_19_Name="ZoneMixingAvailibilitySchedule",
    Input_1_Hidden=False,
    Input_1_Name="WindowSettings",
    Input_20_Hidden=False,
    Input_20_Name="HasFrame",
    Input_21_Hidden=True,
    Input_21_Name="FrameWidth",
    Input_22_Hidden=True,
    Input_22_Name="FrameProjection"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)

material = ConstructCSOpaqueMaterial(
    Name="Partition Plaster",
    Conductivity=1,
    Density=2000,
    Roughness="Rough",
    SpecificHeat=1130,
    ThermalAbsorptance=0.9,
    SolarAbsorptance=0.7,
    VisibleAbsorptance=0.7,
    Type="Finishes",
    Input_0_Hidden=False,
    Input_0_Name="Name",
    Input_10_Hidden=True,
    Input_10_Name="TemperatureCoefficientThermalConductivity",
    Input_11_Hidden=True,
    Input_11_Name="TemperatureArray",
    Input_12_Hidden=True,
    Input_12_Name="EnthalpyArray",
    Input_13_Hidden=True,
    Input_13_Name="VariableConductivityArray",
    Input_14_Hidden=False,
    Input_14_Name="Type",
    Input_15_Hidden=True,
    Input_15_Name="EmbodiedEnergy",
    Input_16_Hidden=True,
    Input_16_Name="EmbodiedCarbon",
    Input_17_Hidden=True,
    Input_17_Name="Cost",
    Input_18_Hidden=True,
    Input_18_Name="Life",
    Input_1_Hidden=False,
    Input_1_Name="Conductivity",
    Input_2_Hidden=False,
    Input_2_Name="Density",
    Input_3_Hidden=False,
    Input_3_Name="Roughness",
    Input_4_Hidden=False,
    Input_4_Name="SpecificHeat",
    Input_5_Hidden=False,
    Input_5_Name="ThermalAbsorptance"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)
material_2 = ConstructCSOpaqueMaterial(
    Name="Stucco",
    Conductivity=0.72,
    Density=1856,
    Roughness="Rough",
    SpecificHeat=840,
    ThermalAbsorptance=0.9,
    SolarAbsorptance=0.7,
    VisibleAbsorptance=0.7,
    Type="Sealing",
    Input_0_Hidden=False,
    Input_0_Name="Name",
    Input_10_Hidden=True,
    Input_10_Name="TemperatureCoefficientThermalConductivity",
    Input_11_Hidden=True,
    Input_11_Name="TemperatureArray",
    Input_12_Hidden=True,
    Input_12_Name="EnthalpyArray",
    Input_13_Hidden=True,
    Input_13_Name="VariableConductivityArray",
    Input_14_Hidden=False,
    Input_14_Name="Type",
    Input_15_Hidden=True,
    Input_15_Name="EmbodiedEnergy",
    Input_16_Hidden=True,
    Input_16_Name="EmbodiedCarbon",
    Input_17_Hidden=True,
    Input_17_Name="Cost",
    Input_18_Hidden=True,
    Input_18_Name="Life",
    Input_1_Hidden=False,
    Input_1_Name="Conductivity",
    Input_2_Hidden=False,
    Input_2_Name="Density",
    Input_3_Hidden=False,
    Input_3_Name="Roughness",
    Input_4_Hidden=False,
    Input_4_Name="SpecificHeat",
    Input_5_Hidden=False,
    Input_5_Name="ThermalAbsorptance"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)
material_3 = ConstructCSOpaqueMaterial(
    Name="Plaster",
    Conductivity=1,
    Density=2000,
    Roughness="Rough",
    SpecificHeat=1130,
    ThermalAbsorptance=0.9,
    SolarAbsorptance=0.7,
    VisibleAbsorptance=0.7,
    Type="Sealing",
    Input_0_Hidden=False,
    Input_0_Name="Name",
    Input_10_Hidden=True,
    Input_10_Name="TemperatureCoefficientThermalConductivity",
    Input_11_Hidden=True,
    Input_11_Name="TemperatureArray",
    Input_12_Hidden=True,
    Input_12_Name="EnthalpyArray",
    Input_13_Hidden=True,
    Input_13_Name="VariableConductivityArray",
    Input_14_Hidden=False,
    Input_14_Name="Type",
    Input_15_Hidden=True,
    Input_15_Name="EmbodiedEnergy",
    Input_16_Hidden=True,
    Input_16_Name="EmbodiedCarbon",
    Input_17_Hidden=True,
    Input_17_Name="Cost",
    Input_18_Hidden=True,
    Input_18_Name="Life",
    Input_1_Hidden=False,
    Input_1_Name="Conductivity",
    Input_2_Hidden=False,
    Input_2_Name="Density",
    Input_3_Hidden=False,
    Input_3_Name="Roughness",
    Input_4_Hidden=False,
    Input_4_Name="SpecificHeat",
    Input_5_Hidden=False,
    Input_5_Name="ThermalAbsorptance"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)
material_4 = ConstructCSOpaqueMaterial(
    Name="Carpet",
    Conductivity=0.6,
    Density=288,
    Roughness="Rough",
    SpecificHeat=1380,
    ThermalAbsorptance=0.9,
    SolarAbsorptance=0.7,
    VisibleAbsorptance=0.7,
    Type="Finishes",
    Input_0_Hidden=False,
    Input_0_Name="Name",
    Input_10_Hidden=True,
    Input_10_Name="TemperatureCoefficientThermalConductivity",
    Input_11_Hidden=True,
    Input_11_Name="TemperatureArray",
    Input_12_Hidden=True,
    Input_12_Name="EnthalpyArray",
    Input_13_Hidden=True,
    Input_13_Name="VariableConductivityArray",
    Input_14_Hidden=False,
    Input_14_Name="Type",
    Input_15_Hidden=True,
    Input_15_Name="EmbodiedEnergy",
    Input_16_Hidden=True,
    Input_16_Name="EmbodiedCarbon",
    Input_17_Hidden=True,
    Input_17_Name="Cost",
    Input_18_Hidden=True,
    Input_18_Name="Life",
    Input_1_Hidden=False,
    Input_1_Name="Conductivity",
    Input_2_Hidden=False,
    Input_2_Name="Density",
    Input_3_Hidden=False,
    Input_3_Name="Roughness",
    Input_4_Hidden=False,
    Input_4_Name="SpecificHeat",
    Input_5_Hidden=False,
    Input_5_Name="ThermalAbsorptance"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)
material_5 = ConstructCSOpaqueMaterial(
    Name="Mineral Wool",
    Conductivity=0.041,
    Density=155,
    Roughness="Rough",
    SpecificHeat=1130,
    ThermalAbsorptance=0.9,
    SolarAbsorptance=0.7,
    VisibleAbsorptance=0.7,
    Type="Sealing",
    Input_0_Hidden=False,
    Input_0_Name="Name",
    Input_10_Hidden=True,
    Input_10_Name="TemperatureCoefficientThermalConductivity",
    Input_11_Hidden=True,
    Input_11_Name="TemperatureArray",
    Input_12_Hidden=True,
    Input_12_Name="EnthalpyArray",
    Input_13_Hidden=True,
    Input_13_Name="VariableConductivityArray",
    Input_14_Hidden=False,
    Input_14_Name="Type",
    Input_15_Hidden=True,
    Input_15_Name="EmbodiedEnergy",
    Input_16_Hidden=True,
    Input_16_Name="EmbodiedCarbon",
    Input_17_Hidden=True,
    Input_17_Name="Cost",
    Input_18_Hidden=True,
    Input_18_Name="Life",
    Input_1_Hidden=False,
    Input_1_Name="Conductivity",
    Input_2_Hidden=False,
    Input_2_Name="Density",
    Input_3_Hidden=False,
    Input_3_Name="Roughness",
    Input_4_Hidden=False,
    Input_4_Name="SpecificHeat",
    Input_5_Hidden=False,
    Input_5_Name="ThermalAbsorptance"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)
material_6 = ConstructCSOpaqueMaterial(
    Name="WallConcrete",
    Conductivity=2,
    Density=2400,
    Roughness="Rough",
    SpecificHeat=950,
    ThermalAbsorptance=0.9,
    SolarAbsorptance=0.7,
    VisibleAbsorptance=0.7,
    Type="Concrete",
    Input_0_Hidden=False,
    Input_0_Name="Name",
    Input_10_Hidden=True,
    Input_10_Name="TemperatureCoefficientThermalConductivity",
    Input_11_Hidden=True,
    Input_11_Name="TemperatureArray",
    Input_12_Hidden=True,
    Input_12_Name="EnthalpyArray",
    Input_13_Hidden=True,
    Input_13_Name="VariableConductivityArray",
    Input_14_Hidden=False,
    Input_14_Name="Type",
    Input_15_Hidden=True,
    Input_15_Name="EmbodiedEnergy",
    Input_16_Hidden=True,
    Input_16_Name="EmbodiedCarbon",
    Input_17_Hidden=True,
    Input_17_Name="Cost",
    Input_18_Hidden=True,
    Input_18_Name="Life",
    Input_1_Hidden=False,
    Input_1_Name="Conductivity",
    Input_2_Hidden=False,
    Input_2_Name="Density",
    Input_3_Hidden=False,
    Input_3_Name="Roughness",
    Input_4_Hidden=False,
    Input_4_Name="SpecificHeat",
    Input_5_Hidden=False,
    Input_5_Name="ThermalAbsorptance"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)
material_7 = ConstructCSOpaqueMaterial(
    Name="Felt",
    Conductivity=0.9,
    Density=0.5,
    Roughness="Rough",
    SpecificHeat=1800,
    ThermalAbsorptance=0.9,
    SolarAbsorptance=0.7,
    VisibleAbsorptance=0.7,
    Type="Sealing",
    Input_0_Hidden=False,
    Input_0_Name="Name",
    Input_10_Hidden=True,
    Input_10_Name="TemperatureCoefficientThermalConductivity",
    Input_11_Hidden=True,
    Input_11_Name="TemperatureArray",
    Input_12_Hidden=True,
    Input_12_Name="EnthalpyArray",
    Input_13_Hidden=True,
    Input_13_Name="VariableConductivityArray",
    Input_14_Hidden=False,
    Input_14_Name="Type",
    Input_15_Hidden=True,
    Input_15_Name="EmbodiedEnergy",
    Input_16_Hidden=True,
    Input_16_Name="EmbodiedCarbon",
    Input_17_Hidden=True,
    Input_17_Name="Cost",
    Input_18_Hidden=True,
    Input_18_Name="Life",
    Input_1_Hidden=False,
    Input_1_Name="Conductivity",
    Input_2_Hidden=False,
    Input_2_Name="Density",
    Input_3_Hidden=False,
    Input_3_Name="Roughness",
    Input_4_Hidden=False,
    Input_4_Name="SpecificHeat",
    Input_5_Hidden=False,
    Input_5_Name="ThermalAbsorptance"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)
material_8 = ConstructCSOpaqueMaterial(
    Name="Concrete",
    Conductivity=2,
    Density=2100,
    Roughness="Rough",
    SpecificHeat=1040,
    ThermalAbsorptance=0.9,
    SolarAbsorptance=0.7,
    VisibleAbsorptance=0.7,
    Type="Concrete",
    Input_0_Hidden=False,
    Input_0_Name="Name",
    Input_10_Hidden=True,
    Input_10_Name="TemperatureCoefficientThermalConductivity",
    Input_11_Hidden=True,
    Input_11_Name="TemperatureArray",
    Input_12_Hidden=True,
    Input_12_Name="EnthalpyArray",
    Input_13_Hidden=True,
    Input_13_Name="VariableConductivityArray",
    Input_14_Hidden=False,
    Input_14_Name="Type",
    Input_15_Hidden=True,
    Input_15_Name="EmbodiedEnergy",
    Input_16_Hidden=True,
    Input_16_Name="EmbodiedCarbon",
    Input_17_Hidden=True,
    Input_17_Name="Cost",
    Input_18_Hidden=True,
    Input_18_Name="Life",
    Input_1_Hidden=False,
    Input_1_Name="Conductivity",
    Input_2_Hidden=False,
    Input_2_Name="Density",
    Input_3_Hidden=False,
    Input_3_Name="Roughness",
    Input_4_Hidden=False,
    Input_4_Name="SpecificHeat",
    Input_5_Hidden=False,
    Input_5_Name="ThermalAbsorptance"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)
material_9 = ConstructCSOpaqueMaterial(
    Name="AcousticTile",
    Conductivity=0.06,
    Density=368,
    Roughness="Rough",
    SpecificHeat=590,
    ThermalAbsorptance=0.9,
    SolarAbsorptance=0.7,
    VisibleAbsorptance=0.7,
    Type="Finishes",
    Input_0_Hidden=False,
    Input_0_Name="Name",
    Input_10_Hidden=True,
    Input_10_Name="TemperatureCoefficientThermalConductivity",
    Input_11_Hidden=True,
    Input_11_Name="TemperatureArray",
    Input_12_Hidden=True,
    Input_12_Name="EnthalpyArray",
    Input_13_Hidden=True,
    Input_13_Name="VariableConductivityArray",
    Input_14_Hidden=False,
    Input_14_Name="Type",
    Input_15_Hidden=True,
    Input_15_Name="EmbodiedEnergy",
    Input_16_Hidden=True,
    Input_16_Name="EmbodiedCarbon",
    Input_17_Hidden=True,
    Input_17_Name="Cost",
    Input_18_Hidden=True,
    Input_18_Name="Life",
    Input_1_Hidden=False,
    Input_1_Name="Conductivity",
    Input_2_Hidden=False,
    Input_2_Name="Density",
    Input_3_Hidden=False,
    Input_3_Name="Roughness",
    Input_4_Hidden=False,
    Input_4_Name="SpecificHeat",
    Input_5_Hidden=False,
    Input_5_Name="ThermalAbsorptance"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)
material_10 = ConstructCSOpaqueMaterial(
    Name="XPS",
    Conductivity=0.034,
    Density=35,
    Roughness="Rough",
    SpecificHeat=1400,
    ThermalAbsorptance=0.9,
    SolarAbsorptance=0.7,
    VisibleAbsorptance=0.7,
    Type="Insulation",
    Input_0_Hidden=False,
    Input_0_Name="Name",
    Input_10_Hidden=True,
    Input_10_Name="TemperatureCoefficientThermalConductivity",
    Input_11_Hidden=True,
    Input_11_Name="TemperatureArray",
    Input_12_Hidden=True,
    Input_12_Name="EnthalpyArray",
    Input_13_Hidden=True,
    Input_13_Name="VariableConductivityArray",
    Input_14_Hidden=False,
    Input_14_Name="Type",
    Input_15_Hidden=True,
    Input_15_Name="EmbodiedEnergy",
    Input_16_Hidden=True,
    Input_16_Name="EmbodiedCarbon",
    Input_17_Hidden=True,
    Input_17_Name="Cost",
    Input_18_Hidden=True,
    Input_18_Name="Life",
    Input_1_Hidden=False,
    Input_1_Name="Conductivity",
    Input_2_Hidden=False,
    Input_2_Name="Density",
    Input_3_Hidden=False,
    Input_3_Name="Roughness",
    Input_4_Hidden=False,
    Input_4_Name="SpecificHeat",
    Input_5_Hidden=False,
    Input_5_Name="ThermalAbsorptance"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)

# ---- group: WallInsul
layer = ConstructCSLayer(Material=material_3, Thickness="0.013")

# ---- group: WallConcrete
layer_2 = ConstructCSLayer(Material=material_6, Thickness=wall_concrete_thickness)

# ---- group: WallInsul
layer_3 = ConstructCSLayer(Material=material_5, Thickness=wall_insul_thickness)

layer_4 = ConstructCSLayer(Material=material_2, Thickness="0.025")

# ---- group: RoofFelt
layer_5 = ConstructCSLayer(Material=material_7, Thickness="0.003")

# ---- group: RoofConcrete
layer_6 = ConstructCSLayer(Material=material_8, Thickness=roof_concrete_thickness)

# ---- group: RoofTile
layer_7 = ConstructCSLayer(Material=material_9, Thickness="0.005")

# ---- group: RoofXPS
layer_8 = ConstructCSLayer(Material=material_10, Thickness=roof_xps_thickness)

# ---- group: GroundCarpet
layer_9 = ConstructCSLayer(Material=material, Thickness="0.013")

# ---- group: GroundConcrete
layer_10 = ConstructCSLayer(Material=material_6, Thickness="0.203")

# ---- group: GroundCarpet
layer_11 = ConstructCSLayer(Material=material_4, Thickness="0.02")

# ---- group: GroundXPS
layer_12 = ConstructCSLayer(Material=material_10, Thickness=slab_insul_thickness)

# ----
relay = Relay([layer_8, layer_6, layer_7, layer_5])
panel_12 = Panel(relay)
mats = Data([material_10, material_8, material_9, material_7, material_6, material_5, material_3, material_2, material_4, material])

dup = DuplicateData(Data=layer_9, Number=2, Order=True)
construction = ConstructCSConstruction(
    Name="CustomExteriorRoof",
    Category="Roof",
    Layers=relay,
    Input_0_Hidden=False,
    Input_0_Name="Name",
    Input_1_Hidden=False,
    Input_1_Name="Category",
    Input_2_Hidden=False,
    Input_2_Name="Layers",
    Input_3_Hidden=True,
    Input_3_Name="EmbodiedEnergy",
    Input_4_Hidden=True,
    Input_4_Name="EmbodiedCarbon",
    Input_5_Hidden=True,
    Input_5_Name="Cost",
    Input_6_Hidden=True,
    Input_6_Name="Life",
    UnitSystem=4,
    Input_3_GHParam_Branch0_Path="{0}",
    Input_3_GHParam_Branch0_Item0_number=0,
    Input_4_GHParam_Branch0_Path="{0}",
    Input_4_GHParam_Branch0_Item0_number=0,
    Input_5_GHParam_Branch0_Path="{0}",
    Input_5_GHParam_Branch0_Item0_number=0,
    Input_6_GHParam_Branch0_Path="{0}",
    Input_6_GHParam_Branch0_Item0_number=10)  # -> Construction, ConstructionInformation
construction_2 = ConstructCSConstruction(
    Name="CustomGroundSlab",
    Category="GroundFloor",
    Layers=flatten([layer_12, layer_10, layer_11]),
    Input_0_Hidden=False,
    Input_0_Name="Name",
    Input_1_Hidden=False,
    Input_1_Name="Category",
    Input_2_Hidden=False,
    Input_2_Name="Layers",
    Input_3_Hidden=True,
    Input_3_Name="EmbodiedEnergy",
    Input_4_Hidden=True,
    Input_4_Name="EmbodiedCarbon",
    Input_5_Hidden=True,
    Input_5_Name="Cost",
    Input_6_Hidden=True,
    Input_6_Name="Life",
    UnitSystem=4,
    Input_3_GHParam_Branch0_Path="{0}",
    Input_3_GHParam_Branch0_Item0_number=0,
    Input_4_GHParam_Branch0_Path="{0}",
    Input_4_GHParam_Branch0_Item0_number=0,
    Input_5_GHParam_Branch0_Path="{0}",
    Input_5_GHParam_Branch0_Item0_number=0,
    Input_6_GHParam_Branch0_Path="{0}",
    Input_6_GHParam_Branch0_Item0_number=10)  # -> Construction, ConstructionInformation
construction_3 = ConstructCSConstruction(
    Name="CustomInteriorPartition",
    Category="Facade",
    Layers=flatten(dup),
    Input_0_Hidden=False,
    Input_0_Name="Name",
    Input_1_Hidden=False,
    Input_1_Name="Category",
    Input_2_Hidden=False,
    Input_2_Name="Layers",
    Input_3_Hidden=True,
    Input_3_Name="EmbodiedEnergy",
    Input_4_Hidden=True,
    Input_4_Name="EmbodiedCarbon",
    Input_5_Hidden=True,
    Input_5_Name="Cost",
    Input_6_Hidden=True,
    Input_6_Name="Life",
    UnitSystem=4,
    Input_3_GHParam_Branch0_Path="{0}",
    Input_3_GHParam_Branch0_Item0_number=0,
    Input_4_GHParam_Branch0_Path="{0}",
    Input_4_GHParam_Branch0_Item0_number=0,
    Input_5_GHParam_Branch0_Path="{0}",
    Input_5_GHParam_Branch0_Item0_number=0,
    Input_6_GHParam_Branch0_Path="{0}",
    Input_6_GHParam_Branch0_Item0_number=10)  # -> Construction, ConstructionInformation
construction_4 = ConstructCSConstruction(
    Name="CustomExteriorWall",
    Category="Roof",
    Layers=flatten([layer_2, layer_3, layer, layer_4]),
    Input_0_Hidden=False,
    Input_0_Name="Name",
    Input_1_Hidden=False,
    Input_1_Name="Category",
    Input_2_Hidden=False,
    Input_2_Name="Layers",
    Input_3_Hidden=True,
    Input_3_Name="EmbodiedEnergy",
    Input_4_Hidden=True,
    Input_4_Name="EmbodiedCarbon",
    Input_5_Hidden=True,
    Input_5_Name="Cost",
    Input_6_Hidden=True,
    Input_6_Name="Life",
    UnitSystem=4,
    Input_3_GHParam_Branch0_Path="{0}",
    Input_3_GHParam_Branch0_Item0_number=0,
    Input_4_GHParam_Branch0_Path="{0}",
    Input_4_GHParam_Branch0_Item0_number=0,
    Input_5_GHParam_Branch0_Path="{0}",
    Input_5_GHParam_Branch0_Item0_number=0,
    Input_6_GHParam_Branch0_Path="{0}",
    Input_6_GHParam_Branch0_Item0_number=10)  # -> Construction, ConstructionInformation
python_6 = GhPythonScript(x=construction_2.ConstructionInformation)  # -> Rval, mass
# ---------- python_6: Python ----------
__author__ = "zoelh"
__version__ = "2023.11.21"

import rhinoscriptsyntax as rs
import re

Rval = None

s = re.sub(r'[^\w.\n]+', ' ', x)
s=s.replace(" ", '')
print(s)
Rval = float(s.split("RValuemKW")[1].split("\n")[0])
mass = float(s.split("CapacitancekJKm")[1].split("\n")[0])
print(Rval)
print(mass)
# ---------- end python_6 ----------

# ---- group: PARTITION CONSTRUCTION
panel_13 = Panel(construction_3.ConstructionInformation)
partition_5 = Data(construction_3.Construction)

# ---- group: ROOF CONSTRUCTION (continued)
panel_14 = Panel(construction.ConstructionInformation)
exteriorroof = Data(construction.Construction)

# ---- group: SLAB CONSTRUCTION (continued)
panel_15 = Panel(construction_2.ConstructionInformation)
slab = Data(construction_2.Construction)

# ---- group: FACADE CONSTRUCTION (continued)
panel_16 = Panel(construction_4.ConstructionInformation)
exteriorwall = Data(construction_4.Construction)

# ----
python_7 = GhPythonScript(x=construction.ConstructionInformation)  # -> Rval, mass; same code as python_6
python_8 = GhPythonScript(x=construction_4.ConstructionInformation)  # -> Rval, mass; same code as python_6
zset = CSZoneSettings(
    Name="ParametricZoneSettings",
    ZoneSettings=item_10,
    RoofConstruction=exteriorroof,
    FacadeConstruction=exteriorwall,
    SlabConstruction=slab,
    PartitionConstruction=partition_5,
    ExternalFloorConstruction=slab,
    InternalMassConstruction=partition_5,
    InternalMassExposedArea=Slider(0, range=0..1),
    GroundSlabConstruction=slab,
    PeopleDensity=peopledensity_ppl_m2,
    AirspeedSchedule="AirSpeed 0",
    EquipmentPowerDensity=epd_w_m2,
    LightingPowerDensity=lpd_w_m2,
    OccupancySchedule=year_schedule.Sched,
    EquipmentAvailabilitySchedule=year_schedule_2.Sched,
    LightsAvailabilitySchedule=year_schedule_3.Sched,
    DimmingType=dimmingtype,
    PeopleIsOn=people_equip_lightson,
    EquipmentIsOn=people_equip_lightson,
    LightsIsOn=people_equip_lightson,
    CoolingCOP=Slider(1, range=0.6..6),
    HeatingCOP=Slider(1, range=0.6..6),
    HeatingSetpoint=heatingsetpoint_degc,
    CoolingSetpoint=coolingsetpoint_degc,
    HeatingSetpointConstant=heating_coolingconstant,
    CoolingSetpointConstant=heating_coolingconstant,
    HeatingSetpointSchedule="S21 B18 8to18",
    CoolingSetpointSchedule="S25 B30 8to18",
    HeatIsOn=heating_coolingon,
    CoolIsOn=heating_coolingon,
    MechVentIsOn=mechventon,
    HumidistatIsOn=humidistaton,
    HeatingLimitType="NoLimit",
    CoolingLimitType="LimitFlowRateAndCapacity",
    MaxHeatingCapacity=100,
    MaxCoolingCapacity=100,
    MaxHeatFlow=100,
    MaxCoolFlow=100,
    HeatingSchedule="AllOn",
    CoolingSchedule="AllOn",
    MechVentSchedule=occupancy,
    MinFreshAirPerson=ventilationperperson_l_s_person,
    MinFreshAirArea=ventilationperarea_l_s_m2,
    EconomizerType=econ,
    HeatRecoveryType=hrv,
    HeatRecoveryEfficiencySensible="0.7",
    HeatRecoveryEfficiencyLatent="0.65",
    MinHumidity="20",
    MaxHumidity="80",
    TurnOnEMSFanEnergy=fanenergy,
    FanPressureRise=1000,
    MaxHeatSupplyAirTemp="30",
    MinCoolSupplyAirTemp="18",
    HeatingSizingFactor=1.2,
    CoolingSizingFactore=1.2,
    NatVentIsOn=natventon,
    SchedVentIsOn=scheduledventilationon,
    ScheduledVentilationAvailability="Off",
    NaturalVentilationSchedule="Off",
    StackDrivenFlow=scheduledventilationon_2,
    Crossventilation=scheduledventilationon_2,
    InfiltrationIsOn=infiltrationon,
    InfiltrationAch=infiltration_ach,
    InfiltrationFlowExtArea=infiltration_m3_s_m2,
    InfiltrationCalculationMethod=infiltrationmethod,
    AFNAirMassFlowCoefficientCrack=0.001,
    FlowRatePerPerson="0",
    DHWOn=dhwon,
    Input_0_Hidden=False,
    Input_0_Name="Name",
    Input_100_Hidden=True,
    Input_100_Name="Interior Vertical Insulation Depth",
    Input_101_Hidden=True,
    Input_101_Name="Exterior Horizontal Insulation Depth",
    Input_102_Hidden=True,
    Input_102_Name="Exterior Horizontal Insulation Width",
    Input_103_Hidden=True,
    Input_103_Name="Footing Thickness",
    Input_104_Hidden=True,
    Input_104_Name="Footing Depth",
    Input_105_Hidden=True,
    Input_105_Name="ElectricityCO2",
    Input_106_Hidden=True,
    Input_106_Name="ElectricityCost",
    Input_107_Hidden=True,
    Input_107_Name="HotWaterCO2",
    Input_108_Hidden=True,
    Input_108_Name="HotWaterCost",
    Input_109_Hidden=True,
    Input_109_Name="CoolingCO2",
    Input_10_Hidden=True,
    Input_10_Name="Ground Wall Construction",
    Input_110_Hidden=True,
    Input_110_Name="HeatingCO2",
    Input_111_Hidden=True,
    Input_111_Name="CoolingCost",
    Input_112_Hidden=True,
    Input_112_Name="HeatingCost"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)
library = CSLibrary(AddObjects=flatten([year_schedule_2.Sched, year_schedule_3.Sched, year_schedule.Sched, simple_window, exteriorroof, exteriorwall, slab, partition_5, mats]))

# ----
# Save building settings
python_9 = GhPythonScript(
    x_dim=x_axis_meters,
    y_dim=y_axis_meters,
    n_floors=n_floors_2,
    f2f_height=f2f_height_meters,
    sb_w=width,
    pd=perim_offset_2,
    cd=core_depth,
    wwr=wwr_2,
    uval=number_slider_6,
    shgc=number_slider_5,
    sched=number_slider_9,
    RoofRval=python_7.Rval,
    RoofMass=python_7.mass,
    WallRval=python_8.Rval,
    WallMass=python_8.mass,
    SlabRval=python_6.Rval)  # -> d
# ---------- python_9: Python ----------
__author__ = "zoelh"
__version__ = "2023.11.18"

import rhinoscriptsyntax as rs
import json
d= dict(
    BuildingSettings=dict(
        x_dim = float(x_dim),
        y_dim = float(y_dim),
        n_floors = float(n_floors),
        f2f_height = float(f2f_height),
        schedule_index=int(sched),
    ),
    ShoeboxConfig=dict(
        FacadeMass = float(WallMass)*1000,
        RoofMass = float(RoofMass)*1000,
        FacadeRValue = float(WallRval),
        RoofRValue = float(RoofRval),
        SlabRValue = float(SlabRval),
        WindowUValue = float(uval),
        WindowShgc = float(shgc),
        wwr = float(wwr)/100,
        template_idx=int(sched),
        width=float(sb_w),
        height=float(f2f_height),
        perim_depth=float(pd),
        core_depth=float(cd),
    )
)
d = json.dumps(d)
print(d)
# ---------- end python_9 ----------
jmerge = MergeJson(SourceJson=python_9, OverrideJson=zset)
panel_17 = Panel(jmerge)
expression_5 = Expression(x=expression_4, Expression="Format(\"{0}_settings\", x)")
panel_18 = Panel(expression_5)
python_10 = GhPythonScript(set=jmerge, name=panel_18, dir=output_directory, save=falsestart)
# ---------- python_10: Python ----------
__author__ = "zoelh"
__version__ = "2023.11.18"

import rhinoscriptsyntax as rs
import json

if save:
    fname = dir + name + ".json"
    print(fname)
    with open(fname, "w") as f:
        json.dump(json.loads(set), f, indent=4)
# ---------- end python_10 ----------

# ----
# Model Setup
window_settings = Data(wset)
zone_settings = Data(zset)
zone = CSEnergyZone(Brep=flatten(item_7), Settings=zone_settings, UsedLibraryObjects="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")  # -> Zones, Settings
zone_2 = CSEnergyZone(Brep=item_8, Settings=zone_settings, UsedLibraryObjects="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")  # -> Zones, Settings
bco = CSBoundaryObject(Brep=item_9, type="GROUND")
window = CSWindow(Surface=item_6, Settings=window_settings, UsedLibraryObjects="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")  # -> Window, Settings
expression_6 = Expression(x=expression_4, Expression="Format(\"{0}_Autozoner\", x)")
model = CSModelMaker(Zones=flatten([zone_2.Zones, zone.Zones]), Windows=window.Window, Boundaries=bco, Shading=extr_4, Library=library)  # -> Model, Invalid
panel_19 = Panel(expression_6)
run_e = RunCSEnergyModel(
    Model=model.Model,
    Name=panel_19,
    Directory=output_directory,
    Location=path,
    Run=Button(),
    NorthOffset=0,
    settings="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")  # -> Model, Settings, Result

# ==== cluster WinShdGen
zone_geometry = ClusterInput()
debrep = DeconstructBrep(ZoneGeometry=zone_geometry)  # -> Faces, Edges, Vertices
area = Area(Geometry=debrep.Faces)  # -> Area, Centroid
evalsrf = EvaluateSurface(Surface=debrep.Faces, Point=area.Centroid)  # -> Point, Normal, UDirection, VDirection, Frame
Z = UnitZ(Factor=1)
dprod = DotProduct(VectorA=evalsrf.Normal, VectorB=Z, Unitize=False)
wwr = ClusterInput()  # WWR (N,E,S,W)
abs = Absolute(Value=dprod)
smaller = SmallerThan(FirstNumber=abs, SecondNumber=".9")  # -> SmallerThan, OrEqualTo
dispatch = Dispatch(List=debrep.Faces, DispatchPattern=smaller.SmallerThan)  # -> ListA, ListB
srf = Surface(dispatch.ListA)
cluster = Cluster_2(srf=srf)
srf_2 = Surface(flatten(cluster))
item = ListItem(List=wwr, Index="0", Wrap=True)
item_2 = ListItem(List=wwr, Index="1", Wrap=True)
item_3 = ListItem(List=wwr, Index="2", Wrap=True)
item_4 = ListItem(List=wwr, Index="3", Wrap=True)
Y = UnitY(Factor=1)
X = UnitX(Factor=1)
Y_2 = UnitY(Factor="-1")
X_2 = UnitX(Factor="-1")
cluster_2 = Cluster(S=srf, dir=X, wwr=item_2)
cluster_3 = Cluster(S=srf, dir=Y_2, wwr=item_3)
cluster_4 = Cluster(S=srf, dir=X_2, wwr=item_4)
cluster_5 = Cluster(S=srf, dir=Y, wwr=item)
geo_n = Geometry(cluster_5)
geo_e = Geometry(cluster_2)
geo_s = Geometry(cluster_3)
geo_w = Geometry(cluster_4)
merge = Merge(Data1=geo_n, Data2=geo_e, Data3=geo_s, Data4=geo_w)
clean = CleanTree(RemoveNulls=True, RemoveInvalid=True, RemoveEmpty=False, Tree=merge)  # -> flatten(Tree)
T = ClusterOutput(clean)

# ==== cluster Cluster_3
floorheight = ClusterInput()
numfloors = ClusterInput()
xlen = ClusterInput()
ylen = ClusterInput()
offset = ClusterInput()

floorheight_2 = Number(floorheight)
numfloors_2 = Number(numfloors)
xlen_2 = Number(xlen)
ylen_2 = Number(ylen)
xy = XYPlane(Origin=Point(0, 0, 0))
Z = UnitZ(Factor=expr("x*0.5", floorheight_2))
footprintcurve = Rectangle(Plane=xy, XSize=xlen_2, YSize=ylen_2, Radius=0)  # -> FootprintBaseCurve, Length
Z_2 = UnitZ(Factor=floorheight_2)
move = Move(Geometry=xy, Motion=Z)  # -> Geometry, Transform
az = Autozoner(FloorPlanOutlines=footprintcurve.FootprintBaseCurve, Offset=offset)  # -> Outline, PerimeterPolylines, CorePolylines, SkeletonPolylines
box = CenterBox(Base=move.Geometry, X=xlen_2, Y=ylen_2, Z=expr("x*0.5", floorheight_2))
series = Series(Start=0, Step=floorheight_2, Count=numfloors_2)
pcol = PolylineCollapse(Polyline=az.PerimeterPolylines, Tolerance=1)  # -> Polyline, Count
pcol_2 = PolylineCollapse(Polyline=az.CorePolylines, Tolerance=1)  # -> Polyline, Count
floorzmove = UnitZ(Factor=series)
extr = Extrude(Base=pcol.Polyline, Direction=Z_2)
extr_2 = Extrude(Base=pcol_2.Polyline, Direction=Z_2)
cap = CapHoles(Brep=extr_2)
cap_2 = CapHoles(Brep=extr)  # -> graft(Brep)
move_2 = Move(Geometry=cap_2, Motion=floorzmove)  # -> Geometry, Transform
move_3 = Move(Geometry=cap, Motion=floorzmove)  # -> Geometry, Transform
ground_plane = Surface(footprintcurve.FootprintBaseCurve)
perimeter = Geometry(move_2.Geometry)
core = Geometry(move_3.Geometry)

footprintbasecurve = ClusterOutput(footprintcurve.FootprintBaseCurve)
f2fzaxismovementvec = ClusterOutput(Z_2)
floorzaxismovementvec = ClusterOutput(floorzmove)
ground_plane_2 = ClusterOutput(ground_plane)
perimeter_2 = ClusterOutput(perimeter)
core_2 = ClusterOutput(core)
panel = Panel("""South
East
North
West""")
series_2 = Series(Start=0, Step=1, Count=numfloors_2)
ins = InsertItems(List=graft(series_2), Item="Core", Indices=0, Wrap=True)  # -> simplify(List)
stack = StackData(Data=graft(panel), Stack=numfloors_2)
stack_2 = StackData(Data=graft(series_2), Stack="4")
join = TextJoin(Text=ins, Join="_Level_")  # -> flatten(Core_Names)
panel_2 = Panel(stack)
flip = FlipMatrix(Data=stack_2)
panel_3 = Panel(flip)
core_names = ClusterOutput(join)
merge = Merge(Data1=simplify(graft(panel_2)), Data2=simplify(graft(panel_3)))
join_2 = TextJoin(Text=merge, Join="_Level_")
panel_4 = Panel(join_2)
trim = TrimTree(Tree=panel_4, Depth="1")
perimnames = ClusterOutput(trim)

# ==== cluster Cluster
wwr = ClusterInput()  # WWR
dir = ClusterInput()  # Dir
S = ClusterInput()  # S

# ----
# north south gets priority
Y = UnitY(Factor=1)
dprod = DotProduct(VectorA=dir, VectorB=Y, Unitize=False)
abs = Absolute(Value=dprod)
int = Integer(abs)
item = ListItem(List=[".71", ".7"], Index=int, Wrap=True)

area = Area(Geometry=S)  # -> Area, Centroid
evalsrf = EvaluateSurface(Surface=S, Point=area.Centroid)  # -> Point, Normal, UDirection, VDirection, Frame
dprod_2 = DotProduct(VectorA=evalsrf.Normal, VectorB=dir, Unitize=False)
larger = LargerThan(FirstNumber=dprod_2, SecondNumber=item)  # -> LargerThan, OrEqualTo
panel = Panel(evalsrf.Normal)
dispatch = Dispatch(List=S, DispatchPattern=larger.LargerThan)  # -> WallsNORTH, ListB
wall_geometry = Geometry(dispatch.WallsNORTH)

# ---- group: User-Defined WWR Scale
division = Division(NorthScaleInput=wwr, B="100")

# ---- group: Centroids of Walls
area_2 = Area(Geometry=wall_geometry)  # -> Area, Centroid

# ----
sqrt = SquareRoot(Value=division)
scale = Scale(Geometry=wall_geometry, Center=area_2.Centroid, Factor=sqrt)  # -> flatten(NORTHWindows), Transform
area_3 = Area(Geometry=scale.NORTHWindows)  # -> Area, Centroid; disabled
division_2 = Division(A=area_3.Area, B=area_2.Area)  # disabled
panel_2 = Panel(division_2)  # disabled
north_windows = ClusterOutput(scale.NORTHWindows)

# ==== cluster Cluster_2
srf = ClusterInput()
srf_2 = Surface(srf)
crv = Curve(srf_2)
crv_2 = Curve(srf_2)  # disabled
srf_3 = Surface(crv_2)  # disabled
area = Area(Geometry=srf_2)  # -> Area, Centroid; disabled
srf_4 = Surface(crv)
area_2 = Area(Geometry=srf_3)  # -> Area, Centroid; disabled
flip = Flip(Surface=srf_4, Guide=srf_2)  # -> Surface, Result
evalsrf = EvaluateSurface(Surface=srf_2, Point=area.Centroid)  # -> Point, Normal, UDirection, VDirection, Frame; disabled
evalsrf_2 = EvaluateSurface(Surface=srf_3, Point=area_2.Centroid)  # -> Point, Normal, UDirection, VDirection, Frame; disabled
panel = Panel(flip.Result)
vdis = VectorDisplay(Anchor=area_2.Centroid)  # disabled
dprod = DotProduct(VectorA=evalsrf.Normal, VectorB=evalsrf_2.Normal, Unitize=False)  # disabled
vdis_2 = VectorDisplay(Anchor=area.Centroid, Vector=expr("x*10", evalsrf.Normal))  # disabled
panel_2 = Panel(".9")  # disabled
smaller = SmallerThan(FirstNumber=dprod, SecondNumber=panel_2)  # -> SmallerThan, OrEqualTo; disabled
dispatch = Dispatch(List=srf_3, DispatchPattern=smaller.SmallerThan)  # -> ListA, ListB; disabled
flip_2 = Flip(Surface=dispatch.ListA)  # -> Surface, Result; disabled
srf_5 = Surface(flatten([flip_2.Surface, dispatch.ListB]))  # disabled
S = ClusterOutput(flip.Surface)
