# Grasshopper definition single_shoebox.gh (Grasshopper 1.0.7)
# plug-ins: ClimateStudioGH, jSwan

number_slider = Slider(5, range=0..15)
panel = Panel("D:\Users\zoelh\GitRepos\ml-for-building-energy-modeling\ml-for-bem\data\")
filename = Panel("Shoebox")
# EPW: C:\ProgramData\Solemma\Common\WeatherData\EPW\USA_MA_Boston-Logan.Intl.AP.725090_TMYx.2004-2018.epw
epw = Panel("D:\Users\zoelh\GitRepos\ml-for-building-energy-modeling\ml-for-bem\data\epws\CAN_PQ_Montreal.Intl.AP.716270_CWEC.epw")
output_directory = Panel("D:\DATA\SingleShoeboxTests\")

# ----
# Input Geometry
orientation = Slider(0, range=0..6.283)
ground = BooleanToggle(True)
roof = BooleanToggle(True)
perim_depth = Slider(3, range=0..10)
width = Slider(5, range=0..10)
height = Slider(4, range=0..10)
core_depth = Slider(9, range=0..10)
wwr = Slider(0.3, range=0..1)
cluster = Cluster(
    core_depth=core_depth,
    perim_depth=perim_depth,
    floor=ground,
    width=width,
    roof=roof,
    height=height,
    orientation=orientation,
    wwr=wwr)  # -> perimeter_2, core_2, window_2, ground_3, adiabatic_3
adiabatic = Data(cluster.adiabatic_3)
perim = Data(cluster.perimeter_2)
core = Data(cluster.core_2)
window = Data(cluster.window_2)
ground_2 = Data(cluster.ground_3)

python = GhPythonScript(index=number_slider, path=panel)  # -> schedules
# ---------- python: Python ----------
__author__ = "zoelh"
__version__ = "2023.11.18"

import rhinoscriptsyntax as rs
import csv
import ghpythonlib.treehelpers as th

schedules = []
l = ["EquipmentAvailabilitySchedule.csv", "LightsAvailabilitySchedule.csv", "OccupancySchedule.csv"]
for file in l:
    filename = path + file
    with open(filename) as csvfile:
        reader = csv.reader(csvfile)
        rows = list(reader)
        row = rows[int(index)+1]
        schedules.append([row[1:]])
schedules = th.list_to_tree(schedules)
# ---------- end python ----------
bang = ExplodeTree(Data=python)  # -> Branch0, Branch1, Branch2
year_schedule = ConstructCSYearSchedule(Name="Occupancy", Type=0, Category=0, DaysHours=bang.Branch2)  # -> Sched, Values
year_schedule_2 = ConstructCSYearSchedule(Name="Equip", Type=0, Category=0, DaysHours=bang.Branch0)  # -> Sched, Values
year_schedule_3 = ConstructCSYearSchedule(Name="Lights", Type=0, Category=0, DaysHours=bang.Branch1)  # -> Sched, Values

ventilationperperson_l_s_person = Slider(6.9, range=0..10)
ventilationperarea_l_s_m2 = Slider(0.1, range=0..5)
coolingsetpoint_degc = Slider(25, range=16..30)
heatingsetpoint_degc = Slider(19, range=10..24)
econ = ValueList({"NoEconomizer", "DifferentialEnthalpy"}, selected="NoEconomizer")
mechventon = BooleanToggle(True)
hrv = ValueList({"None", "Sensible", "Enthalpy"}, selected="None")

infiltrationmethod = ValueList({"ACH", "Flow Per Exterior Area": "FlowExtArea"}, selected="Flow Per Exterior Area")
infiltration_m3_s_m2 = Slider(5e-05, range=0..0.0005)
infiltration_ach = Slider(0, range=0..1)

# ---- group: Loads
lpd_w_m2 = Slider(0, range=0..50)
epd_w_m2 = Slider(0, range=0..50)
peopledensity_ppl_m2 = Slider(0.025, range=0..0.5)

# ---- group: Windows
number_slider_2 = Slider(0.65, range=0..1)
number_slider_3 = Slider(4, range=0.6..7)
tvis = Panel("0.8")

# ----
occupancy = Data(year_schedule.Sched)

# ---- group: MechVentilationSchedule
panel_2 = Panel("AllOn")

# ----
list = ValueList({"Residential", "Kitchen", "Office", "MeetingRoom", "HotelRoom", "ClassRoom", "Library", "LectureHall", "SuperMarket", "Shopping", "ScienceLab"}, selected="Office")
simple_window = ConstructCSSimpleWindow(Name="windowtest", Shgf=number_slider_2, Uval=number_slider_3, Tvis=tvis)
zonetemplate = GetZoneTemplate(SearchZoneTemplate=list, Selection="Office")
heating_coolingconstant = BooleanToggle(True)

# ----
# Boundary condition setup
bco = CSBoundaryObject(Brep=ground_2, type="GROUND")
bco_2 = CSBoundaryObject(Brep=adiabatic, type="ADIABAT")

people_equip_lightson = BooleanToggle(True)
scheduledventilationon = BooleanToggle(False)
scheduledventilationon_2 = BooleanToggle(False)
heating_coolingon = BooleanToggle(True)
humidistaton = BooleanToggle(False)
item = ListItem(List=zonetemplate, Index=0, Wrap=True)
infiltrationon = BooleanToggle(True)
natventon = BooleanToggle(False)
fanenergy = BooleanToggle(False)
dhwon = BooleanToggle(True)
shadingon = BooleanToggle(False)
hasframe = BooleanToggle(False)
panel_3 = Panel("Airspeed 0")
dimmingtype = Panel("Off")
wset = CSWindowSettings(
    Name="SimpleWindowSettings",
    Type="External",
    ShadingSystemIsOn=shadingon,
    GlazingConstruction=simple_window,
    OperableArea="0",
    HasFrame=hasframe,
    AFNWindowAvailability="AllOff",
    Input_0_Hidden=False,
    Input_0_Name="Name",
    Input_10_Hidden=True,
    Input_10_Name="ShadingThickness",
    Input_11_Hidden=True,
    Input_11_Name="ShadeGlassDistance",
    Input_12_Hidden=True,
    Input_12_Name="TopBottomEdgeOpeningMultiplier",
    Input_13_Hidden=True,
    Input_13_Name="Analysis Mesh Resolution",
    Input_14_Hidden=True,
    Input_14_Name="ZoneMixingIsOn",
    Input_15_Hidden=True,
    Input_15_Name="ZoneMixingDeltaTemperature",
    Input_16_Hidden=True,
    Input_16_Name="ZoneMixingFlowRate",
    Input_17_Hidden=False,
    Input_17_Name="Glazing Construction",
    Input_18_Hidden=False,
    Input_18_Name="OperableArea",
    Input_19_Hidden=True,
    Input_19_Name="ZoneMixingAvailibilitySchedule",
    Input_1_Hidden=False,
    Input_1_Name="WindowSettings",
    Input_20_Hidden=False,
    Input_20_Name="HasFrame",
    Input_21_Hidden=True,
    Input_21_Name="FrameWidth",
    Input_22_Hidden=True,
    Input_22_Name="FrameProjection"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)

# ----
# Window
window_2 = Window(Surface=window, Settings=wset, UsedLibraryObjects="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")  # -> Window, Settings

panel_4 = Panel("""Core C, CS
Perim C, CS
Core H, CS
Perim H, CS
Core H, wb
Core C, wb
Perim H, wb
Perim C, wb
Core H, surr
Core C, surr
Perim H, surr
Perim C, surr""")

# ----
# Run Analysis
button = Button()

fetch_push_results = Button()
expression = Expression(x=filename, Expression="Format(\"{0} Loads, by zone\", x)")
merge = Merge(
    Data1=ColourSwatch(SwatchColor=RGB(0, 123, 255)),
    Data2=ColourSwatch(SwatchColor=RGB(157, 0, 255)),
    Data3=ColourSwatch(SwatchColor=RGB(255, 0, 0)),
    Data4=ColourSwatch(SwatchColor=RGB(255, 157, 0)),
    Data5=ColourSwatch(SwatchColor=RGB(112, 0, 0)),
    Data6=ColourSwatch(SwatchColor=RGB(0, 4, 212)),
    Data7=ColourSwatch(SwatchColor=RGB(255, 0, 242)),
    Data8=ColourSwatch(SwatchColor=RGB(0, 255, 0)),
    Data9=ColourSwatch(SwatchColor=RGB(255, 82, 82)),
    Data10=ColourSwatch(SwatchColor=RGB(135, 193, 255)),
    Data11=ColourSwatch(SwatchColor=RGB(255, 176, 92)),
    Data12=ColourSwatch(SwatchColor=RGB(206, 128, 255)))

addition = Addition(A=core_depth, B=perim_depth)
multiplication = Multiplication(A=core_depth, B=width)
multiplication_2 = Multiplication(A=perim_depth, B=width)
perim_a = Data(multiplication_2)
multiplication_3 = Multiplication(A=addition, B=width)
division = Division(A=multiplication, B=multiplication_3)
core_weight = Data(division)
subtraction = Subtraction(A=1, B=core_weight)
perim_weight = Data(subtraction)
merge_2 = Merge(Data1=core_weight, Data2=perim_weight)  # -> simplify(graft(Result))
panel_5 = Panel(merge_2)

expression_2 = Expression(x=filename, Expression="Format(\"{0} Loads, total\", x)")
panel_6 = Panel("""Cooling, CS
Heating, CS
Cooling, WB
Heating, WB
Cooling, surr
Heating, surr""")
merge_3 = Merge(
    Data1=ColourSwatch(SwatchColor=RGB(0, 123, 255)),
    Data2=ColourSwatch(SwatchColor=RGB(255, 0, 0)),
    Data3=ColourSwatch(SwatchColor=RGB(0, 4, 212)),
    Data4=ColourSwatch(SwatchColor=RGB(255, 157, 0)),
    Data5=ColourSwatch(SwatchColor=RGB(0, 255, 0)),
    Data6=ColourSwatch(SwatchColor=RGB(255, 82, 82)))
panel_7 = Panel("""Heating
Cooling""")
panel_8 = Panel("""Core C
Perim C
Core H
Perim H""")
panel_9 = Panel("""Core H
Core C
Perim H
Perim C""")
merge_4 = Merge(
    Data1=ColourSwatch(SwatchColor=RGB(0, 123, 255)),
    Data2=ColourSwatch(SwatchColor=RGB(255, 0, 0)),
    Data3=ColourSwatch(SwatchColor=RGB(255, 157, 0)),
    Data4=ColourSwatch(SwatchColor=RGB(157, 0, 255)))
merge_5 = Merge(
    Data1=ColourSwatch(SwatchColor=RGB(255, 0, 0)),
    Data2=ColourSwatch(SwatchColor=RGB(0, 123, 255)),
    Data3=ColourSwatch(SwatchColor=RGB(255, 157, 0)),
    Data4=ColourSwatch(SwatchColor=RGB(157, 0, 255)))

# ---- group: ROOF CONSTRUCTION
roof_concrete_thickness = Panel("0.203")
roof_xps_thickness = Panel("0.4")

# ---- group: FACADE CONSTRUCTION
wall_concrete_thickness = Panel("0.203")
wall_insul_thickness = Panel("0.05")

# ---- group: SLAB CONSTRUCTION
slab_insul_thickness = Panel("0.151")

# ----
material = ConstructCSOpaqueMaterial(
    Name="Partition Plaster",
    Conductivity=1,
    Density=2000,
    Roughness="Rough",
    SpecificHeat=1130,
    ThermalAbsorptance=0.9,
    SolarAbsorptance=0.7,
    VisibleAbsorptance=0.7,
    Type="Finishes",
    Input_0_Hidden=False,
    Input_0_Name="Name",
    Input_10_Hidden=True,
    Input_10_Name="TemperatureCoefficientThermalConductivity",
    Input_11_Hidden=True,
    Input_11_Name="TemperatureArray",
    Input_12_Hidden=True,
    Input_12_Name="EnthalpyArray",
    Input_13_Hidden=True,
    Input_13_Name="VariableConductivityArray",
    Input_14_Hidden=False,
    Input_14_Name="Type",
    Input_15_Hidden=True,
    Input_15_Name="EmbodiedEnergy",
    Input_16_Hidden=True,
    Input_16_Name="EmbodiedCarbon",
    Input_17_Hidden=True,
    Input_17_Name="Cost",
    Input_18_Hidden=True,
    Input_18_Name="Life",
    Input_1_Hidden=False,
    Input_1_Name="Conductivity",
    Input_2_Hidden=False,
    Input_2_Name="Density",
    Input_3_Hidden=False,
    Input_3_Name="Roughness",
    Input_4_Hidden=False,
    Input_4_Name="SpecificHeat",
    Input_5_Hidden=False,
    Input_5_Name="ThermalAbsorptance"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)
material_2 = ConstructCSOpaqueMaterial(
    Name="Stucco",
    Conductivity=0.72,
    Density=1856,
    Roughness="Rough",
    SpecificHeat=840,
    ThermalAbsorptance=0.9,
    SolarAbsorptance=0.7,
    VisibleAbsorptance=0.7,
    Type="Sealing",
    Input_0_Hidden=False,
    Input_0_Name="Name",
    Input_10_Hidden=True,
    Input_10_Name="TemperatureCoefficientThermalConductivity",
    Input_11_Hidden=True,
    Input_11_Name="TemperatureArray",
    Input_12_Hidden=True,
    Input_12_Name="EnthalpyArray",
    Input_13_Hidden=True,
    Input_13_Name="VariableConductivityArray",
    Input_14_Hidden=False,
    Input_14_Name="Type",
    Input_15_Hidden=True,
    Input_15_Name="EmbodiedEnergy",
    Input_16_Hidden=True,
    Input_16_Name="EmbodiedCarbon",
    Input_17_Hidden=True,
    Input_17_Name="Cost",
    Input_18_Hidden=True,
    Input_18_Name="Life",
    Input_1_Hidden=False,
    Input_1_Name="Conductivity",
    Input_2_Hidden=False,
    Input_2_Name="Density",
    Input_3_Hidden=False,
    Input_3_Name="Roughness",
    Input_4_Hidden=False,
    Input_4_Name="SpecificHeat",
    Input_5_Hidden=False,
    Input_5_Name="ThermalAbsorptance"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)
material_3 = ConstructCSOpaqueMaterial(
    Name="Plaster",
    Conductivity=1,
    Density=2000,
    Roughness="Rough",
    SpecificHeat=1130,
    ThermalAbsorptance=0.9,
    SolarAbsorptance=0.7,
    VisibleAbsorptance=0.7,
    Type="Sealing",
    Input_0_Hidden=False,
    Input_0_Name="Name",
    Input_10_Hidden=True,
    Input_10_Name="TemperatureCoefficientThermalConductivity",
    Input_11_Hidden=True,
    Input_11_Name="TemperatureArray",
    Input_12_Hidden=True,
    Input_12_Name="EnthalpyArray",
    Input_13_Hidden=True,
    Input_13_Name="VariableConductivityArray",
    Input_14_Hidden=False,
    Input_14_Name="Type",
    Input_15_Hidden=True,
    Input_15_Name="EmbodiedEnergy",
    Input_16_Hidden=True,
    Input_16_Name="EmbodiedCarbon",
    Input_17_Hidden=True,
    Input_17_Name="Cost",
    Input_18_Hidden=True,
    Input_18_Name="Life",
    Input_1_Hidden=False,
    Input_1_Name="Conductivity",
    Input_2_Hidden=False,
    Input_2_Name="Density",
    Input_3_Hidden=False,
    Input_3_Name="Roughness",
    Input_4_Hidden=False,
    Input_4_Name="SpecificHeat",
    Input_5_Hidden=False,
    Input_5_Name="ThermalAbsorptance"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)
material_4 = ConstructCSOpaqueMaterial(
    Name="Carpet",
    Conductivity=0.6,
    Density=288,
    Roughness="Rough",
    SpecificHeat=1380,
    ThermalAbsorptance=0.9,
    SolarAbsorptance=0.7,
    VisibleAbsorptance=0.7,
    Type="Finishes",
    Input_0_Hidden=False,
    Input_0_Name="Name",
    Input_10_Hidden=True,
    Input_10_Name="TemperatureCoefficientThermalConductivity",
    Input_11_Hidden=True,
    Input_11_Name="TemperatureArray",
    Input_12_Hidden=True,
    Input_12_Name="EnthalpyArray",
    Input_13_Hidden=True,
    Input_13_Name="VariableConductivityArray",
    Input_14_Hidden=False,
    Input_14_Name="Type",
    Input_15_Hidden=True,
    Input_15_Name="EmbodiedEnergy",
    Input_16_Hidden=True,
    Input_16_Name="EmbodiedCarbon",
    Input_17_Hidden=True,
    Input_17_Name="Cost",
    Input_18_Hidden=True,
    Input_18_Name="Life",
    Input_1_Hidden=False,
    Input_1_Name="Conductivity",
    Input_2_Hidden=False,
    Input_2_Name="Density",
    Input_3_Hidden=False,
    Input_3_Name="Roughness",
    Input_4_Hidden=False,
    Input_4_Name="SpecificHeat",
    Input_5_Hidden=False,
    Input_5_Name="ThermalAbsorptance"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)
material_5 = ConstructCSOpaqueMaterial(
    Name="Mineral Wool",
    Conductivity=0.041,
    Density=155,
    Roughness="Rough",
    SpecificHeat=1130,
    ThermalAbsorptance=0.9,
    SolarAbsorptance=0.7,
    VisibleAbsorptance=0.7,
    Type="Sealing",
    Input_0_Hidden=False,
    Input_0_Name="Name",
    Input_10_Hidden=True,
    Input_10_Name="TemperatureCoefficientThermalConductivity",
    Input_11_Hidden=True,
    Input_11_Name="TemperatureArray",
    Input_12_Hidden=True,
    Input_12_Name="EnthalpyArray",
    Input_13_Hidden=True,
    Input_13_Name="VariableConductivityArray",
    Input_14_Hidden=False,
    Input_14_Name="Type",
    Input_15_Hidden=True,
    Input_15_Name="EmbodiedEnergy",
    Input_16_Hidden=True,
    Input_16_Name="EmbodiedCarbon",
    Input_17_Hidden=True,
    Input_17_Name="Cost",
    Input_18_Hidden=True,
    Input_18_Name="Life",
    Input_1_Hidden=False,
    Input_1_Name="Conductivity",
    Input_2_Hidden=False,
    Input_2_Name="Density",
    Input_3_Hidden=False,
    Input_3_Name="Roughness",
    Input_4_Hidden=False,
    Input_4_Name="SpecificHeat",
    Input_5_Hidden=False,
    Input_5_Name="ThermalAbsorptance"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)
material_6 = ConstructCSOpaqueMaterial(
    Name="WallConcrete",
    Conductivity=2,
    Density=2400,
    Roughness="Rough",
    SpecificHeat=950,
    ThermalAbsorptance=0.9,
    SolarAbsorptance=0.7,
    VisibleAbsorptance=0.7,
    Type="Concrete",
    Input_0_Hidden=False,
    Input_0_Name="Name",
    Input_10_Hidden=True,
    Input_10_Name="TemperatureCoefficientThermalConductivity",
    Input_11_Hidden=True,
    Input_11_Name="TemperatureArray",
    Input_12_Hidden=True,
    Input_12_Name="EnthalpyArray",
    Input_13_Hidden=True,
    Input_13_Name="VariableConductivityArray",
    Input_14_Hidden=False,
    Input_14_Name="Type",
    Input_15_Hidden=True,
    Input_15_Name="EmbodiedEnergy",
    Input_16_Hidden=True,
    Input_16_Name="EmbodiedCarbon",
    Input_17_Hidden=True,
    Input_17_Name="Cost",
    Input_18_Hidden=True,
    Input_18_Name="Life",
    Input_1_Hidden=False,
    Input_1_Name="Conductivity",
    Input_2_Hidden=False,
    Input_2_Name="Density",
    Input_3_Hidden=False,
    Input_3_Name="Roughness",
    Input_4_Hidden=False,
    Input_4_Name="SpecificHeat",
    Input_5_Hidden=False,
    Input_5_Name="ThermalAbsorptance"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)
material_7 = ConstructCSOpaqueMaterial(
    Name="Felt",
    Conductivity=0.9,
    Density=0.5,
    Roughness="Rough",
    SpecificHeat=1800,
    ThermalAbsorptance=0.9,
    SolarAbsorptance=0.7,
    VisibleAbsorptance=0.7,
    Type="Sealing",
    Input_0_Hidden=False,
    Input_0_Name="Name",
    Input_10_Hidden=True,
    Input_10_Name="TemperatureCoefficientThermalConductivity",
    Input_11_Hidden=True,
    Input_11_Name="TemperatureArray",
    Input_12_Hidden=True,
    Input_12_Name="EnthalpyArray",
    Input_13_Hidden=True,
    Input_13_Name="VariableConductivityArray",
    Input_14_Hidden=False,
    Input_14_Name="Type",
    Input_15_Hidden=True,
    Input_15_Name="EmbodiedEnergy",
    Input_16_Hidden=True,
    Input_16_Name="EmbodiedCarbon",
    Input_17_Hidden=True,
    Input_17_Name="Cost",
    Input_18_Hidden=True,
    Input_18_Name="Life",
    Input_1_Hidden=False,
    Input_1_Name="Conductivity",
    Input_2_Hidden=False,
    Input_2_Name="Density",
    Input_3_Hidden=False,
    Input_3_Name="Roughness",
    Input_4_Hidden=False,
    Input_4_Name="SpecificHeat",
    Input_5_Hidden=False,
    Input_5_Name="ThermalAbsorptance"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)
material_8 = ConstructCSOpaqueMaterial(
    Name="Concrete",
    Conductivity=2,
    Density=2100,
    Roughness="Rough",
    SpecificHeat=1040,
    ThermalAbsorptance=0.9,
    SolarAbsorptance=0.7,
    VisibleAbsorptance=0.7,
    Type="Concrete",
    Input_0_Hidden=False,
    Input_0_Name="Name",
    Input_10_Hidden=True,
    Input_10_Name="TemperatureCoefficientThermalConductivity",
    Input_11_Hidden=True,
    Input_11_Name="TemperatureArray",
    Input_12_Hidden=True,
    Input_12_Name="EnthalpyArray",
    Input_13_Hidden=True,
    Input_13_Name="VariableConductivityArray",
    Input_14_Hidden=False,
    Input_14_Name="Type",
    Input_15_Hidden=True,
    Input_15_Name="EmbodiedEnergy",
    Input_16_Hidden=True,
    Input_16_Name="EmbodiedCarbon",
    Input_17_Hidden=True,
    Input_17_Name="Cost",
    Input_18_Hidden=True,
    Input_18_Name="Life",
    Input_1_Hidden=False,
    Input_1_Name="Conductivity",
    Input_2_Hidden=False,
    Input_2_Name="Density",
    Input_3_Hidden=False,
    Input_3_Name="Roughness",
    Input_4_Hidden=False,
    Input_4_Name="SpecificHeat",
    Input_5_Hidden=False,
    Input_5_Name="ThermalAbsorptance"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)
material_9 = ConstructCSOpaqueMaterial(
    Name="AcousticTile",
    Conductivity=0.06,
    Density=368,
    Roughness="Rough",
    SpecificHeat=590,
    ThermalAbsorptance=0.9,
    SolarAbsorptance=0.7,
    VisibleAbsorptance=0.7,
    Type="Finishes",
    Input_0_Hidden=False,
    Input_0_Name="Name",
    Input_10_Hidden=True,
    Input_10_Name="TemperatureCoefficientThermalConductivity",
    Input_11_Hidden=True,
    Input_11_Name="TemperatureArray",
    Input_12_Hidden=True,
    Input_12_Name="EnthalpyArray",
    Input_13_Hidden=True,
    Input_13_Name="VariableConductivityArray",
    Input_14_Hidden=False,
    Input_14_Name="Type",
    Input_15_Hidden=True,
    Input_15_Name="EmbodiedEnergy",
    Input_16_Hidden=True,
    Input_16_Name="EmbodiedCarbon",
    Input_17_Hidden=True,
    Input_17_Name="Cost",
    Input_18_Hidden=True,
    Input_18_Name="Life",
    Input_1_Hidden=False,
    Input_1_Name="Conductivity",
    Input_2_Hidden=False,
    Input_2_Name="Density",
    Input_3_Hidden=False,
    Input_3_Name="Roughness",
    Input_4_Hidden=False,
    Input_4_Name="SpecificHeat",
    Input_5_Hidden=False,
    Input_5_Name="ThermalAbsorptance"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)
material_10 = ConstructCSOpaqueMaterial(
    Name="XPS",
    Conductivity=0.034,
    Density=35,
    Roughness="Rough",
    SpecificHeat=1400,
    ThermalAbsorptance=0.9,
    SolarAbsorptance=0.7,
    VisibleAbsorptance=0.7,
    Type="Insulation",
    Input_0_Hidden=False,
    Input_0_Name="Name",
    Input_10_Hidden=True,
    Input_10_Name="TemperatureCoefficientThermalConductivity",
    Input_11_Hidden=True,
    Input_11_Name="TemperatureArray",
    Input_12_Hidden=True,
    Input_12_Name="EnthalpyArray",
    Input_13_Hidden=True,
    Input_13_Name="VariableConductivityArray",
    Input_14_Hidden=False,
    Input_14_Name="Type",
    Input_15_Hidden=True,
    Input_15_Name="EmbodiedEnergy",
    Input_16_Hidden=True,
    Input_16_Name="EmbodiedCarbon",
    Input_17_Hidden=True,
    Input_17_Name="Cost",
    Input_18_Hidden=True,
    Input_18_Name="Life",
    Input_1_Hidden=False,
    Input_1_Name="Conductivity",
    Input_2_Hidden=False,
    Input_2_Name="Density",
    Input_3_Hidden=False,
    Input_3_Name="Roughness",
    Input_4_Hidden=False,
    Input_4_Name="SpecificHeat",
    Input_5_Hidden=False,
    Input_5_Name="ThermalAbsorptance"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)

# ---- group: WallInsul
layer = ConstructCSLayer(Material=material_3, Thickness="0.013")

# ---- group: WallConcrete
layer_2 = ConstructCSLayer(Material=material_6, Thickness=wall_concrete_thickness)

# ---- group: WallInsul
layer_3 = ConstructCSLayer(Material=material_5, Thickness=wall_insul_thickness)

layer_4 = ConstructCSLayer(Material=material_2, Thickness="0.025")

# ---- group: RoofFelt
layer_5 = ConstructCSLayer(Material=material_7, Thickness="0.003")

# ---- group: RoofConcrete
layer_6 = ConstructCSLayer(Material=material_8, Thickness=roof_concrete_thickness)

# ---- group: RoofTile
layer_7 = ConstructCSLayer(Material=material_9, Thickness="0.005")

# ---- group: RoofXPS
layer_8 = ConstructCSLayer(Material=material_10, Thickness=roof_xps_thickness)

# ---- group: GroundCarpet
layer_9 = ConstructCSLayer(Material=material, Thickness="0.013")

# ---- group: GroundConcrete
layer_10 = ConstructCSLayer(Material=material_6, Thickness="0.203")

# ---- group: GroundCarpet
layer_11 = ConstructCSLayer(Material=material_4, Thickness="0.02")

# ---- group: GroundXPS
layer_12 = ConstructCSLayer(Material=material_10, Thickness=slab_insul_thickness)

# ----
relay = Relay([layer_8, layer_6, layer_7, layer_5])

dup = DuplicateData(Data=layer_9, Number=2, Order=True)
construction = ConstructCSConstruction(
    Name="CustomExteriorRoof",
    Category="Roof",
    Layers=relay,
    Input_0_Hidden=False,
    Input_0_Name="Name",
    Input_1_Hidden=False,
    Input_1_Name="Category",
    Input_2_Hidden=False,
    Input_2_Name="Layers",
    Input_3_Hidden=True,
    Input_3_Name="EmbodiedEnergy",
    Input_4_Hidden=True,
    Input_4_Name="EmbodiedCarbon",
    Input_5_Hidden=True,
    Input_5_Name="Cost",
    Input_6_Hidden=True,
    Input_6_Name="Life",
    UnitSystem=4,
    Input_3_GHParam_Branch0_Path="{0}",
    Input_3_GHParam_Branch0_Item0_number=0,
    Input_4_GHParam_Branch0_Path="{0}",
    Input_4_GHParam_Branch0_Item0_number=0,
    Input_5_GHParam_Branch0_Path="{0}",
    Input_5_GHParam_Branch0_Item0_number=0,
    Input_6_GHParam_Branch0_Path="{0}",
    Input_6_GHParam_Branch0_Item0_number=10)  # -> Construction, ConstructionInformation
construction_2 = ConstructCSConstruction(
    Name="CustomGroundSlab",
    Category="GroundFloor",
    Layers=flatten([layer_12, layer_10, layer_11]),
    Input_0_Hidden=False,
    Input_0_Name="Name",
    Input_1_Hidden=False,
    Input_1_Name="Category",
    Input_2_Hidden=False,
    Input_2_Name="Layers",
    Input_3_Hidden=True,
    Input_3_Name="EmbodiedEnergy",
    Input_4_Hidden=True,
    Input_4_Name="EmbodiedCarbon",
    Input_5_Hidden=True,
    Input_5_Name="Cost",
    Input_6_Hidden=True,
    Input_6_Name="Life",
    UnitSystem=4,
    Input_3_GHParam_Branch0_Path="{0}",
    Input_3_GHParam_Branch0_Item0_number=0,
    Input_4_GHParam_Branch0_Path="{0}",
    Input_4_GHParam_Branch0_Item0_number=0,
    Input_5_GHParam_Branch0_Path="{0}",
    Input_5_GHParam_Branch0_Item0_number=0,
    Input_6_GHParam_Branch0_Path="{0}",
    Input_6_GHParam_Branch0_Item0_number=10)  # -> Construction, ConstructionInformation
construction_3 = ConstructCSConstruction(
    Name="CustomInteriorPartition",
    Category="Facade",
    Layers=flatten(dup),
    Input_0_Hidden=False,
    Input_0_Name="Name",
    Input_1_Hidden=False,
    Input_1_Name="Category",
    Input_2_Hidden=False,
    Input_2_Name="Layers",
    Input_3_Hidden=True,
    Input_3_Name="EmbodiedEnergy",
    Input_4_Hidden=True,
    Input_4_Name="EmbodiedCarbon",
    Input_5_Hidden=True,
    Input_5_Name="Cost",
    Input_6_Hidden=True,
    Input_6_Name="Life",
    UnitSystem=4,
    Input_3_GHParam_Branch0_Path="{0}",
    Input_3_GHParam_Branch0_Item0_number=0,
    Input_4_GHParam_Branch0_Path="{0}",
    Input_4_GHParam_Branch0_Item0_number=0,
    Input_5_GHParam_Branch0_Path="{0}",
    Input_5_GHParam_Branch0_Item0_number=0,
    Input_6_GHParam_Branch0_Path="{0}",
    Input_6_GHParam_Branch0_Item0_number=10)  # -> Construction, ConstructionInformation
construction_4 = ConstructCSConstruction(
    Name="CustomExteriorWall",
    Category="Roof",
    Layers=flatten([layer_2, layer_3, layer, layer_4]),
    Input_0_Hidden=False,
    Input_0_Name="Name",
    Input_1_Hidden=False,
    Input_1_Name="Category",
    Input_2_Hidden=False,
    Input_2_Name="Layers",
    Input_3_Hidden=True,
    Input_3_Name="EmbodiedEnergy",
    Input_4_Hidden=True,
    Input_4_Name="EmbodiedCarbon",
    Input_5_Hidden=True,
    Input_5_Name="Cost",
    Input_6_Hidden=True,
    Input_6_Name="Life",
    UnitSystem=4,
    Input_3_GHParam_Branch0_Path="{0}",
    Input_3_GHParam_Branch0_Item0_number=0,
    Input_4_GHParam_Branch0_Path="{0}",
    Input_4_GHParam_Branch0_Item0_number=0,
    Input_5_GHParam_Branch0_Path="{0}",
    Input_5_GHParam_Branch0_Item0_number=0,
    Input_6_GHParam_Branch0_Path="{0}",
    Input_6_GHParam_Branch0_Item0_number=10)  # -> Construction, ConstructionInformation
python_2 = GhPythonScript(x=construction_2.ConstructionInformation)  # -> Rval, mass
# ---------- python_2: Python ----------
__author__ = "zoelh"
__version__ = "2023.11.21"

import rhinoscriptsyntax as rs
import re

Rval = None

s = re.sub(r'[^\w.\n]+', ' ', x)
s=s.replace(" ", '')
print(s)
Rval = float(s.split("RValuemKW")[1].split("\n")[0])
mass = float(s.split("CapacitancekJKm")[1].split("\n")[0])
print(Rval)
print(mass)
# ---------- end python_2 ----------

# ---- group: PARTITION CONSTRUCTION
panel_10 = Panel(construction_3.ConstructionInformation)
partition = Data(construction_3.Construction)

# ---- group: ROOF CONSTRUCTION (continued)
panel_11 = Panel(construction.ConstructionInformation)
exteriorroof = Data(construction.Construction)

# ---- group: SLAB CONSTRUCTION (continued)
panel_12 = Panel(construction_2.ConstructionInformation)
slab = Data(construction_2.Construction)

# ---- group: FACADE CONSTRUCTION (continued)
panel_13 = Panel(construction_4.ConstructionInformation)
exteriorwall = Data(construction_4.Construction)

# ----
panel_14 = Panel(relay)
python_3 = GhPythonScript(x=construction.ConstructionInformation)  # -> Rval, mass; same code as python_2
python_4 = GhPythonScript(x=construction_4.ConstructionInformation)  # -> Rval, mass; same code as python_2
mats = Data([material_10, material_8, material_9, material_7, material_6, material_5, material_3, material_2, material_4, material])
zset = CSZoneSettings(
    Name="ParametricZoneSettings",
    ZoneSettings=item,
    RoofConstruction=exteriorroof,
    FacadeConstruction=exteriorwall,
    SlabConstruction=slab,
    PartitionConstruction=partition,
    ExternalFloorConstruction=slab,
    InternalMassConstruction=partition,
    InternalMassExposedArea=Slider(0, range=0..1),
    GroundSlabConstruction=slab,
    PeopleDensity=peopledensity_ppl_m2,
    AirspeedSchedule="AirSpeed 0",
    EquipmentPowerDensity=epd_w_m2,
    LightingPowerDensity=lpd_w_m2,
    OccupancySchedule=year_schedule.Sched,
    EquipmentAvailabilitySchedule=year_schedule_2.Sched,
    LightsAvailabilitySchedule=year_schedule_3.Sched,
    DimmingType=dimmingtype,
    PeopleIsOn=people_equip_lightson,
    EquipmentIsOn=people_equip_lightson,
    LightsIsOn=people_equip_lightson,
    CoolingCOP=Slider(1, range=0.6..6),
    HeatingCOP=Slider(1, range=0.6..6),
    HeatingSetpoint=heatingsetpoint_degc,
    CoolingSetpoint=coolingsetpoint_degc,
    HeatingSetpointConstant=heating_coolingconstant,
    CoolingSetpointConstant=heating_coolingconstant,
    HeatIsOn=heating_coolingon,
    CoolIsOn=heating_coolingon,
    MechVentIsOn=mechventon,
    HumidistatIsOn=humidistaton,
    HeatingLimitType="NoLimit",
    CoolingLimitType="LimitFlowRateAndCapacity",
    HeatingSchedule="AllOn",
    CoolingSchedule="AllOn",
    MechVentSchedule=occupancy,
    MinFreshAirPerson=ventilationperperson_l_s_person,
    MinFreshAirArea=ventilationperarea_l_s_m2,
    EconomizerType=econ,
    HeatRecoveryType=hrv,
    HeatRecoveryEfficiencySensible="0.7",
    HeatRecoveryEfficiencyLatent="0.65",
    MinHumidity="20",
    MaxHumidity="80",
    TurnOnEMSFanEnergy=fanenergy,
    MaxHeatSupplyAirTemp="30",
    MinCoolSupplyAirTemp="18",
    NatVentIsOn=natventon,
    SchedVentIsOn=scheduledventilationon,
    ScheduledVentilationAvailability="Off",
    NaturalVentilationSchedule="Off",
    StackDrivenFlow=scheduledventilationon_2,
    Crossventilation=scheduledventilationon_2,
    InfiltrationIsOn=infiltrationon,
    InfiltrationAch=infiltration_ach,
    InfiltrationFlowExtArea=infiltration_m3_s_m2,
    InfiltrationCalculationMethod=infiltrationmethod,
    AFNAirMassFlowCoefficientCrack=0.001,
    FlowRatePerPerson="0",
    DHWOn=dhwon,
    Input_0_Hidden=False,
    Input_0_Name="Name",
    Input_100_Hidden=True,
    Input_100_Name="Interior Vertical Insulation Depth",
    Input_101_Hidden=True,
    Input_101_Name="Exterior Horizontal Insulation Depth",
    Input_102_Hidden=True,
    Input_102_Name="Exterior Horizontal Insulation Width",
    Input_103_Hidden=True,
    Input_103_Name="Footing Thickness",
    Input_104_Hidden=True,
    Input_104_Name="Footing Depth",
    Input_105_Hidden=True,
    Input_105_Name="ElectricityCO2",
    Input_106_Hidden=True,
    Input_106_Name="ElectricityCost",
    Input_107_Hidden=True,
    Input_107_Name="HotWaterCO2",
    Input_108_Hidden=True,
    Input_108_Name="HotWaterCost",
    Input_109_Hidden=True,
    Input_109_Name="CoolingCO2",
    Input_10_Hidden=True,
    Input_10_Name="Ground Wall Construction",
    Input_110_Hidden=True,
    Input_110_Name="HeatingCO2",
    Input_111_Hidden=True,
    Input_111_Name="CoolingCost",
    Input_112_Hidden=True,
    Input_112_Name="HeatingCost"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)

# ----
# Zone Settings
zone = ThermalZone(Brep=core, Name="Core", Settings=zset, UsedLibraryObjects="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")  # -> Zones, Settings
zone_2 = ThermalZone(Brep=perim, Name="Perimeter", Settings=zset, UsedLibraryObjects="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")  # -> Zones, Settings

library = CSLibrary(AddObjects=flatten([year_schedule_2.Sched, year_schedule_3.Sched, year_schedule.Sched, simple_window, exteriorroof, exteriorwall, slab, partition, mats]))

# ----
# Simulate
networker = Networker(
    Zones=flatten([zone.Zones, zone_2.Zones]),
    Windows=window_2.Window,
    Boundaries=flatten([bco, bco_2]),
    Library=library,
    preview_displayAdia=True,
    preview_displayExtFloor=True,
    preview_displayFacades=True,
    preview_displayGround=True,
    preview_displayParts=True,
    preview_displayRoofs=True,
    preview_displayShade=True,
    preview_displaySlabs=True,
    preview_displayWins=True)
run_e = RunCSEnergyModel(
    Model=networker,
    Name=filename,
    Directory=output_directory,
    Location=epw,
    Run=button,
    settings="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")  # -> Model, Settings, Result

demodel = DeconstructCSEnergyModel(
    Model=networker,
    Output_0_Hidden=False,
    Output_0_Name="Facade",
    Output_10_Hidden=False,
    Output_10_Name="Adiabatic Roof",
    Output_11_Hidden=False,
    Output_11_Name="Window",
    Output_12_Hidden=False,
    Output_12_Name="Internal Window",
    Output_13_Hidden=False,
    Output_13_Name="Shading",
    Output_14_Hidden=True,
    Output_14_Name="Face ID",
    Output_15_Hidden=True,
    Output_15_Name="ID Location",
    Output_16_Hidden=True,
    Output_16_Name="Area",
    Output_17_Hidden=True,
    Output_17_Name="Zone Settings",
    Output_18_Hidden=True,
    Output_18_Name="Window Settings",
    Output_19_Hidden=True,
    Output_19_Name="Internal Window Settings",
    Output_1_Hidden=False,
    Output_1_Name="Partition",
    Output_2_Hidden=False,
    Output_2_Name="Ceiling",
    Output_3_Hidden=False,
    Output_3_Name="Roof",
    Output_4_Hidden=False,
    Output_4_Name="External Floor"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)  # -> Facade, Partition, Ceiling, Roof, ExternalFloor, Floor, FloorGround, WallGround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

# ----
# Save building settings
python_5 = GhPythonScript(
    w=width,
    h=height,
    pd=perim_depth,
    cd=core_depth,
    r=roof,
    g=ground,
    wwr=wwr,
    o=orientation,
    sched=number_slider,
    RoofRval=python_3.Rval,
    RoofMass=python_3.mass,
    WallRval=python_4.Rval,
    WallMass=python_4.mass,
    SlabRval=python_2.Rval)  # -> d
# ---------- python_5: Python ----------
__author__ = "zoelh"
__version__ = "2023.11.18"

import rhinoscriptsyntax as rs
import json

d= dict(
    ShoeboxConfig=dict(
        width=w,
        height=h,
        perim_depth=pd,
        core_depth=cd,
        adiabatic_partition_flag=0,
        roof_2_footprint=1 if r else 0,
        ground_2_footprint=1 if g else 0,
        wwr=wwr,
        orientation=o,
        shading_vect=[0]*12,
        schedule_index=int(sched),
        RoofRValue = RoofRval,
        RoofMass = RoofMass,
        FacadeRValue = WallRval,
        FacadeMass = WallMass,
        SlabRValue = SlabRval,
    )
)
d = json.dumps(d)
print(d)
# ---------- end python_5 ----------
python_6 = GhPythonScript(name="windowtest", shgc=number_slider_2, uval=number_slider_3, tvis=tvis)  # -> d
# ---------- python_6: Python ----------
__author__ = "zoelh"
__version__ = "2023.11.18"

import rhinoscriptsyntax as rs
import json

d= dict(
    SimpleWindow=dict(
        Name=name,
        shgc=shgc,
        uval=uval,
        tvis=tvis,
    )
)
d = json.dumps(d)
print(d)
# ---------- end python_6 ----------
jmerge = MergeJson(SourceJson=python_6, OverrideJson=python_5)
jmerge_2 = MergeJson(SourceJson=jmerge, OverrideJson=zset)
panel_15 = Panel(jmerge_2)
python_7 = GhPythonScript(set=jmerge_2, name=filename, dir=output_directory, save=button)
# ---------- python_7: Python ----------
__author__ = "zoelh"
__version__ = "2023.11.18"

import rhinoscriptsyntax as rs
import json

if save:
    fname = dir + name + ".json"
    print(fname)
    with open(fname, "w") as f:
        json.dump(json.loads(set), f, indent=4)
# ---------- end python_7 ----------

toggle = BooleanToggle(True)
load_zone_results = LoadCSZoneResults(
    ThermalModel=run_e.Model,
    Toggle=toggle,
    byzone="True",
    settings="""{
  "zoneIDs": [],
  "output2Display": [
    {
      "key": "Zone Ideal Loads Zone Total Heating Energy",
      "unit": "HVAC Sum [J]",
      "type": 0
    }
  ],
  "normalizeByFloorArea": false
}""")  # -> ResultsPerZone, Labels, Name, Zone
load_zone_results_2 = LoadCSZoneResults(
    ThermalModel=run_e.Model,
    Toggle=toggle,
    byzone="True",
    settings="""{
  "zoneIDs": [],
  "output2Display": [
    {
      "key": "Zone Ideal Loads Zone Total Cooling Energy",
      "unit": "HVAC Sum [J]",
      "type": 0
    }
  ],
  "normalizeByFloorArea": false
}""")  # -> ResultsPerZone, Labels, Name, Zone
panel_16 = Panel(load_zone_results.Labels)
panel_17 = Panel(load_zone_results_2.Name)
panel_18 = Panel(load_zone_results_2.Labels)
panel_19 = Panel(load_zone_results.Name)
joules_to_kw = JoulesToKW(A=load_zone_results.ResultsPerZone)
joules_to_kw_2 = JoulesToKW(A=load_zone_results_2.ResultsPerZone)
merge_6 = Merge(Data1=multiplication, Data2=perim_a)  # -> simplify(graft(Result))
python_8 = GhPythonScript(x=joules_to_kw_2)  # -> monthly, months; inputs x: list
# ---------- python_8: Python ----------
__author__ = "zoelh"
__version__ = "2023.11.18"

import rhinoscriptsyntax as rs

month_map = {
    "Jan": 744,
    "Feb": 672,
    "Mar": 744,
    "Apr": 720,
    "May": 744,
    "Jun": 720,
    "Jul": 744,
    "Aug": 744,
    "Sep": 720,
    "Oct": 744,
    "Nov": 720,
    "Dec": 744,
}

monthly = []
months = list(month_map.keys())
c=0
for _, hours in month_map.items():
    m = sum(x[c : c + hours])
    print(m)
    monthly.append(m)
    c += hours
# ---------- end python_8 ----------
python_9 = GhPythonScript(x=joules_to_kw)  # -> monthly, months; inputs x: list; same code as python_8
ma = MassAddition(Input=joules_to_kw_2)  # -> Result, PartialResults
division_2 = Division(A=python_9.monthly, B=merge_6)
division_3 = Division(A=python_8.monthly, B=merge_6)
panel_20 = Panel(merge_6)
panel_21 = Panel(ma.Result)
flip = FlipMatrix(Data=division_2)
flip_2 = FlipMatrix(Data=division_3)
merge_7 = Merge(Data1=flip_2, Data2=flip)

ma_2 = MassAddition(Input=division_2)  # -> Result, PartialResults
ma_3 = MassAddition(Input=division_3)  # -> Result, PartialResults
bang_2 = ExplodeTree(Data=ma_3.Result)  # -> Branch0, Branch1
bang_3 = ExplodeTree(Data=ma_2.Result)  # -> Branch0, Branch1
core_cooling_eui_kwh_m2_a = Panel(bang_2.Branch0)
core_heating_eui_kwh_m2_a = Panel(bang_3.Branch0)
perim_cooling_eui_kwh_m2_a = Panel(bang_2.Branch1)
perim_heating_eui_kwh_m2_a = Panel(bang_3.Branch1)

merge_8 = Merge(Data1=multiplication, Data2=multiplication, Data3=perim_a, Data4=perim_a)  # -> simplify(graft(Result))
division_4 = Division(A=merge_8, B=2)
division_5 = Division(A=load_zone_results_2.ResultsPerZone, B=division_4)
bang_4 = ExplodeTree(Data=division_5)  # -> Branch0, Branch1, Branch2, Branch3
addition_2 = Addition(A=bang_4.Branch2, B=bang_4.Branch3)
addition_3 = Addition(A=bang_4.Branch0, B=bang_4.Branch1)
merge_9 = Merge(Data1=addition_3, Data2=addition_2)

division_6 = Division(A=merge_8, B=2)
division_7 = Division(A=load_zone_results.ResultsPerZone, B=division_6)
bang_5 = ExplodeTree(Data=division_7)  # -> Branch0, Branch1, Branch2, Branch3
addition_4 = Addition(A=bang_5.Branch2, B=bang_5.Branch3)
addition_5 = Addition(A=bang_5.Branch0, B=bang_5.Branch1)
merge_10 = Merge(Data1=addition_5, Data2=addition_4)

multiplication_4 = Multiplication(A=division_3, B=merge_2)
multiplication_5 = Multiplication(A=division_2, B=merge_2)
bang_6 = ExplodeTree(Data=multiplication_4)  # -> Branch0, Branch1
bang_7 = ExplodeTree(Data=multiplication_5)  # -> Branch0, Branch1
addition_6 = Addition(A=bang_6.Branch0, B=bang_6.Branch1)
addition_7 = Addition(A=bang_7.Branch0, B=bang_7.Branch1)
merge_11 = Merge(Data1=graft(addition_6), Data2=graft(addition_7))  # -> simplify(Result)
flip_3 = FlipMatrix(Data=merge_11)

expression_3 = Expression(x=filename, Expression="Format(\"{0}_whitebox_out.csv\", x)")
expression_4 = Expression(x=filename, Expression="Format(\"{0}_surrogate_out.csv\", x)")
python_10 = GhPythonScript(name=expression_4, path=output_directory, fetch=fetch_push_results)  # -> simplify(data)
# ---------- python_10: Python ----------
__author__ = "zoelh"
__version__ = "2023.11.18"

import rhinoscriptsyntax as rs
import csv
import ghpythonlib.treehelpers as th

filename = path + name
print(filename)
with open(filename) as csvfile:
    reader = csv.reader(csvfile)
    rows = list(reader)
if fetch:
    with open(filename) as csvfile:
        reader = csv.reader(csvfile)
        rows = list(reader)

data = th.list_to_tree(rows)
# ---------- end python_10 ----------
python_11 = GhPythonScript(name=expression_3, path=output_directory, fetch=fetch_push_results)  # -> simplify(data); same code as python_10
flip_4 = FlipMatrix(Data=python_11)
flip_5 = FlipMatrix(Data=python_10)
dup_2 = DuplicateData(Data=core_weight, Number=2, Order=True)
dup_3 = DuplicateData(Data=perim_weight, Number=2, Order=True)
dup_4 = DuplicateData(Data=core_weight, Number=2, Order=True)
dup_5 = DuplicateData(Data=perim_weight, Number=2, Order=True)
merge_12 = Merge(Data1=dup_2, Data2=dup_3)  # -> simplify(graft(Result))
merge_13 = Merge(Data1=dup_4, Data2=dup_5)  # -> simplify(graft(Result))
multiplication_6 = Multiplication(A=python_10, B=merge_12)
multiplication_7 = Multiplication(A=python_11, B=merge_13)
bang_8 = ExplodeTree(Data=multiplication_6)  # -> Branch0, Branch1, Branch2, Branch3
bang_9 = ExplodeTree(Data=multiplication_7)  # -> Branch0, Branch1, Branch2, Branch3
addition_8 = Addition(A=bang_8.Branch0, B=bang_8.Branch2)
addition_9 = Addition(A=bang_8.Branch1, B=bang_8.Branch3)
addition_10 = Addition(A=bang_9.Branch1, B=bang_9.Branch3)
addition_11 = Addition(A=bang_9.Branch0, B=bang_9.Branch2)
merge_14 = Merge(Data1=graft(addition_9), Data2=graft(addition_8))  # -> simplify(Result)
merge_15 = Merge(Data1=graft(addition_10), Data2=graft(addition_11))  # -> simplify(Result)
trim = TrimTree(Tree=merge_14, Depth=1)
trim_2 = TrimTree(Tree=merge_15, Depth=1)
flip_6 = FlipMatrix(Data=trim_2)
flip_7 = FlipMatrix(Data=trim)
merge_16 = Merge(Data1=merge_11, Data2=flip_6, Data3=flip_7)
flip_8 = FlipMatrix(Data=merge_16)

plotter = CSPlotter(
    Type=0,
    Width=550,
    Height=450,
    Title=expression_2,
    Y_title="Cooling Demand (kWh/m2)",
    X_rot=0,
    Y_data=flip_8,
    Colors=merge_3,
    Names=panel_6,
    Range=Slider(14, range=0..50),
    Show_xgrid=False,
    Show_ygrid=True,
    Legend=0,
    PreviewDimension=1,
    InfinateZoomDisplay=True,
    UnitSystem=4)
energy_results = LoadCSEnergyResult(ThermalModel=run_e.Model, Mode=0, Resolution=0, Toggle=Toggle(True))  # -> TotalEUI, Baseline, TotalCO2, TotalCost, FloorArea, Data, Labels, Months, Colors, CSR
flip_9 = FlipMatrix(Data=merge_7)
bang_10 = ExplodeTree(Data=energy_results.Data)  # -> Branch0, Branch1, Branch2, Branch3, Branch4, Branch5
merge_17 = Merge(Data1=bang_10.Branch4, Data2=bang_10.Branch5)

# ----
# Save CS results
python_12 = GhPythonScript(data=simplify(flip_9), outpath=output_directory, name=filename, save=fetch_push_results)  # -> out, a; inputs data: tree
# ---------- python_12: Python ----------
__author__ = "szvsw"
__version__ = "2023.11.15"

import rhinoscriptsyntax as rs
import ghpythonlib.treehelpers as th
import json

cols = ["Core_Cooling", "Perimeter_Cooling", "Core_Heating", "Perimeter_Heating"]

out = {}

assert data.BranchCount == len(cols)

for i, c in enumerate(cols):
    out[c] = [float(val) for val in data.Branch(i)]

print(out) 
fname=str(outpath)+name+"_CSresults.json"
if save:
    with open(fname,"w") as f:
        json.dump(out,f,indent=4)
# ---------- end python_12 ----------

xyplot = XYPlot(
    Type=2,
    Width=550,
    Height=450,
    Title="Total Energy Results (not loads)",
    X_labels=energy_results.Months,
    X_rot=0,
    Y_data=energy_results.Data,
    Colors=energy_results.Colors,
    Names=energy_results.Labels,
    Show_xgrid=False,
    Show_ygrid=True,
    Legend=0)
merge_18 = Merge(Data1=merge_7, Data2=flip_4, Data3=flip_5)
flip_10 = FlipMatrix(Data=merge_18)
plotter_2 = CSPlotter(
    Type=0,
    Width=550,
    Height=450,
    Title=expression,
    Y_title="Cooling Demand (kWh/m2)",
    X_rot=0,
    Y_data=flip_10,
    Colors=merge,
    Names=panel_4,
    Range=Slider(50, range=0..50),
    Show_xgrid=False,
    Show_ygrid=True,
    Legend=0,
    PreviewDimension=1,
    InfinateZoomDisplay=True,
    UnitSystem=4)
xyplot_2 = XYPlot(
    Type=2,
    Width=550,
    Height=450,
    Title="Shoebox Loads - ClimateStudio",
    X_labels=python_8.months,
    X_rot=0,
    Y_data=flip_3,
    Colors=merge_4,
    Names=panel_7,
    Show_xgrid=False,
    Show_ygrid=True,
    Legend=0)
xyplot_3 = XYPlot(
    Type=2,
    Width=550,
    Height=450,
    Title="Shoebox Loads - ClimateStudio",
    X_labels=python_8.months,
    X_rot=0,
    Y_data=flip_9,
    Colors=merge,
    Names=panel_8,
    Show_xgrid=False,
    Show_ygrid=True,
    Legend=0)
xyplot_4 = XYPlot(
    Type=2,
    Width=550,
    Height=450,
    Title="Shoebox Loads - Whitebox",
    X_labels=python_8.months,
    X_rot=0,
    Y_data=trim_2,
    Colors=merge_4,
    Names=panel_7,
    Show_xgrid=False,
    Show_ygrid=True,
    Legend=0)
xyplot_5 = XYPlot(
    Type=2,
    Width=550,
    Height=450,
    Title="Shoebox Loads - Whitebox",
    X_labels=python_8.months,
    X_rot=0,
    Y_data=python_11,
    Colors=merge_5,
    Names=panel_9,
    Show_xgrid=False,
    Show_ygrid=True,
    Legend=0)
xyplot_6 = XYPlot(
    Type=2,
    Width=550,
    Height=450,
    Title="Shoebox Loads - Surrogate",
    X_labels=python_8.months,
    X_rot=0,
    Y_data=trim,
    Colors=merge_4,
    Names=panel_7,
    Show_xgrid=False,
    Show_ygrid=True,
    Legend=0)
xyplot_7 = XYPlot(
    Type=2,
    Width=550,
    Height=450,
    Title="Shoebox Loads - Surrogate",
    X_labels=python_8.months,
    X_rot=0,
    Y_data=python_10,
    Colors=merge_5,
    Names=panel_9,
    Show_xgrid=False,
    Show_ygrid=True,
    Legend=0)

# ==== cluster Cluster
perim_depth = ClusterInput()
core_depth = ClusterInput()
orientation = ClusterInput()
width = ClusterInput()
height = ClusterInput()
division = Division(A=width, B="2")
division_2 = Division(A=perim_depth, B="2")
neg = Negative(Value=core_depth)
division_3 = Division(A=neg, B="2")
wwr = ClusterInput()
Z = UnitZ(Factor=height)
pt = ConstructPoint(XCoordinate=perim_depth, YCoordinate=division, ZCoordinate=0)
pt_2 = ConstructPoint(XCoordinate=neg, YCoordinate=division, ZCoordinate=0)
pt_3 = ConstructPoint(XCoordinate=division_2, YCoordinate=width, ZCoordinate=0)
pt_4 = ConstructPoint(XCoordinate=division_3, YCoordinate=width, ZCoordinate=0)
pt_5 = ConstructPoint(XCoordinate=0, YCoordinate=width, ZCoordinate=height)
pt_6 = ConstructPoint(XCoordinate=0, YCoordinate=width, ZCoordinate=height)
xz = XZPlane(Origin=Point(0, 0, 0))
xz_2 = XZPlane(Origin=Point(0, 0, 0))
multiplication = Multiplication(A=height, B=wwr)

pt_7 = ConstructPoint(XCoordinate=perim_depth, YCoordinate=width, ZCoordinate=0)
pt_8 = ConstructPoint(XCoordinate=neg, YCoordinate=width, ZCoordinate=0)
rec_2pt = Rectangle2Pt(Plane=PlaneXY(0, 0, 0), PointA=Point(0, 0, 0), PointB=pt_8, Radius=0)  # -> Rectangle, Length
rec_2pt_2 = Rectangle2Pt(Plane=PlaneXY(0, 0, 0), PointA=Point(0, 0, 0), PointB=pt_7, Radius=0)  # -> Rectangle, Length

rec_2pt_3 = Rectangle2Pt(Plane=PlaneXY(0, 0, 0), PointA=Point(0, 0, 0), PointB=pt, Radius=0)  # -> Rectangle, Length
rec_2pt_4 = Rectangle2Pt(Plane=PlaneXY(0, 0, 0), PointA=Point(0, 0, 0), PointB=pt_3, Radius=0)  # -> Rectangle, Length
rec_2pt_5 = Rectangle2Pt(Plane=PlaneXY(0, 0, 0), PointA=Point(0, 0, 0), PointB=pt_4, Radius=0)  # -> Rectangle, Length
rec_2pt_6 = Rectangle2Pt(Plane=PlaneXY(0, 0, 0), PointA=Point(0, 0, 0), PointB=pt_2, Radius=0)  # -> Rectangle, Length
rec_2pt_7 = Rectangle2Pt(Plane=xz, PointA=pt_5, PointB=pt_8, Radius=0)  # -> Rectangle, Length
rec_2pt_8 = Rectangle2Pt(Plane=xz_2, PointA=pt_6, PointB=pt_7, Radius=0)  # -> Rectangle, Length
Z_2 = UnitZ(Factor=multiplication)
Y = UnitY(Factor=division)
Y_2 = UnitY(Factor=division)
X = UnitX(Factor=division_2)
X_2 = UnitX(Factor=division_3)
move = Move(Geometry=rec_2pt_3.Rectangle, Motion=Y)  # -> Geometry, Transform
move_2 = Move(Geometry=rec_2pt_4.Rectangle, Motion=X)  # -> Geometry, Transform
move_3 = Move(Geometry=rec_2pt_5.Rectangle, Motion=X_2)  # -> Geometry, Transform
move_4 = Move(Geometry=rec_2pt_6.Rectangle, Motion=Y_2)  # -> Geometry, Transform
uniform_perim = Data(rec_2pt_2.Rectangle)
uniform_core = Data(rec_2pt.Rectangle)
perim_floors = Data([rec_2pt_3.Rectangle, move.Geometry])
perim_floors_2 = Data([rec_2pt_4.Rectangle, move_2.Geometry])
core_floors = Data([rec_2pt_5.Rectangle, move_3.Geometry])
core_floors_2 = Data([rec_2pt_6.Rectangle, move_4.Geometry])
perim_floor = Surface(uniform_perim)
core_floor = Surface(uniform_core)
Z_3 = UnitZ(Factor=height)
Y_3 = UnitY(Factor=width)
pt_9 = ConstructPoint(XCoordinate=neg, YCoordinate=0, ZCoordinate=height)
yz = YZPlane(Origin=pt_8)
explode = Explode(Curve=uniform_perim, Recursive=True)  # -> Segments, Vertices
extr = Extrude(Base=core_floor, Direction=Z_3)
move_5 = Move(Geometry=[rec_2pt_8.Rectangle, rec_2pt_7.Rectangle], Motion=Y_3)  # -> Geometry, Transform
extr_2 = Extrude(Base=perim_floor, Direction=Z)
rec_2pt_9 = Rectangle2Pt(Plane=yz, PointA=pt_9, PointB=pt_8, Radius=0)  # -> Rectangle, Length
item = ListItem(List=explode.Segments, Index=1, Wrap=True)
extr_3 = Extrude(Base=item, Direction=Z)
area = Area(Geometry=extr_3)  # -> Area, Centroid
move_6 = Move(Geometry=perim_floor, Motion=Z)  # -> Geometry, Transform
move_7 = Move(Geometry=core_floor, Motion=Z)  # -> Geometry, Transform
extr_4 = Extrude(Base=item, Direction=Z_2)
area_2 = Area(Geometry=extr_4)  # -> Area, Centroid
vec2pt = Vector2Pt(PointA=area_2.Centroid, PointB=area.Centroid, Unitize=False)  # -> Vector, Length
floor = ClusterInput()
srf = Surface([move_5.Geometry, rec_2pt_8.Rectangle, rec_2pt_7.Rectangle, rec_2pt_9.Rectangle])
roof = ClusterInput()
move_8 = Move(Geometry=extr_4, Motion=vec2pt.Vector)  # -> Geometry, Transform
area_3 = Area(Geometry=move_8.Geometry)  # -> Area, Centroid
dispatch = Dispatch(List=[move_7.Geometry, move_6.Geometry], DispatchPattern=roof)  # -> ListA, ListB
dispatch_2 = Dispatch(List=[core_floor, perim_floor], DispatchPattern=floor)  # -> ListA, ListB
scale = Scale(Geometry=move_8.Geometry, Center=area_3.Centroid, Factor=Slider(0.99, range=0..1))  # -> Geometry, Transform
adiabatic = Surface(flatten([srf, dispatch.ListB, dispatch_2.ListB]))
expression = Expression(x=orientation, Expression="x - π/2")
ground = Surface(dispatch_2.ListA)
expression_2 = Expression(x=orientation, Expression="x + π")
data = Data(flatten(scale.Geometry))
X_3 = UnitX(Factor=core_depth)
rotate = Rotate(Geometry=ground, Angle=expression, Plane=PlaneXY(0, 0, 0))  # -> Geometry, Transform
rotate_2 = Rotate(Geometry=data, Angle=expression, Plane=PlaneXY(0, 0, 0))  # -> Geometry, Transform
rotate_3 = Rotate(Geometry=extr, Angle=expression, Plane=PlaneXY(0, 0, 0))  # -> Geometry, Transform
rotate_4 = Rotate(Geometry=adiabatic, Angle=expression, Plane=PlaneXY(0, 0, 0))  # -> Geometry, Transform
rotate_5 = Rotate(Geometry=extr_2, Angle=expression, Plane=PlaneXY(0, 0, 0))  # -> Geometry, Transform
perimeter = Data(rotate_5.Geometry)
window = Data(rotate_2.Geometry)
ground_2 = Data(flatten(rotate.Geometry))
core = Data(rotate_3.Geometry)
adiabatic_2 = Data(flatten(rotate_4.Geometry))
perimeter_2 = ClusterOutput(perimeter)
core_2 = ClusterOutput(core)
window_2 = ClusterOutput(window)
ground_3 = ClusterOutput(ground_2)
adiabatic_3 = ClusterOutput(adiabatic_2)

# ==== cluster JoulesToKW
pow = Power(A="10", B="-7")
A = ClusterInput()
multiplication = Multiplication(A="2.777", B=pow)
multiplication_2 = Multiplication(A=A, B=multiplication)
R = ClusterOutput(multiplication_2)
